# Grasshopper definition capsule-dream.gh (Grasshopper 1.0.8)
# Copyright: GNU Lesser General Public License Version 3
# plug-ins: RhinoCodePluginGH, semio

sep = Separator()  # -> S; same code as sep
dir = Directory()  # -> D
# ---------- dir: C# ----------
#region Usings
using System;
using System.Linq;
using System.Collections;
using System.Collections.Generic;
using System.Drawing;
using System.IO;

using Rhino;
using Rhino.Geometry;

using Grasshopper;
using Grasshopper.Kernel;
using Grasshopper.Kernel.Data;
using Grasshopper.Kernel.Types;
#endregion

public class Script_Instance : GH_ScriptInstance
{
    private void RunScript(ref object D)
    {
        D = Path.GetDirectoryName(this.GrasshopperDocument.FilePath);
    }
}
# ---------- end dir ----------
# ^                                    ^
#    |                                     |
# <-- Constants    Preview -->
# Parameters    External    Local -->
# <-- Meta               |
#      |                       v
#      v
par = ParentDirectory(D=dir)  # -> P; inputs D: String
# ---------- par: C# ----------
#region Usings
using System;
using System.Linq;
using System.Collections;
using System.Collections.Generic;
using System.Drawing;
using System.IO;

using Rhino;
using Rhino.Geometry;

using Grasshopper;
using Grasshopper.Kernel;
using Grasshopper.Kernel.Data;
using Grasshopper.Kernel.Types;
#endregion

public class Script_Instance : GH_ScriptInstance
{
    private void RunScript(string D, ref object P)
    {
        P = new DirectoryInfo(D).Parent;
    }
}
# ---------- end par ----------

load_kit = BooleanToggle(False)
kit = CacheKit(uri=par, R=load_kit)  # -> ty_2, ur_2, objects_2, urpa_2, urpalc_2, urpare_2
ty = Type([null x45])
objects = Data(Tree({0;0;0}: [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], {0;0;1}: [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], {0;0;2}: [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], {0;0;3}: [], {0;0;4}: [], {0;0;5}: [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]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))
dn = Design([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])

variant = GetString("", AtLeast=0, AtMost=1, TreeAccess=False)
view = GetString("", AtLeast=0, AtMost=1, TreeAccess=False)

# ----
# Reuse designs
panel = Panel("Nakagin Capsule Tower")
# Outputs   ->
#                 |
#                 v
panel_2 = Panel("Explosion Axonometry")
seldsn = SelectDesign(dn=dn, na=panel)
seldsn_2 = SelectDesign(dn=dn, na=panel, variant="Slanted")
seldsn_3 = SelectDesign(dn=dn, na=panel, variant="Twisted")
seldsn_4 = SelectDesign(dn=dn, na=panel, variant="Dancing", view=panel_2)
dancing = Design(seldsn_4)
original = Design(seldsn)
slanted = Design(seldsn_2)
twisted = Design(seldsn_3)

# ----
# Orient
pln = Plane(Plane(origin=(0, 27.5, 0), x=(0, 1, 0), y=(-1, 0, 0)))
pln_2 = Plane(Plane(origin=(110, 0, 0), x=(-1, 0, 0), y=(0, -1, 0)))
pln_3 = Plane(PlaneXY(27.5, 137.5, 0))
pln_4 = Plane(Plane(origin=(137.5, 110, 0), x=(0, -1, 0), y=(1, 0, 0)))
orient = Orient(Source=PlaneXY(0, 0, 0), Target=pln_4)  # -> Geometry, Transform
orient_2 = Orient(Source=PlaneXY(0, 0, 0), Target=pln_3)  # -> Geometry, Transform
orient_3 = Orient(Source=PlaneXY(0, 0, 0), Target=pln_2)  # -> Geometry, Transform
orient_4 = Orient(Source=PlaneXY(0, 0, 0), Target=pln)  # -> Geometry, Transform
dsn = MoveDesign(dn=original, pn=orient_4.Transform)
dsn_2 = MoveDesign(dn=slanted, pn=orient_2.Transform)
dsn_3 = MoveDesign(dn=twisted, pn=orient_3.Transform)
dsn_4 = MoveDesign(dn=dancing, pn=orient.Transform)

energy_global_warming_potential_kgco2e_k = ValueList({"Natural Gas": 0.201, "Heating Oil": 0.216, "Electricity Non-Renewable": 0.5, "Electricity Renewable": 0}, selected="Natural Gas")  # "Energy Global Warming Potential [kgCO2e/kWh]"
energy_global_warming_potential_kgco2e_k_2 = ValueList({"Natural Gas": 0.201, "Heating Oil": 0.216, "Electricity Non-Renewable": 0.5, "Electricity Renewable": 0}, selected="Electricity Non-Renewable")  # "Energy Global Warming Potential [kgCO2e/kWh]"
energy_price_kwh = ValueList({"Natural Gas": 0.095, "Heating Oil": 0.10, "Electricity Non-Renewable": 0.25, "Electrictiy Renewable": 0.35}, selected="Natural Gas")
energy_price_kwh_2 = ValueList({"Natural Gas": 0.095, "Heating Oil": 0.10, "Electricity Non-Renewable": 0.25, "Electrictiy Renewable": 0.35}, selected="Electricity Non-Renewable")

# ----
# Interpolate between
number_slider = Slider(0.33, range=0..1)
expression = Expression(x=number_slider, Expression="1-x")
inpdsn = InterpolateDesigns(S=dsn, T=dsn_2, t=number_slider)  # -> dn_s_u_t_2, dn_s_t_2, dn_t_s_2
inpdsn_2 = InterpolateDesigns(S=dsn, T=dsn_2, t=expression)  # -> dn_s_u_t_2, dn_s_t_2, dn_t_s_2
inpdsn_3 = InterpolateDesigns(S=dsn, T=dsn_3, t=number_slider)  # -> dn_s_u_t_2, dn_s_t_2, dn_t_s_2
inpdsn_4 = InterpolateDesigns(S=dsn, T=dsn_3, t=expression)  # -> dn_s_u_t_2, dn_s_t_2, dn_t_s_2
inpdsn_5 = InterpolateDesigns(S=dsn_2, T=dsn_4, t=number_slider)  # -> dn_s_u_t_2, dn_s_t_2, dn_t_s_2
inpdsn_6 = InterpolateDesigns(S=dsn_2, T=dsn_4, t=expression)  # -> dn_s_u_t_2, dn_s_t_2, dn_t_s_2
inpdsn_7 = InterpolateDesigns(S=dsn_3, T=dsn_4, t=number_slider)  # -> dn_s_u_t_2, dn_s_t_2, dn_t_s_2
inpdsn_8 = InterpolateDesigns(S=dsn_3, T=dsn_4, t=expression)  # -> dn_s_u_t_2, dn_s_t_2, dn_t_s_2
inpdsn_9 = InterpolateDesigns(S=dsn_2, T=dsn_3, t=number_slider)  # -> dn_s_u_t_2, dn_s_t_2, dn_t_s_2
inpdsn_10 = InterpolateDesigns(S=dsn_2, T=dsn_3, t=expression)  # -> dn_s_u_t_2, dn_s_t_2, dn_t_s_2
inpdsn_11 = InterpolateDesigns(S=dsn, T=dsn_4, t=number_slider)  # -> dn_s_u_t_2, dn_s_t_2, dn_t_s_2
inpdsn_12 = InterpolateDesigns(S=dsn, T=dsn_4, t=expression)  # -> dn_s_u_t_2, dn_s_t_2, dn_t_s_2

heating_energy_price_cent_kwh = Number(energy_price_kwh)
heating_efficiency_factor = Number(Slider(0.9, range=0.5..4))
heating_global_warming_potential_kgco2e = Number(energy_global_warming_potential_kgco2e_k)  # "Heating Global Warming Potential [kgCO2e/kWh]"
cooling_energy_price_cent_kwh = Number(energy_price_kwh_2)
cooling_efficiency_factor = Number(Slider(0.9, range=0.5..4))
cooling_global_warming_potential_kgco2e = Number(energy_global_warming_potential_kgco2e_k_2)  # "Cooling Global Warming Potential [kgCO2e/kWh]"
electrictiy_energy_price_cent_kwh = Number(energy_price_kwh_2)
electrictiy_global_warming_potential_kgc = Number(energy_global_warming_potential_kgco2e_k_2)  # "Electrictiy Global Warming Potential [kgCO2e/kWh]"

aut = ModelAuthor(Name="Ueli Saluz", Email="ueli@semio-tech.org")  # -> Author, Valid, Name, Email

concat = Concatenate(FragmentA="images/", FragmentB="capsule-dream", FragmentC=".png")

concat_2 = Concatenate(FragmentA="icons/", FragmentB="capsule-dream", FragmentC=".svg")

# ----
# Merge designs
merge = Merge(
    Data1=dsn,
    Data2=dsn_2,
    Data3=dsn_4,
    Data4=dsn_3,
    Data5=inpdsn.dn_s_u_t_2,
    Data6=inpdsn_2.dn_s_u_t_2,
    Data7=inpdsn_3.dn_s_u_t_2,
    Data8=inpdsn_4.dn_s_u_t_2,
    Data9=inpdsn_5.dn_s_u_t_2,
    Data10=inpdsn_6.dn_s_u_t_2,
    Data11=inpdsn_7.dn_s_u_t_2,
    Data12=inpdsn_8.dn_s_u_t_2,
    Data13=inpdsn_9.dn_s_u_t_2,
    Data14=inpdsn_10.dn_s_u_t_2,
    Data15=inpdsn_11.dn_s_u_t_2,
    Data16=inpdsn_12.dn_s_u_t_2)
dsns = MergeDesigns(
    dn=merge,
    na="Capsule Dream",
    description="A wild dream of capsule towers.",
    icon=concat_2,
    image=concat,
    variant=variant,
    view=view,
    authors=aut.Author)

# ----
# Do some calculations based on metadata
prf = AssessPerformance(
    dn=dsns,
    ty=ty,
    heating_efficiency_factor=heating_efficiency_factor,
    heating_energy_price_kwh=heating_energy_price_cent_kwh,
    heating_global_warming_potential_kgco2e=heating_global_warming_potential_kgco2e,
    cooling_efficiency_factor=cooling_efficiency_factor,
    cooling_global_warming_potential_kgco2e=cooling_global_warming_potential_kgco2e,
    cooling_energy_price_kwh=cooling_energy_price_cent_kwh,
    electrictiy_global_warming_potential_kgc=electrictiy_global_warming_potential_kgc,
    electrictiy_energy_price_kwh=electrictiy_energy_price_cent_kwh)  # -> dn_3, interest_2, area_efficiency_eff_m²_m²_2, area_comfort_m²_person_2, income_a_3, expenses_a_3, energy_expenses_a_3, effective_floor_area_m²_12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
expression_2 = Expression(x=prf.construction_cost_5, Expression="x/1000000")
expression_3 = Expression(Expression="x/1000000")
expression_4 = Expression(x=prf.expenses_a_3, Expression="x/1000000")
expression_5 = Expression(x=prf.income_a_3, Expression="x/1000000")
expression_6 = Expression(Expression="x/1000000")
expression_7 = Expression(x=prf.energy_expenses_a_3, Expression="x/1000000")
expression_8 = Expression(x=prf.construction_global_warming_potential_kg_2, Expression="x/1000")
expression_9 = Expression(Expression="x/1000")
expression_10 = Expression(x=prf.heating_energy_demand_kwh_a_5, Expression="x/1000")
expression_11 = Expression(x=prf.cooling_energy_demand_kwh_a_5, Expression="x/1000")
expression_12 = Expression(Expression="x/1000")
roundmult = RoundToMultiple(N=expression_5, M="0.05")  # -> R; inputs N: tree, M: tree
# ---------- roundmult: Python ----------
#Component Information
#--------------------------------------------------------------------------------------------
if ghenv.Component.RunCount<2:
    #General
    #--------------------------------------------------------------------------------------------
    __author__ = "YOUR NAME"
    __version__ = "2000.00.00"
    
    ghenv.Component.Name = "Round to Multiple"
    ghenv.Component.NickName = "RoundMult"
    ghenv.Component.Description = "Rounds a number to the nearest specified multiple."
    ghenv.Component.Message = "VER 1.0"
    ghenv.Component.Category = "Math"
    ghenv.Component.SubCategory = "Arithmetic"
    
     #Inputs
    #--------------------------------------------------------------------------------------------
    inputIndex=0
    
    ghenv.Component.Params.Input[inputIndex].Name = "Number"
    ghenv.Component.Params.Input[inputIndex].NickName = "N"
    ghenv.Component.Params.Input[inputIndex].Description = "Number to round."
    ghenv.Component.Params.Input[inputIndex].Optional = False
    inputIndex+=1
    
    ghenv.Component.Params.Input[inputIndex].Name = "Multiple"
    ghenv.Component.Params.Input[inputIndex].NickName = "M"
    ghenv.Component.Params.Input[inputIndex].Description = "Multiple to round to."
    ghenv.Component.Params.Input[inputIndex].Optional = False
    inputIndex+=1
    
    #Outputs
    #--------------------------------------------------------------------------------------------
    outputIndex=0
    
    ghenv.Component.Params.Output[outputIndex].Name = "Rounded"
    ghenv.Component.Params.Output[outputIndex].NickName = "R"
    ghenv.Component.Params.Output[outputIndex].Description = "Number rounded to the nearest specified multiple."
    outputIndex+=1


#Imports
#--------------------------------------------------------------------------------------------
from System import Object
from Grasshopper import DataTree
import math


#The Component function - Business logic only (e.g. working without trees)
#--------------------------------------------------------------------------------------------
"""Function that this component is computing.
    Inputs:
        number: The number to round.
        multiple: The multiple to round to.
    Output:
        rounded: The number rounded to the nearest specified multiple."""
def RoundToMultiple(number, multiple):
    rounded = math.ceil(number / multiple) * multiple
    return rounded

#Solver - Run with trees to enhance performance drastically
#--------------------------------------------------------------------------------------------
if __name__ == "__main__":
    
    #Initialize trees
    #--------------------------------------------------------------------------------------------
    RoundedTree = DataTree[Object]()
    
    #Data matching
    #--------------------------------------------------------------------------------------------
    for path in N.Paths:
        numberBranch = N.Branch(path)
        for i, number in enumerate(numberBranch):
            multiple = M.Branch(path)[i]
            rounded = RoundToMultiple(number, multiple)
            RoundedTree.Add(rounded, path)
    
     #Assign trees to output
    #--------------------------------------------------------------------------------------------
    R = RoundedTree
# ---------- end roundmult ----------
roundmult_2 = RoundToMultiple(N=expression_4, M="0.05")  # -> R; inputs N: tree, M: tree; same code as roundmult
roundmult_3 = RoundToMultiple(N=prf.specific_final_energy_demand_kwh_m²a_2, M="2.5")  # -> R; inputs N: tree, M: tree; same code as roundmult
roundmult_4 = RoundToMultiple(N=expression_7, M="0.05")  # -> R; inputs N: tree, M: tree; same code as roundmult
roundmult_5 = RoundToMultiple(N=expression_10, M=1)  # -> R; inputs N: tree, M: tree; same code as roundmult
roundmult_6 = RoundToMultiple(N=expression_11, M=1)  # -> R; inputs N: tree, M: tree; same code as roundmult
roundmult_7 = RoundToMultiple(N=expression_12, M=1)  # -> R; inputs N: tree, M: tree; same code as roundmult
roundmult_8 = RoundToMultiple(N=prf.effective_floor_area_m²_12, M="25")  # -> R; inputs N: tree, M: tree; same code as roundmult
roundmult_9 = RoundToMultiple(M=1)  # -> R; inputs N: tree, M: tree; same code as roundmult
roundmult_10 = RoundToMultiple(N=expression_2, M="0.05")  # -> R; inputs N: tree, M: tree; same code as roundmult
roundmult_11 = RoundToMultiple(N=expression_6, M="0.05")  # -> R; inputs N: tree, M: tree; same code as roundmult
roundmult_12 = RoundToMultiple(N=expression_8, M="25")  # -> R; inputs N: tree, M: tree; same code as roundmult
roundmult_13 = RoundToMultiple(N=expression_3, M="0.05")  # -> R; inputs N: tree, M: tree; same code as roundmult
roundmult_14 = RoundToMultiple(N=expression_9, M="5")  # -> R; inputs N: tree, M: tree; same code as roundmult
effective_floor_area_m² = Number(roundmult_8)
specific_operational_global_warming_pote = Number(roundmult_9)  # "Specific Operational Global Warming Potential [kgCO2e/m²a]"
operational_cost_mio_a = Number(roundmult_13)
maintenance_expenses_mio_a = Number(roundmult_2)
construction_cost_mio = Number(roundmult_10)
return_a = Number(roundmult_11)
construction_global_warming_potential_tc = Number(roundmult_12)  # "Construction Global Warming Potential [tCO2e]"
operational_global_warming_potential_tco = Number(roundmult_14)  # "Operational Global Warming Potential [tCO2e/a]"
income_mio_a = Number(roundmult)
specific_energy_demand_kwh_m²a = Number(roundmult_3)
operational_energy_cost_a = Number(roundmult_4)
heating_energy_demand_mwh_a = Number(roundmult_5)
cooling_energy_demand_mwh_a = Number(roundmult_6)
technical_equipment_energy_demand_mwh_a = Number(roundmult_7)

mime = Mime({".stl": "model/stl", ".obj": "model/obj", ".glb": "model/gltf-binary", ".gltf": "model/gltf+json", ".3dm": "model/vnd.3dm", ".speckle": "model/vnd.speckle+json", ".png": "image/png", ".jpg": "image/jpeg", ".jpeg": "image/jpeg", ".svg": "image/svg+xml", ".pdf": "application/pdf", ".zip": "application/zip", ".json": "application/json", ".csv": "text/csv", ".txt": "text/plain"}, selected=".3dm")
panel_3 = Panel("collider")
list = ValueList({"1to500", "1to200"}, selected="1to500")
zoom = Button()
bbox = BoundingBox(Plane=PlaneXY(0, 0, 0), UnionBox=True)  # -> Box, Box_2
zoom2bb = ZoomToBoundingBox(N=["Top", "Front", "Right", "Perspective", "Parallel"], BB=bbox.Box, S=0, R=zoom)  # -> F, SBB; inputs BB: Box, R: Boolean
# ---------- zoom2bb: Python ----------
#Component Information
#--------------------------------------------------------------------------------------------
if ghenv.Component.RunCount<2:
    #General
    #--------------------------------------------------------------------------------------------
    __author__ = "Ueli Saluz"
    __version__ = "2022.05.21"
    
    ghenv.Component.Name = "ZoomToBoundingBox"
    ghenv.Component.NickName = "Zoom2BB"
    ghenv.Component.Description = "Zoom the view of a Rhino viewport to a bounding box."
    ghenv.Component.Message = "VER 1.1"
    ghenv.Component.Category = "Display"
    ghenv.Component.SubCategory = "Camera"
    
     #Inputs
    #--------------------------------------------------------------------------------------------
    inputIndex=0
    
    ghenv.Component.Params.Input[inputIndex].Name = "Name"
    ghenv.Component.Params.Input[inputIndex].NickName = "N"
    ghenv.Component.Params.Input[inputIndex].Description = "Name of the viewport"
    ghenv.Component.Params.Input[inputIndex].Optional = False
    inputIndex+=1
    
    ghenv.Component.Params.Input[inputIndex].Name = "BoundingBox"
    ghenv.Component.Params.Input[inputIndex].NickName = "BB"
    ghenv.Component.Params.Input[inputIndex].Description = ""
    ghenv.Component.Params.Input[inputIndex].Optional = False
    inputIndex+=1
    
    ghenv.Component.Params.Input[inputIndex].Name = "ScaleFactor"
    ghenv.Component.Params.Input[inputIndex].NickName = "S"
    ghenv.Component.Params.Input[inputIndex].Description = "A factor for the extension of the bounding box." \
    +"0 means 0 extension, a positive number makes the bounding box larger a negative smaller. The amount is proportional to the length."
    ghenv.Component.Params.Input[inputIndex].Optional = False
    inputIndex+=1
   
    
    ghenv.Component.Params.Input[inputIndex].Name = "Run"
    ghenv.Component.Params.Input[inputIndex].NickName = "R"
    ghenv.Component.Params.Input[inputIndex].Description = "Zoom to the given bounding box."
    ghenv.Component.Params.Input[inputIndex].Optional = False
    inputIndex+=1
    
    #Outputs
    #--------------------------------------------------------------------------------------------
    outputIndex=0
    
    ghenv.Component.Params.Output[outputIndex].Name = "Finished"
    ghenv.Component.Params.Output[outputIndex].NickName = "F"
    ghenv.Component.Params.Output[outputIndex].Description = "Sends True when finished. Just to trigger other depending components."
    outputIndex+=1
    
    ghenv.Component.Params.Output[outputIndex].Name = "ScaledBoundingBox"
    ghenv.Component.Params.Output[outputIndex].NickName = "SBB"
    ghenv.Component.Params.Output[outputIndex].Description = "The scaled bounding box."
    outputIndex+=1


#Imports
#--------------------------------------------------------------------------------------------
from Rhino import RhinoDoc
from Rhino.Geometry import Box

#Solver - Run with trees to enhance performance drastically
#--------------------------------------------------------------------------------------------
if __name__ == "__main__":
    try:
        vp = RhinoDoc.ActiveDoc.Views.Find(N, False).ActiveViewport
        if R:
            box = BB
            bb = BB.BoundingBox
            bb.Inflate(S*box.X.Length,S*box.Y.Length,S*box.Z.Length)
            vp.ZoomBoundingBox(bb)
            SBB = bb
        F = True
    except:
        pass
# ---------- end zoom2bb ----------
dsn_5 = PreviewDesign(dn=prf.dn_3, ty=ty, ob=objects, tags=list, sc=1)

dn_2 = Design(prf.dn_3)
dn_3 = Design("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")
dsn_6 = SerializeDesign(Design=dn_3)

effective_floor_area_m²_2 = Panel(effective_floor_area_m²)
construction_cost_mio_2 = Panel(construction_cost_mio)
return_a_2 = Panel(return_a)
income_mio_a_2 = Panel(income_mio_a)
operational_cost_mio_a_2 = Panel(operational_cost_mio_a)
operational_energy_cost_a_2 = Panel(operational_energy_cost_a)
maintenance_expenses_mio_a_2 = Panel(maintenance_expenses_mio_a)
operational_global_warming_potential_tco_2 = Panel(operational_global_warming_potential_tco)  # "Operational Global Warming Potential [tCO2e/a]"
heating_energy_demand_mwh_a_2 = Panel(heating_energy_demand_mwh_a)
cooling_energy_demand_mwh_a_2 = Panel(cooling_energy_demand_mwh_a)
technical_equipment_energy_demand_mwh_a_2 = Panel(technical_equipment_energy_demand_mwh_a)
specific_operational_global_warming_pote_2 = Panel(specific_operational_global_warming_pote)  # "Specific Operational Global Warming Potential [kgCO2e/m²a]"
construction_global_warming_potential_tc_2 = Panel(construction_global_warming_potential_tc)  # "Construction Global Warming Potential [tCO2e]"
specific_energy_demand_kwh_m²a_2 = Panel(specific_energy_demand_kwh_m²a)

# ----
# Save the new design
save = BooleanToggle(False)
dsn_7 = PutDesign(Design=prf.dn_3, Uri=par, Run=save)

txt = EncodeText(Text=dsn_6, Mode=0)
context_bake = ContextBake(Content=txt)

# ==== cluster PreviewDesign: Preview the pieces and connections of a design.
dn = ClusterInput()
ty = ClusterInput()
ob = ClusterInput()
sc = ClusterInput()
tags = ClusterInput()
dn_2 = Design(dn)
ty_2 = Type(ty)
ob_2 = Data(ob)
tags_2 = Tags(tags)
sc_2 = Number(sc)
dn_3 = Design(graft(dn_2))
ty_3 = Type(ty_2)
lng = ListLength(List=ty_3)
ob_3 = Data(ob_2)
tstat = TreeStatistics(Tree=ob_3)  # -> Paths, Length, Count
trim = TrimTree(Tree=ob_3, Depth=1)
item = ListItem(List=tstat.Length, Index=0, Wrap=True)
lng_2 = ListLength(List=tstat.Paths)
lng_3 = ListLength(List=trim)
lng_4 = ListLength(List=trim)
sc_3 = Number(sc_2)
tags_3 = Tags(tags_2)
trim_2 = TrimTree(Tree=lng_4, Depth=1)
null = NullItem(Item=trim_2)  # -> NullFlags, InvalidFlags, Description
fltdsn = FlattenDesign(Design=dn_3, Type=ty_3)
item_2 = ListItem(List=null.NullFlags, Index=0, Wrap=True)
item_3 = ListItem(List=trim_2, Index=0, Wrap=True)
dsn = ModelDesign(Design=fltdsn)  # -> Design, Valid, Name, Description, Icon, Image, Variant, View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
trim_3 = TrimTree(Tree=dsn.Pieces, Depth=1)
filter = StreamFilter(Gate=item_2, Stream0=item_3, Stream1=lng_3)
null_2 = NullItem(Item=filter)  # -> NullFlags, InvalidFlags, Description
typ = SelectTypeByPiece(ty=ty_3, pc=trim_3)  # -> ty_4, i_2
typ_2 = ModelType(Type=typ.ty_4)  # -> Type, Valid, Name, Description, Icon, Image, Variant, Stock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
object = ModelObject(Object=ob_3)  # -> Object, Geometry, Name, Layer, Visibility, Display, Drafting, Render
filter_2 = StreamFilter(Gate=null_2.NullFlags, Stream0=filter, Stream1=lng)
expression = Expression(x=lng_2, y=item, z=lng, u=filter_2, Expression="If((x=1)and(y=1)and(z=1),0,If((x=1)and(y=z),1,If((x=z)and(u=z),2,3)))")
lng_5 = ListLength(List=typ_2.Representations)
rep = SelectRepresentation(rp=typ_2.Representations, tags=tags_3)  # -> rp_4, i_2
group = Group(Geometry=object.Geometry)
expression_2 = Expression(x="0", y=typ.ty_4, Expression="x")
trim_4 = TrimTree(Tree=lng_5, Depth=1)
merge = Merge(Data1=graft(expression_2), Data2=graft(rep.i_2))
trim_5 = TrimTree(Tree=group, Depth=1)
group_2 = Group(Geometry=trim_5)
trim_6 = TrimTree(Tree=group_2, Depth=1)
expression_3 = Expression(x=trim_4, Expression="x=0")
filter_3 = StreamFilter(Gate=expression, Stream0=ob_3, Stream1=object.Geometry, Stream2=trim_5, Stream3=trim_6)
item_4 = ListItem(List=filter_3, Index=typ.i_2, Wrap=True)
ungroup = Ungroup(Group=item_4)
filter_4 = StreamFilter(Gate=expression, Stream0=item_4, Stream1=ungroup, Stream2=ungroup, Stream3=ungroup)
bool = Boolean(invert(graft(expression_3)))
item_5 = ListItem(List=merge, Index=bool, Wrap=True)
i = Integer(item_5)
pce = ModelPiece(Piece=dsn.Pieces)  # -> Piece, Valid, Id, Description, TypeName, TypeVariant, Plane, Center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
item_6 = ListItem(List=filter_4, Index=i, Wrap=True)
trim_7 = TrimTree(Tree=item_6, Depth=1)
orient = Orient(Geometry=trim_7, Source=PlaneXY(0, 0, 0), Target=pce.Plane)  # -> Geometry, Transform
geo = PreviewGeometry(geo=orient.Geometry, sc=sc_3)
con = PreviewConnections(dn=dn_2, ty=ty_2, sc=sc_2)

# ==== cluster CacheKit: Cache a kit by downloading the remote kit with all remote representations.
uri = ClusterInput()
R = ClusterInput()
R_2 = Run(R)
uri_2 = Uri(uri)
kit = LoadKit(Uri=uri_2, Run=R_2)  # -> Success, Kit, LocalDirectory
sep = Separator()  # -> S
# ---------- sep: C# ----------
#region Usings
using System;
using System.Linq;
using System.Collections;
using System.Collections.Generic;
using System.Drawing;
using System.IO;

using Rhino;
using Rhino.Geometry;

using Grasshopper;
using Grasshopper.Kernel;
using Grasshopper.Kernel.Data;
using Grasshopper.Kernel.Types;
#endregion

public class Script_Instance : GH_ScriptInstance
{
    private void RunScript(ref object S)
    {
        S = Path.DirectorySeparatorChar;
    }
}
# ---------- end sep ----------
kit_2 = ModelKit(Kit=kit.Kit)  # -> Kit, Valid, Name, Description, Icon, Image, Preview, Version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
trim = TrimTree(Tree=kit_2.Types, Depth=1)
typ = ModelType(Type=trim)  # -> Type, Valid, Name, Description, Icon, Image, Variant, Stock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
rep = ModelRepresentation(Representation=typ.Representations)  # -> Representation, Valid, Url, Description, Tags, Qualities
tmatch = MatchText(Text=rep.Url, Pattern="http*", Case=True)
dispatch = Dispatch(List=rep.Url, DispatchPattern=tmatch)  # -> ListA, ListB
rep_2 = ReplaceText(Text=dispatch.ListB, Find="/", Replace=sep, RecursiveReplace=False)
rep_3 = CacheRepresentation(Url=dispatch.ListA, Run=R_2)  # -> Path, Success
concat = Concatenate(FragmentA=kit.LocalDirectory, FragmentB=sep, FragmentC=rep_2)
weave = Weave(Pattern=tmatch, Stream0=concat, Stream1=rep_3.Path, NullGaps=False)
import = ImportContent(FilePath=weave, Import=R_2)  # -> ModelTransform, Objects, Layers, Linetypes, HatchPatterns, AnnotationStyles, Materials, BlockDefinitions
objects = Data(import.Objects)
ur = Url(rep.Url)
urpa = Url(weave)
urpalc = Url(concat)
urpare = Url(rep_3.Path)
ty = Type(trim)
objects_2 = ClusterOutput(objects)
urpa_2 = ClusterOutput(urpa)
urpalc_2 = ClusterOutput(urpalc)
urpare_2 = ClusterOutput(urpare)
ty_2 = ClusterOutput(ty)
ur_2 = ClusterOutput(ur)

# ==== cluster SelectDesign: Select a design with a name, an optional variant and an optional view. If no variant is provided it will select all variants. If you want to select the default variant then use the empty text. If no view is provided it will select all views. If you want to select the default view then use the empty text.
dn = ClusterInput()
na = ClusterInput()
variant = ClusterInput()
view = ClusterInput()
dn_2 = Design(dn)
na_2 = Name(na)
variant_2 = Variant(variant)
view_2 = View(view)
dsn = ModelDesign(Design=dn_2)  # -> Design, Valid, Name, Description, Icon, Image, Variant, View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
expression = Expression(x=dsn.Name, y=na_2, Expression="x=y")
cull = CullPattern(List=dsn.Design, CullPattern=expression)
dsn_2 = ModelDesign(Design=cull)  # -> Design, Valid, Name, Description, Icon, Image, Variant, View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
expression_2 = Expression(x=dsn_2.Variant, y=variant_2, Expression="x=y")
null = NullItem(Item=view_2)  # -> NullFlags, InvalidFlags, Description
cull_2 = CullPattern(List=dsn_2.Design, CullPattern=expression_2)
not = GateNot(A=null.NullFlags)
null_2 = NullItem(Item=variant_2)  # -> NullFlags, InvalidFlags, Description
and = GateAnd(A=not, B=null_2.NullFlags)
filter = StreamFilter(Gate=and, Stream0=cull_2, Stream1=cull)
dsn_3 = ModelDesign(Design=filter)  # -> Design, Valid, Name, Description, Icon, Image, Variant, View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
expression_3 = Expression(x=view_2, y=dsn_3.View, Expression="x=y")
cull_3 = CullPattern(List=dsn_3.Design, CullPattern=expression_3)
filter_2 = StreamFilter(Gate=null.NullFlags, Stream0=cull_3, Stream1=cull_2)
filter_3 = StreamFilter(Gate=null_2.NullFlags, Stream0=filter_2, Stream1=cull)
filter_4 = StreamFilter(Gate=and, Stream0=filter_3, Stream1=cull_3)
dn_3 = Design(filter_4)
dn_4 = ClusterOutput(dn_3)

# ==== cluster InterpolateDesigns: Interpolate between a source design and a target design. The target will act as a blueprint. The result is an interpolated union design and two unmodified but filtered difference design. Piece planes and connection values are linearly interpolated.
T = ClusterInput()
S = ClusterInput()
t = ClusterInput()
T_2 = Design(T)
S_2 = Design(S)
t_2 = Number(t)
dsn = NormalizeDesign(dn=S_2)
dsn_2 = NormalizeDesign(dn=T_2)
dsn_3 = ModelDesign(Design=dsn)  # -> Design, Valid, Name, Description, Icon, Image, Variant, View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
dsn_4 = ModelDesign(Design=dsn_2)  # -> Design, Valid, Name, Description, Icon, Image, Variant, View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
trim = TrimTree(Tree=dsn_3.Pieces, Depth=1)
trim_2 = TrimTree(Tree=dsn_3.Connections, Depth=1)
trim_3 = TrimTree(Tree=dsn_4.Pieces, Depth=1)
trim_4 = TrimTree(Tree=dsn_4.Connections, Depth=1)
con = ModelConnection(Connection=trim_4)  # -> Connection, Valid, ConnectedPieceId, ConnectedPieceTypePortId, ConnectingPieceId, ConnectingPieceTypePortId, Description, Gap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
con_2 = ModelConnection(Connection=trim_2)  # -> Connection, Valid, ConnectedPieceId, ConnectedPieceTypePortId, ConnectingPieceId, ConnectingPieceTypePortId, Description, Gap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
pce = ModelPiece(Piece=trim)  # -> Piece, Valid, Id, Description, TypeName, TypeVariant, Plane, Center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
pce_2 = ModelPiece(Piece=trim_3)  # -> Piece, Valid, Id, Description, TypeName, TypeVariant, Plane, Center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
intersection = SetIntersection(SetA=pce.Id, SetB=pce_2.Id)
difference = SetDifference(SetA=pce.Id, SetB=pce_2.Id)
difference_2 = SetDifference(SetA=pce_2.Id, SetB=pce.Id)
con_3 = SelectConnection(co=trim_4, cdpc=con_2.ConnectedPieceId, cgpc=con_2.ConnectingPieceId)  # -> co_4, i_2, fl_2
con_4 = SelectConnection(co=trim_2, cdpc=con.ConnectedPieceId, cgpc=con.ConnectingPieceId)  # -> co_4, i_2, fl_2
pce_3 = SelectPiece(pc=pce.Piece, id=difference)  # -> pc_4, i_2
pce_4 = SelectPiece(pc=pce.Piece, id=intersection)  # -> pc_4, i_2
pce_5 = SelectPiece(pc=pce_2.Piece, id=intersection)  # -> pc_4, i_2
pce_6 = SelectPiece(pc=pce_2.Piece, id=difference_2)  # -> pc_4, i_2
expression = Expression(x=t_2, Expression="1-x")
con_5 = ModelConnection(Connection=con_4.co_4)  # -> Connection, Valid, ConnectedPieceId, ConnectedPieceTypePortId, ConnectingPieceId, ConnectingPieceTypePortId, Description, Gap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
con_6 = ModelConnection(Connection=con_3.co_4)  # -> Connection, Valid, ConnectedPieceId, ConnectedPieceTypePortId, ConnectingPieceId, ConnectingPieceTypePortId, Description, Gap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
pce_7 = ModelPiece(Piece=pce_4.pc_4)  # -> Piece, Valid, Id, Description, TypeName, TypeVariant, Plane, Center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
pce_8 = ModelPiece(Piece=pce_5.pc_4)  # -> Piece, Valid, Id, Description, TypeName, TypeVariant, Plane, Center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
merge = Merge(Data1=expression, Data2=t_2)
expression_2 = Expression(x=con_5.Rotation, y=con_6.Rotation, Expression="If(Abs(x-y)≤180,y,-(360-y))")
expression_3 = Expression(x=con_5.Tilt, y=con_6.Tilt, Expression="If(Abs(x-y)≤180,y,-(360-y))")
merge_2 = Merge(Data1=graft(pce_7.Plane), Data2=graft(pce_8.Plane))
merge_3 = Merge(Data1=graft(con_5.Gap), Data2=graft(con_6.Gap))
merge_4 = Merge(Data1=graft(con_5.Shift), Data2=graft(con_6.Shift))
merge_5 = Merge(Data1=graft(con_5.Tilt), Data2=graft(expression_3))
merge_6 = Merge(Data1=graft(con_5.Rotation), Data2=graft(expression_2))
tstat = TreeStatistics(Tree=con_4.co_4)  # -> Paths, Length, Count
tstat_2 = TreeStatistics(Tree=con_3.co_4)  # -> Paths, Length, Count
concat = Concatenate(FragmentA=dsn_3.Name, FragmentE=",", FragmentF=dsn_3.Variant)
concat_2 = Concatenate(FragmentA=dsn_4.Name, FragmentE=",", FragmentF=dsn_4.Variant)
expression_4 = Expression(x=t_2, Expression="x≥0.5")
avgpl = AveragePlane(Pl=merge_2, M=merge)  # -> AvPl; inputs Pl: list of Plane, M: list of Double
# ---------- avgpl: C# usings ----------
using System.Linq;
# ---------- avgpl: C# ----------
    //Author: Ueli Saluz
    //Last modified: 29.05.2020
    //Contact: usaluz@outlook.de

    if (Component.RunCount < 2)
    {
      Component.Name = "AveragePlane";
      Component.NickName = "AvgPl";
      Component.Description = "Get the average plane from a set of planes. Provide multiplier to weight some planes more.";

      Component.Params.Input[0].Name = "Planes";
      Component.Params.Input[0].Description = "Planes to take average from.";
      Component.Params.Input[1].Name = "weights";
      Component.Params.Input[1].Description = "weights act like weights towards a plane.";

      Component.Params.Output[0].Name = "AveragePlane";
      Component.Params.Output[0].Description = "Resulting average plane.";

      Component.Message = "VER 1.0";
    }
    AvPl = GetAveragePlane(Pl.ToArray(), M.ToArray());
# ---------- avgpl: C# additional code ----------
  /// <summary>
  /// Gets the average plane from a set of of planes. Each plane can have a weight.
  /// </summary>
  /// <param name="planes"></param>
  /// <param name="weights"></param>
  /// <returns>Average plane under consideration of weights</returns>
  public Plane GetAveragePlane(Plane[] planes, double[] weights)
  {
    //If there are less weights than planes then the weight of 1 is assumed.
    if (weights.Length < planes.Length)
      weights = weights.Concat(Enumerable.Repeat(1d, planes.Length - weights.Length)).ToArray();
    //If there are more weights than planes then the last ones will be ignored.
    else if (weights.Length > planes.Length)
      weights = weights.Take(planes.Length).ToArray();

    if (weights.Sum() == 0)
      weights = Enumerable.Repeat(1d, planes.Length).ToArray();

    var sum = weights.Sum();
    weights = weights.Select(x => x / sum).ToArray();

    var origins = planes.Select(x => x.Origin).ToArray();
    var xAxes = planes.Select(x => x.XAxis).ToArray();
    var yAxes = planes.Select(x => x.YAxis).ToArray();

    for (int i = 0; i < planes.Length; i++)
    {
      origins[i].Transform(new Transform(weights[i]));
      xAxes[i].Transform(new Transform(weights[i]));
      yAxes[i].Transform(new Transform(weights[i]));
    }

    return new Plane(origins.Aggregate((a,b) => a + b), xAxes.Aggregate((a,b) => a + b), yAxes.Aggregate((a,b) => a + b));
  }
# ---------- end avgpl ----------
interp = InterpolateData(Data=merge_6, Parameter=t_2, Interpolation=2)
interp_2 = InterpolateData(Data=merge_3, Parameter=t_2, Interpolation=2)
interp_3 = InterpolateData(Data=merge_4, Parameter=t_2, Interpolation=2)
interp_4 = InterpolateData(Data=merge_5, Parameter=t_2, Interpolation=2)
concat_3 = Concatenate(FragmentD=")")
concat_4 = Concatenate(FragmentA=concat_2, FragmentB="(", FragmentD=")")
c_script = CSharpScript(x=avgpl)  # -> a; inputs x: Plane
# ---------- c_script: C# ----------
// Grasshopper Script Instance
#region Usings
using System;
using System.Linq;
using System.Collections;
using System.Collections.Generic;
using System.Drawing;

using Rhino;
using Rhino.Geometry;

using Grasshopper;
using Grasshopper.Kernel;
using Grasshopper.Kernel.Data;
using Grasshopper.Kernel.Types;
#endregion

public class Script_Instance : GH_ScriptInstance
{
    #region Notes
    /* 
      Members:
        RhinoDoc RhinoDocument
        GH_Document GrasshopperDocument
        IGH_Component Component
        int Iteration

      Methods (Virtual & overridable):
        Print(string text)
        Print(string format, params object[] args)
        Reflect(object obj)
        Reflect(object obj, string method_name)
    */
    #endregion

    private void RunScript(Plane x, ref object a)
    {
        a = x.IsValid ? x : null;
    }
}
# ---------- end c_script ----------
filter = StreamFilter(Gate=expression_4, Stream0=con_5.Connection, Stream1=con_6.Connection)
equals = Equality(FirstNumber=tstat.Length, SecondNumber="0")  # -> Equality, Inequality
equals_2 = Equality(FirstNumber=tstat_2.Paths, SecondNumber="0")  # -> Equality, Inequality
trim_5 = TrimTree(Tree=interp, Depth=1)
trim_6 = TrimTree(Tree=interp_4, Depth=1)
trim_7 = TrimTree(Tree=interp_2, Depth=1)
trim_8 = TrimTree(Tree=interp_3, Depth=1)
filter_2 = StreamFilter(Gate=expression_4, Stream0=pce_7.Piece, Stream1=pce_8.Piece)
concat_5 = Concatenate(FragmentA=concat, FragmentB=" U ", FragmentC=concat_2)
concat_6 = Concatenate(FragmentA=concat, FragmentB=" \ ", FragmentC=concat_2)
concat_7 = Concatenate(FragmentA=concat, FragmentB=" \ ", FragmentC=concat_2)
trim_9 = TrimTree(Tree=c_script, Depth=1)
cull = CullPattern(List=trim_2, CullPattern=equals_2.Equality)
cull_2 = CullPattern(List=trim_4, CullPattern=equals.Equality)
con_7 = ModelConnection(Connection=filter, Gap=trim_7, Shift=trim_8, Rotation=trim_5, Tilt=trim_6)  # -> Connection, Valid, ConnectedPieceId, ConnectedPieceTypePortId, ConnectingPieceId, ConnectingPieceTypePortId, Description, Gap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
pce_9 = ModelPiece(Piece=filter_2, Plane=trim_9)  # -> Piece, Valid, Id, Description, TypeName, TypeVariant, Plane, Center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
concat_8 = Concatenate(FragmentA=t_2, FragmentB=",", FragmentC=expression)
pc_s_u_t = Piece(pce_9.Piece)
pc_s_t = Piece(pce_3.pc_4)
pc_t_s = Piece(pce_6.pc_4)
co_s_u_t = Connection(con_7.Connection)
co_s_t = Connection(cull)
co_t_s = Connection(cull_2)
dsn_5 = ModelDesign(Name=concat_5, Variant=concat_8, Pieces=pc_s_u_t, Connections=co_s_u_t)  # -> Design, Valid, Name, Description, Icon, Image, Variant, View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
dsn_6 = ModelDesign(Name=concat_6, Pieces=pc_s_t, Connections=co_s_t)  # -> Design, Valid, Name, Description, Icon, Image, Variant, View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
dsn_7 = ModelDesign(Name=concat_7, Pieces=pc_t_s, Connections=co_t_s)  # -> Design, Valid, Name, Description, Icon, Image, Variant, View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
dn_s_u_t = Design(dsn_5.Design)
dn_s_t = Design(dsn_6.Design)
dn_t_s = Design(dsn_7.Design)
dn_t_s_2 = ClusterOutput(dn_t_s)
dn_s_t_2 = ClusterOutput(dn_s_t)
dn_s_u_t_2 = ClusterOutput(dn_s_u_t)

# ==== cluster MergeDesigns: Merge a list of distinct designs into a new design. All designs are normalized first, so the connections align. All the pieces have the name and variant as a prefix to ensure uniqueness. Make sure every design is distinct by having a unique combination of name and variant.
dn = ClusterInput()
na = ClusterInput()
description = ClusterInput()
icon = ClusterInput()
image = ClusterInput()
variant = ClusterInput()
view = ClusterInput()
qualities = ClusterInput()
authors = ClusterInput()
na_2 = Name(na)
description_2 = Description(description)
icon_2 = Icon(icon)
image_2 = Image(image)
variant_2 = Variant(variant)
view_2 = View(view)
qualities_2 = Qualities(qualities)
authors_2 = Authors(authors)
dn_2 = Design(dn)
dsn = NormalizeDesign(dn=dn_2)
dsn_2 = ModelDesign(Design=dsn)  # -> Design, Valid, Name, Description, Icon, Image, Variant, View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
con = ModelConnection(Connection=dsn_2.Connections)  # -> Connection, Valid, ConnectedPieceId, ConnectedPieceTypePortId, ConnectingPieceId, ConnectingPieceTypePortId, Description, Gap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
pce = ModelPiece(Piece=dsn_2.Pieces)  # -> Piece, Valid, Id, Description, TypeName, TypeVariant, Plane, Center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
concat = Concatenate(FragmentA=dsn_2.Name, FragmentB=",", FragmentC=dsn_2.Variant, FragmentD=",", FragmentE=dsn_2.View)
concat_2 = Concatenate(FragmentC=graft(concat), FragmentA=",", FragmentB=pce.Id)
concat_3 = Concatenate(FragmentC=graft(concat), FragmentA=",", FragmentB=con.ConnectedPieceId)
concat_4 = Concatenate(FragmentC=graft(concat), FragmentA=",", FragmentB=con.ConnectingPieceId)
con_2 = ModelConnection(Connection=con.Connection, ConnectedPieceId=concat_3, ConnectingPieceId=concat_4)  # -> Connection, Valid, ConnectedPieceId, ConnectedPieceTypePortId, ConnectingPieceId, ConnectingPieceTypePortId, Description, Gap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
pce_2 = ModelPiece(Piece=pce.Piece, Id=concat_2)  # -> Piece, Valid, Id, Description, TypeName, TypeVariant, Plane, Center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
trim = TrimTree(Tree=pce_2.Piece, Depth=1)
trim_2 = TrimTree(Tree=con_2.Connection, Depth=1)
dsn_3 = ModelDesign(
    Name=na_2,
    Description=description_2,
    Icon=icon_2,
    Image=image_2,
    Variant=variant_2,
    View=view_2,
    Pieces=trim,
    Connections=trim_2,
    Authors=authors_2,
    Qualities=qualities_2)  # -> Design, Valid, Name, Description, Icon, Image, Variant, View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
dn_3 = Design(dsn_3.Design)
dn_4 = ClusterOutput(dn_3)

# ==== cluster AssessPerformance: Simple performance assement based on the following qualities of the types (No unit conversion is applied for now, so make sure that all your types have the values with the same unit.): floor area, effective floor area, residents, workspaces, construction cost, maintenance expenses, income, transmission heat loss, ventilation heat loss, cooling energy demand, technical equipment energy demand,construction global warming potential, heating load, cooling load, ventilation air flow volume
dn = ClusterInput()
ty = ClusterInput()
technical_equipment_cost = ClusterInput()
technical_equipment_gwp_kgco2e = ClusterInput()
ventilation_heat_recovery_factor = ClusterInput()
heating_efficiency_factor = ClusterInput()
heating_primary_energy_factor = ClusterInput()
heating_energy_price_kwh = ClusterInput()
heating_global_warming_potential_kgco2e = ClusterInput()  # "Heating Global Warming Potential [kgCO2e/kWh]"
cooling_efficiency_factor = ClusterInput()
cooling_primary_energy_factor = ClusterInput()
cooling_global_warming_potential_kgco2e = ClusterInput()  # "Cooling Global Warming Potential [kgCO2e/kWh]"
cooling_energy_price_kwh = ClusterInput()
electrictiy_primary_energy_factor = ClusterInput()
electrictiy_global_warming_potential_kgc = ClusterInput()  # "Electrictiy Global Warming Potential [kgCO2e/kWh]"
electrictiy_energy_price_kwh = ClusterInput()
co2_price_tco2e = ClusterInput()
life_cycle_a = ClusterInput()
electrictiy_energy_price_kwh_2 = Number(electrictiy_energy_price_kwh)
heating_primary_energy_factor_2 = Number(heating_primary_energy_factor)
heating_energy_price_kwh_2 = Number(heating_energy_price_kwh)
heating_global_warming_potential_kgco2e_2 = Number(heating_global_warming_potential_kgco2e)  # "Heating Global Warming Potential [kgCO2e/kWh]"
cooling_energy_price_kwh_2 = Number(cooling_energy_price_kwh)
electrictiy_primary_energy_factor_2 = Number(electrictiy_primary_energy_factor)
ventilation_heat_recovery_factor_2 = Number(ventilation_heat_recovery_factor)
heating_efficiency_factor_2 = Number(heating_efficiency_factor)
cooling_efficiency_factor_2 = Number(cooling_efficiency_factor)
cooling_primary_energy_factor_2 = Number(cooling_primary_energy_factor)
cooling_global_warming_potential_kgco2e_2 = Number(cooling_global_warming_potential_kgco2e)  # "Cooling Global Warming Potential [kgCO2e/kWh]"
electrictiy_global_warming_potential_kgc_2 = Number(electrictiy_global_warming_potential_kgc)  # "Electrictiy Global Warming Potential [kgCO2e/kWh]"
co2_price_tco2e_2 = Number(co2_price_tco2e)
life_cycle_a_2 = Number(life_cycle_a)
dn_2 = Design(dn)
ty_2 = Type(ty)
technical_equipment_cost_2 = Number(technical_equipment_cost)
technical_equipment_gwp_kgco2e_2 = Number(technical_equipment_gwp_kgco2e)
expression = Expression(x=co2_price_tco2e_2, Expression="x/1000")
co2_price_kgco2e = Number(expression)
qal = SumQualities(dn=dn_2, ty=ty_2, na="floor area")  # -> num_2, ql_2
qal_2 = SumQualities(dn=dn_2, ty=ty_2, na="effective floor area")  # -> num_2, ql_2
qal_3 = SumQualities(dn=dn_2, ty=ty_2, na="residents")  # -> num_2, ql_2
qal_4 = SumQualities(dn=dn_2, ty=ty_2, na="workspaces")  # -> num_2, ql_2
qal_5 = SumQualities(dn=dn_2, ty=ty_2, na="construction cost")  # -> num_2, ql_2
qal_6 = SumQualities(dn=dn_2, ty=ty_2, na="maintenance expenses")  # -> num_2, ql_2
qal_7 = SumQualities(dn=dn_2, ty=ty_2, na="income")  # -> num_2, ql_2
qal_8 = SumQualities(dn=dn_2, ty=ty_2, na="transmission heat demand")  # -> num_2, ql_2
qal_9 = SumQualities(dn=dn_2, ty=ty_2, na="ventilation heat demand")  # -> num_2, ql_2
qal_10 = SumQualities(dn=dn_2, ty=ty_2, na="cooling energy demand")  # -> num_2, ql_2
qal_11 = SumQualities(dn=dn_2, ty=ty_2, na="technical equipment energy demand")  # -> num_2, ql_2
qal_12 = SumQualities(dn=dn_2, ty=ty_2, na="construction global warming potential")  # -> num_2, ql_2
qal_13 = SumQualities(dn=dn_2, ty=ty_2, na="heating load")  # -> num_2, ql_2
qal_14 = SumQualities(dn=dn_2, ty=ty_2, na="cooling load")  # -> num_2, ql_2
qal_15 = SumQualities(dn=dn_2, ty=ty_2, na="ventilation air flow volume")  # -> num_2, ql_2
addition = Addition(A=qal_3.num_2, B=qal_4.num_2)
ventilation_heat_recovery_factor_3 = Number(ventilation_heat_recovery_factor_2)
users_person = Number(addition)
ventiation_heat_loss_kwh_a = Number(qal_9.num_2)
transmission_heat_loss_kwh_a = Number(qal_8.num_2)
expression_2 = Expression(x=ventilation_heat_recovery_factor_3, Expression="1-x")
multiplication = Multiplication(A=ventiation_heat_loss_kwh_a, B=expression_2)
heating_global_warming_potential_kgco2e_3 = Number(heating_global_warming_potential_kgco2e_2)  # "Heating Global Warming Potential [kgCO2e/kWh]"
electrictiy_global_warming_potential_kgc_3 = Number(electrictiy_global_warming_potential_kgc_2)  # "Electrictiy Global Warming Potential [kgCO2e/kWh]"
cooling_global_warming_potential_kgco2e_3 = Number(cooling_global_warming_potential_kgco2e_2)  # "Cooling Global Warming Potential [kgCO2e/kWh]"
addition_2 = Addition(A=transmission_heat_loss_kwh_a, B=multiplication)
heating_energy_demand_kwh_a = Number(addition_2)
cooling_energy_demand_kwh_a = Number(qal_10.num_2)
heating_efficiency_factor_3 = Number(heating_efficiency_factor_2)
cooling_efficiency_factor_3 = Number(cooling_efficiency_factor_2)
technical_equipment_energy_demand_kwh_a = Number(qal_11.num_2)
electricity_energy_demand_kwh_a = Number(technical_equipment_energy_demand_kwh_a)
multiplication_2 = Multiplication(A=electricity_energy_demand_kwh_a, B=electrictiy_global_warming_potential_kgc_3)
multiplication_3 = Multiplication(A=heating_energy_demand_kwh_a, B=heating_efficiency_factor_3)
final_heating_energy_demand_kwh_a = Number(multiplication_3)
multiplication_4 = Multiplication(A=final_heating_energy_demand_kwh_a, B=heating_global_warming_potential_kgco2e_3)
multiplication_5 = Multiplication(A=cooling_energy_demand_kwh_a, B=cooling_efficiency_factor_3)
final_cooling_energy_demand_kwh_a = Number(multiplication_5)
multiplication_6 = Multiplication(A=final_cooling_energy_demand_kwh_a, B=cooling_global_warming_potential_kgco2e_3)
heating_global_warming_potential_kgco2e_4 = Number(multiplication_4)  # "Heating Global Warming Potential [kgCO2e/a]"
cooling_global_warming_potential_kgco2e_4 = Number(multiplication_6)  # "Cooling Global Warming Potential [kgCO2e/a]"
electricity_global_warming_potential_kgc = Number(multiplication_2)  # "Electricity Global Warming Potential [kgCO2e/a]"
final_heating_energy_demand_kwh_a_2 = Number(multiplication_3)
final_cooling_energy_demand_kwh_a_2 = Number(multiplication_5)
electricity_energy_demand_kwh_a_2 = Number(technical_equipment_energy_demand_kwh_a)
electrictiy_energy_price_kwh_3 = Number(electrictiy_energy_price_kwh_2)
heating_energy_price_kwh_3 = Number(heating_energy_price_kwh_2)
cooling_energy_price_kwh_3 = Number(cooling_energy_price_kwh_2)
co2_price_kgco2e_2 = Number(co2_price_kgco2e)
co2_price_kgco2e_3 = Number(co2_price_kgco2e)
co2_price_kgco2e_4 = Number(co2_price_kgco2e)
multiplication_7 = Multiplication(A=final_heating_energy_demand_kwh_a_2, B=heating_energy_price_kwh_3)
multiplication_8 = Multiplication(A=electricity_energy_demand_kwh_a_2, B=electrictiy_energy_price_kwh_3)
multiplication_9 = Multiplication(A=final_cooling_energy_demand_kwh_a_2, B=cooling_energy_price_kwh_3)
multiplication_10 = Multiplication(A=heating_global_warming_potential_kgco2e_4, B=co2_price_kgco2e_2)
multiplication_11 = Multiplication(A=cooling_global_warming_potential_kgco2e_4, B=co2_price_kgco2e_3)
multiplication_12 = Multiplication(A=electricity_global_warming_potential_kgc, B=co2_price_kgco2e_4)
electricity_global_warming_potential_kgc_2 = Number(electricity_global_warming_potential_kgc)  # "Electricity Global Warming Potential [kgCO2e/a]"
heating_global_warming_potential_kgco2e_5 = Number(heating_global_warming_potential_kgco2e_4)  # "Heating Global Warming Potential [kgCO2e/a]"
cooling_global_warming_potential_kgco2e_5 = Number(cooling_global_warming_potential_kgco2e_4)  # "Cooling Global Warming Potential [kgCO2e/a]"
heating_energy_price_a = Number(multiplication_7)
cooling_energy_price_a = Number(multiplication_8)
heating_co2_price_a = Number(multiplication_10)
cooling_co2_price_a = Number(multiplication_11)
cooling_energy_price_a_2 = Number(multiplication_9)
electricity_co2_price_a = Number(multiplication_12)
final_heating_energy_demand_kwh_a_3 = Number(final_heating_energy_demand_kwh_a_2)
final_cooling_energy_demand_kwh_a_3 = Number(final_cooling_energy_demand_kwh_a_2)
electricity_energy_demand_kwh_a_3 = Number(electricity_energy_demand_kwh_a_2)
electricity_energy_demand_kwh_a_4 = Number(electricity_energy_demand_kwh_a_2)
electrictiy_primary_energy_factor_3 = Number(electrictiy_primary_energy_factor_2)
heating_primary_energy_factor_3 = Number(heating_primary_energy_factor_2)
final_cooling_energy_demand_kwh_a_4 = Number(final_cooling_energy_demand_kwh_a_2)
cooling_primary_energy_factor_3 = Number(cooling_primary_energy_factor_2)
final_heating_energy_demand_kwh_a_4 = Number(final_heating_energy_demand_kwh_a_2)
building_construction_gwp_kgco2e = Number(qal_12.num_2)
technical_equipment_gwp_kgco2e_3 = Number(technical_equipment_gwp_kgco2e_2)
addition_3 = Addition(A=cooling_energy_price_a_2, B=cooling_co2_price_a)
addition_4 = Addition(A=heating_energy_price_a, B=heating_co2_price_a)
addition_5 = Addition(A=cooling_energy_price_a, B=electricity_co2_price_a)
addition_6 = Addition(
    A=heating_global_warming_potential_kgco2e_5,
    B=cooling_global_warming_potential_kgco2e_5,
    C=electricity_global_warming_potential_kgc_2)
addition_7 = Addition(A=final_heating_energy_demand_kwh_a_3, B=final_cooling_energy_demand_kwh_a_3, C=electricity_energy_demand_kwh_a_4)
multiplication_13 = Multiplication(A=electricity_energy_demand_kwh_a_3, B=electrictiy_primary_energy_factor_3)
multiplication_14 = Multiplication(A=final_heating_energy_demand_kwh_a_4, B=heating_primary_energy_factor_3)
multiplication_15 = Multiplication(A=final_cooling_energy_demand_kwh_a_4, B=cooling_primary_energy_factor_3)
electricity_expenses_a = Number(addition_5)
heating_expenses_a = Number(addition_4)
cooling_expenses_a = Number(addition_3)
energy_global_warming_potential_kgco2e_a = Number(addition_6)
final_energy_demand_kwh_a = Number(addition_7)
primary_heating_energy_demand_kwh_a = Number(multiplication_14)
primary_cooling_energy_demand_kwh_a = Number(multiplication_15)
primary_electricity_energy_demand_kwh_a = Number(multiplication_13)
addition_8 = Addition(A=building_construction_gwp_kgco2e, B=technical_equipment_gwp_kgco2e_3)
addition_9 = Addition(A=heating_expenses_a, B=cooling_expenses_a, C=electricity_expenses_a)
life_cycle_a_3 = Number(life_cycle_a_2)
construction_gwp_kgco2e = Number(addition_8)
maintenance_expenses_a = Number(qal_6.num_2)
energy_expenses_a = Number(addition_9)
multiplication_16 = Multiplication(A=energy_global_warming_potential_kgco2e_a, B=life_cycle_a_3)
addition_10 = Addition(A=primary_heating_energy_demand_kwh_a, B=primary_cooling_energy_demand_kwh_a, C=primary_electricity_energy_demand_kwh_a)
addition_11 = Addition(A=multiplication_16, B=construction_gwp_kgco2e)
addition_12 = Addition(A=maintenance_expenses_a, B=energy_expenses_a)
primary_energy_demand_kwh_a = Number(addition_10)
building_construction_cost = Number(qal_5.num_2)
technical_equipment_cost_3 = Number(technical_equipment_cost_2)
life_cycle_gwp_kgco2e = Number(addition_11)
expenses_a = Number(addition_12)
life_cycle_a_4 = Number(life_cycle_a_2)
multiplication_17 = Multiplication(A=expenses_a, B=life_cycle_a_4)
addition_13 = Addition(A=building_construction_cost, B=technical_equipment_cost_3)
life_cycle_expenses = Number(multiplication_17)
construction_cost = Number(addition_13)
income_a = Number(qal_7.num_2)
life_cycle_a_5 = Number(life_cycle_a_2)
addition_14 = Addition(A=construction_cost, B=life_cycle_expenses)
multiplication_18 = Multiplication(A=income_a, B=life_cycle_a_5)
cooling_energy_demand_kwh_a_2 = Number(cooling_energy_demand_kwh_a)
heating_energy_demand_kwh_a_2 = Number(heating_energy_demand_kwh_a)
heating_energy_demand_kwh_a_3 = Number(heating_energy_demand_kwh_a)
cooling_energy_demand_kwh_a_3 = Number(cooling_energy_demand_kwh_a)
primary_energy_demand_kwh_a_2 = Number(primary_energy_demand_kwh_a)
primary_energy_demand_kwh_a_3 = Number(primary_energy_demand_kwh_a)
final_energy_demand_kwh_a_2 = Number(final_energy_demand_kwh_a)
final_energy_demand_kwh_a_3 = Number(final_energy_demand_kwh_a)
construction_gwp_kgco2e_2 = Number(construction_gwp_kgco2e)
construction_gwp_kgco2e_3 = Number(construction_gwp_kgco2e)
life_cycle_gwp_kgco2e_2 = Number(life_cycle_gwp_kgco2e)
life_cycle_gwp_kgco2e_3 = Number(life_cycle_gwp_kgco2e)
effective_floor_area_m² = Number(qal_2.num_2)
effective_floor_area_m²_2 = Number(qal_2.num_2)
effective_floor_area_m²_3 = Number(qal_2.num_2)
effective_floor_area_m²_4 = Number(qal_2.num_2)
effective_floor_area_m²_5 = Number(qal_2.num_2)
effective_floor_area_m²_6 = Number(qal_2.num_2)
effective_floor_area_m²_7 = Number(qal_2.num_2)
effective_floor_area_m²_8 = Number(qal_2.num_2)
effective_floor_area_m²_9 = Number(qal_2.num_2)
effective_floor_area_m²_10 = Number(qal_2.num_2)
construction_cost_2 = Number(addition_13)
life_cycle_income = Number(multiplication_18)
construction_cost_3 = Number(addition_13)
life_cycle_cost = Number(addition_14)
life_cycle_cost_2 = Number(addition_14)
life_cycle_cost_3 = Number(addition_14)
floor_area_m² = Number(qal.num_2)
users_person_2 = Number(users_person)
users_person_3 = Number(users_person)
users_person_4 = Number(users_person)
users_person_5 = Number(users_person)
users_person_6 = Number(users_person)
users_person_7 = Number(users_person)
users_person_8 = Number(users_person)
users_person_9 = Number(users_person)
users_person_10 = Number(users_person)
division = Division(A=effective_floor_area_m², B=floor_area_m²)
division_2 = Division(A=effective_floor_area_m²_5, B=users_person_5)
division_3 = Division(A=construction_cost_2, B=effective_floor_area_m²_2)
division_4 = Division(A=construction_cost_3, B=users_person_6)
division_5 = Division(A=life_cycle_cost_2, B=effective_floor_area_m²_3)
division_6 = Division(A=life_cycle_cost_3, B=users_person_7)
division_7 = Division(A=construction_gwp_kgco2e_2, B=effective_floor_area_m²_6)
division_8 = Division(A=construction_gwp_kgco2e_3, B=users_person_8)
division_9 = Division(A=life_cycle_gwp_kgco2e_2, B=effective_floor_area_m²_4)
division_10 = Division(A=life_cycle_gwp_kgco2e_3, B=users_person_9)
division_11 = Division(A=primary_energy_demand_kwh_a_2, B=effective_floor_area_m²_7)
division_12 = Division(A=primary_energy_demand_kwh_a_3, B=users_person_10)
division_13 = Division(A=final_energy_demand_kwh_a_2, B=effective_floor_area_m²_8)
division_14 = Division(A=final_energy_demand_kwh_a_3, B=users_person_2)
division_15 = Division(A=heating_energy_demand_kwh_a_2, B=effective_floor_area_m²_9)
division_16 = Division(A=heating_energy_demand_kwh_a_3, B=users_person_3)
division_17 = Division(A=cooling_energy_demand_kwh_a_2, B=effective_floor_area_m²_10)
division_18 = Division(A=cooling_energy_demand_kwh_a_3, B=users_person_4)
expression_3 = Expression(Start=construction_cost, End=life_cycle_income, Expression="((End-Start)/Start)*100")
area_comfort_m²_person = Number(division_2)
life_cycle_cost_4 = Number(life_cycle_cost)
specific_life_cycle_cost_m² = Number(division_5)
construction_global_warming_potential_pe = Number(division_8)  # "Construction Global Warming Potential per User [kgCO2e/Person]"
specific_life_cycle_global_warming_poten = Number(division_9)  # "Specific Life Cycle Global Warming Potential [kgCO2e/m²]"
life_cycle_global_warming_potential_per = Number(division_10)  # "Life Cycle Global Warming Potential per User [kgCO2e/Person]"
primary_energy_demand_kwh_a_4 = Number(primary_energy_demand_kwh_a)
primary_energy_demand_per_user_kwh_perso = Number(division_12)  # "Primary Energy Demand per User [kWh/Person a]"
final_energy_demand_kwh_a_4 = Number(final_energy_demand_kwh_a)
specific_final_energy_demand_kwh_m²a = Number(division_13)
ventilation_air_flow_volume_m³_s = Number(qal_15.num_2)
area_efficiency_eff_m²_m² = Number(division)
income_a_2 = Number(qal_7.num_2)
expenses_a_2 = Number(addition_12)
energy_expenses_a_2 = Number(addition_9)
effective_floor_area_m²_11 = Number(qal_2.num_2)
floor_area_m²_2 = Number(qal.num_2)
users_person_11 = Number(users_person)
construction_cost_4 = Number(addition_13)
specific_construction_cost_m² = Number(division_3)
construction_cost_per_user_person = Number(division_4)
life_cycle_cost_per_user_person = Number(division_6)
construction_global_warming_potential_kg = Number(construction_gwp_kgco2e)  # "Construction Global Warming Potential [kgCO2e]"
specific_construction_global_warming_pot = Number(division_7)  # "Specific Construction Global Warming Potential [kgCO2e/m²]"
life_cycle_global_warming_potential_kgco = Number(life_cycle_gwp_kgco2e)  # "Life Cycle Global Warming Potential [kgCO2e]"
specific_primary_energy_demand_kwh_m²a = Number(division_11)
final_energy_demand_per_user_kwh_person = Number(division_14)  # "Final Energy Demand per User [kWh/Person a]"
heating_load_kw = Number(qal_13.num_2)
heating_energy_demand_kwh_a_4 = Number(heating_energy_demand_kwh_a)
specific_heating_energy_demand_kwh_m²a = Number(division_15)
heating_energy_demand_per_user_kwh_perso = Number(division_16)  # "Heating Energy Demand per User [kWh/Person a]"
cooling_load_kw = Number(qal_14.num_2)
cooling_energy_demand_kwh_a_4 = Number(cooling_energy_demand_kwh_a)
specific_cooling_energy_demand_kwh_m²a = Number(division_17)
cooling_energy_demand_per_user_kwh_perso = Number(division_18)  # "Cooling Energy Demand per User [kWh/Person a]"
interest = Number(expression_3)
panel = Panel("""interest
area efficiency 
area comfort 
income
expenses 
energy expenses 
effective floor area 
floor area 
users 
construction cost 
specific construction cost 
construction cost per user 
life cycle cost 
specific life cycle cost 
life cycle cost per user 
construction global warming potential 
specific construction global warming potential 
construction global warming potential per user 
life cycle global warming potential 
specific life cycle global warming potential 
life cycle global warming potential per user 
primary energy demand 
specific primary energy demand 
primary energy demand per user 
final energy demand 
specific final energy demand 
final energy demand per user 
heating load 
heating energy demand 
specific heating energy demand 
heating energy demand per user 
cooling load 
cooling energy demand 
specific cooling energy demand 
cooling energy demand per user 
ventilation air flow volume  """)
merge = Merge(
    Data1=interest,
    Data2=area_efficiency_eff_m²_m²,
    Data3=area_comfort_m²_person,
    Data4=income_a_2,
    Data5=expenses_a_2,
    Data6=energy_expenses_a_2,
    Data7=effective_floor_area_m²_11,
    Data8=floor_area_m²_2,
    Data9=users_person_11,
    Data10=construction_cost_4,
    Data11=specific_construction_cost_m²,
    Data12=construction_cost_per_user_person,
    Data13=life_cycle_cost_4,
    Data14=specific_life_cycle_cost_m²,
    Data15=life_cycle_cost_per_user_person,
    Data16=construction_global_warming_potential_kg,
    Data17=specific_construction_global_warming_pot,
    Data18=construction_global_warming_potential_pe,
    Data19=life_cycle_global_warming_potential_kgco,
    Data20=specific_life_cycle_global_warming_poten,
    Data21=life_cycle_global_warming_potential_per,
    Data22=primary_energy_demand_kwh_a_4,
    Data23=specific_primary_energy_demand_kwh_m²a,
    Data24=primary_energy_demand_per_user_kwh_perso,
    Data25=final_energy_demand_kwh_a_4,
    Data26=specific_final_energy_demand_kwh_m²a,
    Data27=final_energy_demand_per_user_kwh_person,
    Data28=heating_load_kw,
    Data29=heating_energy_demand_kwh_a_4,
    Data30=specific_heating_energy_demand_kwh_m²a,
    Data31=heating_energy_demand_per_user_kwh_perso,
    Data32=cooling_load_kw,
    Data33=cooling_energy_demand_kwh_a_4,
    Data34=specific_cooling_energy_demand_kwh_m²a,
    Data35=cooling_energy_demand_per_user_kwh_perso,
    Data36=ventilation_air_flow_volume_m³_s)
dsn = ModelDesign(Design=dn_2)  # -> Design, Valid, Name, Description, Icon, Image, Variant, View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
panel_2 = Panel(merge)
trim = TrimTree(Tree=dsn.Qualities, Depth=1)
panel_3 = Panel("""%
eff. m²/m²
m²/Person
€/a
€/a
€/a
m²
m²
Person
€
€/m²
€/Person
€
€/m²
€/Person
kgCO2e
kgCO2e/m²
kgCO2e/Person
kgCO2e
kgCO2e/m²
kgCO2e/Person
kWh/a
kWh/m²a
kWh/Person a
kWh/a
kWh/m²a
kWh/Person a
kW
kWh/a
kWh/m²a
kWh/Person a
kW
kWh/a
kWh/m²a
kWh/Person a
m³/s""")
qal_16 = ModelQuality(Name=panel, Value=merge, Unit=panel_3)  # -> Quality, Valid, Name, Value, Unit, Definition
merge_2 = Merge(Data1=trim, Data2=qal_16.Quality)
dsn_2 = ModelDesign(Design=dsn.Design, Qualities=merge_2)  # -> Design, Valid, Name, Description, Icon, Image, Variant, View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
dn_3 = ClusterOutput(dsn_2.Design)
interest_2 = ClusterOutput(interest)
area_efficiency_eff_m²_m²_2 = ClusterOutput(area_efficiency_eff_m²_m²)
area_comfort_m²_person_2 = ClusterOutput(area_comfort_m²_person)
income_a_3 = ClusterOutput(income_a_2)
expenses_a_3 = ClusterOutput(expenses_a_2)
energy_expenses_a_3 = ClusterOutput(energy_expenses_a_2)
effective_floor_area_m²_12 = ClusterOutput(effective_floor_area_m²_11)
floor_area_m²_3 = ClusterOutput(floor_area_m²_2)
users_person_12 = ClusterOutput(users_person_11)
construction_cost_5 = ClusterOutput(construction_cost_4)
specific_construction_cost_m²_2 = ClusterOutput(specific_construction_cost_m²)
construction_cost_per_user_person_2 = ClusterOutput(construction_cost_per_user_person)
life_cycle_cost_5 = ClusterOutput(life_cycle_cost_4)
specific_life_cycle_cost_m²_2 = ClusterOutput(specific_life_cycle_cost_m²)
life_cycle_cost_per_user_person_2 = ClusterOutput(life_cycle_cost_per_user_person)
construction_global_warming_potential_kg_2 = ClusterOutput(construction_global_warming_potential_kg)  # "Construction Global Warming Potential [kgCO2e]"
specific_construction_global_warming_pot_2 = ClusterOutput(specific_construction_global_warming_pot)  # "Specific Construction Global Warming Potential [kgCO2e/m²]"
construction_global_warming_potential_pe_2 = ClusterOutput(construction_global_warming_potential_pe)  # "Construction Global Warming Potential per User [kgCO2e/Person]"
life_cycle_global_warming_potential_kgco_2 = ClusterOutput(life_cycle_global_warming_potential_kgco)  # "Life Cycle Global Warming Potential [kgCO2e]"
specific_life_cycle_global_warming_poten_2 = ClusterOutput(specific_life_cycle_global_warming_poten)  # "Specific Life Cycle Global Warming Potential [kgCO2e/m²]"
life_cycle_global_warming_potential_per_2 = ClusterOutput(life_cycle_global_warming_potential_per)  # "Life Cycle Global Warming Potential per User [kgCO2e/Person]"
primary_energy_demand_kwh_a_5 = ClusterOutput(primary_energy_demand_kwh_a_4)
specific_primary_energy_demand_kwh_m²a_2 = ClusterOutput(specific_primary_energy_demand_kwh_m²a)
primary_energy_demand_per_user_kwh_perso_2 = ClusterOutput(primary_energy_demand_per_user_kwh_perso)  # "Primary Energy Demand per User [kWh/Person a]"
final_energy_demand_kwh_a_5 = ClusterOutput(final_energy_demand_kwh_a_4)
specific_final_energy_demand_kwh_m²a_2 = ClusterOutput(specific_final_energy_demand_kwh_m²a)
final_energy_demand_per_user_kwh_person_2 = ClusterOutput(final_energy_demand_per_user_kwh_person)  # "Final Energy Demand per User [kWh/Person a]"
heating_load_kw_2 = ClusterOutput(heating_load_kw)
heating_energy_demand_kwh_a_5 = ClusterOutput(heating_energy_demand_kwh_a_4)
specific_heating_energy_demand_kwh_m²a_2 = ClusterOutput(specific_heating_energy_demand_kwh_m²a)
heating_energy_demand_per_user_kwh_perso_2 = ClusterOutput(heating_energy_demand_per_user_kwh_perso)  # "Heating Energy Demand per User [kWh/Person a]"
cooling_load_kw_2 = ClusterOutput(cooling_load_kw)
cooling_energy_demand_kwh_a_5 = ClusterOutput(cooling_energy_demand_kwh_a_4)
specific_cooling_energy_demand_kwh_m²a_2 = ClusterOutput(specific_cooling_energy_demand_kwh_m²a)
cooling_energy_demand_per_user_kwh_perso_2 = ClusterOutput(cooling_energy_demand_per_user_kwh_perso)  # "Cooling Energy Demand per User [kWh/Person a]"
ventilation_air_flow_volume_m³_s_2 = ClusterOutput(ventilation_air_flow_volume_m³_s)

# ==== cluster MoveDesign: Move (translate and rotate) the design by moving all planes and centers.
ce = ClusterInput()
dn = ClusterInput()
pn = ClusterInput()
dn_2 = Design(dn)
pn_2 = Transform(pn)
ce_2 = Transform(ce)
dsn = ModelDesign(Design=dn_2)  # -> Design, Valid, Name, Description, Icon, Image, Variant, View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
trim = TrimTree(Tree=dsn.Pieces, Depth=1)
pce = ModelPiece(Piece=trim)  # -> Piece, Valid, Id, Description, TypeName, TypeVariant, Plane, Center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
pt = Point(pce.Center)
pt_2 = Point(ce_2)
transform = Transform(Geometry=pce.Plane, Transform=pn_2)
transform_2 = Transform(Geometry=pt, Transform=pt_2)
pce_2 = ModelPiece(Piece=pce.Piece, Plane=transform, Center=transform_2)  # -> Piece, Valid, Id, Description, TypeName, TypeVariant, Plane, Center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
dsn_2 = ModelDesign(Design=dsn.Design, Pieces=pce_2.Piece)  # -> Design, Valid, Name, Description, Icon, Image, Variant, View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
dn_3 = Design(dsn_2.Design)
dn_4 = ClusterOutput(dn_3)

# ==== cluster PreviewConnections: Preview all connections of a design by visualizing the ports of the types and the connection parameters.
dn = ClusterInput()
ty = ClusterInput()
sc = ClusterInput()
sc_2 = Number(sc)
dn_2 = Design(dn)
ty_2 = Type(ty)
fltdsn = FlattenDesign(Design=dn_2, Types=ty_2)
dsn = ModelDesign(Design=dn_2)  # -> Design, Valid, Name, Description, Icon, Image, Variant, View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
dsn_2 = ModelDesign(Design=fltdsn)  # -> Design, Valid, Name, Description, Icon, Image, Variant, View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
trim = TrimTree(Tree=dsn_2.Pieces, Depth=1)
trim_2 = TrimTree(Tree=dsn.Connections, Depth=1)
trim_3 = TrimTree(Tree=dsn.Pieces, Depth=1)
roo = SelectRoot(pc=trim_3)  # -> ro_2, i_2
null = NullItem(Item=roo.i_2)  # -> NullFlags, InvalidFlags, Description
filter = StreamFilter(Gate=null.NullFlags, Stream0=roo.i_2, Stream1="0")
cull_i = CullIndex(List=trim, Indices=filter, Wrap=True)
pce = ModelPiece(Piece=cull_i)  # -> Piece, Valid, Id, Description, TypeName, TypeVariant, Plane, Center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
panel = Panel("semio.parent")
qal = ModelQuality(Quality=pce.Qualities)  # -> Quality, Valid, Name, Value, Unit, Definition
trim_4 = TrimTree(Tree=qal.Value, Depth=1)
pce_2 = SelectPiece(pc=trim, id=trim_4)  # -> pc_4, i_2
con = SelectConnection(co=trim_2, cdpc=trim_4, cgpc=pce.Id)  # -> co_4, i_2, fl_2
co = Connection(con.co_4)
parent = Piece(pce_2.pc_4)
child = Piece(cull_i)
con_2 = ModelConnection(Connection=co)  # -> Connection, Valid, ConnectedPieceId, ConnectedPieceTypePortId, ConnectingPieceId, ConnectingPieceTypePortId, Description, Gap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
pce_3 = ModelPiece(Piece=parent)  # -> Piece, Valid, Id, Description, TypeName, TypeVariant, Plane, Center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
pce_4 = ModelPiece(Piece=child)  # -> Piece, Valid, Id, Description, TypeName, TypeVariant, Plane, Center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
typ = SelectTypeByPiece(ty=ty_2, pc=pce_3.Piece)  # -> ty_4, i_2
typ_2 = SelectTypeByPiece(ty=ty_2, pc=pce_4.Piece)  # -> ty_4, i_2
merge = Merge(Data1=graft(con_2.ConnectedPieceTypePortId), Data2=graft(con_2.ConnectingPieceTypePortId))
merge_2 = Merge(Data1=graft(con_2.ConnectingPieceTypePortId), Data2=graft(con_2.ConnectedPieceTypePortId))
typ_3 = ModelType(Type=typ.ty_4)  # -> Type, Valid, Name, Description, Icon, Image, Variant, Stock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
typ_4 = ModelType(Type=typ_2.ty_4)  # -> Type, Valid, Name, Description, Icon, Image, Variant, Stock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
item = ListItem(List=merge, Index=graft(con.fl_2), Wrap=True)
item_2 = ListItem(List=merge_2, Index=graft(con.fl_2), Wrap=True)
por = SelectPort(po=typ_3.Ports, id=item)  # -> po_4, i_2
por_2 = SelectPort(po=typ_4.Ports, id=item_2)  # -> po_4, i_2
deplane = DeconstructPlane(Plane=pce_4.Plane)  # -> Origin, XAxis, YAxis, ZAxis
orient = Orient(Source=PlaneXY(0, 0, 0), Target=pce_4.Plane)  # -> Geometry, Transform
orient_2 = Orient(Source=PlaneXY(0, 0, 0), Target=pce_3.Plane)  # -> Geometry, Transform
trim_5 = TrimTree(Tree=por.po_4, Depth=1)
trim_6 = TrimTree(Tree=por_2.po_4, Depth=1)
Y = UnitY(Factor=1)
c_script = CSharpScript(X=orient.Transform)  # -> T, R, I; inputs X: Transform
# ---------- c_script: C# ----------
// Grasshopper Script Instance
#region Usings
using System;
using System.Linq;
using System.Collections;
using System.Collections.Generic;
using System.Drawing;

using Rhino;
using Rhino.Geometry;

using Grasshopper;
using Grasshopper.Kernel;
using Grasshopper.Kernel.Data;
using Grasshopper.Kernel.Types;
#endregion

public class Script_Instance : GH_ScriptInstance
{
    #region Notes
    /* 
      Members:
        RhinoDoc RhinoDocument
        GH_Document GrasshopperDocument
        IGH_Component Component
        int Iteration

      Methods (Virtual & overridable):
        Print(string text)
        Print(string format, params object[] args)
        Reflect(object obj)
        Reflect(object obj, string method_name)
    */
    #endregion

    private void RunScript(Transform X, ref object T, ref object R, ref object I)
    {
        var i = new Transform();
        T = X.TryGetInverse(out i);
        var translation = new Vector3d();
        var rotation = new Transform();
        var orthogonal = new Transform();
        var diagonal = new Vector3d();
        X.DecomposeAffine(out translation, out rotation, out orthogonal,out diagonal);
        T = translation;
        R = rotation;
        I = i;
    }
}
# ---------- end c_script ----------
c_script_2 = CSharpScript(X=orient_2.Transform)  # -> T, R, I; inputs X: Transform; same code as c_script
Z = UnitZ(Factor=1)
rotate = RotateDirection(Center=Point(0, 0, 0), From=Y, To=deplane.YAxis)  # -> Geometry, Transform
parent_po = Port(trim_5)
child_po = Port(trim_6)
por_3 = ModelPort(Port=parent_po)  # -> Port, Valid, Id, Description, Mandatory, Family, CompatibleFamilies, Point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
por_4 = ModelPort(Port=child_po)  # -> Port, Valid, Id, Description, Mandatory, Family, CompatibleFamilies, Point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
deplane_2 = DeconstructPlane(Plane=pce_3.Plane)  # -> Origin, XAxis, YAxis, ZAxis
transform = Transform(Geometry=por_3.Direction, Transform=c_script_2.R)
transform_2 = Transform(Geometry=por_3.Point, Transform=orient_2.Transform)
transform_3 = Transform(Geometry=por_4.Point, Transform=orient.Transform)
transform_4 = Transform(Geometry=por_4.Direction, Transform=c_script.R)
Y_2 = UnitY(Factor=1)
por_5 = ModelPort(Port=por_3.Port, Point=transform_2, Direction=transform)  # -> Port, Valid, Id, Description, Mandatory, Family, CompatibleFamilies, Point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
por_6 = ModelPort(Port=por_4.Port, Point=transform_3, Direction=transform_4)  # -> Port, Valid, Id, Description, Mandatory, Family, CompatibleFamilies, Point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
transform_5 = Transform(Geometry=Z, Transform=c_script_2.R)
transform_6 = Transform(Geometry=Y_2, Transform=c_script_2.R)
expression = Expression(x=transform_6, Expression="x")
prv = PreviewPort(po=por_5.Port, sc=sc_2)
prv_2 = PreviewPort(po=por_6.Port, sc=sc_2)
ln = Line(EndPoint=por_6.Point)
merge_3 = Merge(Data1=graft(transform_5), Data2=graft(expression))
expression_2 = Expression(x=transform, Expression="x=y")
preview = CustomPreview(Geometry=ln, Material=ColourSwatch(SwatchColor=RGB(250, 149, 0)))
pl = ConstructPlane(Origin=Point(0, 0, 0), XAxis=Z, YAxis=Vector(0, 1, 0))
item_3 = ListItem(List=merge_3, Index=graft(expression_2), Wrap=True)
log = Logarithm(Value=sc_2)
expression_3 = Expression(x=con_2.Raise, Expression="x≠0")
expression_4 = Expression(x=con_2.Shift, Expression="x≠0")
expression_5 = Expression(x=con_2.Gap, Expression="x≠0")
deplane_3 = DeconstructPlane(Plane=pl)  # -> Origin, XAxis, YAxis, ZAxis
rev = Reverse(Vector=deplane_3.ZAxis)
pl_2 = ConstructPlane(Origin=por_6.Point, XAxis=rev, YAxis=deplane_3.XAxis)
rev_2 = Reverse(Vector=deplane_3.ZAxis)
expression_6 = Expression(x=sc_2, Expression="x/2")
prot = RotatePlane(Plane=pl_2, Angle=degrees(con_2.Rotation))
deplane_4 = DeconstructPlane(Plane=prot)  # -> Origin, XAxis, YAxis, ZAxis
rev_3 = Reverse(Vector=deplane_4.ZAxis)
pl_3 = ConstructPlane(Origin=deplane_4.Origin, XAxis=deplane_4.XAxis, YAxis=rev_3)
prot_2 = RotatePlane(Plane=pl_3, Angle=degrees(con_2.Turn))
deplane_5 = DeconstructPlane(Plane=prot_2)  # -> Origin, XAxis, YAxis, ZAxis
rev_4 = Reverse(Vector=deplane_5.ZAxis)
pl_4 = ConstructPlane(Origin=deplane_5.Origin, XAxis=deplane_5.YAxis, YAxis=deplane_5.ZAxis)
multiplication = Multiplication(A=log, B=Slider(2, range=0..10))
trim_7 = TrimTree(Tree=item_3, Depth=1)
amp = Amplitude(Vector=rev_2, Amplitude=con_2.Shift)
amp_2 = Amplitude(Vector=deplane_3.XAxis, Amplitude=con_2.Raise)
amp_3 = Amplitude(Amplitude=con_2.Gap)
move = Move(Motion=amp_3)  # -> Geometry, Transform
move_2 = Move(Geometry=move.Geometry, Motion=amp)  # -> Geometry, Transform
swatch = ColourSwatch(SwatchColor=RGB(219, 190, 161))
swatch_2 = ColourSwatch(SwatchColor=RGB(0, 0, 0))
swatch_3 = ColourSwatch(SwatchColor=RGB(252, 207, 5))
swatch_4 = ColourSwatch(SwatchColor=RGB(126, 183, 127))
rotate_2 = Rotate(Angle=degrees(con_2.Turn), Plane=PlaneXY(0, 0, 0))  # -> Geometry, Transform
cull = CullPattern(List=move_2.Geometry, CullPattern=expression_3)
cull_2 = CullPattern(CullPattern=expression_5)
cull_3 = CullPattern(List=amp_3, CullPattern=expression_5)
cull_4 = CullPattern(List=amp, CullPattern=expression_4)
cull_5 = CullPattern(List=amp_2, CullPattern=expression_3)
cull_6 = CullPattern(List=move.Geometry, CullPattern=expression_4)
cir = Circle(Plane=pl_2, Radius=expression_6)
remap = RemapNumbers(Value=con_2.Rotation, Source="360", Target=Domain(0, 1))  # -> Mapped, Clipped
cir_2 = Circle(Plane=pl_3, Radius=expression_6)
cir_3 = Circle(Plane=pl_4, Radius=expression_6)
remap_2 = RemapNumbers(Value=con_2.Turn, Source="360", Target=Domain(0, 1))  # -> Mapped, Clipped
remap_3 = RemapNumbers(Value=con_2.Tilt, Source="360", Target=Domain(0, 1))  # -> Mapped, Clipped
vdisex = VectorDisplayEx(Point=cull_2, Vector=cull_3, Colour=swatch_3, Width=multiplication)
vdisex_2 = VectorDisplayEx(Point=cull_6, Vector=cull_4, Colour=swatch_4, Width=multiplication)
vdisex_3 = VectorDisplayEx(Point=cull, Vector=cull_5, Colour=swatch, Width=multiplication)
expression_7 = Expression(x=con_2.Rotation, Expression="x≠0")
eval = EvaluateCurve(Curve=reparameterize(cir), Parameter="0")  # -> Point, Tangent, Angle
eval_2 = EvaluateCurve(Curve=reparameterize(cir), Parameter=remap.Mapped)  # -> Point, Tangent, Angle
expression_8 = Expression(x=con_2.Turn, Expression="x≠0")
expression_9 = Expression(x=con_2.Tilt, Expression="x≠0")
eval_3 = EvaluateCurve(Curve=reparameterize(cir_2), Parameter="0")  # -> Point, Tangent, Angle
eval_4 = EvaluateCurve(Curve=reparameterize(cir_3), Parameter="0")  # -> Point, Tangent, Angle
eval_5 = EvaluateCurve(Curve=reparameterize(cir_2), Parameter=remap_2.Mapped)  # -> Point, Tangent, Angle
eval_6 = EvaluateCurve(Curve=reparameterize(cir_3), Parameter=remap_3.Mapped)  # -> Point, Tangent, Angle
expression_10 = Expression(x=amp_3, Expression="x/2")
expression_11 = Expression(x=amp, Expression="x/2")
expression_12 = Expression(x=amp_2, Expression="x/2")
cull_7 = CullPattern(List=cir, CullPattern=expression_7)
cull_8 = CullPattern(List=eval.Point, CullPattern=expression_7)
cull_9 = CullPattern(List=eval_2.Point, CullPattern=expression_7)
cull_10 = CullPattern(List=cir_2, CullPattern=expression_8)
cull_11 = CullPattern(List=cir_3, CullPattern=expression_9)
cull_12 = CullPattern(List=eval_3.Point, CullPattern=expression_8)
cull_13 = CullPattern(List=eval_4.Point, CullPattern=expression_9)
cull_14 = CullPattern(List=eval_5.Point, CullPattern=expression_8)
cull_15 = CullPattern(List=eval_6.Point, CullPattern=expression_9)
move_3 = Move(Motion=expression_10)  # -> Geometry, Transform
move_4 = Move(Geometry=move.Geometry, Motion=expression_11)  # -> Geometry, Transform
move_5 = Move(Geometry=move_2.Geometry, Motion=expression_12)  # -> Geometry, Transform
concat = Concatenate(FragmentA=con_2.Gap, FragmentC=" ", FragmentB=dsn.Unit)
concat_2 = Concatenate(FragmentA=con_2.Gap, FragmentC=" ", FragmentB=dsn.Unit)
concat_3 = Concatenate(FragmentA=con_2.Raise, FragmentC=" ", FragmentB=dsn.Unit)
circledim = CircularDimension(Circle=cull_7, PointA=cull_8, PointB=cull_9, Text="{0:0}°", Size=sc_2)
circledim_2 = CircularDimension(Circle=cull_10, PointA=cull_12, PointB=cull_14, Text="{0:0}°", Size=sc_2)
circledim_3 = CircularDimension(Circle=cull_11, PointA=cull_13, PointB=cull_15, Text="{0:0}°", Size=sc_2)
cull_16 = CullPattern(List=move_3.Geometry, CullPattern=expression_5)
cull_17 = CullPattern(List=concat, CullPattern=expression_5)
cull_18 = CullPattern(List=move_4.Geometry, CullPattern=expression_5)
cull_19 = CullPattern(List=concat_2, CullPattern=expression_5)
cull_20 = CullPattern(List=move_5.Geometry, CullPattern=expression_3)
cull_21 = CullPattern(List=concat_3, CullPattern=expression_3)
tag = TextTag(Location=cull_16, Text=cull_17, Colour=swatch_3)
tag_2 = TextTag(Location=cull_18, Text=cull_19, Colour=swatch_4)
tag_3 = TextTag(Location=cull_20, Text=cull_21, Colour=swatch)

# ==== cluster SelectRepresentation: Select exactly one representation based on tags. The tag matching is based on the highest Jaccard index (|∩|/|∪|).
rp = ClusterInput()
tags = ClusterInput()
rp_2 = Representation(rp)
tags_2 = Tags(tags)
rep = ModelRepresentation(Representation=rp_2)  # -> Representation, Valid, Url, Description, Tags, Qualities
jac = JaccardIndex(set1=tags_2, set2=rep.Tags)
trim = TrimTree(Tree=jac, Depth=1)
minmax = MinimumMaximum(L=trim)  # -> Max, MaxI, Min, MinI; inputs L: list
# ---------- minmax: Python ----------
#Component Information
#--------------------------------------------------------------------------------------------
if ghenv.Component.RunCount<2:
    #General
    #--------------------------------------------------------------------------------------------
    __author__ = "Ueli Saluz"
    __version__ = "2022.04.22"
    
    ghenv.Component.Name = "MinimumMaximum"
    ghenv.Component.NickName = "MinMax"
    ghenv.Component.Description = "Returns the maximum and mininum of a list and their corresponding index."
    ghenv.Component.Message = "VER 1.0"
    ghenv.Component.Category = "Maths"
    ghenv.Component.SubCategory = "Util"
    
     #Inputs
    #--------------------------------------------------------------------------------------------
    inputIndex=0
    
    ghenv.Component.Params.Input[inputIndex].Name = "L"
    ghenv.Component.Params.Input[inputIndex].NickName = "L"
    ghenv.Component.Params.Input[inputIndex].Description = "A list of numbers."
    ghenv.Component.Params.Input[inputIndex].Optional = False
    inputIndex+=1
    
    
    #Outputs
    #--------------------------------------------------------------------------------------------
    outputIndex=0
    
    ghenv.Component.Params.Output[outputIndex].Name = "Max"
    ghenv.Component.Params.Output[outputIndex].NickName = "Max"
    ghenv.Component.Params.Output[outputIndex].Description = "Maximum of the list"
    outputIndex+=1
    
    ghenv.Component.Params.Output[outputIndex].Name = "MaxI"
    ghenv.Component.Params.Output[outputIndex].NickName = "MaxI"
    ghenv.Component.Params.Output[outputIndex].Description = "Index of the maximum of the list"
    outputIndex+=1
    
    ghenv.Component.Params.Output[outputIndex].Name = "Min"
    ghenv.Component.Params.Output[outputIndex].NickName = "Min"
    ghenv.Component.Params.Output[outputIndex].Description = "Minimum of the list"
    outputIndex+=1
    
    ghenv.Component.Params.Output[outputIndex].Name = "MinI"
    ghenv.Component.Params.Output[outputIndex].NickName = "MinI"
    ghenv.Component.Params.Output[outputIndex].Description = "Index of the minimum of the list"
    outputIndex+=1


#Solver - Run with trees to enhance performance drastically
#--------------------------------------------------------------------------------------------
if __name__ == "__main__":
    
    maximum = max(L)
    MaxI = L.index(maximum)
    Max = maximum
    
    minimum = min(L)
    MinI = L.index(minimum)
    Min = minimum
# ---------- end minmax ----------
txt = Text(rp_2)
item = ListItem(List=rep.Representation, Index=minmax.MaxI, Wrap=True)
txt_2 = Text(item)
itemindex = ItemIndex(L=txt, I=txt_2)  # -> i; inputs L: list
# ---------- itemindex: Python ----------
#Component Information
#--------------------------------------------------------------------------------------------
if ghenv.Component.RunCount<2:
    #General
    #--------------------------------------------------------------------------------------------
    __author__ = "Ueli Saluz"
    __version__ = "2022.11.18"
    
    ghenv.Component.Name = "ItemIndex"
    ghenv.Component.NickName = "ItemIndex"
    ghenv.Component.Description = "A better IdemIndex"
    ghenv.Component.Message = "VER 1.0"
    ghenv.Component.Category = "Set"
    ghenv.Component.SubCategory = "List"
    
     #Inputs
    #--------------------------------------------------------------------------------------------
    inputIndex=0
    
    ghenv.Component.Params.Input[inputIndex].Name = "List"
    ghenv.Component.Params.Input[inputIndex].NickName = "L"
    ghenv.Component.Params.Input[inputIndex].Description = "Input1 is..."
    ghenv.Component.Params.Input[inputIndex].Optional = False
    inputIndex+=1
    
    ghenv.Component.Params.Input[inputIndex].Name = "Item"
    ghenv.Component.Params.Input[inputIndex].NickName = "I"
    ghenv.Component.Params.Input[inputIndex].Description = "Input2 is..."
    ghenv.Component.Params.Input[inputIndex].Optional = False
    inputIndex+=1
    
    #Outputs
    #--------------------------------------------------------------------------------------------
    outputIndex=0
    
    ghenv.Component.Params.Output[outputIndex].Name = "Index"
    ghenv.Component.Params.Output[outputIndex].NickName = "i"
    ghenv.Component.Params.Output[outputIndex].Description = "Output1 is..."
    outputIndex+=1

i = L.index(I)
# ---------- end itemindex ----------
trim_2 = TrimTree(Tree=itemindex, Depth=1)
trim_3 = TrimTree(Tree=item, Depth=1)
i = Integer(trim_2)
rp_3 = Representation(trim_3)
i_2 = ClusterOutput(i)
rp_4 = ClusterOutput(rp_3)

# ==== cluster PreviewGeometry: Preview geometry by ungrouping everything, showing light surfaces and dark edges.
sc = ClusterInput()
geo = ClusterInput()
geo_2 = Geometry(flatten(geo))
sc_2 = Number(sc)
expression = Expression(x=sc_2, Expression="x+1")
swatch = ColourSwatch(SwatchColor=RGB(0, 0, 0))
swatch_2 = ColourSwatch(SwatchColor=RGB(255, 255, 255))
ungroup = Ungroup(Group=geo_2)
ungroup_2 = Ungroup(Group=ungroup)
ungroup_3 = Ungroup(Group=ungroup_2)
ungroup_4 = Ungroup(Group=ungroup_3)
log = Logarithm(Value=expression)
clean = CleanTree(RemoveNulls=True, RemoveInvalid=True, RemoveEmpty=invert(False), Tree=ungroup_4)  # -> flatten(Tree)
multiplication = Multiplication(A=log, B=Slider(0.05, range=0..1))
linetype = ModelLinetype(Name="semio", Width=multiplication)  # -> ModelLinetype, Name, Segments, CapStyle, JoinStyle, Width, WidthUnits, TaperWidths, TaperPositions
dispatch = CSharpScript(D=clean)  # -> P, C, B, M, R
# ---------- dispatch: C# ----------
// Grasshopper Script Instance
#region Usings
using System;
using System.Linq;
using System.Collections;
using System.Collections.Generic;
using System.Drawing;

using Rhino;
using Rhino.Geometry;

using Grasshopper;
using Grasshopper.Kernel;
using Grasshopper.Kernel.Data;
using Grasshopper.Kernel.Types;
#endregion

public class Script_Instance : GH_ScriptInstance
{
    #region Notes
    /* 
      Members:
        RhinoDoc RhinoDocument
        GH_Document GrasshopperDocument
        IGH_Component Component
        int Iteration

      Methods (Virtual & overridable):
        Print(string text)
        Print(string format, params object[] args)
        Reflect(object obj)
        Reflect(object obj, string method_name)
    */
    #endregion

    private void RunScript(
	object D,
	ref object P,
	ref object C,
	ref object B,
	ref object M,
	ref object R)
    {
        if (D is Curve) C = D; // Curve
        else if (
            D is Rhino.Geometry.Point ||
            D is PointCloud
            )
            P = D; // Point
        else if ( D is Mesh) M = D; // Mesh
        else if (
            D is Surface ||
            D is Extrusion ||
            D is SubD ||
            D is Brep
            )
            B = D; // Brep
        else R = D; // Rest
            
    }
}
# ---------- end dispatch ----------
clean_2 = CleanTree(RemoveNulls=True, RemoveInvalid=True, RemoveEmpty=False, Tree=dispatch.M)
clean_3 = CleanTree(RemoveNulls=True, RemoveInvalid=True, RemoveEmpty=False, Tree=dispatch.R)
clean_4 = CleanTree(RemoveNulls=True, RemoveInvalid=True, RemoveEmpty=False, Tree=dispatch.B)
clean_5 = CleanTree(RemoveNulls=True, RemoveInvalid=True, RemoveEmpty=False, Tree=dispatch.P)
clean_6 = CleanTree(RemoveNulls=True, RemoveInvalid=True, RemoveEmpty=False, Tree=dispatch.C)
debrep = DeconstructBrep(Brep=clean_4)  # -> Faces, Edges, Vertices
preview = CustomPreview(Geometry=flatten(clean_5), Material=swatch)
preview_2 = CustomPreview(Geometry=flatten(debrep.Faces), Material=swatch_2)
preview_3 = CustomPreview(Geometry=flatten(clean_2), Material=swatch_2)
preview_4 = CustomPreview(Geometry=flatten(clean_3), Material=swatch)
curve_preview = CustomCurvePreview(Curve=clean_6, Linetype=linetype.ModelLinetype, Colour=swatch)
curve_preview_2 = CustomCurvePreview(Curve=debrep.Edges, Linetype=linetype.ModelLinetype, Colour=swatch)

# ==== cluster NormalizeDesign: Normalize a design for this document. This includes changing the unit to the document unit and rescaling the affected values. Further it reoders pieces, connections and qualities. Connections might be swapped, so that the connected piece id is lexically first. The order of authors is not changed.
dn = ClusterInput()
dn_2 = Design(graft(dn))
dsn = ModelDesign()  # -> Design, Valid, Name, Description, Icon, Image, Variant, View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
dsn_2 = ModelDesign(Design=dn_2)  # -> Design, Valid, Name, Description, Icon, Image, Variant, View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
cnvunt = ConvertUnit(Value=1, FromUnit=dsn_2.Unit, ToUnit=dsn.Unit)
trim = TrimTree(Tree=dsn_2.Pieces, Depth=1)
trim_2 = TrimTree(Tree=dsn_2.Connections, Depth=1)
trim_3 = TrimTree(Tree=dsn_2.Qualities, Depth=1)
con = ModelConnection(Connection=trim_2)  # -> Connection, Valid, ConnectedPieceId, ConnectedPieceTypePortId, ConnectingPieceId, ConnectingPieceTypePortId, Description, Gap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
multiplication = Multiplication(A=con.Gap, B=cnvunt)
multiplication_2 = Multiplication(A=con.Shift, B=cnvunt)
multiplication_3 = Multiplication(A=con.Raise, B=cnvunt)
con_2 = ModelConnection(Connection=con.Connection, Gap=multiplication, Shift=multiplication_2, Raise=multiplication_3)  # -> Connection, Valid, ConnectedPieceId, ConnectedPieceTypePortId, ConnectingPieceId, ConnectingPieceTypePortId, Description, Gap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
merge = Merge(Data1=graft(con_2.ConnectedPieceId), Data2=graft(con_2.ConnectingPieceId))
tsort = SortText(Keys=merge, Culture=127)  # -> Keys, Values
trim_4 = TrimTree(Tree=tsort.Keys, Depth=1)
expression = Expression(x=merge, y=trim_4, Expression="x=y")
item = ListItem(List=expression, Index=0, Wrap=True)
trim_5 = TrimTree(Tree=item, Depth=1)
dispatch = Dispatch(List=con_2.Connection, DispatchPattern=trim_5)  # -> ListA, ListB
con_3 = ModelConnection(Connection=dispatch.ListB)  # -> Connection, Valid, ConnectedPieceId, ConnectedPieceTypePortId, ConnectingPieceId, ConnectingPieceTypePortId, Description, Gap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
txt = Text(dispatch.ListB)
clean = CleanTree(RemoveNulls=True, RemoveInvalid=True, RemoveEmpty=invert(False), Tree=txt)
con_4 = ModelConnection(
    Connection=dispatch.ListB,
    ConnectedPieceId=con_3.ConnectingPieceId,
    ConnectedPieceTypePortId=con_3.ConnectingPieceTypePortId,
    ConnectingPieceId=con_3.ConnectedPieceId,
    ConnectingPieceTypePortId=con_3.ConnectedPieceTypePortId)  # -> Connection, Valid, ConnectedPieceId, ConnectedPieceTypePortId, ConnectingPieceId, ConnectingPieceTypePortId, Description, Gap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
tstat = TreeStatistics(Tree=clean)  # -> Paths, Length, Count
branch = TreeBranch(Tree=con_4.Connection, Path=tstat.Paths, MaintainPaths=True)
merge_2 = Merge(Data1=dispatch.ListA, Data2=branch)
con_5 = ModelConnection(Connection=merge_2)  # -> Connection, Valid, ConnectedPieceId, ConnectedPieceTypePortId, ConnectingPieceId, ConnectingPieceTypePortId, Description, Gap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
pce = ModelPiece(Piece=trim)  # -> Piece, Valid, Id, Description, TypeName, TypeVariant, Plane, Center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
qal = ModelQuality(Quality=trim_3)  # -> Quality, Valid, Name, Value, Unit, Definition
concat = Concatenate(FragmentA=con_5.ConnectedPieceId, FragmentC="##", FragmentB=con_5.ConnectingPieceId)
tsort_2 = SortText(Keys=pce.Id, Values=pce.Piece, Culture=127)  # -> Keys, Values
tsort_3 = SortText(Keys=qal.Name, Values=qal.Quality, Culture=127)  # -> Keys, Values
tsort_4 = SortText(Keys=concat, Values=con_5.Connection, Culture=127)  # -> Keys, Values
trim_6 = TrimTree(Tree=tsort_2.Values, Depth=1)
trim_7 = TrimTree(Tree=tsort_4.Values, Depth=1)
trim_8 = TrimTree(Tree=tsort_3.Values, Depth=1)
dsn_3 = ModelDesign(Design=dsn_2.Design, Unit=dsn.Unit, Pieces=trim_6, Connections=trim_7, Qualities=trim_8)  # -> Design, Valid, Name, Description, Icon, Image, Variant, View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
trim_9 = TrimTree(Tree=dsn_3.Design, Depth=1)
dn_3 = Design(trim_9)
dn_4 = ClusterOutput(dn_3)

# ==== cluster SumQualities: Sum up the qualities of a type for each piece with this type in a design.
dn = ClusterInput()
ty = ClusterInput()
na = ClusterInput()
dn_2 = Design(dn)
ty_2 = Type(ty)
na_2 = Name(na)
dsn = ModelDesign(Design=dn_2)  # -> Design, Valid, Name, Description, Icon, Image, Variant, View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
typ = ModelType(Type=ty_2)  # -> Type, Valid, Name, Description, Icon, Image, Variant, Stock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
qal = ModelQuality(Quality=typ.Qualities)  # -> Quality, Valid, Name, Value, Unit, Definition
trim = TrimTree(Tree=dsn.Pieces, Depth=1)
pce = ModelPiece(Piece=trim)  # -> Piece, Valid, Id, Description, TypeName, TypeVariant, Plane, Center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
expression = Expression(x=graft(pce.TypeName), y=typ.Name, Expression="x=y")
expression_2 = Expression(x=graft(pce.TypeVariant), y=typ.Variant, Expression="x=y")
expression_3 = Expression(x=na_2, y=qal.Name, Expression="x=y")
and = GateAnd(A=expression, B=expression_2)
cull = CullPattern(List=typ.Qualities, CullPattern=expression_3)
cull_2 = CullPattern(List=ty_2, CullPattern=and)
qal_2 = ModelQuality(Quality=cull)  # -> Quality, Valid, Name, flatten(Value), Unit, Definition
lng = ListLength(List=ty_2)
txt = Text(cull_2)
txt_2 = Text(ty_2)
series = Series(Start=0, Step=1, Count=lng)
expression_4 = Expression(x=txt, y=txt_2, Expression="x=y")
trim_2 = TrimTree(Tree=series, Depth=1)
cull_3 = CullPattern(List=trim_2, CullPattern=expression_4)
trim_3 = TrimTree(Tree=cull_3, Depth=1)
item = ListItem(List=qal_2.Value, Index=trim_3, Wrap=True)
clean = CleanTree(RemoveNulls=True, RemoveInvalid=True, RemoveEmpty=False, Tree=item)
ma = MassAddition(Input=clean)  # -> Result, PartialResults
num = Number(ma.Result)
ql = Quality(qal_2.Quality)
num_2 = ClusterOutput(num)
ql_2 = ClusterOutput(ql)

# ==== cluster SelectRoot: Select a root piece. A piece is a root when it has a plane (and a center).
pc = ClusterInput()
pc_2 = Piece(pc)
lng = ListLength(List=pc_2)
pce = ModelPiece(Piece=pc_2)  # -> Piece, Valid, Id, Description, TypeName, TypeVariant, Plane, Center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
series = Series(Start=0, Step=1, Count=lng)
trim = TrimTree(Tree=series, Depth=1)
null = NullItem(Item=pce.Plane)  # -> NullFlags, InvalidFlags, Description
dispatch = Dispatch(List=pc_2, DispatchPattern=null.NullFlags)  # -> ListA, ListB
dispatch_2 = Dispatch(List=trim, DispatchPattern=null.NullFlags)  # -> ListA, ListB
ro = Piece(dispatch.ListB)
i = Integer(dispatch_2.ListB)
ro_2 = ClusterOutput(ro)
i_2 = ClusterOutput(i)

# ==== cluster SelectPort: Select a port with the id. If no port matches, null is returned.
po = ClusterInput()
id = ClusterInput()
id_2 = Id(graft(id))
po_2 = Port(po)
lng = ListLength(List=po_2)
por = ModelPort(Port=po_2)  # -> Port, Valid, Id, Description, Mandatory, Family, CompatibleFamilies, Point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
series = Series(Start=0, Step=1, Count=lng)
expression = Expression(x=por.Id, y=id_2, Expression="x=y")
trim = TrimTree(Tree=series, Depth=1)
cull = CullPattern(List=po_2, CullPattern=expression)
cull_2 = CullPattern(List=trim, CullPattern=expression)
nulltobranch = AddNullToEmptyBranch(D=cull_2)  # -> R; inputs D: tree
# ---------- nulltobranch: C# ----------
#region Usings
using System;
using System.Linq;
using System.Collections;
using System.Collections.Generic;
using System.Drawing;

using Rhino;
using Rhino.Geometry;

using Grasshopper;
using Grasshopper.Kernel;
using Grasshopper.Kernel.Data;
using Grasshopper.Kernel.Types;
#endregion

public class Script_Instance : GH_ScriptInstance
{

    private void RunScript(DataTree<object> D, ref object R)
    {
        foreach (GH_Path path in D.Paths)
            if (D.Branch(path).Count == 0)
                D.Add(null, path);

        R = D;
    }
}
# ---------- end nulltobranch ----------
nulltobranch_2 = AddNullToEmptyBranch(D=cull)  # -> R; inputs D: tree; same code as nulltobranch
trim_2 = TrimTree(Tree=nulltobranch, Depth=1)
trim_3 = TrimTree(Tree=nulltobranch_2, Depth=1)
i = Integer(trim_2)
po_3 = Port(trim_3)
i_2 = ClusterOutput(i)
po_4 = ClusterOutput(po_3)

# ==== cluster SelectConnection: Select a connection with the connected id and the connecting id. The connections are symetric, so if the conected is the connecting and vice versa it will still selct them.
co = ClusterInput()
cdpc = ClusterInput()
cgpc = ClusterInput()
cdpc_2 = ConnectedPieceId(graft(cdpc))
cgpc_2 = ConnectingPieceId(graft(cgpc))
co_2 = Connection(co)
con = ModelConnection(Connection=co_2)  # -> Connection, Valid, ConnectedPieceId, ConnectedPieceTypePortId, ConnectingPieceId, ConnectingPieceTypePortId, Description, Gap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
expression = Expression(x=con.ConnectedPieceId, y=cdpc_2, Expression="x=y")
expression_2 = Expression(x=con.ConnectedPieceId, y=cgpc_2, Expression="x=y")
expression_3 = Expression(x=con.ConnectingPieceId, y=cgpc_2, Expression="x=y")
expression_4 = Expression(x=con.ConnectingPieceId, y=cdpc_2, Expression="x=y")
lng = ListLength(List=co_2)
series = Series(Start=0, Step=1, Count=lng)
and = GateAnd(A=expression, B=expression_3)
and_2 = GateAnd(A=expression_2, B=expression_4)
trim = TrimTree(Tree=series, Depth=1)
or = GateOr(A=and, B=and_2)
not = GateNot(A=and)
cull = CullPattern(List=con.Connection, CullPattern=or)
and_3 = GateAnd(A=not, B=and_2)
cull_2 = CullPattern(List=trim, CullPattern=or)
nulltobranch = AddNullToEmptyBranch(D=cull)  # -> R; inputs D: tree; same code as nulltobranch
nulltobranch_2 = AddNullToEmptyBranch(D=cull_2)  # -> R; inputs D: tree; same code as nulltobranch
ma = MassAddition(Input=and_3)  # -> Result, PartialResults
trim_2 = TrimTree(Tree=nulltobranch, Depth=1)
trim_3 = TrimTree(Tree=nulltobranch_2, Depth=1)
trim_4 = TrimTree(Tree=ma.Result, Depth=1)
co_3 = Connection(trim_2)
fl = Boolean(trim_4)
i = Integer(trim_3)
co_4 = ClusterOutput(co_3)
fl_2 = ClusterOutput(fl)
i_2 = ClusterOutput(i)

# ==== cluster PreviewPort: Preview a port by showing the point and direction and if exists: id, family and compatible families.
po = ClusterInput()
sc = ClusterInput()
sc_2 = Number(sc)
po_2 = Port(po)
por = ModelPort(Port=po_2)  # -> Port, Valid, Id, Description, Mandatory, Family, CompatibleFamilies, Point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
swatch = ColourSwatch(SwatchColor=RGB(235, 52, 79))
swatch_2 = ColourSwatch(SwatchColor=RGB(250, 149, 0))
amp = Amplitude(Vector=por.Direction, Amplitude=sc_2)
lng = ListLength(List=por.CompatibleFamilies)
expression = Expression(x=por.Family, Expression="x=\"\"")
cull = CullPattern(List=por.Point, CullPattern=expression)
expression_2 = Expression(x=lng, Expression="x=0")
join = TextJoin(Text=por.CompatibleFamilies, Join=",")
merge = Merge(Data1=":")
trim = TrimTree(Tree=join, Depth=1)
trim_2 = TrimTree(Tree=expression_2, Depth=1)
item = ListItem(List=merge, Index=expression, Wrap=invert(True))
log = Logarithm(Value=sc_2)
concat = Concatenate(FragmentA="[", FragmentB=trim, FragmentC="]")
expression_3 = Expression(y=trim_2, Expression="x")
merge_2 = Merge(Data1=graft(concat), Data2=graft(expression_3))
item_2 = ListItem(List=merge_2, Index=graft(expression), Wrap=invert(True))
multiplication = Multiplication(A=log, B=Slider(2, range=0..10))
trim_3 = TrimTree(Tree=item_2, Depth=1)
concat_2 = Concatenate(FragmentA=por.Id, FragmentB=item, FragmentC=por.Family, FragmentD=trim_3)
preview = CustomPreview(Geometry=cull, Material=swatch)
tag = TextTag(Location=por.Point, Text=concat_2, Colour=swatch)
vdisex = VectorDisplayEx(Point=por.Point, Vector=amp, Colour=ColourSwatch(SwatchColor=RGB(0, 166, 157)), Width=multiplication)

# ==== cluster SelectPiece: Select a piece with the id.
pc = ClusterInput()
id = ClusterInput()
id_2 = Id(graft(id))
pc_2 = Piece(pc)
lng = ListLength(List=pc_2)
pce = ModelPiece(Piece=pc_2)  # -> Piece, Valid, Id, Description, TypeName, TypeVariant, Plane, Center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
series = Series(Start=0, Step=1, Count=lng)
trim = TrimTree(Tree=series, Depth=1)
expression = Expression(x=pce.Id, y=id_2, Expression="x=y")
cull = CullPattern(List=pce.Piece, CullPattern=expression)
cull_2 = CullPattern(List=trim, CullPattern=expression)
trim_2 = TrimTree(Tree=cull_2, Depth=1)
trim_3 = TrimTree(Tree=cull, Depth=1)
pc_3 = Piece(trim_3)
i = Integer(trim_2)
pc_4 = ClusterOutput(pc_3)
i_2 = ClusterOutput(i)

# ==== cluster SelectTypeByPiece: Select the type of a piece.
ty = ClusterInput()
pc = ClusterInput()
pc_2 = Piece(graft(pc))
ty_2 = Type(ty)
pce = ModelPiece(Piece=pc_2)  # -> Piece, Valid, Id, Description, TypeName, TypeVariant, Plane, Center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
typ = SelectType(ty=ty_2, na=pce.TypeName, variant=pce.TypeVariant)  # -> ty_4, i_2
trim = TrimTree(Tree=typ.ty_4, Depth=1)
trim_2 = TrimTree(Tree=typ.i_2, Depth=1)
ty_3 = Type(trim)
i = Integer(trim_2)
ty_4 = ClusterOutput(ty_3)
i_2 = ClusterOutput(i)

# ==== cluster JaccardIndex: Compute the Jaccard Index of two sets.
set1 = ClusterInput()
set2 = ClusterInput()
set1_2 = Data(set1)
set2_2 = Data(set2)
cset = CreateSet(List=set2_2)  # -> Set, Map
cset_2 = CreateSet(List=set1_2)  # -> Set, Map
lng = ListLength(List=set1_2)
lng_2 = ListLength(List=set2_2)
intersection = SetIntersection(SetA=cset_2.Set, SetB=cset.Set)
expression = Expression(x=lng, Expression="x=0")
expression_2 = Expression(x=lng_2, Expression="x=0")
sunion = SetUnion(SetA=cset_2.Set, SetB=cset.Set)
null = NullItem(Item=lng)  # -> NullFlags, InvalidFlags, Description
null_2 = NullItem(Item=lng_2)  # -> NullFlags, InvalidFlags, Description
lng_3 = ListLength(List=sunion)
lng_4 = ListLength(List=intersection)
or = GateOr(A=null.NullFlags, B=expression)
or_2 = GateOr(A=null_2.NullFlags, B=expression_2)
division = Division(A=lng_4, B=lng_3)
int = Integer(or)
int_2 = Integer(or_2)
concat = Concatenate(FragmentA=int, FragmentB=int_2)
b2d = BinaryToDecimal(Binary=concat)  # -> Decimal
# ---------- b2d: Python ----------
if ghenv.Component.RunCount<2:
    __author__ = "Ueli Saluz"
    __version__ = "2021.11.14"
    
    ghenv.Component.Name = "BinaryToDecimal"
    ghenv.Component.NickName = "B2D"
    ghenv.Component.Description = "Converts a number in binary representation to a number in decimal representation."
    ghenv.Component.Message = "VER 1.0"
    
    ghenv.Component.Params.Input[0].NickName = "Binary"
    
    ghenv.Component.Params.Input[0].Description = "Binary representation of a number."
    
    ghenv.Component.Params.Output[0].NickName = "Decimal"
    
    ghenv.Component.Params.Output[0].Description = "Converted decimal representation of the same number."

if __name__ == "__main__":
    Decimal = int(Binary,2)
# ---------- end b2d ----------
expression_3 = Expression(c=b2d, x=division, Expression="If(c=0,x,If(c=3,1,0))")
N = Number(expression_3)
N_2 = ClusterOutput(N)

# ==== cluster SelectType: Select a type with a name and an optional variant. If no variant is provided it will select all variants. If you want to select the default type then use the empty text.
ty = ClusterInput()
na = ClusterInput()
variant = ClusterInput()
na_2 = Name(na)
variant_2 = Variant(variant)
ty_2 = Type(ty)
typ = ModelType(Type=ty_2)  # -> Type, Valid, Name, Description, Icon, Image, Variant, Stock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
expression = Expression(x=typ.Name, y=na_2, Expression="x=y")
cull = CullPattern(List=typ.Type, CullPattern=expression)
typ_2 = ModelType(Type=cull)  # -> Type, Valid, Name, Description, Icon, Image, Variant, Stock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
expression_2 = Expression(x=typ_2.Variant, y=variant_2, Expression="x=y")
txt = Text(ty_2)
cull_2 = CullPattern(List=typ_2.Type, CullPattern=expression_2)
null = NullItem(Item=variant_2)  # -> NullFlags, InvalidFlags, Description
filter = StreamFilter(Gate=null.NullFlags, Stream0=cull_2, Stream1=cull)
txt_2 = Text(filter)
mindex = MemberIndex(Set=txt, Member=txt_2)  # -> Index, Count
trim = TrimTree(Tree=mindex.Index, Depth=1)
ty_3 = Type(filter)
i = Integer(trim)
ty_4 = ClusterOutput(ty_3)
i_2 = ClusterOutput(i)
