# Grasshopper definition nakagin-capsule-tower.gh (Grasshopper 1.0.8)
# Copyright: GNU Lesser General Public License Version 3
# plug-ins: RhinoCodePluginGH, semio

panel = Panel("""_slanted
_twisted
_dancing_axonometry_explosion""")
variant = Slider(0, range=0..3)
save_diagram = BooleanToggle(False)
icon_export = BooleanToggle(False)
panel_2 = Panel("""Slanted
Twisted
Dancing""")
save = BooleanToggle(False)
sep = Separator()  # -> S
# ---------- sep: C# ----------
#region Usings
using System;
using System.Linq;
using System.Collections;
using System.Collections.Generic;
using System.Drawing;
using System.IO;

using Rhino;
using Rhino.Geometry;

using Grasshopper;
using Grasshopper.Kernel;
using Grasshopper.Kernel.Data;
using Grasshopper.Kernel.Types;
#endregion

public class Script_Instance : GH_ScriptInstance
{
    private void RunScript(ref object S)
    {
        S = Path.DirectorySeparatorChar;
    }
}
# ---------- end sep ----------
dir = Directory()  # -> D
# ---------- dir: C# ----------
#region Usings
using System;
using System.Linq;
using System.Collections;
using System.Collections.Generic;
using System.Drawing;
using System.IO;

using Rhino;
using Rhino.Geometry;

using Grasshopper;
using Grasshopper.Kernel;
using Grasshopper.Kernel.Data;
using Grasshopper.Kernel.Types;
#endregion

public class Script_Instance : GH_ScriptInstance
{
    private void RunScript(ref object D)
    {
        D = Path.GetDirectoryName(this.GrasshopperDocument.FilePath);
    }
}
# ---------- end dir ----------
and = GateAnd(A=save, B=save_diagram)
and_2 = GateAnd(A=save, B=icon_export)
loop_slider = PythonScript(SliderToModify=variant, Min="0", Max="3", stepSize="1", Delay=Slider(0, range=0..1), Run=Toggle(False), Reset=Button())  # inputs Run: Boolean, Reset: Boolean
# ---------- loop_slider: Python ----------
import time

def updateSliderInput(inputName,min,max,value,decimalPlace=2):
    for input in ghenv.Component.Params.Input:
        for source in input.Sources:
            if input.Name == str(inputName):
                source.Slider.DecimalPlaces = decimalPlace
                source.Slider.Minimum = min
                source.Slider.Maximum = max
                source.Slider.Value = value
                source.ExpireSolution(True)

def countDecimal(number):
    string= str(number)
    return string[::-1].find('.')

if Run == True:
    if SliderToModify < Max:
        time.sleep(Delay)
        updateSliderInput("SliderToModify",Min,Max,SliderToModify+stepSize,countDecimal(stepSize))
if Reset == True:
    updateSliderInput("SliderToModify",Min,Max,Min)
# ---------- end loop_slider ----------
# ^                                    ^
#    |                                     |
# <-- Constants    Preview -->
# Parameters    External    Local -->
# <-- Meta               |
#      |                       v
#      v
par = ParentDirectory(D=dir)  # -> P; inputs D: String
# ---------- par: C# ----------
#region Usings
using System;
using System.Linq;
using System.Collections;
using System.Collections.Generic;
using System.Drawing;
using System.IO;

using Rhino;
using Rhino.Geometry;

using Grasshopper;
using Grasshopper.Kernel;
using Grasshopper.Kernel.Data;
using Grasshopper.Kernel.Types;
#endregion

public class Script_Instance : GH_ScriptInstance
{
    private void RunScript(string D, ref object P)
    {
        P = new DirectoryInfo(D).Parent;
    }
}
# ---------- end par ----------

load_kit = BooleanToggle(True)
kit = LoadKit(Uri=par, Run=load_kit)  # -> Success, Kit, LocalDirectory
kit_2 = ModelKit(Kit=kit.Kit)  # -> Kit, Valid, Name, Description, Icon, Image, Preview, Version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
trim = TrimTree(Tree=kit_2.Types, Depth=1)

ty = Type([null x45])
item = ListItem(List=panel_2, Index=variant, Wrap=True)
panel_3 = Panel(item)
item_2 = ListItem(List="Explosion Axonometry", Index=variant, Wrap=True)
mime = Mime({".stl": "model/stl", ".obj": "model/obj", ".glb": "model/gltf-binary", ".gltf": "model/gltf+json", ".3dm": "model/vnd.3dm", ".speckle": "model/vnd.speckle+json", ".png": "image/png", ".jpg": "image/jpeg", ".jpeg": "image/jpeg", ".svg": "image/svg+xml", ".pdf": "application/pdf", ".zip": "application/zip", ".json": "application/json", ".csv": "text/csv", ".txt": "text/plain"}, selected=".3dm")
xy = XYPlane(Origin=Point(0, 0, 0))
item_3 = ListItem(List="Explosion Axonometry", Index=0, Wrap=True)  # -> Item, Item1, Item2, Item3
item_4 = ListItem(List=panel_2, Index=0, Wrap=True)  # -> Item, Item1, Item2, Item3
item_5 = ListItem(List=panel, Index=0, Wrap=True)  # -> Item, Item1, Item2, Item3
variant_2 = GetString(item, AtLeast=0, AtMost=1, TreeAccess=False)
view = GetString(item_2, AtLeast=0, AtMost=1, TreeAccess=False)
list = ValueList({"1to500", "1to200"}, selected="1to500")
concat = Concatenate(FragmentC="icons", FragmentB=sep, FragmentA="nakagin-capsule-tower", FragmentF=item_5.Item, FragmentG=".svg")
concat_2 = Concatenate(FragmentC="icons", FragmentB=sep, FragmentA="nakagin-capsule-tower", FragmentF=item_5.Item1, FragmentG=".svg")
concat_3 = Concatenate(FragmentC="icons", FragmentB=sep, FragmentA="nakagin-capsule-tower", FragmentF=item_5.Item2, FragmentG=".svg")
concat_4 = Concatenate(FragmentC="icons", FragmentB=sep, FragmentA="nakagin-capsule-tower", FragmentF=item_5.Item3, FragmentG=".svg")
concat_5 = Concatenate(FragmentC="images", FragmentB=sep, FragmentA="nakagin-capsule-tower", FragmentF=item_5.Item, FragmentG=".png")
concat_6 = Concatenate(FragmentC="images", FragmentB=sep, FragmentA="nakagin-capsule-tower", FragmentF=item_5.Item1, FragmentG=".png")
concat_7 = Concatenate(FragmentC="images", FragmentB=sep, FragmentA="nakagin-capsule-tower", FragmentF=item_5.Item2, FragmentG=".png")
concat_8 = Concatenate(FragmentC="images", FragmentB=sep, FragmentA="nakagin-capsule-tower", FragmentF=item_5.Item3, FragmentG=".png")

genes = GenePool(Decimals=0, Maximum=8, Minimum=0, Value=[8, 8, 8, 8, 8, 8, 8, 8, 8, 8, 8])
genes_2 = GenePool(Decimals=0, Maximum=8, Minimum=0, Value=[6, 0, 0, 6, 0, 3, 6, 6, 0])
genes_3 = GenePool(Decimals=0, Maximum=8, Minimum=0, Value=[6, 6, 6, 6, 6, 6, 6, 7, 7])
genes_4 = GenePool(Decimals=0, Maximum=8, Minimum=0, Value=[6, 0, 0, 0, 6, 6, 0, 6, 0, 6, 3])

itemindex = ItemIndex(L=panel_2, I=variant_2)  # -> i; inputs L: list
# ---------- itemindex: Python ----------
#Component Information
#--------------------------------------------------------------------------------------------
if ghenv.Component.RunCount<2:
    #General
    #--------------------------------------------------------------------------------------------
    __author__ = "Ueli Saluz"
    __version__ = "2022.11.18"
    
    ghenv.Component.Name = "ItemIndex"
    ghenv.Component.NickName = "ItemIndex"
    ghenv.Component.Description = "A better IdemIndex"
    ghenv.Component.Message = "VER 1.0"
    ghenv.Component.Category = "Set"
    ghenv.Component.SubCategory = "List"
    
     #Inputs
    #--------------------------------------------------------------------------------------------
    inputIndex=0
    
    ghenv.Component.Params.Input[inputIndex].Name = "List"
    ghenv.Component.Params.Input[inputIndex].NickName = "L"
    ghenv.Component.Params.Input[inputIndex].Description = "Input1 is..."
    ghenv.Component.Params.Input[inputIndex].Optional = False
    inputIndex+=1
    
    ghenv.Component.Params.Input[inputIndex].Name = "Item"
    ghenv.Component.Params.Input[inputIndex].NickName = "I"
    ghenv.Component.Params.Input[inputIndex].Description = "Input2 is..."
    ghenv.Component.Params.Input[inputIndex].Optional = False
    inputIndex+=1
    
    #Outputs
    #--------------------------------------------------------------------------------------------
    outputIndex=0
    
    ghenv.Component.Params.Output[outputIndex].Name = "Index"
    ghenv.Component.Params.Output[outputIndex].NickName = "i"
    ghenv.Component.Params.Output[outputIndex].Description = "Output1 is..."
    outputIndex+=1

i = L.index(I)
# ---------- end itemindex ----------
zoom = Button()
item_6 = ListItem(List=panel, Index=itemindex, Wrap=True)
panel_4 = Panel("The expolsion axonometry of a futuristic variant of the Nakagin Capsule Tower where two towers are dancing with each other. The capsules are ellipsoids around a round shaft and a blob base.")
panel_5 = Panel("The digital shadow of the former Nakagin Capsule Tower which was a mixed-use residential and office tower designed by architect Kisho Kurokawa and located in Shimbashi, Tokyo, Japan. Completed in 1972, the building was a rare remaining example of Japanese Metabolism, an architectural movement emblematic of Japan's postwar cultural resurgence.")
panel_6 = Panel("A sloped variant of the Nakagin Capsule Tower where the capsules have balconies and the towers are graduated in opposing directions. Each tower has a direction and every floor is stepped in this direction.")

tambour_rotation = Slider(15, range=-360..360)
tambour_tilt = Slider(-2, range=-360..360)
tambour_gap = Slider(7.5, range=-10..10)
tambour_shift = Slider(-0.5, range=-10..10)
capsule_rotation = Slider(3, range=-360..360)
capsule_tilt = Slider(2, range=-360..360)
capsule_gap = Slider(2.5, range=-10..10)
capsule_shift = Slider(0.5, range=-10..10)
shaft_tilt = Slider(5, range=-360..360)
shaft_gap = Slider(5, range=-10..10)
shaft_shift = Slider(5, range=-10..10)
capital_rotation = Slider(0, range=-360..360)
capital_tilt = Slider(0, range=-360..360)
capital_gap = Slider(5, range=-10..10)
# Outputs   ->
#                 |
#                 v
capital_shift = Slider(0, range=-10..10)
shaft_rotation = Slider(10, range=-360..360)

energy_global_warming_potential_kgco2e_k = ValueList({"Natural Gas": 0.201, "Heating Oil": 0.216, "Electricity Non-Renewable": 0.5, "Electricity Renewable": 0}, selected="Natural Gas")  # "Energy Global Warming Potential [kgCO2e/kWh]"
energy_global_warming_potential_kgco2e_k_2 = ValueList({"Natural Gas": 0.201, "Heating Oil": 0.216, "Electricity Non-Renewable": 0.5, "Electricity Renewable": 0}, selected="Electricity Non-Renewable")  # "Energy Global Warming Potential [kgCO2e/kWh]"
energy_price_kwh = ValueList({"Natural Gas": 0.095, "Heating Oil": 0.10, "Electricity Non-Renewable": 0.25, "Electrictiy Renewable": 0.35}, selected="Natural Gas")
energy_price_kwh_2 = ValueList({"Natural Gas": 0.095, "Heating Oil": 0.10, "Electricity Non-Renewable": 0.25, "Electrictiy Renewable": 0.35}, selected="Electricity Non-Renewable")

panel_7 = Panel("A twisted variant of the Nakagin Capsule Tower where the capsules are trapezoids and towers are round with the floors twisting in one direction.")

tambour_tilt_2 = Slider(0, range=-360..360)
tambour_gap_2 = Slider(0, range=-10..10)
tambour_shift_2 = Slider(0, range=-10..10)
capsule_rotation_2 = Slider(0, range=-360..360)
tambour_rotation_2 = Slider(0, range=-360..360)
capsule_tilt_2 = Slider(0, range=-360..360)
capsule_gap_2 = Slider(0, range=-10..10)
capsule_shift_2 = Slider(0, range=-10..10)
capital_rotation_2 = Slider(0, range=-360..360)
capital_tilt_2 = Slider(0, range=-360..360)
capital_gap_2 = Slider(0, range=-10..10)
capital_shift_2 = Slider(0, range=-10..10)
shaft_rotation_2 = Slider(0, range=-360..360)
shaft_tilt_2 = Slider(0, range=-360..360)
shaft_gap_2 = Slider(0, range=-10..10)
shaft_shift_2 = Slider(0, range=-10..10)
number_slider = Slider(0.6, range=0.6..1.4)

shaft_rotation_3 = Slider(-3, range=-360..360)
tambour_rotation_3 = Slider(3, range=-360..360)
shaft_shift_3 = Slider(-1, range=-10..10)

tambour_shift_3 = Slider(0.5, range=-10..10)

list_2 = ValueList({"Box": 0, "Balcony": 1, "Ellipsoid": 2, "Trapezoid": 3}, selected="Ellipsoid")

genes_5 = GenePool(Decimals=0, Maximum=8, Minimum=0, Value=[7, 7, 7, 7, 7, 7, 7, 7, 7, 7, 7])

list_3 = ValueList({"Box": 0, "Balcony": 1, "Ellipsoid": 2, "Trapezoid": 3}, selected="Trapezoid")

list_4 = ValueList({"Box": 0, "Balcony": 1, "Ellipsoid": 2, "Trapezoid": 3}, selected="Box")
list_5 = ValueList({"Box": 0, "Balcony": 1, "Ellipsoid": 2, "Trapezoid": 3}, selected="Balcony")
heating_energy_price_cent_kwh = Number(energy_price_kwh)
heating_global_warming_potential_kgco2e = Number(energy_global_warming_potential_kgco2e_k)  # "Heating Global Warming Potential [kgCO2e/kWh]"
electrictiy_global_warming_potential_kgc = Number(energy_global_warming_potential_kgco2e_k_2)  # "Electrictiy Global Warming Potential [kgCO2e/kWh]"
heating_efficiency_factor = Number(Slider(0.9, range=0.5..4))
cooling_energy_price_cent_kwh = Number(energy_price_kwh_2)
cooling_efficiency_factor = Number(Slider(0.9, range=0.5..4))
cooling_global_warming_potential_kgco2e = Number(energy_global_warming_potential_kgco2e_k_2)  # "Cooling Global Warming Potential [kgCO2e/kWh]"
electrictiy_energy_price_cent_kwh = Number(energy_price_kwh_2)
base_with_twin_capsule_towers_with_capit = BaseWithTwinCapsuleTowersWithCapital(
    ty=ty,
    name="Nakagin Capsule Tower",
    description=panel_7,
    icon=concat_3,
    image=concat_7,
    variant=item_4.Item2,
    view=item_3.Item2,
    capsule_type=list_3,
    capsule_corner_ne=genes_2,
    capsule_corner_se=genes_3,
    capsule_corner_sw=genes,
    capsule_corner_nw=genes_4,
    shaft_rotation=shaft_rotation_3,
    shaft_tilt=shaft_tilt_2,
    shaft_gap=shaft_gap_2,
    shaft_shift=shaft_shift_3,
    tambour_rotation=tambour_rotation_3,
    tambour_tilt=tambour_tilt_2,
    tambour_gap=tambour_gap_2,
    tambour_shift=tambour_shift_2,
    capsule_rotation=capsule_rotation_2,
    capsule_tilt=capsule_tilt_2,
    capsule_gap=capsule_gap_2,
    capsule_shift=capsule_shift_2,
    capital_rotation=capital_rotation_2,
    capital_tilt=capital_tilt_2,
    capital_gap=capital_gap_2,
    capital_shift=capital_shift_2,
    diagram_force=number_slider,
    heating_energy_price_kwh=heating_energy_price_cent_kwh,
    heating_efficiency_factor=heating_efficiency_factor,
    heating_global_warming_potential_kgco2e=heating_global_warming_potential_kgco2e,
    cooling_energy_price_kwh=cooling_energy_price_cent_kwh,
    cooling_efficiency_factor=cooling_efficiency_factor,
    cooling_global_warming_potential_kgco2e=cooling_global_warming_potential_kgco2e,
    electrictiy_energy_price_cent_kwh=electrictiy_energy_price_cent_kwh,
    electrictiy_global_warming_potential_kgc=electrictiy_global_warming_potential_kgc)  # -> dn, effective_floor_area_m²_2, specific_operational_global_warming_pote_2, construction_cost_mio_2, return_a_2, construction_global_warming_potential_tc_2, operational_cost_mio_a_2, operational_global_warming_potential_tco_2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; "Base with Twin Capsule Towers with Capital"
base_with_twin_capsule_towers_with_capit_2 = BaseWithTwinCapsuleTowersWithCapital(
    ty=ty,
    name="Nakagin Capsule Tower",
    description=panel_5,
    icon=concat,
    image=concat_5,
    variant=item_4.Item,
    view=item_3.Item,
    capsule_type=list_4,
    capsule_corner_ne=genes_2,
    capsule_corner_se=genes_3,
    capsule_corner_sw=genes,
    capsule_corner_nw=genes_4,
    shaft_rotation=shaft_rotation_2,
    shaft_tilt=shaft_tilt_2,
    shaft_gap=shaft_gap_2,
    shaft_shift=shaft_shift_2,
    tambour_rotation=tambour_rotation_2,
    tambour_tilt=tambour_tilt_2,
    tambour_gap=tambour_gap_2,
    tambour_shift=tambour_shift_2,
    capsule_rotation=capsule_rotation_2,
    capsule_tilt=capsule_tilt_2,
    capsule_gap=capsule_gap_2,
    capsule_shift=capsule_shift_2,
    capital_rotation=capital_rotation_2,
    capital_tilt=capital_tilt_2,
    capital_gap=capital_gap_2,
    capital_shift=capital_shift_2,
    diagram_force=number_slider,
    heating_energy_price_kwh=heating_energy_price_cent_kwh,
    heating_efficiency_factor=heating_efficiency_factor,
    heating_global_warming_potential_kgco2e=heating_global_warming_potential_kgco2e,
    cooling_energy_price_kwh=cooling_energy_price_cent_kwh,
    cooling_efficiency_factor=cooling_efficiency_factor,
    cooling_global_warming_potential_kgco2e=cooling_global_warming_potential_kgco2e,
    electrictiy_energy_price_cent_kwh=electrictiy_energy_price_cent_kwh,
    electrictiy_global_warming_potential_kgc=electrictiy_global_warming_potential_kgc)  # -> dn, effective_floor_area_m²_2, specific_operational_global_warming_pote_2, construction_cost_mio_2, return_a_2, construction_global_warming_potential_tc_2, operational_cost_mio_a_2, operational_global_warming_potential_tco_2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; "Base with Twin Capsule Towers with Capital"
base_with_twin_capsule_towers_with_capit_3 = BaseWithTwinCapsuleTowersWithCapital(
    ty=ty,
    name="Nakagin Capsule Tower",
    description=panel_4,
    icon=concat_4,
    image=concat_8,
    variant=item_4.Item3,
    view=item_3.Item3,
    capsule_type=list_2,
    capsule_corner_ne=genes_2,
    capsule_corner_se=genes_3,
    capsule_corner_sw=genes,
    capsule_corner_nw=genes_4,
    shaft_rotation=shaft_rotation,
    shaft_tilt=shaft_tilt,
    shaft_gap=shaft_gap,
    shaft_shift=shaft_shift,
    tambour_rotation=tambour_rotation,
    tambour_tilt=tambour_tilt,
    tambour_gap=tambour_gap,
    tambour_shift=tambour_shift,
    capsule_rotation=capsule_rotation,
    capsule_tilt=capsule_tilt,
    capsule_gap=capsule_gap,
    capsule_shift=capsule_shift,
    capital_rotation=capital_rotation,
    capital_tilt=capital_tilt,
    capital_gap=capital_gap,
    capital_shift=capital_shift,
    diagram_force=number_slider,
    heating_energy_price_kwh=heating_energy_price_cent_kwh,
    heating_efficiency_factor=heating_efficiency_factor,
    heating_global_warming_potential_kgco2e=heating_global_warming_potential_kgco2e,
    cooling_energy_price_kwh=cooling_efficiency_factor,
    cooling_efficiency_factor=cooling_efficiency_factor,
    cooling_global_warming_potential_kgco2e=cooling_global_warming_potential_kgco2e,
    electrictiy_energy_price_cent_kwh=electrictiy_energy_price_cent_kwh,
    electrictiy_global_warming_potential_kgc=electrictiy_global_warming_potential_kgc)  # -> dn, effective_floor_area_m²_2, specific_operational_global_warming_pote_2, construction_cost_mio_2, return_a_2, construction_global_warming_potential_tc_2, operational_cost_mio_a_2, operational_global_warming_potential_tco_2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; "Base with Twin Capsule Towers with Capital"
base_with_twin_capsule_towers_with_capit_4 = BaseWithTwinCapsuleTowersWithCapital(
    ty=ty,
    name="Nakagin Capsule Tower",
    description=panel_6,
    icon=concat_2,
    image=concat_6,
    variant=item_4.Item1,
    view=item_3.Item1,
    capsule_type=list_5,
    capsule_corner_ne=genes_2,
    capsule_corner_se=genes_3,
    capsule_corner_sw=genes_5,
    capsule_corner_nw=genes_4,
    shaft_rotation=shaft_rotation_2,
    shaft_tilt=shaft_tilt_2,
    shaft_gap=shaft_gap_2,
    shaft_shift=shaft_shift_2,
    tambour_rotation=tambour_rotation_2,
    tambour_tilt=tambour_tilt_2,
    tambour_gap=tambour_gap_2,
    tambour_shift=tambour_shift_3,
    capsule_rotation=capsule_rotation_2,
    capsule_tilt=capsule_tilt_2,
    capsule_gap=Slider(0.15, range=0..1),
    capsule_shift=Slider(0.2, range=-1..1),
    capital_rotation=capital_rotation_2,
    capital_tilt=capital_tilt_2,
    capital_gap=capital_gap_2,
    capital_shift=capital_shift_2,
    diagram_force=number_slider,
    heating_energy_price_kwh=heating_energy_price_cent_kwh,
    heating_efficiency_factor=heating_efficiency_factor,
    heating_global_warming_potential_kgco2e=heating_global_warming_potential_kgco2e,
    cooling_energy_price_kwh=cooling_energy_price_cent_kwh,
    cooling_efficiency_factor=cooling_efficiency_factor,
    cooling_global_warming_potential_kgco2e=cooling_global_warming_potential_kgco2e,
    electrictiy_energy_price_cent_kwh=electrictiy_energy_price_cent_kwh,
    electrictiy_global_warming_potential_kgc=electrictiy_global_warming_potential_kgc)  # -> dn, effective_floor_area_m²_2, specific_operational_global_warming_pote_2, construction_cost_mio_2, return_a_2, construction_global_warming_potential_tc_2, operational_cost_mio_a_2, operational_global_warming_potential_tco_2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; "Base with Twin Capsule Towers with Capital"
merge = Merge(
    Data1=base_with_twin_capsule_towers_with_capit_2.dn,
    Data2=base_with_twin_capsule_towers_with_capit_4.dn,
    Data3=base_with_twin_capsule_towers_with_capit.dn,
    Data4=base_with_twin_capsule_towers_with_capit_3.dn)

effective_floor_area_m² = Panel(base_with_twin_capsule_towers_with_capit_2.effective_floor_area_m²_2)
construction_cost_mio = Panel(base_with_twin_capsule_towers_with_capit_2.construction_cost_mio_2)
return_a = Panel(base_with_twin_capsule_towers_with_capit_2.return_a_2)
income_mio_a = Panel(base_with_twin_capsule_towers_with_capit_2.income_mio_a_2)
operational_cost_mio_a = Panel(base_with_twin_capsule_towers_with_capit_2.operational_cost_mio_a_2)
operational_energy_cost_a = Panel(base_with_twin_capsule_towers_with_capit_2.operational_energy_cost_a_2)
maintenance_expenses_mio_a = Panel(base_with_twin_capsule_towers_with_capit_2.maintenance_expenses_mio_a_2)
specific_operational_global_warming_pote = Panel(base_with_twin_capsule_towers_with_capit_2.specific_operational_global_warming_pote_2)  # "Specific Operational Global Warming Potential [kgCO2e/m²a]"
construction_global_warming_potential_tc = Panel(base_with_twin_capsule_towers_with_capit_2.construction_global_warming_potential_tc_2)  # "Construction Global Warming Potential [tCO2e]"
operational_global_warming_potential_tco = Panel(base_with_twin_capsule_towers_with_capit_2.operational_global_warming_potential_tco_2)  # "Operational Global Warming Potential [tCO2e/a]"
heating_energy_demand_mwh_a = Panel(base_with_twin_capsule_towers_with_capit_2.heating_energy_demand_mwh_a_2)
cooling_energy_demand_mwh_a = Panel(base_with_twin_capsule_towers_with_capit_2.cooling_energy_demand_mwh_a_2)
technical_equipment_energy_demand_mwh_a = Panel(base_with_twin_capsule_towers_with_capit_2.technical_equipment_energy_demand_mwh_a_2)
specific_energy_demand_kwh_m²a = Panel(base_with_twin_capsule_towers_with_capit_2.specific_energy_demand_kwh_m²a_2)

effective_floor_area_m²_2 = Panel(base_with_twin_capsule_towers_with_capit_4.effective_floor_area_m²_2)
construction_cost_mio_2 = Panel(base_with_twin_capsule_towers_with_capit_4.construction_cost_mio_2)
return_a_2 = Panel(base_with_twin_capsule_towers_with_capit_4.return_a_2)
income_mio_a_2 = Panel(base_with_twin_capsule_towers_with_capit_4.income_mio_a_2)
operational_cost_mio_a_2 = Panel(base_with_twin_capsule_towers_with_capit_4.operational_cost_mio_a_2)
operational_energy_cost_a_2 = Panel(base_with_twin_capsule_towers_with_capit_4.operational_energy_cost_a_2)
maintenance_expenses_mio_a_2 = Panel(base_with_twin_capsule_towers_with_capit_4.maintenance_expenses_mio_a_2)
operational_global_warming_potential_tco_2 = Panel(base_with_twin_capsule_towers_with_capit_4.operational_global_warming_potential_tco_2)  # "Operational Global Warming Potential [tCO2e/a]"
heating_energy_demand_mwh_a_2 = Panel(base_with_twin_capsule_towers_with_capit_4.heating_energy_demand_mwh_a_2)
cooling_energy_demand_mwh_a_2 = Panel(base_with_twin_capsule_towers_with_capit_4.cooling_energy_demand_mwh_a_2)
technical_equipment_energy_demand_mwh_a_2 = Panel(base_with_twin_capsule_towers_with_capit_4.technical_equipment_energy_demand_mwh_a_2)
specific_operational_global_warming_pote_2 = Panel(base_with_twin_capsule_towers_with_capit_4.specific_operational_global_warming_pote_2)  # "Specific Operational Global Warming Potential [kgCO2e/m²a]"
construction_global_warming_potential_tc_2 = Panel(base_with_twin_capsule_towers_with_capit_4.construction_global_warming_potential_tc_2)  # "Construction Global Warming Potential [tCO2e]"
specific_energy_demand_kwh_m²a_2 = Panel(base_with_twin_capsule_towers_with_capit_4.specific_energy_demand_kwh_m²a_2)

item_7 = ListItem(List=merge, Index=itemindex, Wrap=True)
dn = Design(item_7)
shwdsn = ShowDesign(dn=dn, ty=ty, mm=mime, lod=list, tags="volume")  # -> id_2, ur_2, pa_ur_2, pln_2
concat_9 = Concatenate(FragmentA=par, FragmentB=sep, FragmentC=shwdsn.pa_ur_2)
geo = LoadGeometry(path=flatten(concat_9), pln=flatten(shwdsn.pln_2), run=Toggle(True))  # -> object_4, col_2, shader_2
bbox = BoundingBox(Content=flatten(geo.object_4), Plane=PlaneXY(0, 0, 0), UnionBox=True)  # -> Box, Box_2
zoom2bb = ZoomToBoundingBox(N=["Top", "Front", "Right", "Perspective", "Parallel"], BB=bbox.Box, S=0, R=zoom)  # -> F, SBB; inputs BB: Box, R: Boolean
# ---------- zoom2bb: Python ----------
#Component Information
#--------------------------------------------------------------------------------------------
if ghenv.Component.RunCount<2:
    #General
    #--------------------------------------------------------------------------------------------
    __author__ = "Ueli Saluz"
    __version__ = "2022.05.21"
    
    ghenv.Component.Name = "ZoomToBoundingBox"
    ghenv.Component.NickName = "Zoom2BB"
    ghenv.Component.Description = "Zoom the view of a Rhino viewport to a bounding box."
    ghenv.Component.Message = "VER 1.1"
    ghenv.Component.Category = "Display"
    ghenv.Component.SubCategory = "Camera"
    
     #Inputs
    #--------------------------------------------------------------------------------------------
    inputIndex=0
    
    ghenv.Component.Params.Input[inputIndex].Name = "Name"
    ghenv.Component.Params.Input[inputIndex].NickName = "N"
    ghenv.Component.Params.Input[inputIndex].Description = "Name of the viewport"
    ghenv.Component.Params.Input[inputIndex].Optional = False
    inputIndex+=1
    
    ghenv.Component.Params.Input[inputIndex].Name = "BoundingBox"
    ghenv.Component.Params.Input[inputIndex].NickName = "BB"
    ghenv.Component.Params.Input[inputIndex].Description = ""
    ghenv.Component.Params.Input[inputIndex].Optional = False
    inputIndex+=1
    
    ghenv.Component.Params.Input[inputIndex].Name = "ScaleFactor"
    ghenv.Component.Params.Input[inputIndex].NickName = "S"
    ghenv.Component.Params.Input[inputIndex].Description = "A factor for the extension of the bounding box." \
    +"0 means 0 extension, a positive number makes the bounding box larger a negative smaller. The amount is proportional to the length."
    ghenv.Component.Params.Input[inputIndex].Optional = False
    inputIndex+=1
   
    
    ghenv.Component.Params.Input[inputIndex].Name = "Run"
    ghenv.Component.Params.Input[inputIndex].NickName = "R"
    ghenv.Component.Params.Input[inputIndex].Description = "Zoom to the given bounding box."
    ghenv.Component.Params.Input[inputIndex].Optional = False
    inputIndex+=1
    
    #Outputs
    #--------------------------------------------------------------------------------------------
    outputIndex=0
    
    ghenv.Component.Params.Output[outputIndex].Name = "Finished"
    ghenv.Component.Params.Output[outputIndex].NickName = "F"
    ghenv.Component.Params.Output[outputIndex].Description = "Sends True when finished. Just to trigger other depending components."
    outputIndex+=1
    
    ghenv.Component.Params.Output[outputIndex].Name = "ScaledBoundingBox"
    ghenv.Component.Params.Output[outputIndex].NickName = "SBB"
    ghenv.Component.Params.Output[outputIndex].Description = "The scaled bounding box."
    outputIndex+=1


#Imports
#--------------------------------------------------------------------------------------------
from Rhino import RhinoDoc
from Rhino.Geometry import Box

#Solver - Run with trees to enhance performance drastically
#--------------------------------------------------------------------------------------------
if __name__ == "__main__":
    try:
        vp = RhinoDoc.ActiveDoc.Views.Find(N, False).ActiveViewport
        if R:
            box = BB
            bb = BB.BoundingBox
            bb.Inflate(S*box.X.Length,S*box.Y.Length,S*box.Z.Length)
            vp.ZoomBoundingBox(bb)
            SBB = bb
        F = True
    except:
        pass
# ---------- end zoom2bb ----------
geo_2 = SemioGeometryPreview(geo=flatten(geo.object_4))
dsn = SerializeDesign(Design=dn)
txt = EncodeText(Text=dsn)

# ----
# Evaluate metrics
panel_8 = Panel(".svg")
dgm = DrawDiagram(Design=dn, Types=ty, Uri=par, Run=and)
concat_10 = Concatenate(
    FragmentA=par,
    FragmentB=sep,
    FragmentC="diagrams",
    FragmentD=sep,
    FragmentE="nakagin-capsule-tower",
    FragmentF=item_6,
    FragmentG=panel_8)
write = Write(T=dgm, P=concat_10, R=and)  # -> S; inputs T: String, P: String, R: Boolean
# ---------- write: C# ----------
#region Usings
using System;
using System.Linq;
using System.Collections;
using System.Collections.Generic;
using System.Drawing;
using System.IO;

using Rhino;
using Rhino.Geometry;

using Grasshopper;
using Grasshopper.Kernel;
using Grasshopper.Kernel.Data;
using Grasshopper.Kernel.Types;
#endregion

public class Script_Instance : GH_ScriptInstance
{
    private void RunScript(string T, string P, bool R, ref object S)
    {
        if (R==true){
            File.WriteAllText(P, T);
            S = true;
        }
        S = false;
    }
}
# ---------- end write ----------

context_bake = ContextBake(Content=txt)
dsn_2 = PutDesign(Design=dn, Uri=par, Run=save)

return_a_3 = Panel(base_with_twin_capsule_towers_with_capit_3.return_a_2)
operational_cost_mio_a_3 = Panel(base_with_twin_capsule_towers_with_capit_3.operational_cost_mio_a_2)
effective_floor_area_m²_3 = Panel(base_with_twin_capsule_towers_with_capit_3.effective_floor_area_m²_2)
construction_cost_mio_3 = Panel(base_with_twin_capsule_towers_with_capit_3.construction_cost_mio_2)
income_mio_a_3 = Panel(base_with_twin_capsule_towers_with_capit_3.income_mio_a_2)
operational_energy_cost_a_3 = Panel(base_with_twin_capsule_towers_with_capit_3.operational_energy_cost_a_2)
maintenance_expenses_mio_a_3 = Panel(base_with_twin_capsule_towers_with_capit_3.maintenance_expenses_mio_a_2)
specific_operational_global_warming_pote_3 = Panel(base_with_twin_capsule_towers_with_capit_3.specific_operational_global_warming_pote_2)  # "Specific Operational Global Warming Potential [kgCO2e/m²a]"
construction_global_warming_potential_tc_3 = Panel(base_with_twin_capsule_towers_with_capit_3.construction_global_warming_potential_tc_2)  # "Construction Global Warming Potential [tCO2e]"
operational_global_warming_potential_tco_3 = Panel(base_with_twin_capsule_towers_with_capit_3.operational_global_warming_potential_tco_2)  # "Operational Global Warming Potential [tCO2e/a]"
specific_energy_demand_kwh_m²a_3 = Panel(base_with_twin_capsule_towers_with_capit_3.specific_energy_demand_kwh_m²a_2)
heating_energy_demand_mwh_a_3 = Panel(base_with_twin_capsule_towers_with_capit_3.heating_energy_demand_mwh_a_2)
cooling_energy_demand_mwh_a_3 = Panel(base_with_twin_capsule_towers_with_capit_3.cooling_energy_demand_mwh_a_2)
technical_equipment_energy_demand_mwh_a_3 = Panel(base_with_twin_capsule_towers_with_capit_3.technical_equipment_energy_demand_mwh_a_2)

effective_floor_area_m²_4 = Panel(base_with_twin_capsule_towers_with_capit.effective_floor_area_m²_2)
construction_cost_mio_4 = Panel(base_with_twin_capsule_towers_with_capit.construction_cost_mio_2)
return_a_4 = Panel(base_with_twin_capsule_towers_with_capit.return_a_2)
income_mio_a_4 = Panel(base_with_twin_capsule_towers_with_capit.income_mio_a_2)
operational_cost_mio_a_4 = Panel(base_with_twin_capsule_towers_with_capit.operational_cost_mio_a_2)
operational_energy_cost_a_4 = Panel(base_with_twin_capsule_towers_with_capit.operational_energy_cost_a_2)
maintenance_expenses_mio_a_4 = Panel(base_with_twin_capsule_towers_with_capit.maintenance_expenses_mio_a_2)
specific_operational_global_warming_pote_4 = Panel(base_with_twin_capsule_towers_with_capit.specific_operational_global_warming_pote_2)  # "Specific Operational Global Warming Potential [kgCO2e/m²a]"
construction_global_warming_potential_tc_4 = Panel(base_with_twin_capsule_towers_with_capit.construction_global_warming_potential_tc_2)  # "Construction Global Warming Potential [tCO2e]"
operational_global_warming_potential_tco_4 = Panel(base_with_twin_capsule_towers_with_capit.operational_global_warming_potential_tco_2)  # "Operational Global Warming Potential [tCO2e/a]"
heating_energy_demand_mwh_a_4 = Panel(base_with_twin_capsule_towers_with_capit.heating_energy_demand_mwh_a_2)
cooling_energy_demand_mwh_a_4 = Panel(base_with_twin_capsule_towers_with_capit.cooling_energy_demand_mwh_a_2)
technical_equipment_energy_demand_mwh_a_4 = Panel(base_with_twin_capsule_towers_with_capit.technical_equipment_energy_demand_mwh_a_2)
specific_energy_demand_kwh_m²a_4 = Panel(base_with_twin_capsule_towers_with_capit.specific_energy_demand_kwh_m²a_2)

# ==== cluster BaseWithTwinCapsuleTowersWithCapital

electrictiy_global_warming_potential_kgc = ClusterInput()  # "Electrictiy Global Warming Potential [kgCO2e/kWh]"
heating_energy_price_kwh = ClusterInput()
heating_efficiency_factor = ClusterInput()
cooling_efficiency_factor = ClusterInput()
cooling_global_warming_potential_kgco2e = ClusterInput()  # "Cooling Global Warming Potential [kgCO2e/kWh]"
heating_global_warming_potential_kgco2e = ClusterInput()  # "Heating Global Warming Potential [kgCO2e/kWh]"
cooling_energy_price_kwh = ClusterInput()
electrictiy_energy_price_cent_kwh = ClusterInput()
electrictiy_global_warming_potential_kgc_2 = Number(electrictiy_global_warming_potential_kgc)  # "Electrictiy Global Warming Potential [kgCO2e/kWh]"
heating_energy_price_kwh_2 = Number(heating_energy_price_kwh)
heating_efficiency_factor_2 = Number(heating_efficiency_factor)
heating_global_warming_potential_kgco2e_2 = Number(heating_global_warming_potential_kgco2e)  # "Heating Global Warming Potential [kgCO2e/kWh]"
cooling_efficiency_factor_2 = Number(cooling_efficiency_factor)
cooling_global_warming_potential_kgco2e_2 = Number(cooling_global_warming_potential_kgco2e)  # "Cooling Global Warming Potential [kgCO2e/kWh]"
electrictiy_energy_price_cent_kwh_2 = Number(electrictiy_energy_price_cent_kwh)
cooling_energy_price_kwh_2 = Number(cooling_energy_price_kwh)

diagram_force = ClusterInput()
description = ClusterInput()
icon = ClusterInput()
image = ClusterInput()

capsule_type = ClusterInput()
variant = ClusterInput()
name = ClusterInput()
variant_2 = Text(variant)
name_2 = Text(name)
capsule_type_2 = Integer(capsule_type)

capsule_corner_ne = ClusterInput()
capsule_corner_se = ClusterInput()
capsule_corner_sw = ClusterInput()
capsule_corner_nw = ClusterInput()
capsule_corner_nw_2 = Integer(capsule_corner_nw)
capsule_corner_ne_2 = Integer(capsule_corner_ne)
capsule_corner_se_2 = Integer(capsule_corner_se)
capsule_corner_sw_2 = Integer(capsule_corner_sw)

shaft_rotation = ClusterInput()
shaft_tilt = ClusterInput()
shaft_gap = ClusterInput()
shaft_shift = ClusterInput()
tambour_rotation = ClusterInput()
tambour_tilt = ClusterInput()
tambour_gap = ClusterInput()
tambour_shift = ClusterInput()
capsule_rotation = ClusterInput()
capsule_tilt = ClusterInput()
capsule_gap = ClusterInput()
capsule_shift = ClusterInput()
capital_rotation = ClusterInput()
capital_tilt = ClusterInput()
capital_gap = ClusterInput()
capital_shift = ClusterInput()
shaft_tilt_2 = Number(shaft_tilt)
capsule_rotation_2 = Number(capsule_rotation)
capsule_shift_2 = Number(capsule_shift)
capital_rotation_2 = Number(capital_rotation)
capital_gap_2 = Number(capital_gap)
capital_shift_2 = Number(capital_shift)
shaft_rotation_2 = Number(shaft_rotation)
shaft_gap_2 = Number(shaft_gap)
shaft_shift_2 = Number(shaft_shift)
tambour_rotation_2 = Number(tambour_rotation)
tambour_tilt_2 = Number(tambour_tilt)
tambour_gap_2 = Number(tambour_gap)
tambour_shift_2 = Number(tambour_shift)
capsule_tilt_2 = Number(capsule_tilt)
capsule_gap_2 = Number(capsule_gap)
capital_tilt_2 = Number(capital_tilt)

ty = ClusterInput()
view = ClusterInput()
ty_2 = Type(ty)
description_2 = Description(description)
icon_2 = Icon(icon)
image_2 = Image(image)
view_2 = View(view)
diagram_force_2 = Number(diagram_force)
expression = Expression(x=diagram_force_2, Expression="1+x")
expression_2 = Expression(x=diagram_force_2, Expression="x*2")
expression_3 = Expression(x=diagram_force_2, Expression="x-((1-x)*0.3)")
neg = Negative(Value=expression_2)

lng = ListLength(List=capsule_corner_sw_2)
lng_2 = ListLength(List=capsule_corner_ne_2)
dup = DuplicateData(Data="0", Number=lng_2, Order=True)
dup_2 = DuplicateData(Data="6", Number=lng_2, Order=True)
dup_3 = DuplicateData(Data="0", Number=lng, Order=True)
dup_4 = DuplicateData(Data="6", Number=lng, Order=True)
trim = TrimTree(Tree=dup, Depth=1)
trim_2 = TrimTree(Tree=dup_2, Depth=1)
trim_3 = TrimTree(Tree=dup_3, Depth=1)
trim_4 = TrimTree(Tree=dup_4, Depth=1)

dpt = ModelDiagramPoint()  # -> DiagramPoint, Valid, X, Y
xy = XYPlane(Origin=Point(0, 0, 0))

# ----
# Model the initial design
panel = Panel("Capital")
neg_2 = Negative(Value="-90")
neg_3 = Negative(Value="-9")
addition = Addition(A="-90", B=neg_3)
addition_2 = Addition(A="-90", B=neg_3)
filter = StreamFilter(Gate=capsule_type_2, Stream0="-90", Stream1="-90", Stream2=addition, Stream3="-90")
filter_2 = StreamFilter(Gate=capsule_type_2, Stream0="-90", Stream1="-90", Stream2=addition_2, Stream3="-90")
concat = Concatenate(FragmentA="c", FragmentC="1")
concat_2 = Concatenate(FragmentA="c", FragmentC="0")
neg_4 = Negative(Value=filter_2)
bridge_tilt = Slider(0, range=-360..360)
bridge_gap = Slider(0, range=-10..10)
bridge_rotation = Slider(0, range=-360..360)
bridge_shift = Slider(-0.8, range=-10..10)
aut = ModelAuthor(Name="Ueli Saluz", Email="ueli@semio-tech.org")  # -> Author, Valid, Name, Email
genes = GenePool(Decimals=0, Maximum=10, Minimum=0, Value=[3, 6, 9])

pce = ModelPiece(Id="b", TypeName="Base", Plane=xy, ScreenPoint=dpt.DiagramPoint)  # -> Piece, Valid, Id, TypeName, TypeVariant, Plane, ScreenPoint
addition_3 = Addition(A=neg_2, B=shaft_rotation_2)
addition_4 = Addition(A="-90", B=capital_rotation_2)
addition_5 = Addition(A=neg_4, B=capital_rotation_2)
addition_6 = Addition(A=shaft_rotation_2, B=filter)

concat_3 = Concatenate(FragmentA="b", FragmentB="_", FragmentC=concat_2)
tower = Tower(
    shaftpieceid=concat_3,
    capsulepatternnorthwest=trim_2,
    capsulepatternsoutheast=capsule_corner_ne_2,
    capsulepatternsouthwest=capsule_corner_se_2,
    capsulepatternnortheast=trim,
    capsulerotation=capsule_rotation_2,
    capsuletilt=capsule_tilt_2,
    capsulegap=capsule_gap_2,
    capsuleshift=capsule_shift_2,
    tambourrotation=tambour_rotation_2,
    tambourtilt=tambour_tilt_2,
    tambourgap=tambour_gap_2,
    tambourshift=tambour_shift_2,
    rotation=addition_6,
    diagram_force=diagram_force_2)  # -> pc_2, co_2, tambour_co_2, tambour_pc_2, first_tambour_id_2, last_tambour_id_2, capsule_pc_2, caspule_co_2

concat_4 = Concatenate(FragmentA="b", FragmentB="_", FragmentC=concat)
tower_2 = Tower(
    shaftpieceid=concat_4,
    capsulepatternnorthwest=trim_4,
    capsulepatternsoutheast=capsule_corner_sw_2,
    capsulepatternsouthwest=capsule_corner_nw_2,
    capsulepatternnortheast=trim_3,
    capsulerotation=capsule_rotation_2,
    capsuletilt=capsule_tilt_2,
    capsulegap=capsule_gap_2,
    capsuleshift=capsule_shift_2,
    tambourrotation=tambour_rotation_2,
    tambourtilt=tambour_tilt_2,
    tambourgap=tambour_gap_2,
    tambourshift=tambour_shift_2,
    rotation=addition_3,
    diagram_force=diagram_force_2)  # -> pc_2, co_2, tambour_co_2, tambour_pc_2, first_tambour_id_2, last_tambour_id_2, capsule_pc_2, caspule_co_2

concat_5 = Concatenate(FragmentD="ci", FragmentC="_", FragmentB=tower_2.last_tambour_id_2)
concat_6 = Concatenate(FragmentD="ci", FragmentC="_", FragmentB=tower.last_tambour_id_2)
merge = Merge(Data1=tower.pc_2, Data2=tower_2.pc_2)
merge_2 = Merge(Data1=tower.co_2, Data2=tower_2.co_2)

pce_2 = ModelPiece(Id=concat_5, TypeName=panel)  # -> Piece, Valid, Id, TypeName, TypeVariant, Plane, ScreenPoint
pce_3 = ModelPiece(Id=concat_6, TypeName=panel)  # -> Piece, Valid, Id, TypeName, TypeVariant, Plane, ScreenPoint
con = ModelConnection(
    ConnectedPieceId=pce.Id,
    ConnectedPieceTypePortId=concat_2,
    ConnectingPieceId=tower.first_tambour_id_2,
    ConnectingPieceTypePortId="b",
    Rotation=addition_6,
    Tilt=shaft_tilt_2,
    Gap=shaft_gap_2,
    Shift=shaft_shift_2,
    X=neg,
    Y=expression_2)  # -> Connection, Valid, ConnectedPieceId, ConnectedPieceTypePortId, ConnectingPieceId, ConnectingPieceTypePortId, Rotation, Tilt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
con_2 = ModelConnection(
    ConnectedPieceId=pce.Id,
    ConnectedPieceTypePortId=concat,
    ConnectingPieceId=tower_2.first_tambour_id_2,
    ConnectingPieceTypePortId="b",
    Rotation=addition_3,
    Tilt=shaft_tilt_2,
    Gap=shaft_gap_2,
    Shift=shaft_shift_2,
    X=expression_2,
    Y=expression_2)  # -> Connection, Valid, ConnectedPieceId, ConnectedPieceTypePortId, ConnectingPieceId, ConnectingPieceTypePortId, Rotation, Tilt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
con_3 = ModelConnection(
    ConnectedPieceId=tower.last_tambour_id_2,
    ConnectedPieceTypePortId="t",
    ConnectingPieceId=pce_3.Id,
    Rotation=addition_5,
    Tilt=capital_tilt_2,
    Gap=capital_gap_2,
    Shift=capital_shift_2,
    Y=expression)  # -> Connection, Valid, ConnectedPieceId, ConnectedPieceTypePortId, ConnectingPieceId, ConnectingPieceTypePortId, Rotation, Tilt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
con_4 = ModelConnection(
    ConnectedPieceId=tower_2.last_tambour_id_2,
    ConnectedPieceTypePortId="t",
    ConnectingPieceId=pce_2.Id,
    Rotation=addition_4,
    Tilt=capital_tilt_2,
    Gap=capital_gap_2,
    Shift=capital_shift_2,
    Y=expression)  # -> Connection, Valid, ConnectedPieceId, ConnectedPieceTypePortId, ConnectingPieceId, ConnectingPieceTypePortId, Rotation, Tilt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

merge_3 = Merge(Data1=pce.Piece, Data2=pce_3.Piece, Data3=pce_2.Piece)
merge_4 = Merge(Data1=con.Connection, Data2=con_2.Connection, Data3=con_3.Connection, Data4=con_4.Connection)
merge_5 = Merge(Data1=merge_4, Data2=merge_2)
merge_6 = Merge(Data1=merge_3, Data2=merge)
dsn = ModelDesign(
    Name=name_2,
    Description=description_2,
    Icon=icon_2,
    Image=image_2,
    Variant=variant_2,
    View=view_2,
    Unit="m",
    Pieces=merge_6,
    Connections=merge_5,
    Authors=aut.Author)  # -> Design, Valid, Name, Description, Icon, Image, Variant, View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
addbridges = AddBridges(
    dn=dsn.Design,
    levels=genes,
    bridge_rotation=bridge_rotation,
    bridge_tilt=bridge_tilt,
    bridge_gap=bridge_gap,
    bridge_shift=bridge_shift,
    bridge_x_addition=expression_3)

# ----
# Change the design later
panel_2 = Panel("Base")
vartyp = VaryTypes(dn=addbridges, na=panel_2, new_vn="Blob")
rpltyp = ReplaceType(dn=vartyp, old_na="Capsule", new_na="Ellipsoid Capsule")
rpltyp_2 = ReplaceType(dn=addbridges, old_na="Capsule", new_na="Trapezoid Capsule")
rpltyp_3 = ReplaceType(dn=addbridges, old_na="Capsule", new_na="Capsule with Balcony")
rpltyp_4 = ReplaceType(dn=rpltyp, old_na="Tambour", new_na="Cylindric Tambour")
rpltyp_5 = ReplaceType(dn=rpltyp_2, old_na="Tambour", new_na="Cylindric Tambour")
rpltyp_6 = ReplaceType(dn=rpltyp_4, old_na="Capital", new_na="Cylindric Capital")
rpltyp_7 = ReplaceType(dn=rpltyp_5, old_na="Capital", new_na="Cylindric Capital")
filter_3 = StreamFilter(Gate=capsule_type_2, Stream0=addbridges, Stream1=rpltyp_3, Stream2=rpltyp_6, Stream3=rpltyp_7)

# ----
# Do some calculations based on metadata
perfasm = PerformanceAssessment(
    dn=filter_3,
    ty=ty_2,
    heating_energy_price_cent_kwh=heating_energy_price_kwh_2,
    heating_efficiency_factor=heating_efficiency_factor_2,
    heating_global_warming_potential_kgco2e=heating_global_warming_potential_kgco2e_2,
    cooling_energy_price_cent_kwh=cooling_energy_price_kwh_2,
    cooling_efficiency_factor=cooling_efficiency_factor_2,
    cooling_global_warming_potential_kgco2e=cooling_global_warming_potential_kgco2e_2,
    electrictiy_energy_price_cent_kwh=electrictiy_energy_price_cent_kwh_2,
    electrictiy_global_warming_potential_kgc=electrictiy_global_warming_potential_kgc_2)  # -> dn_4, effective_floor_area_m²_2, specific_operational_global_warming_pote_2, construction_cost_2, return_a_2, construction_global_warming_potential_kg_2, operational_cost_a_2, operational_global_warming_potential_kgc_2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
expression_4 = Expression(x=perfasm.construction_cost_2, Expression="x/1000000")
expression_5 = Expression(x=perfasm.operational_cost_a_2, Expression="x/1000000")
expression_6 = Expression(x=perfasm.maintenance_expenses_a_2, Expression="x/1000000")
expression_7 = Expression(x=perfasm.income_2, Expression="x/1000000")
expression_8 = Expression(x=perfasm.return_a_2, Expression="x/1000000")
expression_9 = Expression(x=perfasm.operational_energy_cost_a_2, Expression="x/1000000")
expression_10 = Expression(x=perfasm.construction_global_warming_potential_kg_2, Expression="x/1000")
expression_11 = Expression(x=perfasm.operational_global_warming_potential_kgc_2, Expression="x/1000")
expression_12 = Expression(x=perfasm.heating_energy_demand_kwh_a_2, Expression="x/1000")
expression_13 = Expression(x=perfasm.cooling_energy_demand_kwh_a_2, Expression="x/1000")
expression_14 = Expression(x=perfasm.technical_equipment_energy_demand_kwh_a_2, Expression="x/1000")
roundmult = RoundToMultiple(N=expression_7, M="0.05")  # -> R; inputs N: tree, M: tree
# ---------- roundmult: Python ----------
#Component Information
#--------------------------------------------------------------------------------------------
if ghenv.Component.RunCount<2:
    #General
    #--------------------------------------------------------------------------------------------
    __author__ = "YOUR NAME"
    __version__ = "2000.00.00"
    
    ghenv.Component.Name = "Round to Multiple"
    ghenv.Component.NickName = "RoundMult"
    ghenv.Component.Description = "Rounds a number to the nearest specified multiple."
    ghenv.Component.Message = "VER 1.0"
    ghenv.Component.Category = "Math"
    ghenv.Component.SubCategory = "Arithmetic"
    
     #Inputs
    #--------------------------------------------------------------------------------------------
    inputIndex=0
    
    ghenv.Component.Params.Input[inputIndex].Name = "Number"
    ghenv.Component.Params.Input[inputIndex].NickName = "N"
    ghenv.Component.Params.Input[inputIndex].Description = "Number to round."
    ghenv.Component.Params.Input[inputIndex].Optional = False
    inputIndex+=1
    
    ghenv.Component.Params.Input[inputIndex].Name = "Multiple"
    ghenv.Component.Params.Input[inputIndex].NickName = "M"
    ghenv.Component.Params.Input[inputIndex].Description = "Multiple to round to."
    ghenv.Component.Params.Input[inputIndex].Optional = False
    inputIndex+=1
    
    #Outputs
    #--------------------------------------------------------------------------------------------
    outputIndex=0
    
    ghenv.Component.Params.Output[outputIndex].Name = "Rounded"
    ghenv.Component.Params.Output[outputIndex].NickName = "R"
    ghenv.Component.Params.Output[outputIndex].Description = "Number rounded to the nearest specified multiple."
    outputIndex+=1


#Imports
#--------------------------------------------------------------------------------------------
from System import Object
from Grasshopper import DataTree
import math


#The Component function - Business logic only (e.g. working without trees)
#--------------------------------------------------------------------------------------------
"""Function that this component is computing.
    Inputs:
        number: The number to round.
        multiple: The multiple to round to.
    Output:
        rounded: The number rounded to the nearest specified multiple."""
def RoundToMultiple(number, multiple):
    rounded = math.ceil(number / multiple) * multiple
    return rounded

#Solver - Run with trees to enhance performance drastically
#--------------------------------------------------------------------------------------------
if __name__ == "__main__":
    
    #Initialize trees
    #--------------------------------------------------------------------------------------------
    RoundedTree = DataTree[Object]()
    
    #Data matching
    #--------------------------------------------------------------------------------------------
    for path in N.Paths:
        numberBranch = N.Branch(path)
        for i, number in enumerate(numberBranch):
            multiple = M.Branch(path)[i]
            rounded = RoundToMultiple(number, multiple)
            RoundedTree.Add(rounded, path)
    
     #Assign trees to output
    #--------------------------------------------------------------------------------------------
    R = RoundedTree
# ---------- end roundmult ----------
roundmult_2 = RoundToMultiple(N=expression_6, M="0.05")  # -> R; inputs N: tree, M: tree; same code as roundmult
roundmult_3 = RoundToMultiple(N=perfasm.specific_energy_demand_kwh_m²a_2, M="2.5")  # -> R; inputs N: tree, M: tree; same code as roundmult
roundmult_4 = RoundToMultiple(N=expression_9, M="0.05")  # -> R; inputs N: tree, M: tree; same code as roundmult
roundmult_5 = RoundToMultiple(N=expression_12, M=1)  # -> R; inputs N: tree, M: tree; same code as roundmult
roundmult_6 = RoundToMultiple(N=expression_13, M=1)  # -> R; inputs N: tree, M: tree; same code as roundmult
roundmult_7 = RoundToMultiple(N=expression_14, M=1)  # -> R; inputs N: tree, M: tree; same code as roundmult
roundmult_8 = RoundToMultiple(N=perfasm.effective_floor_area_m²_2, M="25")  # -> R; inputs N: tree, M: tree; same code as roundmult
roundmult_9 = RoundToMultiple(N=perfasm.specific_operational_global_warming_pote_2, M=1)  # -> R; inputs N: tree, M: tree; same code as roundmult
roundmult_10 = RoundToMultiple(N=expression_4, M="0.05")  # -> R; inputs N: tree, M: tree; same code as roundmult
roundmult_11 = RoundToMultiple(N=expression_8, M="0.05")  # -> R; inputs N: tree, M: tree; same code as roundmult
roundmult_12 = RoundToMultiple(N=expression_10, M="25")  # -> R; inputs N: tree, M: tree; same code as roundmult
roundmult_13 = RoundToMultiple(N=expression_5, M="0.05")  # -> R; inputs N: tree, M: tree; same code as roundmult
roundmult_14 = RoundToMultiple(N=expression_11, M="5")  # -> R; inputs N: tree, M: tree; same code as roundmult
effective_floor_area_m² = Number(roundmult_8)
operational_cost_mio_a = Number(roundmult_13)
specific_operational_global_warming_pote = Number(roundmult_9)  # "Specific Operational Global Warming Potential [kgCO2e/m²a]"
construction_cost_mio = Number(roundmult_10)
return_a = Number(roundmult_11)
construction_global_warming_potential_tc = Number(roundmult_12)  # "Construction Global Warming Potential [tCO2e]"
operational_global_warming_potential_tco = Number(roundmult_14)  # "Operational Global Warming Potential [tCO2e/a]"
income_mio_a = Number(roundmult)
maintenance_expenses_mio_a = Number(roundmult_2)
specific_energy_demand_kwh_m²a = Number(roundmult_3)
operational_energy_cost_a = Number(roundmult_4)
heating_energy_demand_mwh_a = Number(roundmult_5)
cooling_energy_demand_mwh_a = Number(roundmult_6)
technical_equipment_energy_demand_mwh_a = Number(roundmult_7)

dn = ClusterOutput(perfasm.dn_4)
effective_floor_area_m²_2 = ClusterOutput(effective_floor_area_m²)
specific_operational_global_warming_pote_2 = ClusterOutput(specific_operational_global_warming_pote)  # "Specific Operational Global Warming Potential [kgCO2e/m²a]"
construction_cost_mio_2 = ClusterOutput(construction_cost_mio)
return_a_2 = ClusterOutput(return_a)
construction_global_warming_potential_tc_2 = ClusterOutput(construction_global_warming_potential_tc)  # "Construction Global Warming Potential [tCO2e]"
operational_cost_mio_a_2 = ClusterOutput(operational_cost_mio_a)
operational_global_warming_potential_tco_2 = ClusterOutput(operational_global_warming_potential_tco)  # "Operational Global Warming Potential [tCO2e/a]"
income_mio_a_2 = ClusterOutput(income_mio_a)
maintenance_expenses_mio_a_2 = ClusterOutput(maintenance_expenses_mio_a)
specific_energy_demand_kwh_m²a_2 = ClusterOutput(specific_energy_demand_kwh_m²a)
operational_energy_cost_a_2 = ClusterOutput(operational_energy_cost_a)
heating_energy_demand_mwh_a_2 = ClusterOutput(heating_energy_demand_mwh_a)
cooling_energy_demand_mwh_a_2 = ClusterOutput(cooling_energy_demand_mwh_a)
technical_equipment_energy_demand_mwh_a_2 = ClusterOutput(technical_equipment_energy_demand_mwh_a)

# ==== cluster SemioGeometryPreview: semio styled preview of geometry.
geo = ClusterInput()
geo_2 = Geometry(flatten(geo))
debrep = DeconstructBrep(Brep=geo_2)  # -> Faces, Edges, Vertices
preview = CustomPreview(Geometry=flatten(debrep.Edges), Material=ColourSwatch(SwatchColor=RGB(0, 0, 0)))
preview_2 = CustomPreview(Geometry=flatten(debrep.Faces), Material=ColourSwatch(SwatchColor=RGB(255, 255, 255)))

# ==== cluster ShowDesign: Show a design by flattening it and selecting only representations with the same mime, lod and tags.
ty = ClusterInput()
dn = ClusterInput()
mm = ClusterInput()
lod = ClusterInput()
tags = ClusterInput()
ty_2 = Type(ty)
mm_2 = Mime(mm)
tags_2 = Tags(tags)
dn_2 = Design(dn)
lod_2 = Lod(lod)
fltdsn = FlattenDesign(Design=dn_2, Type=ty_2)
dsn = ModelDesign(Design=fltdsn)  # -> Design, Valid, Name, Description, Icon, Image, Variant, View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
typ = ModelType(Type=ty_2)  # -> Type, Valid, Name, Description, Icon, Image, Variant, Unit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
trim = TrimTree(Tree=dsn.Pieces, Depth=1)
tstat = TreeStatistics(Tree=typ.Representations)  # -> Paths, Length, Count
pce = ModelPiece(Piece=trim)  # -> Piece, Valid, Id, TypeName, TypeVariant, Plane, ScreenPoint
expression = Expression(x=graft(pce.TypeName), y=typ.Name, Expression="x=y")
expression_2 = Expression(x=graft(pce.TypeVariant), y=typ.Variant, Expression="x=y")
and = GateAnd(A=expression, B=expression_2)
cull = CullPattern(List=ty_2, CullPattern=and)
lng = ListLength(List=ty_2)
txt = Text(cull)
series = Series(Start=0, Step=1, Count=lng)
txt_2 = Text(ty_2)
expression_3 = Expression(x=txt, y=txt_2, Expression="x=y")
trim_2 = TrimTree(Tree=series, Depth=1)
cull_2 = CullPattern(List=trim_2, CullPattern=expression_3)
trim_3 = TrimTree(Tree=cull_2, Depth=1)
item = ListItem(List=tstat.Paths, Index=trim_3, Wrap=True)
branch = TreeBranch(Tree=typ.Representations, Path=item, MaintainPaths=False)
mrg_p = MergeSeperatlyPrepend(x=branch)  # -> Mrgd; inputs x: tree
# ---------- mrg_p: Python ----------
if ghenv.Component.RunCount<2:
    __author__ = "Ueli Saluz"
    __version__ = "2020.05.28"
    
    ghenv.Component.Name = "MergeSeperatly(Prepend)"
    ghenv.Component.NickName = "Mrg(P)"
    ghenv.Component.Description = "Merge inputs seperatly on a new path. Prepend index of input parameter for distincting."
    ghenv.Component.Message = "VER 1.0"

from System import Object
from Grasshopper import DataTree
from Grasshopper.Kernel import GH_ParamAccess as Access

if __name__ == "__main__":
    Mrgd = DataTree[Object]()
    access = Access()
    
    for input in ghenv.Component.Params.Input:  #set all Inputaccess to Tree Access
        input.Access = access.tree
    
    for i,input in enumerate(ghenv.Component.Params.Input):
        for j,source in enumerate(input.Sources):
            for path in source.VolatileData.Paths:
                Mrgd.AddRange(source.VolatileData[path],path.PrependElement(i))
# ---------- end mrg_p ----------
selrep = SelectRepresentation(rp=mrg_p, mm=mm_2, lod=lod_2, tags=tags_2)  # -> rp_4, ur_2, pa_ur_2
trim_4 = TrimTree(Tree=selrep.ur_2, Depth=1)
trim_5 = TrimTree(Tree=selrep.pa_ur_2, Depth=1)
id = Id(pce.Id)
ur = Url(trim_4)
pa_ur = Url(trim_5)
pln = Plane(pce.Plane)
id_2 = ClusterOutput(id)
ur_2 = ClusterOutput(ur)
pa_ur_2 = ClusterOutput(pa_ur)
pln_2 = ClusterOutput(pln)

# ==== cluster LoadGeometry: Load local geometry from absolute file paths to planes.
path = ClusterInput()
pln = ClusterInput()
run = ClusterInput()
pln_2 = Plane(graft(pln))
path_2 = FilePath(path)
run_2 = Boolean(run)
import = ImportContent(
    FilePath=path_2,
    Name="*",
    Layer="*",
    Linetype="*",
    HatchPattern="*",
    AnnotationStyles="*",
    Materials="*",
    BlockDefinitions="*",
    Import=run_2)  # -> ModelTransform, Objects, Layers, Linetypes, HatchPatterns, AnnotationStyles, Materials, BlockDefinitions
object = ModelObject(Object=import.Objects)  # -> Object, Geometry, Name, Layer, Visibility, Display, Drafting, Render
orient = Orient(Geometry=object.Geometry, Source=PlaneXY(0, 0, 0), Target=pln_2)  # -> Geometry, Transform
object_2 = ModelObject(Object=object.Object, Geometry=orient.Geometry)  # -> Object, Geometry, Name, Layer, Visibility, Display, Drafting, Render
layer = ModelLayer(Layer=object_2.Layer)  # -> Layer, Name, Hidden, Locked, DisplayColour, Material, Linetype
display = DisplayAttributes(Display=object_2.Display)  # -> Display, DisplayColour, DisplayMode
display_colour = DisplayColour(DisplayColour=layer.DisplayColour)  # -> DisplayColour, Source, Colour
material = ModelMaterial(Material=layer.Material)  # -> Material, Name, Shader
display_colour_2 = DisplayColour(DisplayColour=display.DisplayColour)  # -> DisplayColour, Source, Colour
object_3 = ModelObject(object_2.Object)
col = Colour(display_colour.DisplayColour)
shader = Shader(material.Shader)
preview = CustomPreview(Geometry=object_3, Material=material.Shader)
object_4 = ClusterOutput(object_3)
shader_2 = ClusterOutput(shader)
col_2 = ClusterOutput(col)

# ==== cluster Tower
floor = Panel("f")
shaftpieceid = ClusterInput()
capsulepatternnorthwest = ClusterInput()
capsulepatternsoutheast = ClusterInput()
capsulepatternsouthwest = ClusterInput()
capsulepatternnortheast = ClusterInput()
capsulerotation = ClusterInput()
capsuletilt = ClusterInput()
capsulegap = ClusterInput()
capsuleshift = ClusterInput()
tambourrotation = ClusterInput()
tambourtilt = ClusterInput()
tambourgap = ClusterInput()
tambourshift = ClusterInput()
panel = Panel("""0
0
1
0
1
0
2
3
3""")
rotation = ClusterInput()
panel_2 = Panel("""2
3
3
0
0
1
0
0
1""")
diagram_force = ClusterInput()
merge = Merge(Data1="\", Data2="q", Data3="J", Data4="s")
merge_2 = Merge(Data1="/", Data2="p", Data3="L", Data4="z")
split_level = Panel("sl")
door = Panel("d")
shaftpieceid_2 = Text(shaftpieceid)
capsulepatternnorthwest_2 = Integer(capsulepatternnorthwest)
item = ListItem(List=panel, Index=capsulepatternnorthwest_2, Wrap=True)
item_2 = ListItem(List=panel_2, Index=capsulepatternnorthwest_2, Wrap=True)
item_3 = ListItem(List=merge, Index=item, Wrap=True)
item_4 = ListItem(List=merge_2, Index=item_2, Wrap=True)
lng = ListLength(List=capsulepatternnorthwest_2)
capsulepatternsoutheast_2 = Integer(capsulepatternsoutheast)
item_5 = ListItem(List=panel_2, Index=capsulepatternsoutheast_2, Wrap=True)
item_6 = ListItem(List=panel, Index=capsulepatternsoutheast_2, Wrap=True)
item_7 = ListItem(List=merge, Index=item_6, Wrap=True)
item_8 = ListItem(List=merge_2, Index=item_5, Wrap=True)
capsulepatternsouthwest_2 = Integer(capsulepatternsouthwest)
item_9 = ListItem(List=panel, Index=capsulepatternsouthwest_2, Wrap=True)
item_10 = ListItem(List=panel_2, Index=capsulepatternsouthwest_2, Wrap=True)
item_11 = ListItem(List=merge, Index=item_9, Wrap=True)
item_12 = ListItem(List=merge_2, Index=item_10, Wrap=True)
capsulepatternnortheast_2 = Integer(capsulepatternnortheast)
item_13 = ListItem(List=panel, Index=capsulepatternnortheast_2, Wrap=True)
item_14 = ListItem(List=panel_2, Index=capsulepatternnortheast_2, Wrap=True)
item_15 = ListItem(List=merge_2, Index=item_14, Wrap=True)
item_16 = ListItem(List=merge, Index=item_13, Wrap=True)
capsulerotation_2 = Number(capsulerotation)
tambourrotation_2 = Number(tambourrotation)
tambourtilt_2 = Number(tambourtilt)
capsuletilt_2 = Number(capsuletilt)
capsulegap_2 = Number(capsulegap)
capsuleshift_2 = Number(capsuleshift)
tambourgap_2 = Number(tambourgap)
tambourshift_2 = Number(tambourshift)
rotation_2 = Number(rotation)
diagram_force_2 = Number(diagram_force)

multiplication = Multiplication(A=diagram_force_2, B=Slider(0.3, range=0..1))
multiplication_2 = Multiplication(A=diagram_force_2, B=Slider(0.75, range=0..10))
num = Number(multiplication)
num_2 = Number(multiplication_2)
neg = Negative(Value=num_2)
neg_2 = Negative(Value=num)
dpt = ModelDiagramPoint(X=neg_2, Y=num_2)  # -> DiagramPoint, Valid, X, Y
dpt_2 = ModelDiagramPoint(X=num, Y=num_2)  # -> DiagramPoint, Valid, X, Y
dpt_3 = ModelDiagramPoint(X=num_2, Y=num)  # -> DiagramPoint, Valid, X, Y
dpt_4 = ModelDiagramPoint(X=num_2, Y=neg_2)  # -> DiagramPoint, Valid, X, Y
dpt_5 = ModelDiagramPoint(X=num, Y=neg)  # -> DiagramPoint, Valid, X, Y
dpt_6 = ModelDiagramPoint(X=neg_2, Y=neg)  # -> DiagramPoint, Valid, X, Y
dpt_7 = ModelDiagramPoint(X=neg, Y=neg_2)  # -> DiagramPoint, Valid, X, Y
dpt_8 = ModelDiagramPoint(X=neg, Y=num)  # -> DiagramPoint, Valid, X, Y
nw = DiagramPoint(dpt.DiagramPoint)
ne = DiagramPoint(dpt_2.DiagramPoint)
en = DiagramPoint(dpt_3.DiagramPoint)
es = DiagramPoint(dpt_4.DiagramPoint)
se = DiagramPoint(dpt_5.DiagramPoint)
sw = DiagramPoint(dpt_6.DiagramPoint)
ws = DiagramPoint(dpt_7.DiagramPoint)
wn = DiagramPoint(dpt_8.DiagramPoint)
merge_3 = Merge(Data1=nw, Data2=ne, Data3=en, Data4=es, Data5=se, Data6=sw, Data7=ws, Data8=wn)
pt = Point(merge_3)
rotate = Rotate(Geometry=pt, Angle=degrees(rotation_2), Plane=PlaneXY(0, 0, 0))  # -> Geometry, Transform
item_17 = ListItem(List=rotate.Geometry, Index=0, Wrap=True)  # -> Item, Item1, Item2, Item3, Item4, Item5, Item6, Item7
sl0d2 = DiagramPoint(item_17.Item)
sl0d1 = DiagramPoint(item_17.Item1)
sl0d0 = DiagramPoint(item_17.Item2)
sl2d0 = DiagramPoint(item_17.Item4)
sl1d1 = DiagramPoint(item_17.Item5)
sl1d0 = DiagramPoint(item_17.Item6)
sl2d1 = DiagramPoint(item_17.Item3)
sl0d3 = DiagramPoint(item_17.Item7)

points = PointList(Points=rotate.Geometry, Size=Slider(0.2, range=0..1))
capsulevariantsouthright = Text(item_12)
capsulevariantwestright = Text(item_4)
capsulevariantnorthleft = Text(item_3)
capsulevariantwestleft = Text(item_11)
bottom = Panel("b")
capsulevariantsouthleft = Text(item_7)
capsulevariantnorthright = Text(item_15)
capsulevarianteastright = Text(item_8)
number_of_floors = Integer(lng)
capsulevarianteastleft = Text(item_16)
neg_3 = Negative(Value=capsuleshift_2)
top = Panel("t")

series = Series(Start=0, Step=1, Count=number_of_floors)
trim = TrimTree(Tree=series, Depth=1)
concat = Concatenate(FragmentA=floor, FragmentB=trim)
concat_2 = Concatenate(FragmentD="t", FragmentE="_", FragmentA=concat, FragmentF="_", FragmentG=shaftpieceid_2)
lito3p = ListInto3Parts(ListToSlice=concat_2, StartIndex="1", EndIndex="-1")  # -> FilteredList, ItemsBefore, ItemsAfter; inputs ListToSlice: tree, StartIndex: tree of Int32, EndIndex: tree of Int32
# ---------- lito3p: Python ----------
if ghenv.Component.RunCount<2:
    __author__ = "Ueli Saluz"
    __version__ = "2020.05.28"
    
    ghenv.Component.Name = "ListInto3Parts"
    ghenv.Component.NickName = "LiTo3P"
    ghenv.Component.Description = "Slice list into 3 parts. All lists are sliced with the same indices. End index = 0 = length(list)."
    ghenv.Component.Message = "VER 1.6"

from System import Object
from Grasshopper import DataTree

def filterList(listToFilter,startIndex,endIndex):
    # Return: FilteredList, Before, After
    if (((startIndex == 0) or (startIndex is None)) and ((endIndex == 0) or (endIndex is None))) or (endIndex <= startIndex and endIndex > 0):
        return (listToFilter,None,None)
    elif (startIndex == 0) or (startIndex is None):
        return (listToFilter[:endIndex],None,listToFilter[endIndex:])
    elif (endIndex == 0) or (endIndex is None):
        print 1
        return (listToFilter[:startIndex],listToFilter[startIndex:],None)
    else:
        return (listToFilter[startIndex:endIndex],listToFilter[:startIndex],listToFilter[endIndex:])

if __name__ == "__main__":
    FilteredList = DataTree[Object]()
    ItemsBefore = DataTree[Object]()
    ItemsAfter = DataTree[Object]()
    
    for path in ListToSlice.Paths:
        listBranch = ListToSlice.Branch(path)
        pyList = list(listBranch)   #Convert .Net List to Python
        try: #terrible way of writing code but if I set the list to list access the performance decreases massivly due to many calls
            startIndex = StartIndex.Branch(path)
            startIndex = startIndex[0]
        except Exception:
            try:
                startIndex = StartIndex.Branch(0)
                startIndex = startIndex[0]
            except Exception:
                startIndex = 0
        try:
            endIndex = EndIndex.Branch(path)
            endIndex = endIndex[0]
        except Exception:
            try:
                endIndex = EndIndex.Branch(0)
                endIndex = endIndex[0]
            except Exception:
                endIndex = len(pyList)
        filtList=filterList(pyList,startIndex,endIndex)
        if filtList[0]:
            FilteredList.AddRange(filtList[0],path)
        if filtList[1]:
            ItemsBefore.AddRange(filtList[1],path)
        if filtList[2]:
            ItemsAfter.AddRange(filtList[2],path)
# ---------- end lito3p ----------
pce = ModelPiece(Id=lito3p.FilteredList, TypeName="Tambour")  # -> Piece, Valid, Id, TypeName, TypeVariant, Plane, ScreenPoint
pce_2 = ModelPiece(Id=lito3p.ItemsBefore, TypeName="Tambour", TypeVariant="First Storey")  # -> Piece, Valid, Id, TypeName, TypeVariant, Plane, ScreenPoint
pce_3 = ModelPiece(Id=lito3p.ItemsAfter, TypeName="Tambour", TypeVariant="Last Storey")  # -> Piece, Valid, Id, TypeName, TypeVariant, Plane, ScreenPoint
expression = Expression(x=number_of_floors, Expression="x=1")
merge_4 = Merge(Data1=pce_2.Piece, Data2=pce.Piece, Data3=pce_3.Piece)
pce_4 = ModelPiece(Id=concat_2, TypeName="Tambour")  # -> Piece, Valid, Id, TypeName, TypeVariant, Plane, ScreenPoint
filter = StreamFilter(Gate=expression, Stream0=merge_4, Stream1=pce_4.Piece)
pce_5 = ModelPiece(Piece=filter, TypeName="Tambour")  # -> Piece, Valid, Id, TypeName, TypeVariant, Plane, ScreenPoint
tambour_pc = Piece(pce_5.Piece)

concat_3 = Concatenate(FragmentA=split_level, FragmentB="0")
concat_4 = Concatenate(FragmentA=door, FragmentB="0")
concat_5 = Concatenate(FragmentA=concat_3, FragmentC="_", FragmentB=concat_4)
concat_6 = Concatenate(FragmentF="cs", FragmentA="_", FragmentD=concat_5, FragmentB="_", FragmentC=concat_2)
dpt_9 = ModelDiagramPoint(DiagramPoint=sl0d0)  # -> DiagramPoint, Valid, X, Y
pce_6 = ModelPiece(Id=concat_6, TypeName="Capsule", TypeVariant=capsulevarianteastleft)  # -> Piece, Valid, Id, TypeName, TypeVariant, Plane, ScreenPoint
con = ModelConnection(
    ConnectedPieceId=pce_5.Id,
    ConnectedPieceTypePortId=concat_5,
    ConnectingPieceId=pce_6.Id,
    Rotation=capsulerotation_2,
    Tilt=capsuletilt_2,
    Gap=capsulegap_2,
    Shift=neg_3,
    X=dpt_9.X,
    Y=dpt_9.Y)  # -> Connection, Valid, ConnectedPieceId, ConnectedPieceTypePortId, ConnectingPieceId, ConnectingPieceTypePortId, Rotation, Tilt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

concat_7 = Concatenate(FragmentA=door, FragmentB="1")
concat_8 = Concatenate(FragmentA=split_level, FragmentB="0")
concat_9 = Concatenate(FragmentA=concat_8, FragmentC="_", FragmentB=concat_7)
concat_10 = Concatenate(FragmentF="cs", FragmentA="_", FragmentD=concat_9, FragmentB="_", FragmentC=concat_2)
pce_7 = ModelPiece(Id=concat_10, TypeName="Capsule", TypeVariant=capsulevariantnorthright)  # -> Piece, Valid, Id, TypeName, TypeVariant, Plane, ScreenPoint
dpt_10 = ModelDiagramPoint(DiagramPoint=sl0d1)  # -> DiagramPoint, Valid, X, Y
con_2 = ModelConnection(
    ConnectedPieceId=pce_5.Id,
    ConnectedPieceTypePortId=concat_9,
    ConnectingPieceId=pce_7.Id,
    Rotation=capsulerotation_2,
    Tilt=capsuletilt_2,
    Gap=capsulegap_2,
    Shift=capsuleshift_2,
    X=dpt_10.X,
    Y=dpt_10.Y)  # -> Connection, Valid, ConnectedPieceId, ConnectedPieceTypePortId, ConnectingPieceId, ConnectingPieceTypePortId, Rotation, Tilt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

concat_11 = Concatenate(FragmentA=split_level, FragmentB="0")
concat_12 = Concatenate(FragmentA=door, FragmentB="2")
concat_13 = Concatenate(FragmentA=concat_11, FragmentC="_", FragmentB=concat_12)
concat_14 = Concatenate(FragmentF="cs", FragmentA="_", FragmentD=concat_13, FragmentB="_", FragmentC=concat_2)
dpt_11 = ModelDiagramPoint(DiagramPoint=sl0d2)  # -> DiagramPoint, Valid, X, Y
pce_8 = ModelPiece(Id=concat_14, TypeName="Capsule", TypeVariant=capsulevariantnorthleft)  # -> Piece, Valid, Id, TypeName, TypeVariant, Plane, ScreenPoint
con_3 = ModelConnection(
    ConnectedPieceId=pce_5.Id,
    ConnectedPieceTypePortId=concat_13,
    ConnectingPieceId=pce_8.Id,
    Rotation=capsulerotation_2,
    Tilt=capsuletilt_2,
    Gap=capsulegap_2,
    Shift=neg_3,
    X=dpt_11.X,
    Y=dpt_11.Y)  # -> Connection, Valid, ConnectedPieceId, ConnectedPieceTypePortId, ConnectingPieceId, ConnectingPieceTypePortId, Rotation, Tilt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

dpt_12 = ModelDiagramPoint(DiagramPoint=sl0d3)  # -> DiagramPoint, Valid, X, Y

concat_15 = Concatenate(FragmentA=door, FragmentB="3")
concat_16 = Concatenate(FragmentA=split_level, FragmentB="0")
concat_17 = Concatenate(FragmentA=concat_16, FragmentC="_", FragmentB=concat_15)
concat_18 = Concatenate(FragmentF="cs", FragmentA="_", FragmentD=concat_17, FragmentB="_", FragmentC=concat_2)
pce_9 = ModelPiece(Id=concat_18, TypeName="Capsule", TypeVariant=capsulevariantwestright)  # -> Piece, Valid, Id, TypeName, TypeVariant, Plane, ScreenPoint
con_4 = ModelConnection(
    ConnectedPieceId=pce_5.Id,
    ConnectedPieceTypePortId=concat_17,
    ConnectingPieceId=pce_9.Id,
    Rotation=capsulerotation_2,
    Tilt=capsuletilt_2,
    Gap=capsulegap_2,
    Shift=capsuleshift_2,
    X=dpt_12.X,
    Y=dpt_12.Y)  # -> Connection, Valid, ConnectedPieceId, ConnectedPieceTypePortId, ConnectingPieceId, ConnectingPieceTypePortId, Rotation, Tilt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

concat_19 = Concatenate(FragmentA=split_level, FragmentB="1")
concat_20 = Concatenate(FragmentA=door, FragmentB="0")
concat_21 = Concatenate(FragmentA=concat_19, FragmentC="_", FragmentB=concat_20)
concat_22 = Concatenate(FragmentF="cs", FragmentA="_", FragmentD=concat_21, FragmentB="_", FragmentC=concat_2)
dpt_13 = ModelDiagramPoint(DiagramPoint=sl1d0)  # -> DiagramPoint, Valid, X, Y
pce_10 = ModelPiece(Id=concat_22, TypeName="Capsule", TypeVariant=capsulevariantwestleft)  # -> Piece, Valid, Id, TypeName, TypeVariant, Plane, ScreenPoint
con_5 = ModelConnection(
    ConnectedPieceId=pce_5.Id,
    ConnectedPieceTypePortId=concat_21,
    ConnectingPieceId=pce_10.Id,
    Rotation=capsulerotation_2,
    Tilt=capsuletilt_2,
    Gap=capsulegap_2,
    Shift=neg_3,
    X=dpt_13.X,
    Y=dpt_13.Y)  # -> Connection, Valid, ConnectedPieceId, ConnectedPieceTypePortId, ConnectingPieceId, ConnectingPieceTypePortId, Rotation, Tilt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

concat_23 = Concatenate(FragmentA=door, FragmentB="1")
concat_24 = Concatenate(FragmentA=split_level, FragmentB="1")
concat_25 = Concatenate(FragmentA=concat_24, FragmentC="_", FragmentB=concat_23)
concat_26 = Concatenate(FragmentF="cs", FragmentA="_", FragmentD=concat_25, FragmentB="_", FragmentC=concat_2)
pce_11 = ModelPiece(Id=concat_26, TypeName="Capsule", TypeVariant=capsulevariantsouthright)  # -> Piece, Valid, Id, TypeName, TypeVariant, Plane, ScreenPoint
dpt_14 = ModelDiagramPoint(DiagramPoint=sl1d1)  # -> DiagramPoint, Valid, X, Y
con_6 = ModelConnection(
    ConnectedPieceId=pce_5.Id,
    ConnectedPieceTypePortId=concat_25,
    ConnectingPieceId=pce_11.Id,
    Rotation=capsulerotation_2,
    Tilt=capsuletilt_2,
    Gap=capsulegap_2,
    Shift=capsuleshift_2,
    X=dpt_14.X,
    Y=dpt_14.Y)  # -> Connection, Valid, ConnectedPieceId, ConnectedPieceTypePortId, ConnectingPieceId, ConnectingPieceTypePortId, Rotation, Tilt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

tambour_pc_2 = ClusterOutput(tambour_pc)
expression_2 = Expression(x=diagram_force_2, Expression="2+(x+0.5)^2-0.25")

concat_27 = Concatenate(FragmentA=split_level, FragmentB="2")
concat_28 = Concatenate(FragmentA=door, FragmentB="0")
concat_29 = Concatenate(FragmentA=concat_27, FragmentC="_", FragmentB=concat_28)
concat_30 = Concatenate(FragmentF="cs", FragmentA="_", FragmentD=concat_29, FragmentB="_", FragmentC=concat_2)
dpt_15 = ModelDiagramPoint(DiagramPoint=sl2d0)  # -> DiagramPoint, Valid, X, Y
pce_12 = ModelPiece(Id=concat_30, TypeName="Capsule", TypeVariant=capsulevariantsouthleft)  # -> Piece, Valid, Id, TypeName, TypeVariant, Plane, ScreenPoint
con_7 = ModelConnection(
    ConnectedPieceId=pce_5.Id,
    ConnectedPieceTypePortId=concat_29,
    ConnectingPieceId=pce_12.Id,
    Rotation=capsulerotation_2,
    Tilt=capsuletilt_2,
    Gap=capsulegap_2,
    Shift=neg_3,
    X=dpt_15.X,
    Y=dpt_15.Y)  # -> Connection, Valid, ConnectedPieceId, ConnectedPieceTypePortId, ConnectingPieceId, ConnectingPieceTypePortId, Rotation, Tilt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

concat_31 = Concatenate(FragmentA=split_level, FragmentB="2")
concat_32 = Concatenate(FragmentA=door, FragmentB="1")
concat_33 = Concatenate(FragmentA=concat_31, FragmentC="_", FragmentB=concat_32)
concat_34 = Concatenate(FragmentF="cs", FragmentA="_", FragmentD=concat_33, FragmentB="_", FragmentC=concat_2)
dpt_16 = ModelDiagramPoint(DiagramPoint=sl2d1)  # -> DiagramPoint, Valid, X, Y
pce_13 = ModelPiece(Id=concat_34, TypeName="Capsule", TypeVariant=capsulevarianteastright)  # -> Piece, Valid, Id, TypeName, TypeVariant, Plane, ScreenPoint
con_8 = ModelConnection(
    ConnectedPieceId=pce_5.Id,
    ConnectedPieceTypePortId=concat_33,
    ConnectingPieceId=pce_13.Id,
    Rotation=capsulerotation_2,
    Tilt=capsuletilt_2,
    Gap=capsulegap_2,
    Shift=capsuleshift_2,
    X=dpt_16.X,
    Y=dpt_16.Y)  # -> Connection, Valid, ConnectedPieceId, ConnectedPieceTypePortId, ConnectingPieceId, ConnectingPieceTypePortId, Rotation, Tilt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

merge_5 = Merge(
    Data1=pce_6.Piece,
    Data2=pce_7.Piece,
    Data3=pce_8.Piece,
    Data4=pce_9.Piece,
    Data5=pce_10.Piece,
    Data6=pce_11.Piece,
    Data7=pce_12.Piece,
    Data8=pce_13.Piece)
merge_6 = Merge(
    Data1=con.Connection,
    Data2=con_2.Connection,
    Data3=con_3.Connection,
    Data4=con_4.Connection,
    Data5=con_5.Connection,
    Data6=con_6.Connection,
    Data7=con_7.Connection,
    Data8=con_8.Connection)
capsule_pc = Piece(merge_5)
caspule_co = Connection(merge_6)
merge_7 = Merge(Data1=tambour_pc, Data2=capsule_pc)
pc = Piece(merge_7)
capsule_pc_2 = ClusterOutput(capsule_pc)
caspule_co_2 = ClusterOutput(caspule_co)
pc_2 = ClusterOutput(pc)
item_18 = ListItem(List=tambour_pc, Index=0, Wrap=True)  # -> Item1, Item
pce_14 = ModelPiece(Piece=item_18.Item)  # -> Piece, Valid, Id, TypeName, TypeVariant, Plane, ScreenPoint
lincons = LinearConnections(
    pc=tambour_pc,
    cdpo=top,
    cgpo=bottom,
    rotation=tambourrotation_2,
    tilt=tambourtilt_2,
    gap=tambourgap_2,
    shift=tambourshift_2,
    y=expression_2)
pce_15 = ModelPiece(Piece=item_18.Item1)  # -> Piece, Valid, Id, TypeName, TypeVariant, Plane, ScreenPoint
filter_2 = StreamFilter(Gate=expression, Stream0=lincons)
first_tambour_id = Text(pce_14.Id)
first_tambour_id_2 = ClusterOutput(first_tambour_id)
last_tambour_id = Text(pce_15.Id)
last_tambour_id_2 = ClusterOutput(last_tambour_id)
tambour_co = Connection(filter_2)
merge_8 = Merge(Data1=tambour_co, Data2=caspule_co)
co = Connection(merge_8)
tambour_co_2 = ClusterOutput(tambour_co)
co_2 = ClusterOutput(co)

# ==== cluster AddBridges
bridge_x_addition = ClusterInput()
dn = ClusterInput()
levels = ClusterInput()
bridge_rotation = ClusterInput()
bridge_tilt = ClusterInput()
bridge_gap = ClusterInput()
bridge_shift = ClusterInput()
dn_2 = Design(dn)
levels_2 = Integer(levels)
bridge_rotation_2 = Number(bridge_rotation)
bridge_tilt_2 = Number(bridge_tilt)
bridge_x_addition_2 = Number(bridge_x_addition)
bridge_gap_2 = Number(bridge_gap)
bridge_shift_2 = Number(bridge_shift)
expression = Expression(x=levels_2, Expression="x-1")
concat = Concatenate(
    FragmentA="cs_",
    FragmentD="sl",
    FragmentH="0",
    FragmentI="_d",
    FragmentJ="1",
    FragmentB="_t_f",
    FragmentC=expression,
    FragmentE="_b_c",
    FragmentF="1")
concat_2 = Concatenate(
    FragmentA="cs_",
    FragmentD="sl",
    FragmentH="0",
    FragmentI="_d",
    FragmentJ="2",
    FragmentB="_t_f",
    FragmentC=expression,
    FragmentE="_b_c",
    FragmentF="0")
merge = Merge(Data1=concat_2, Data2=concat)
rmvpces = RemovePieces(dn=dn_2, ids=merge)  # -> dn_4, pc_2, co_2
dsn = ModelDesign(Design=rmvpces.dn_4)  # -> Design, Valid, Name, Description, Icon, Image, Variant, View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
lng = ListLength(List=levels_2)
split = SplitList(List=rmvpces.pc_2, Index=lng)  # -> ListA, ListB
split_2 = SplitList(List=rmvpces.co_2, Index=lng)  # -> ListA, ListB
trim = TrimTree(Tree=dsn.Pieces, Depth=1)
trim_2 = TrimTree(Tree=dsn.Connections, Depth=1)
concat_3 = Concatenate(
    FragmentA="br_",
    FragmentD="sl",
    FragmentH="0",
    FragmentI="_d",
    FragmentJ="2",
    FragmentB="_t_f",
    FragmentC=expression,
    FragmentE="_b_c",
    FragmentF="0")
trim_3 = TrimTree(Tree=split.ListA, Depth=1)
trim_4 = TrimTree(Tree=split_2.ListA, Depth=1)
pce = ModelPiece(Piece=trim_3, Id=concat_3, TypeName="Bridge")  # -> Piece, Valid, Id, TypeName, TypeVariant, Plane, ScreenPoint
con = ModelConnection(Connection=trim_4)  # -> Connection, Valid, ConnectedPieceId, ConnectedPieceTypePortId, ConnectingPieceId, ConnectingPieceTypePortId, Rotation, Tilt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
addition = Addition(A=con.X, B=bridge_x_addition_2)
con_2 = ModelConnection(
    Connection=con.Connection,
    ConnectingPieceId=pce.Id,
    ConnectingPieceTypePortId="e",
    Rotation=bridge_rotation_2,
    Tilt=bridge_tilt_2,
    Offset=bridge_gap_2,
    Shift=bridge_shift_2,
    X=addition)  # -> Connection, Valid, ConnectedPieceId, ConnectedPieceTypePortId, ConnectingPieceId, ConnectingPieceTypePortId, Rotation, Tilt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
merge_2 = Merge(Data1=trim_2, Data2=con_2.Connection)
merge_3 = Merge(Data1=trim, Data2=pce.Piece)
dsn_2 = ModelDesign(Design=dsn.Design, Pieces=merge_3, Connections=merge_2)  # -> Design, Valid, Name, Description, Icon, Image, Variant, View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
dn_3 = Design(dsn_2.Design)
dn_4 = ClusterOutput(dn_3)

# ==== cluster VaryTypes: Change a variant (name) from one type to another variant of the same type for all pieces of a design.
dn = ClusterInput()
na = ClusterInput()
old_vn = ClusterInput()
new_vn = ClusterInput()
dn_2 = Design(dn)
na_2 = TypeName(na)
old_vn_2 = TypeVariant(old_vn)
new_vn_2 = TypeVariant(new_vn)
dsn = ModelDesign(Design=dn_2)  # -> Design, Valid, Name, Description, Icon, Image, Variant, View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
trim = TrimTree(Tree=dsn.Pieces, Depth=1)
pce = ModelPiece(Piece=trim)  # -> Piece, Valid, Id, TypeName, TypeVariant, Plane, DiagramPoint
lng = ListLength(List=trim)
series = Series(Start=0, Step=1, Count=lng)
expression = Expression(x=pce.TypeVariant, y=old_vn_2, Expression="x=y")
expression_2 = Expression(x=pce.TypeName, y=na_2, Expression="x=y")
trim_2 = TrimTree(Tree=series, Depth=1)
and = GateAnd(A=expression_2, B=expression)
dispatch = Dispatch(List=trim_2, DispatchPattern=and)  # -> ListA, ListB
dispatch_2 = Dispatch(List=pce.Piece, DispatchPattern=and)  # -> ListA, ListB
pce_2 = ModelPiece(Piece=dispatch_2.ListA, TypeVariant=new_vn_2)  # -> Piece, Valid, Id, TypeName, TypeVariant, Plane, DiagramPoint
replace = ReplaceItems(List=trim, Item=pce_2.Piece, Indices=dispatch.ListA, Wrap=False)
trim_3 = TrimTree(Tree=replace, Depth=1)
dsn_2 = ModelDesign(Design=dsn.Design, Pieces=trim_3)  # -> Design, Valid, Name, Description, Icon, Image, Variant, View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
dn_3 = Design(dsn_2.Design)
dn_4 = ClusterOutput(dn_3)

# ==== cluster ReplaceType: Replace a type (name) in a design. All variants stay the same and must exist in the new type.
new_na = ClusterInput()
dn = ClusterInput()
old_na = ClusterInput()
new_na_2 = Text(new_na)
dn_2 = Design(dn)
old_na_2 = Text(old_na)
dsn = ModelDesign(Design=dn_2)  # -> Design, Valid, Name, Description, Icon, Image, Variant, View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
trim = TrimTree(Tree=dsn.Pieces, Depth=1)
lng = ListLength(List=trim)
pce = ModelPiece(Piece=trim)  # -> Piece, Valid, Id, TypeName, TypeVariant, Plane, DiagramPoint
series = Series(Start=0, Step=1, Count=lng)
trim_2 = TrimTree(Tree=series, Depth=1)
expression = Expression(x=pce.TypeName, y=old_na_2, Expression="x=y")
dispatch = Dispatch(List=pce.Piece, DispatchPattern=expression)  # -> ListA, ListB
dispatch_2 = Dispatch(List=trim_2, DispatchPattern=expression)  # -> ListA, ListB
pce_2 = ModelPiece(Piece=dispatch.ListA, TypeName=new_na_2)  # -> Piece, Valid, Id, TypeName, TypeVariant, Plane, DiagramPoint
replace = ReplaceItems(List=trim, Item=pce_2.Piece, Indices=dispatch_2.ListA, Wrap=False)
trim_3 = TrimTree(Tree=replace, Depth=1)
dsn_2 = ModelDesign(Design=dsn.Design, Pieces=trim_3)  # -> Design, Valid, Name, Description, Icon, Image, Variant, View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
dn_3 = Design(dsn_2.Design)
dn_4 = ClusterOutput(dn_3)

# ==== cluster PerformanceAssessment: Perform simple performance assement based on the following qualities of the types: (No unit conversion is applied for now, so make sure that all your types have the values with the same unit.) effective floor area construction cost maintenance expenses income heating energy demand cooling energy demand technical equipment energy demand construction global warming potential
dn = ClusterInput()
ty = ClusterInput()
heating_energy_price_cent_kwh = ClusterInput()
heating_efficiency_factor = ClusterInput()
heating_global_warming_potential_kgco2e = ClusterInput()  # "Heating Global Warming Potential [kgCO2e/kWh]"
cooling_energy_price_cent_kwh = ClusterInput()
cooling_efficiency_factor = ClusterInput()
cooling_global_warming_potential_kgco2e = ClusterInput()  # "Cooling Global Warming Potential [kgCO2e/kWh]"
electrictiy_energy_price_cent_kwh = ClusterInput()
electrictiy_global_warming_potential_kgc = ClusterInput()  # "Electrictiy Global Warming Potential [kgCO2e/kWh]"
dn_2 = Design(dn)
heating_energy_price_cent_kwh_2 = Number(heating_energy_price_cent_kwh)
heating_efficiency_factor_2 = Number(heating_efficiency_factor)
heating_global_warming_potential_kgco2e_2 = Number(heating_global_warming_potential_kgco2e)  # "Heating Global Warming Potential [kgCO2e/kWh]"
cooling_energy_price_cent_kwh_2 = Number(cooling_energy_price_cent_kwh)
cooling_efficiency_factor_2 = Number(cooling_efficiency_factor)
cooling_global_warming_potential_kgco2e_2 = Number(cooling_global_warming_potential_kgco2e)  # "Cooling Global Warming Potential [kgCO2e/kWh]"
electrictiy_energy_price_cent_kwh_2 = Number(electrictiy_energy_price_cent_kwh)
electrictiy_global_warming_potential_kgc_2 = Number(electrictiy_global_warming_potential_kgc)  # "Electrictiy Global Warming Potential [kgCO2e/kWh]"
ty_2 = Type(ty)
sumqal = SumQualities(dn=dn_2, ty=ty_2, na="heating energy demand")  # -> num_2, ql_2
sumqal_2 = SumQualities(dn=dn_2, ty=ty_2, na="cooling energy demand")  # -> num_2, ql_2
sumqal_3 = SumQualities(dn=dn_2, ty=ty_2, na="technical equipment energy demand")  # -> num_2, ql_2
sumqal_4 = SumQualities(dn=dn_2, ty=ty_2, na="income")  # -> num_2, ql_2
sumqal_5 = SumQualities(dn=dn_2, ty=ty_2, na="maintenance expenses")  # -> num_2, ql_2
sumqal_6 = SumQualities(dn=dn_2, ty=ty_2, na="construction cost")  # -> num_2, ql_2
sumqal_7 = SumQualities(dn=dn_2, ty=ty_2, na="effective floor area")  # -> num_2, ql_2
expression = Expression(x=sumqal.num_2, y=heating_efficiency_factor_2, Expression="x*(1/y)")
expression_2 = Expression(x=sumqal_2.num_2, y=cooling_efficiency_factor_2, Expression="x*(1/y)")
addition = Addition(A=expression, B=expression_2, C=sumqal_3.num_2)
multiplication = Multiplication(A=heating_energy_price_cent_kwh_2, B=expression)
multiplication_2 = Multiplication(A=heating_global_warming_potential_kgco2e_2, B=expression)
multiplication_3 = Multiplication(A=cooling_energy_price_cent_kwh_2, B=expression_2)
multiplication_4 = Multiplication(A=cooling_global_warming_potential_kgco2e_2, B=expression_2)
multiplication_5 = Multiplication(A=sumqal_3.num_2, B=electrictiy_energy_price_cent_kwh_2)
multiplication_6 = Multiplication(A=electrictiy_global_warming_potential_kgc_2, B=electrictiy_global_warming_potential_kgc_2)
sumqal_8 = SumQualities(dn=dn_2, ty=ty_2, na="construction global warming potential")  # -> num_2, ql_2
division = Division(A=addition, B=sumqal_7.num_2)
addition_2 = Addition(A=multiplication, B=multiplication_3, C=multiplication_5)
addition_3 = Addition(A=multiplication_2, B=multiplication_4, C=multiplication_6)
division_2 = Division(A=addition_3, B=sumqal_7.num_2)
addition_4 = Addition(A=sumqal_5.num_2, B=addition_2)
subtraction = Subtraction(A=sumqal_4.num_2, B=addition_4)
panel = Panel("""https://identifier.buildingsmart.org/uri/buildingsmart/ifc/4.3/prop/NetFloorArea
https://identifier.buildingsmart.org/uri/etim/etim/9.0/prop/EF016979


https://identifier.buildingsmart.org/uri/etim/etim/9.0/prop/EF016979

https://identifier.buildingsmart.org/uri/etim/etim/9.0/prop/EF016979


https://identifier.buildingsmart.org/uri/buildingsmart/ifc/4.3/prop/EnergyConsumption

https://identifier.buildingsmart.org/uri/buildingsmart/ifc/4.3/prop/EnergyConsumption
https://identifier.buildingsmart.org/uri/buildingsmart/ifc/4.3/prop/EnergyConsumption
https://identifier.buildingsmart.org/uri/buildingsmart/ifc/4.3/prop/EnergyConsumption""")
panel_2 = Panel("""effective floor area
specific operational global warming potential
construction cost
return
construction global warming potential
operational cost
operational global warming potential
income
maintenance expenses
specific energy demand
operational energy cost
heating energy demand
cooling energy demand
technical equipment energy demand""")
effective_floor_area_m² = Number(sumqal_7.num_2)
specific_operational_global_warming_pote = Number(division_2)  # "Specific Operational Global Warming Potential [kgCO2e/m²a]"
construction_cost = Number(sumqal_6.num_2)
return_a = Number(subtraction)
operational_cost_a = Number(addition_4)
maintenance_expenses_a = Number(sumqal_5.num_2)
specific_energy_demand_kwh_m²a = Number(division)
operational_energy_cost_a = Number(addition_2)
cooling_energy_demand_kwh_a = Number(sumqal_2.num_2)
construction_global_warming_potential_kg = Number(sumqal_8.num_2)  # "Construction Global Warming Potential [kgCO2e]"
operational_global_warming_potential_kgc = Number(addition_3)  # "Operational Global Warming Potential [kgCO2e/a]"
income = Number(sumqal_4.num_2)
heating_energy_demand_kwh_a = Number(sumqal.num_2)
technical_equipment_energy_demand_kwh_a = Number(sumqal_3.num_2)
merge = Merge(
    Data1=effective_floor_area_m²,
    Data2=specific_operational_global_warming_pote,
    Data3=construction_cost,
    Data4=return_a,
    Data5=construction_global_warming_potential_kg,
    Data6=operational_cost_a,
    Data7=operational_global_warming_potential_kgc,
    Data8=income,
    Data9=maintenance_expenses_a,
    Data10=specific_energy_demand_kwh_m²a,
    Data11=operational_energy_cost_a,
    Data12=heating_energy_demand_kwh_a,
    Data13=cooling_energy_demand_kwh_a,
    Data14=technical_equipment_energy_demand_kwh_a)
panel_3 = Panel("""m²
kgCO2e/m²a
€
€/a
kgCO2e
€/a
kgCO2e/a
€
€/a
kWh/m²a
€/a
kWh/a
kWh/a
kWh/a""")
dsn = ModelDesign(Design=dn_2)  # -> Design, Valid, Name, Description, Icon, Image, Variant, View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
trim = TrimTree(Tree=dsn.Qualities, Depth=1)
qal = ModelQuality(Name=panel_2, Value=merge, Unit=panel_3, Definition=panel)  # -> Quality, Valid, Name, Value, Unit, Definition
merge_2 = Merge(Data1=trim, Data2=qal.Quality)
dsn_2 = ModelDesign(Design=dsn.Design, Qualities=merge_2)  # -> Design, Valid, Name, Description, Icon, Image, Variant, View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
dn_3 = Design(dsn_2.Design)
effective_floor_area_m²_2 = ClusterOutput(effective_floor_area_m²)
specific_operational_global_warming_pote_2 = ClusterOutput(specific_operational_global_warming_pote)  # "Specific Operational Global Warming Potential [kgCO2e/m²a]"
construction_cost_2 = ClusterOutput(construction_cost)
return_a_2 = ClusterOutput(return_a)
construction_global_warming_potential_kg_2 = ClusterOutput(construction_global_warming_potential_kg)  # "Construction Global Warming Potential [kgCO2e]"
operational_cost_a_2 = ClusterOutput(operational_cost_a)
operational_global_warming_potential_kgc_2 = ClusterOutput(operational_global_warming_potential_kgc)  # "Operational Global Warming Potential [kgCO2e/a]"
income_2 = ClusterOutput(income)
maintenance_expenses_a_2 = ClusterOutput(maintenance_expenses_a)
specific_energy_demand_kwh_m²a_2 = ClusterOutput(specific_energy_demand_kwh_m²a)
operational_energy_cost_a_2 = ClusterOutput(operational_energy_cost_a)
heating_energy_demand_kwh_a_2 = ClusterOutput(heating_energy_demand_kwh_a)
cooling_energy_demand_kwh_a_2 = ClusterOutput(cooling_energy_demand_kwh_a)
technical_equipment_energy_demand_kwh_a_2 = ClusterOutput(technical_equipment_energy_demand_kwh_a)
dn_4 = ClusterOutput(dn_3)

# ==== cluster SelectRepresentation: Select a representation based on mime, lod and tags. The mime and lod must be equal and the tags must contain all the given tags.
rp = ClusterInput()
mm = ClusterInput()
lod = ClusterInput()
tags = ClusterInput()
rp_2 = Representation(rp)
mm_2 = Mime(mm)
lod_2 = Lod(lod)
tags_2 = Tags(tags)
rep = ModelRepresentation(Representation=rp_2)  # -> Representation, Valid, Url, Mime, Lod, Tags
expression = Expression(x=rep.Mime, y=mm_2, Expression="x=y")
cull = CullPattern(List=rep.Representation, CullPattern=expression)
rep_2 = ModelRepresentation(Representation=cull)  # -> Representation, Valid, Url, Mime, Lod, Tags
expression_2 = Expression(x=rep_2.Lod, y=lod_2, Expression="x=y")
cull_2 = CullPattern(List=rep_2.Representation, CullPattern=expression_2)
rep_3 = ModelRepresentation(Representation=cull_2)  # -> Representation, Valid, Url, Mime, Lod, Tags
trim = TrimTree(Tree=rep_3.Tags, Depth=1)
contains = Contains(L=trim, I=tags_2)  # -> R; inputs L: list, I: list
# ---------- contains: Python ----------
#Component Information
#--------------------------------------------------------------------------------------------
if ghenv.Component.RunCount<2:
    #General
    #--------------------------------------------------------------------------------------------
    __author__ = "Ueli Saluz"
    __version__ = "2023.02.04"
    
    ghenv.Component.Name = "Contains"
    ghenv.Component.NickName = "Contains"
    ghenv.Component.Description = "True if list contains one of the items."
    ghenv.Component.Message = "VER 1.0"
    ghenv.Component.Category = "Set"
    ghenv.Component.SubCategory = "List"
    
     #Inputs
    #--------------------------------------------------------------------------------------------
    inputIndex=0
    
    ghenv.Component.Params.Input[inputIndex].Name = "List"
    ghenv.Component.Params.Input[inputIndex].NickName = "L"
    ghenv.Component.Params.Input[inputIndex].Description = ""
    ghenv.Component.Params.Input[inputIndex].Optional = False
    inputIndex+=1
    
    ghenv.Component.Params.Input[inputIndex].Name = "Items"
    ghenv.Component.Params.Input[inputIndex].NickName = "I"
    ghenv.Component.Params.Input[inputIndex].Description = ""
    ghenv.Component.Params.Input[inputIndex].Optional = False
    inputIndex+=1
    
    #Outputs
    #--------------------------------------------------------------------------------------------
    outputIndex=0
    
    ghenv.Component.Params.Output[outputIndex].Name = "Contains"
    ghenv.Component.Params.Output[outputIndex].NickName = "R"
    ghenv.Component.Params.Output[outputIndex].Description = ""
    outputIndex+=1

R = False
for i in I:
    if i in L:
        R = True
# ---------- end contains ----------
ma = MassAddition(Input=contains)  # -> Result, PartialResults
lng = ListLength(List=contains)
equals = Equality(FirstNumber=ma.Result, SecondNumber=lng)  # -> Equality, Inequality
cull_3 = CullPattern(List=rep_3.Representation, CullPattern=equals.Equality)
rep_4 = ModelRepresentation(Representation=cull_3)  # -> Representation, Valid, Url, Mime, Lod, Tags
curdir = CSharpScript()  # -> D, S
# ---------- curdir: C# ----------
#region Usings
using System;
using System.Linq;
using System.Collections;
using System.Collections.Generic;
using System.Drawing;
using System.IO;

using Rhino;
using Rhino.Geometry;

using Grasshopper;
using Grasshopper.Kernel;
using Grasshopper.Kernel.Data;
using Grasshopper.Kernel.Types;
#endregion

public class Script_Instance : GH_ScriptInstance
{
    private void RunScript(ref object D, ref object S)
    {
        D = Path.GetDirectoryName(this.GrasshopperDocument.FilePath);
        S = Path.DirectorySeparatorChar;
    }
}
# ---------- end curdir ----------
rep_5 = ReplaceText(Text=rep_4.Url, Find="/", Replace=curdir.S, RecursiveReplace=False)
rp_3 = Representation(rep_4.Representation)
pa_ur = Text(rep_5)
ur = Url(rep_4.Url)
rp_4 = ClusterOutput(rp_3)
ur_2 = ClusterOutput(ur)
pa_ur_2 = ClusterOutput(pa_ur)

# ==== cluster LinearConnections: Create an array of linear connections where the connecting port is always going to the connected port.
pc = ClusterInput()
cdpo = ClusterInput()
cgpo = ClusterInput()
rotation = ClusterInput()
tilt = ClusterInput()
gap = ClusterInput()
shift = ClusterInput()
x = ClusterInput()
y = ClusterInput()
pc_2 = Piece(pc)
cdpo_2 = ConnectedPieceTypePortId(cdpo)
cgpo_2 = ConnectingPieceTypePortId(cgpo)
rotation_2 = Rotation(rotation)
tilt_2 = Tilt(tilt)
gap_2 = Gap(gap)
shift_2 = Shift(shift)
x_2 = X(x)
y_2 = Y(y)
shift_3 = ShiftList(List=pc_2, Shift=1, Wrap=invert(True))
shift_4 = ShiftList(List=pc_2, Shift="-1", Wrap=invert(True))
trim = TrimTree(Tree=shift_3, Depth=1)
trim_2 = TrimTree(Tree=shift_4, Depth=1)
pce = ModelPiece(Piece=trim_2)  # -> Piece, Valid, Id, TypeName, TypeVariant, Plane, DiagramPoint
pce_2 = ModelPiece(Piece=trim)  # -> Piece, Valid, Id, TypeName, TypeVariant, Plane, DiagramPoint
con = ModelConnection(
    ConnectedPieceId=pce.Id,
    ConnectedPieceTypePortId=cdpo_2,
    ConnectingPieceId=pce_2.Id,
    ConnectingPieceTypePortId=cgpo_2,
    Rotation=rotation_2,
    Tilt=tilt_2,
    Gap=gap_2,
    Shift=shift_2,
    X=x_2,
    Y=y_2)  # -> Connection, Valid, ConnectedPieceId, ConnectedPieceTypePortId, ConnectingPieceId, ConnectingPieceTypePortId, Rotation, Tilt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
co = Connection(con.Connection)
co_2 = ClusterOutput(co)

# ==== cluster RemovePieces: Remove all pieces (and all associated connections) from a design.
dn = ClusterInput()
ids = ClusterInput()
ids_2 = Text(ids)
dn_2 = Design(dn)
dsn = ModelDesign(Design=dn_2)  # -> Design, Valid, Name, Description, Icon, Image, Variant, View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

trim = TrimTree(Tree=dsn.Connections, Depth=1)
con = ModelConnection(Connection=trim)  # -> Connection, Valid, ConnectedPieceId, ConnectedPieceTypePortId, ConnectingPieceId, ConnectingPieceTypePortId, Rotation, Tilt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
expression = Expression(x=graft(con.ConnectingPieceId), y=ids_2, Expression="x=y")
expression_2 = Expression(x=graft(con.ConnectedPieceId), y=ids_2, Expression="x=y")
ma = MassAddition(Input=expression)  # -> Result, PartialResults
ma_2 = MassAddition(Input=expression_2)  # -> Result, PartialResults
or = GateOr(A=ma_2.Result, B=ma.Result)
trim_2 = TrimTree(Tree=or, Depth=1)
dispatch = Dispatch(List=trim, DispatchPattern=trim_2)  # -> ListA, ListB

trim_3 = TrimTree(Tree=dsn.Pieces, Depth=1)
pce = ModelPiece(Piece=trim_3)  # -> Piece, Valid, Id, TypeName, TypeVariant, Plane, DiagramPoint
expression_3 = Expression(x=graft(pce.Id), y=ids_2, Expression="x=y")
ma_3 = MassAddition(Input=expression_3)  # -> Result, PartialResults
trim_4 = TrimTree(Tree=ma_3.Result, Depth=1)
dispatch_2 = Dispatch(List=trim_3, DispatchPattern=trim_4)  # -> ListA, ListB

dsn_2 = ModelDesign(Design=dsn.Design, Pieces=dispatch_2.ListB, Connections=dispatch.ListB)  # -> Design, Valid, Name, Description, Icon, Image, Variant, View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
dn_3 = Design(dsn_2.Design)
pc = Piece(dispatch_2.ListA)
co = Connection(dispatch.ListA)
dn_4 = ClusterOutput(dn_3)
pc_2 = ClusterOutput(pc)
co_2 = ClusterOutput(co)

# ==== cluster SumQualities: Sum up the qualities of a type for each piece with this type in a design.
dn = ClusterInput()
ty = ClusterInput()
na = ClusterInput()
dn_2 = Design(dn)
ty_2 = Type(ty)
na_2 = Name(na)
dsn = ModelDesign(Design=dn_2)  # -> Design, Valid, Name, Description, Icon, Image, Variant, View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
typ = ModelType(Type=ty_2)  # -> Type, Valid, Name, Description, Icon, Image, Variant, Unit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
trim = TrimTree(Tree=dsn.Pieces, Depth=1)
qal = ModelQuality(Quality=typ.Qualities)  # -> Quality, Valid, Name, Value, Unit, Definition
pce = ModelPiece(Piece=trim)  # -> Piece, Valid, Id, TypeName, TypeVariant, Plane, DiagramPoint
expression = Expression(x=na_2, y=qal.Name, Expression="x=y")
expression_2 = Expression(x=graft(pce.TypeVariant), y=typ.Variant, Expression="x=y")
expression_3 = Expression(x=graft(pce.TypeName), y=typ.Name, Expression="x=y")
cull = CullPattern(List=typ.Qualities, CullPattern=expression)
and = GateAnd(A=expression_3, B=expression_2)
qal_2 = ModelQuality(Quality=cull)  # -> Quality, Valid, Name, flatten(Value), Unit, Definition
cull_2 = CullPattern(List=ty_2, CullPattern=and)
lng = ListLength(List=ty_2)
txt = Text(ty_2)
txt_2 = Text(cull_2)
series = Series(Start=0, Step=1, Count=lng)
expression_4 = Expression(x=txt_2, y=txt, Expression="x=y")
trim_2 = TrimTree(Tree=series, Depth=1)
cull_3 = CullPattern(List=trim_2, CullPattern=expression_4)
trim_3 = TrimTree(Tree=cull_3, Depth=1)
item = ListItem(List=qal_2.Value, Index=trim_3, Wrap=True)
clean = CleanTree(RemoveNulls=True, RemoveInvalid=True, RemoveEmpty=False, Tree=item)
ma = MassAddition(Input=clean)  # -> Result, PartialResults
num = Number(ma.Result)
ql = Quality(qal_2.Quality)
num_2 = ClusterOutput(num)
ql_2 = ClusterOutput(ql)
