# Grasshopper definition nakagin-capsule-tower.gh (Grasshopper 1.0.8)
# Copyright: GNU Lesser General Public License Version 3
# plug-ins: RhinoCodePluginGH, semio

# ----
# Reuse from others ↻
panel = Panel("metabolism")
ghbkit = GitHubKit_2(domain="github.com", account="usalu", repo=panel, tag="r24.12-1")  # -> remote_2, homepage_2

energy_global_warming_potential_kgco2e_k = ValueList({"Natural Gas": 0.201, "Heating Oil": 0.216, "Electricity Non-Renewable": 0.5, "Electricity Renewable": 0}, selected="Natural Gas")  # "Energy Global Warming Potential [kgCO2e/kWh]"
energy_global_warming_potential_kgco2e_k_2 = ValueList({"Natural Gas": 0.201, "Heating Oil": 0.216, "Electricity Non-Renewable": 0.5, "Electricity Renewable": 0}, selected="Electricity Non-Renewable")  # "Energy Global Warming Potential [kgCO2e/kWh]"
energy_price_kwh = ValueList({"Natural Gas": 0.095, "Heating Oil": 0.10, "Electricity Non-Renewable": 0.25, "Electrictiy Renewable": 0.35}, selected="Natural Gas")
energy_price_kwh_2 = ValueList({"Natural Gas": 0.095, "Heating Oil": 0.10, "Electricity Non-Renewable": 0.25, "Electrictiy Renewable": 0.35}, selected="Electricity Non-Renewable")

# ----
# Choose the
# Level of Detail ↻
lod = ValueList({"1to500", "1to200"}, selected="1to500")
tags = Panel("volume")

# ----
# If the internet changes,
# just clear your cache
# and recompute ↻
button = Button()
clear_cache = ClearCache(Run=button)

# ----
# Load from this computer or the internet ↓
panel_2 = Panel("Nakagin Capsule Tower")
toggle = BooleanToggle(False)
dsn = LoadDesign_2(uri=ghbkit.remote_2, na=panel_2, mm="model/vnd.3dm", lod=lod, tags=tags, R=toggle)  # -> dn_2, geo_2, ur_2, path_2, id_2, pln_2
geo = SemioGeometryPreview(geo=flatten(dsn.geo_2))
dsn_2 = LoadDesign(uri=ghbkit.remote_2, na="Capsule Dream", lod=lod, tags=tags, R=Toggle(False))  # -> dn_2, geo_2, ur_2, path_2, id_2, pln_2
geo_2 = SemioGeometryPreview(geo=flatten(dsn_2.geo_2))
typ = LoadType(uri=ghbkit.remote_2, na="Capsule", variant="s", lod=lod, tags=tags, R=Toggle(False))  # -> ty_2, geo_2, ur_2, path_2
geo_3 = SemioGeometryPreview(geo=flatten(typ.geo_2))

# ----
# Read metadata ↝
typ_2 = ModelType(Type=typ.ty_2)  # -> Type, Valid, Name, Description, Icon, Variant, Unit, Representations, Ports, Qualities
dsn_3 = ModelDesign(Design=dsn_2.dn_2)  # -> Design, Valid, Name, Description, Icon, Variant, Unit, Pieces, Connections, Qualities
trim = TrimTree(Tree=typ_2.Qualities, Depth=1)
trim_2 = TrimTree(Tree=dsn_3.Qualities, Depth=1)
qal = ModelQuality(Quality=trim)  # -> Quality, Valid, Name, Value, Unit, Definition
qal_2 = ModelQuality(Quality=trim_2)  # -> Quality, Valid, Name, Value, Unit, Definition
panel_3 = Panel(qal.Name)
panel_4 = Panel(qal_2.Name)
panel_5 = Panel(qal.Value)
panel_6 = Panel(qal_2.Value)
panel_7 = Panel(qal.Unit)
panel_8 = Panel(qal_2.Unit)
panel_9 = Panel(qal.Definition)
panel_10 = Panel(qal_2.Definition)

# ----
# Or create your own!
dir = CurrentDirectory()  # -> D
# ---------- dir: C# ----------
#region Usings
using System;
using System.Linq;
using System.Collections;
using System.Collections.Generic;
using System.Drawing;
using System.IO;

using Rhino;
using Rhino.Geometry;

using Grasshopper;
using Grasshopper.Kernel;
using Grasshopper.Kernel.Data;
using Grasshopper.Kernel.Types;
#endregion

public class Script_Instance : GH_ScriptInstance
{
    private void RunScript(ref object D)
    {
        D = Path.GetDirectoryName(this.GrasshopperDocument.FilePath);
    }
}
# ---------- end dir ----------
capsule_dream = CapsuleDream(
    path=dir,
    version="r24.12-1",
    heating_energy_price_cent_kwh=energy_price_kwh,
    heating_efficiency_factor=Slider(0.9, range=0.5..4),
    heating_global_warming_potential_kgco2e=energy_global_warming_potential_kgco2e_k,
    cooling_energy_price_cent_kwh=energy_price_kwh_2,
    cooling_efficiency_factor=Slider(0.9, range=0.5..4),
    cooling_global_warming_potential_kgco2e=energy_global_warming_potential_kgco2e_k_2,
    electrictiy_energy_price_cent_kwh=energy_price_kwh_2,
    electrictiy_global_warming_potential_kgc=energy_global_warming_potential_kgco2e_k_2)  # -> dn_2, effective_floor_area_m²_6, specific_operational_global_warming_pote_6, construction_cost_mio_6, return_a_6, construction_global_warming_potential_tc_6, operational_cost_mio_a_6, operational_global_warming_potential_tco_6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; disabled

# ----
# Change ↻
panel_11 = Panel("Capsule with Balcony")
rpltyp = ReplaceType(dn=dsn.dn_2, old_na="Capsule", new_na=panel_11)  # disabled
dsn_geo = DesignToGeometry(dn=rpltyp, uri=ghbkit.remote_2, R=toggle, lod=lod, tags=tags)
geo_4 = SemioGeometryPreview(geo=flatten(dsn_geo))

# ==== cluster SemioGeometryPreview: semio styled preview of geometry.
geo = ClusterInput()
geo_2 = Geometry(flatten(geo))
debrep = DeconstructBrep(Brep=geo_2)  # -> Faces, Edges, Vertices
preview = CustomPreview(Geometry=flatten(debrep.Edges), Material=ColourSwatch(SwatchColor=RGB(0, 0, 0)))
preview_2 = CustomPreview(Geometry=flatten(debrep.Faces), Material=ColourSwatch(SwatchColor=RGB(255, 255, 255)))

# ==== cluster LoadDesign: Load the design. If the representations are urls to files then the geometry is loaded for a certain level of details and tags.
uri = ClusterInput()
na = ClusterInput()
variant = ClusterInput()
lod = ClusterInput()
tags = ClusterInput()
R = ClusterInput()
uri_2 = Uri(uri)
na_2 = Name(na)
variant_2 = Variant(variant)
lod_2 = Lod(lod)
tags_2 = Tags(tags)
R_2 = Run(R)
kit = LoadKit(Uri=uri_2, Run=R_2)  # -> Success, Kit, LocalDirectory
kit_2 = ModelKit(Kit=kit.Kit)  # -> Kit, Valid, Name, Description, Icon, Remote, Homepage, Types, Designs, Designs_2
mime = Mime({".stl": "model/stl", ".obj": "model/obj", ".glb": "model/gltf-binary", ".gltf": "model/gltf+json", ".3dm": "model/vnd.3dm", ".speckle": "model/vnd.speckle+json", ".png": "image/png", ".jpg": "image/jpeg", ".jpeg": "image/jpeg", ".svg": "image/svg+xml", ".pdf": "application/pdf", ".zip": "application/zip", ".json": "application/json", ".csv": "text/csv", ".txt": "text/plain"}, selected=".3dm")
trim = TrimTree(Tree=kit_2.Types, Depth=1)
trim_2 = TrimTree(Tree=kit_2.Designs, Depth=1)
seldsn = SelectDesign(dn=trim_2, na=na_2, variant=variant_2)
shwdsn = ShowDesign(dn=seldsn, ty=trim, mm=mime, lod=lod_2, tags=tags_2)  # -> id_2, ur_2, pa_ur_2, pln_2
curdir = CSharpScript()  # -> D, S; same code as curdir
concat = Concatenate(FragmentA=kit.LocalDirectory, FragmentB=curdir.S, FragmentC=shwdsn.pa_ur_2)
loageo = LoadGeometry(path=flatten(concat), pln=flatten(shwdsn.pln_2))
pln = Plane(flatten(shwdsn.pln_2))
path = FilePath(concat)
id = Id(shwdsn.id_2)
dn = Design(seldsn)
geo = Geometry(loageo)
ur = Url(shwdsn.ur_2)
dn_2 = ClusterOutput(dn)
geo_2 = ClusterOutput(geo)
ur_2 = ClusterOutput(ur)
path_2 = ClusterOutput(path)
id_2 = ClusterOutput(id)
pln_2 = ClusterOutput(pln)

# ==== cluster LoadType: Load the type. If the representations are urls to files then the geometry is loaded for a certain level of details and tags.
uri = ClusterInput()
na = ClusterInput()
variant = ClusterInput()
lod = ClusterInput()
tags = ClusterInput()
R = ClusterInput()
uri_2 = Uri(uri)
lod_2 = Lod(lod)
tags_2 = Tags(tags)
R_2 = Run(R)
na_2 = Name(na)
variant_2 = Variant(variant)
kit = LoadKit(Uri=uri_2, Run=R_2)  # -> Success, Kit, LocalDirectory
kit_2 = ModelKit(Kit=kit.Kit)  # -> Kit, Valid, Name, Description, Icon, Remote, Homepage, Types, Designs, Designs_2
trim = TrimTree(Tree=kit_2.Types, Depth=1)
seltyp = SelectType(ty=trim, na=na_2, variant=variant_2)
mime = Mime({".stl": "model/stl", ".obj": "model/obj", ".glb": "model/gltf-binary", ".gltf": "model/gltf+json", ".3dm": "model/vnd.3dm", ".speckle": "model/vnd.speckle+json", ".png": "image/png", ".jpg": "image/jpeg", ".jpeg": "image/jpeg", ".svg": "image/svg+xml", ".pdf": "application/pdf", ".zip": "application/zip", ".json": "application/json", ".csv": "text/csv", ".txt": "text/plain"}, selected=".3dm")
typ = ModelType(Type=seltyp)  # -> Type, Valid, Name, Description, Icon, Variant, Unit, Representations, Ports, Qualities
trim_2 = TrimTree(Tree=typ.Representations, Depth=1)
selrep = SelectRepresentation(rp=trim_2, mm=mime, lod=lod_2, tags=tags_2)  # -> rp_4, ur_2, pa_ur_2
sep = CurrentDirectory()  # -> S
# ---------- sep: C# ----------
#region Usings
using System;
using System.Linq;
using System.Collections;
using System.Collections.Generic;
using System.Drawing;
using System.IO;

using Rhino;
using Rhino.Geometry;

using Grasshopper;
using Grasshopper.Kernel;
using Grasshopper.Kernel.Data;
using Grasshopper.Kernel.Types;
#endregion

public class Script_Instance : GH_ScriptInstance
{
    private void RunScript(ref object S)
    {
        S = Path.DirectorySeparatorChar;
    }
}
# ---------- end sep ----------
concat = Concatenate(FragmentA=kit.LocalDirectory, FragmentB=sep, FragmentC=selrep.pa_ur_2)
xy = XYPlane(Origin=Point(0, 0, 0))
loageo = LoadGeometry(path=flatten(concat), pln=flatten(xy))
ty = Type(typ.Type)
geo = Geometry(loageo)
ur = Url(selrep.ur_2)
path = FilePath(concat)
ty_2 = ClusterOutput(ty)
geo_2 = ClusterOutput(geo)
ur_2 = ClusterOutput(ur)
path_2 = ClusterOutput(path)

# ==== cluster CapsuleDream
path = ClusterInput()
version = ClusterInput()
heating_energy_price_cent_kwh = ClusterInput()
heating_efficiency_factor = ClusterInput()
heating_global_warming_potential_kgco2e = ClusterInput()  # "Heating Global Warming Potential [kgCO2e/kWh]"
cooling_energy_price_cent_kwh = ClusterInput()
cooling_efficiency_factor = ClusterInput()
cooling_global_warming_potential_kgco2e = ClusterInput()  # "Cooling Global Warming Potential [kgCO2e/kWh]"
electrictiy_energy_price_cent_kwh = ClusterInput()
electrictiy_global_warming_potential_kgc = ClusterInput()  # "Electrictiy Global Warming Potential [kgCO2e/kWh]"
path_2 = FilePath(path)
version_2 = Text(version)
heating_energy_price_cent_kwh_2 = Number(heating_energy_price_cent_kwh)
heating_efficiency_factor_2 = Number(heating_efficiency_factor)
heating_global_warming_potential_kgco2e_2 = Number(heating_global_warming_potential_kgco2e)  # "Heating Global Warming Potential [kgCO2e/kWh]"
cooling_energy_price_cent_kwh_2 = Number(cooling_energy_price_cent_kwh)
cooling_efficiency_factor_2 = Number(cooling_efficiency_factor)
cooling_global_warming_potential_kgco2e_2 = Number(cooling_global_warming_potential_kgco2e)  # "Cooling Global Warming Potential [kgCO2e/kWh]"
electrictiy_energy_price_cent_kwh_2 = Number(electrictiy_energy_price_cent_kwh)
electrictiy_global_warming_potential_kgc_2 = Number(electrictiy_global_warming_potential_kgc)  # "Electrictiy Global Warming Potential [kgCO2e/kWh]"

genes = GenePool(Decimals=0, Maximum=8, Minimum=0, Value=[8, 8, 8, 8, 8, 8, 8, 8, 8, 8, 8])
# Change parameters
genes_2 = GenePool(Decimals=0, Maximum=8, Minimum=0, Value=[6, 0, 0, 6, 0, 3, 6, 6, 0])
genes_3 = GenePool(Decimals=0, Maximum=8, Minimum=0, Value=[6, 6, 6, 6, 6, 6, 6, 7, 7])
genes_4 = GenePool(Decimals=0, Maximum=8, Minimum=0, Value=[6, 0, 0, 0, 6, 6, 0, 6, 0, 6, 3])

tambour_tilt = Slider(-2, range=-360..360)
tambour_gap = Slider(7.5, range=-10..10)
tambour_shift = Slider(-0.5, range=-10..10)
capsule_rotation = Slider(3, range=-360..360)
tambour_rotation = Slider(15, range=-360..360)
capsule_tilt = Slider(2, range=-360..360)
capsule_gap = Slider(2.5, range=-10..10)
capsule_shift = Slider(0.5, range=-10..10)
capital_rotation = Slider(0, range=-360..360)
capital_tilt = Slider(0, range=-360..360)
capital_gap = Slider(5, range=-10..10)
capital_shift = Slider(0, range=-10..10)
shaft_rotation = Slider(10, range=-360..360)
shaft_tilt = Slider(5, range=-360..360)
shaft_gap = Slider(5, range=-10..10)
shaft_shift = Slider(5, range=-10..10)

pln = Plane(Plane(origin=(137.5, 110, 0), x=(0, -1, 0), y=(1, 0, 0)))
list = ValueList({"Box": 0, "Balcony": 1, "Ellipsoid": 2, "Trapezoid": 3}, selected="Ellipsoid")

capsule_rotation_2 = Slider(0, range=-360..360)
tambour_rotation_2 = Slider(0, range=-360..360)
tambour_tilt_2 = Slider(0, range=-360..360)
tambour_gap_2 = Slider(0, range=-10..10)
tambour_shift_2 = Slider(0, range=-10..10)
capsule_tilt_2 = Slider(0, range=-360..360)
capsule_gap_2 = Slider(0, range=-10..10)
capsule_shift_2 = Slider(0, range=-10..10)
capital_tilt_2 = Slider(0, range=-360..360)
capital_gap_2 = Slider(0, range=-10..10)
shaft_tilt_2 = Slider(0, range=-360..360)
shaft_gap_2 = Slider(0, range=-10..10)
shaft_shift_2 = Slider(0, range=-10..10)
capital_rotation_2 = Slider(0, range=-360..360)
capital_shift_2 = Slider(0, range=-10..10)
shaft_rotation_2 = Slider(0, range=-360..360)

shaft_rotation_3 = Slider(-3, range=-360..360)
tambour_rotation_3 = Slider(3, range=-360..360)
shaft_shift_3 = Slider(-1, range=-10..10)

pln_2 = Plane(Plane(origin=(0, 27.5, 0), x=(0, 1, 0), y=(-1, 0, 0)))
list_2 = ValueList({"Box": 0, "Balcony": 1, "Ellipsoid": 2, "Trapezoid": 3}, selected="Box")

pln_3 = Plane(Plane(origin=(110, 0, 0), x=(-1, 0, 0), y=(0, -1, 0)))
list_3 = ValueList({"Box": 0, "Balcony": 1, "Ellipsoid": 2, "Trapezoid": 3}, selected="Trapezoid")

tambour_shift_3 = Slider(0.5, range=-10..10)
genes_5 = GenePool(Decimals=0, Maximum=8, Minimum=0, Value=[7, 7, 7, 7, 7, 7, 7, 7, 7, 7, 7])

pln_4 = Plane(PlaneXY(27.5, 137.5, 0))
list_4 = ValueList({"Box": 0, "Balcony": 1, "Ellipsoid": 2, "Trapezoid": 3}, selected="Balcony")

# ----
# Create, delete or load the kit
panel = Panel("Everything for metabolistic architecture.")
ghbkit = GitHubKit(account="usalu", repo="metabolism", tag=version_2)  # -> remote_2, homepage_2
ty = Type([null x45])
delete_kit = BooleanToggle(False)
create_kit = BooleanToggle(True)
load_kit = BooleanToggle(True)
kit = DeleteKit(Uri=path_2, Run=delete_kit)
kit_2 = LoadKit(Uri=path_2, Run=load_kit)  # -> Success, Kit, LocalDirectory
kit_3 = ModelKit(Kit=kit_2.Kit)  # -> Kit, Valid, Name, Description, Icon, Version, Remote, Homepage, Types, Designs
trim = TrimTree(Tree=kit_3.Types, Depth=1)

base_with_twin_capsule_towers_with_capit = BaseWithTwinCapsuleTowersWithCapital(
    ty=trim,
    name="Flying Baroque Capsule Tower",
    variant="Axonometry",
    capsule_type=list,
    base_plane=pln,
    capsule_corner_ne=genes_2,
    capsule_corner_se=genes_3,
    capsule_corner_sw=genes,
    capsule_corner_nw=genes_4,
    shaft_rotation=shaft_rotation,
    shaft_tilt=shaft_tilt,
    shaft_gap=shaft_gap,
    shaft_shift=shaft_shift,
    tambour_rotation=tambour_rotation,
    tambour_tilt=tambour_tilt,
    tambour_gap=tambour_gap,
    tambour_shift=tambour_shift,
    capsule_rotation=capsule_rotation,
    capsule_tilt=capsule_tilt,
    capsule_gap=capsule_gap,
    capsule_shift=capsule_shift,
    capital_rotation=capital_rotation,
    capital_tilt=capital_tilt,
    capital_gap=capital_gap,
    capital_shift=capital_shift,
    heating_energy_price_kwh=heating_energy_price_cent_kwh_2,
    heating_efficiency_factor=heating_efficiency_factor_2,
    heating_global_warming_potential_kgco2e=heating_global_warming_potential_kgco2e_2,
    cooling_energy_price_kwh=cooling_efficiency_factor_2,
    cooling_efficiency_factor=cooling_efficiency_factor_2,
    cooling_global_warming_potential_kgco2e=cooling_global_warming_potential_kgco2e_2,
    electrictiy_energy_price_cent_kwh=electrictiy_energy_price_cent_kwh_2,
    electrictiy_global_warming_potential_kgc=electrictiy_global_warming_potential_kgc_2)  # -> dn, effective_floor_area_m²_2, specific_operational_global_warming_pote_2, construction_cost_mio_2, return_a_2, construction_global_warming_potential_tc_2, operational_cost_mio_a_2, operational_global_warming_potential_tco_2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; "Base with Twin Capsule Towers with Capital"
base_with_twin_capsule_towers_with_capit_2 = BaseWithTwinCapsuleTowersWithCapital(
    ty=trim,
    name="Sharp Capsule Tower",
    capsule_type=list_3,
    base_plane=pln_3,
    capsule_corner_ne=genes_2,
    capsule_corner_se=genes_3,
    capsule_corner_sw=genes,
    capsule_corner_nw=genes_4,
    shaft_rotation=shaft_rotation_3,
    shaft_tilt=shaft_tilt_2,
    shaft_gap=shaft_gap_2,
    shaft_shift=shaft_shift_3,
    tambour_rotation=tambour_rotation_3,
    tambour_tilt=tambour_tilt_2,
    tambour_gap=tambour_gap_2,
    tambour_shift=tambour_shift_2,
    capsule_rotation=capsule_rotation_2,
    capsule_tilt=capsule_tilt_2,
    capsule_gap=capsule_gap_2,
    capsule_shift=capsule_shift_2,
    capital_rotation=capital_rotation_2,
    capital_tilt=capital_tilt_2,
    capital_gap=capital_gap_2,
    capital_shift=capital_shift_2,
    heating_energy_price_kwh=heating_energy_price_cent_kwh_2,
    heating_efficiency_factor=heating_efficiency_factor_2,
    heating_global_warming_potential_kgco2e=heating_global_warming_potential_kgco2e_2,
    cooling_energy_price_kwh=cooling_energy_price_cent_kwh_2,
    cooling_efficiency_factor=cooling_efficiency_factor_2,
    cooling_global_warming_potential_kgco2e=cooling_global_warming_potential_kgco2e_2,
    electrictiy_energy_price_cent_kwh=electrictiy_energy_price_cent_kwh_2,
    electrictiy_global_warming_potential_kgc=electrictiy_global_warming_potential_kgc_2)  # -> dn, effective_floor_area_m²_2, specific_operational_global_warming_pote_2, construction_cost_mio_2, return_a_2, construction_global_warming_potential_tc_2, operational_cost_mio_a_2, operational_global_warming_potential_tco_2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; "Base with Twin Capsule Towers with Capital"
base_with_twin_capsule_towers_with_capit_3 = BaseWithTwinCapsuleTowersWithCapital(
    ty=trim,
    name="Nakagin Capsule Tower",
    variant="Balcony",
    capsule_type=list_4,
    base_plane=pln_4,
    capsule_corner_ne=genes_2,
    capsule_corner_se=genes_3,
    capsule_corner_sw=genes_5,
    capsule_corner_nw=genes_4,
    shaft_rotation=shaft_rotation_2,
    shaft_tilt=shaft_tilt_2,
    shaft_gap=shaft_gap_2,
    shaft_shift=shaft_shift_2,
    tambour_rotation=tambour_rotation_2,
    tambour_tilt=tambour_tilt_2,
    tambour_gap=tambour_gap_2,
    tambour_shift=tambour_shift_3,
    capsule_rotation=capsule_rotation_2,
    capsule_tilt=capsule_tilt_2,
    capsule_gap=Slider(0.15, range=0..1),
    capsule_shift=Slider(0.2, range=-1..1),
    capital_rotation=capital_rotation_2,
    capital_tilt=capital_tilt_2,
    capital_gap=capital_gap_2,
    capital_shift=capital_shift_2,
    heating_energy_price_kwh=heating_energy_price_cent_kwh_2,
    heating_efficiency_factor=heating_efficiency_factor_2,
    heating_global_warming_potential_kgco2e=heating_global_warming_potential_kgco2e_2,
    cooling_energy_price_kwh=cooling_energy_price_cent_kwh_2,
    cooling_efficiency_factor=cooling_efficiency_factor_2,
    cooling_global_warming_potential_kgco2e=cooling_global_warming_potential_kgco2e_2,
    electrictiy_energy_price_cent_kwh=electrictiy_energy_price_cent_kwh_2,
    electrictiy_global_warming_potential_kgc=electrictiy_global_warming_potential_kgc_2)  # -> dn, effective_floor_area_m²_2, specific_operational_global_warming_pote_2, construction_cost_mio_2, return_a_2, construction_global_warming_potential_tc_2, operational_cost_mio_a_2, operational_global_warming_potential_tco_2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; "Base with Twin Capsule Towers with Capital"
base_with_twin_capsule_towers_with_capit_4 = BaseWithTwinCapsuleTowersWithCapital(
    ty=trim,
    name="Nakagin Capsule Tower",
    capsule_type=list_2,
    base_plane=pln_2,
    capsule_corner_ne=genes_2,
    capsule_corner_se=genes_3,
    capsule_corner_sw=genes,
    capsule_corner_nw=genes_4,
    shaft_rotation=shaft_rotation_2,
    shaft_tilt=shaft_tilt_2,
    shaft_gap=shaft_gap_2,
    shaft_shift=shaft_shift_2,
    tambour_rotation=tambour_rotation_2,
    tambour_tilt=tambour_tilt_2,
    tambour_gap=tambour_gap_2,
    tambour_shift=tambour_shift_2,
    capsule_rotation=capsule_rotation_2,
    capsule_tilt=capsule_tilt_2,
    capsule_gap=capsule_gap_2,
    capsule_shift=capsule_shift_2,
    capital_rotation=capital_rotation_2,
    capital_tilt=capital_tilt_2,
    capital_gap=capital_gap_2,
    capital_shift=capital_shift_2,
    heating_energy_price_kwh=heating_energy_price_cent_kwh_2,
    heating_efficiency_factor=heating_efficiency_factor_2,
    heating_global_warming_potential_kgco2e=heating_global_warming_potential_kgco2e_2,
    cooling_energy_price_kwh=cooling_energy_price_cent_kwh_2,
    cooling_efficiency_factor=cooling_efficiency_factor_2,
    cooling_global_warming_potential_kgco2e=cooling_global_warming_potential_kgco2e_2,
    electrictiy_energy_price_cent_kwh=electrictiy_energy_price_cent_kwh_2,
    electrictiy_global_warming_potential_kgc=electrictiy_global_warming_potential_kgc_2)  # -> dn, effective_floor_area_m²_2, specific_operational_global_warming_pote_2, construction_cost_mio_2, return_a_2, construction_global_warming_potential_tc_2, operational_cost_mio_a_2, operational_global_warming_potential_tco_2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; "Base with Twin Capsule Towers with Capital"

return_a = Panel(base_with_twin_capsule_towers_with_capit_4.return_a_2)
operational_cost_mio_a = Panel(base_with_twin_capsule_towers_with_capit_4.operational_cost_mio_a_2)
effective_floor_area_m² = Panel(base_with_twin_capsule_towers_with_capit_4.effective_floor_area_m²_2)
construction_cost_mio = Panel(base_with_twin_capsule_towers_with_capit_4.construction_cost_mio_2)
income_mio_a = Panel(base_with_twin_capsule_towers_with_capit_4.income_mio_a_2)
operational_energy_cost_a = Panel(base_with_twin_capsule_towers_with_capit_4.operational_energy_cost_a_2)
maintenance_expenses_mio_a = Panel(base_with_twin_capsule_towers_with_capit_4.maintenance_expenses_mio_a_2)
specific_operational_global_warming_pote = Panel(base_with_twin_capsule_towers_with_capit_4.specific_operational_global_warming_pote_2)  # "Specific Operational Global Warming Potential [kgCO2e/m²a]"
construction_global_warming_potential_tc = Panel(base_with_twin_capsule_towers_with_capit_4.construction_global_warming_potential_tc_2)  # "Construction Global Warming Potential [tCO2e]"
operational_global_warming_potential_tco = Panel(base_with_twin_capsule_towers_with_capit_4.operational_global_warming_potential_tco_2)  # "Operational Global Warming Potential [tCO2e/a]"
specific_energy_demand_kwh_m²a = Panel(base_with_twin_capsule_towers_with_capit_4.specific_energy_demand_kwh_m²a_2)
heating_energy_demand_mwh_a = Panel(base_with_twin_capsule_towers_with_capit_4.heating_energy_demand_mwh_a_2)
cooling_energy_demand_mwh_a = Panel(base_with_twin_capsule_towers_with_capit_4.cooling_energy_demand_mwh_a_2)
technical_equipment_energy_demand_mwh_a = Panel(base_with_twin_capsule_towers_with_capit_4.technical_equipment_energy_demand_mwh_a_2)

# ----
# Interpolate
number_slider = Slider(0.33, range=0..1)
expression = Expression(x=number_slider, Expression="1-x")
inpdsn = InterpolateDesigns(S=base_with_twin_capsule_towers_with_capit_4.dn, T=base_with_twin_capsule_towers_with_capit_3.dn, t=number_slider)  # -> dn_s_u_t_2, dn_s_t_2, dn_t_s_2
inpdsn_2 = InterpolateDesigns(S=base_with_twin_capsule_towers_with_capit_4.dn, T=base_with_twin_capsule_towers_with_capit_3.dn, t=expression)  # -> dn_s_u_t_2, dn_s_t_2, dn_t_s_2
inpdsn_3 = InterpolateDesigns(S=base_with_twin_capsule_towers_with_capit_4.dn, T=base_with_twin_capsule_towers_with_capit_2.dn, t=number_slider)  # -> dn_s_u_t_2, dn_s_t_2, dn_t_s_2
inpdsn_4 = InterpolateDesigns(S=base_with_twin_capsule_towers_with_capit_4.dn, T=base_with_twin_capsule_towers_with_capit_2.dn, t=expression)  # -> dn_s_u_t_2, dn_s_t_2, dn_t_s_2
inpdsn_5 = InterpolateDesigns(S=base_with_twin_capsule_towers_with_capit_3.dn, T=base_with_twin_capsule_towers_with_capit.dn, t=number_slider)  # -> dn_s_u_t_2, dn_s_t_2, dn_t_s_2
inpdsn_6 = InterpolateDesigns(S=base_with_twin_capsule_towers_with_capit_3.dn, T=base_with_twin_capsule_towers_with_capit.dn, t=expression)  # -> dn_s_u_t_2, dn_s_t_2, dn_t_s_2
inpdsn_7 = InterpolateDesigns(S=base_with_twin_capsule_towers_with_capit_2.dn, T=base_with_twin_capsule_towers_with_capit.dn, t=number_slider)  # -> dn_s_u_t_2, dn_s_t_2, dn_t_s_2
inpdsn_8 = InterpolateDesigns(S=base_with_twin_capsule_towers_with_capit_2.dn, T=base_with_twin_capsule_towers_with_capit.dn, t=expression)  # -> dn_s_u_t_2, dn_s_t_2, dn_t_s_2
inpdsn_9 = InterpolateDesigns(S=base_with_twin_capsule_towers_with_capit_3.dn, T=base_with_twin_capsule_towers_with_capit_2.dn, t=number_slider)  # -> dn_s_u_t_2, dn_s_t_2, dn_t_s_2
inpdsn_10 = InterpolateDesigns(S=base_with_twin_capsule_towers_with_capit_3.dn, T=base_with_twin_capsule_towers_with_capit_2.dn, t=expression)  # -> dn_s_u_t_2, dn_s_t_2, dn_t_s_2
inpdsn_11 = InterpolateDesigns(S=base_with_twin_capsule_towers_with_capit_4.dn, T=base_with_twin_capsule_towers_with_capit.dn, t=number_slider)  # -> dn_s_u_t_2, dn_s_t_2, dn_t_s_2
inpdsn_12 = InterpolateDesigns(S=base_with_twin_capsule_towers_with_capit_4.dn, T=base_with_twin_capsule_towers_with_capit.dn, t=expression)  # -> dn_s_u_t_2, dn_s_t_2, dn_t_s_2

effective_floor_area_m²_2 = Panel(base_with_twin_capsule_towers_with_capit_3.effective_floor_area_m²_2)
construction_cost_mio_2 = Panel(base_with_twin_capsule_towers_with_capit_3.construction_cost_mio_2)
return_a_2 = Panel(base_with_twin_capsule_towers_with_capit_3.return_a_2)
income_mio_a_2 = Panel(base_with_twin_capsule_towers_with_capit_3.income_mio_a_2)
operational_cost_mio_a_2 = Panel(base_with_twin_capsule_towers_with_capit_3.operational_cost_mio_a_2)
operational_energy_cost_a_2 = Panel(base_with_twin_capsule_towers_with_capit_3.operational_energy_cost_a_2)
maintenance_expenses_mio_a_2 = Panel(base_with_twin_capsule_towers_with_capit_3.maintenance_expenses_mio_a_2)
# Evaluate metrics
specific_operational_global_warming_pote_2 = Panel(base_with_twin_capsule_towers_with_capit_3.specific_operational_global_warming_pote_2)  # "Specific Operational Global Warming Potential [kgCO2e/m²a]"
construction_global_warming_potential_tc_2 = Panel(base_with_twin_capsule_towers_with_capit_3.construction_global_warming_potential_tc_2)  # "Construction Global Warming Potential [tCO2e]"
operational_global_warming_potential_tco_2 = Panel(base_with_twin_capsule_towers_with_capit_3.operational_global_warming_potential_tco_2)  # "Operational Global Warming Potential [tCO2e/a]"
heating_energy_demand_mwh_a_2 = Panel(base_with_twin_capsule_towers_with_capit_3.heating_energy_demand_mwh_a_2)
cooling_energy_demand_mwh_a_2 = Panel(base_with_twin_capsule_towers_with_capit_3.cooling_energy_demand_mwh_a_2)
technical_equipment_energy_demand_mwh_a_2 = Panel(base_with_twin_capsule_towers_with_capit_3.technical_equipment_energy_demand_mwh_a_2)
specific_energy_demand_kwh_m²a_2 = Panel(base_with_twin_capsule_towers_with_capit_3.specific_energy_demand_kwh_m²a_2)

# ----
# Merge designs
merge = Merge(
    Data1=base_with_twin_capsule_towers_with_capit_4.dn,
    Data2=base_with_twin_capsule_towers_with_capit_3.dn,
    Data3=base_with_twin_capsule_towers_with_capit.dn,
    Data4=base_with_twin_capsule_towers_with_capit_2.dn,
    Data5=inpdsn.dn_s_u_t_2,
    Data6=inpdsn_2.dn_s_u_t_2,
    Data7=inpdsn_3.dn_s_u_t_2,
    Data8=inpdsn_4.dn_s_u_t_2,
    Data9=inpdsn_5.dn_s_u_t_2,
    Data10=inpdsn_6.dn_s_u_t_2,
    Data11=inpdsn_7.dn_s_u_t_2,
    Data12=inpdsn_8.dn_s_u_t_2,
    Data13=inpdsn_9.dn_s_u_t_2,
    Data14=inpdsn_10.dn_s_u_t_2,
    Data15=inpdsn_11.dn_s_u_t_2,
    Data16=inpdsn_12.dn_s_u_t_2)
dsns = MergeDesigns(dn=merge, na="Capsule Dream")

return_a_3 = Panel(base_with_twin_capsule_towers_with_capit.return_a_2)
operational_cost_mio_a_3 = Panel(base_with_twin_capsule_towers_with_capit.operational_cost_mio_a_2)
maintenance_expenses_mio_a_3 = Panel(base_with_twin_capsule_towers_with_capit.maintenance_expenses_mio_a_2)
effective_floor_area_m²_3 = Panel(base_with_twin_capsule_towers_with_capit.effective_floor_area_m²_2)
construction_cost_mio_3 = Panel(base_with_twin_capsule_towers_with_capit.construction_cost_mio_2)
income_mio_a_3 = Panel(base_with_twin_capsule_towers_with_capit.income_mio_a_2)
operational_energy_cost_a_3 = Panel(base_with_twin_capsule_towers_with_capit.operational_energy_cost_a_2)
operational_global_warming_potential_tco_3 = Panel(base_with_twin_capsule_towers_with_capit.operational_global_warming_potential_tco_2)  # "Operational Global Warming Potential [tCO2e/a]"
technical_equipment_energy_demand_mwh_a_3 = Panel(base_with_twin_capsule_towers_with_capit.technical_equipment_energy_demand_mwh_a_2)
specific_operational_global_warming_pote_3 = Panel(base_with_twin_capsule_towers_with_capit.specific_operational_global_warming_pote_2)  # "Specific Operational Global Warming Potential [kgCO2e/m²a]"
construction_global_warming_potential_tc_3 = Panel(base_with_twin_capsule_towers_with_capit.construction_global_warming_potential_tc_2)  # "Construction Global Warming Potential [tCO2e]"
specific_energy_demand_kwh_m²a_3 = Panel(base_with_twin_capsule_towers_with_capit.specific_energy_demand_kwh_m²a_2)
heating_energy_demand_mwh_a_3 = Panel(base_with_twin_capsule_towers_with_capit.heating_energy_demand_mwh_a_2)
cooling_energy_demand_mwh_a_3 = Panel(base_with_twin_capsule_towers_with_capit.cooling_energy_demand_mwh_a_2)

return_a_4 = Panel(base_with_twin_capsule_towers_with_capit_2.return_a_2)
operational_cost_mio_a_4 = Panel(base_with_twin_capsule_towers_with_capit_2.operational_cost_mio_a_2)
effective_floor_area_m²_4 = Panel(base_with_twin_capsule_towers_with_capit_2.effective_floor_area_m²_2)
construction_cost_mio_4 = Panel(base_with_twin_capsule_towers_with_capit_2.construction_cost_mio_2)
income_mio_a_4 = Panel(base_with_twin_capsule_towers_with_capit_2.income_mio_a_2)
operational_energy_cost_a_4 = Panel(base_with_twin_capsule_towers_with_capit_2.operational_energy_cost_a_2)
maintenance_expenses_mio_a_4 = Panel(base_with_twin_capsule_towers_with_capit_2.maintenance_expenses_mio_a_2)
specific_operational_global_warming_pote_4 = Panel(base_with_twin_capsule_towers_with_capit_2.specific_operational_global_warming_pote_2)  # "Specific Operational Global Warming Potential [kgCO2e/m²a]"
construction_global_warming_potential_tc_4 = Panel(base_with_twin_capsule_towers_with_capit_2.construction_global_warming_potential_tc_2)  # "Construction Global Warming Potential [tCO2e]"
operational_global_warming_potential_tco_4 = Panel(base_with_twin_capsule_towers_with_capit_2.operational_global_warming_potential_tco_2)  # "Operational Global Warming Potential [tCO2e/a]"
specific_energy_demand_kwh_m²a_4 = Panel(base_with_twin_capsule_towers_with_capit_2.specific_energy_demand_kwh_m²a_2)
heating_energy_demand_mwh_a_4 = Panel(base_with_twin_capsule_towers_with_capit_2.heating_energy_demand_mwh_a_2)
cooling_energy_demand_mwh_a_4 = Panel(base_with_twin_capsule_towers_with_capit_2.cooling_energy_demand_mwh_a_2)
technical_equipment_energy_demand_mwh_a_4 = Panel(base_with_twin_capsule_towers_with_capit_2.technical_equipment_energy_demand_mwh_a_2)

# ----
# Do some calculations based on metadata
egyasm = PerformanceAssessment(
    dn=dsns,
    ty=trim,
    heating_energy_price_cent_kwh=heating_energy_price_cent_kwh_2,
    heating_efficiency_factor=heating_efficiency_factor_2,
    heating_global_warming_potential_kgco2e=heating_global_warming_potential_kgco2e_2,
    cooling_energy_price_cent_kwh=cooling_energy_price_cent_kwh_2,
    cooling_efficiency_factor=cooling_efficiency_factor_2,
    cooling_global_warming_potential_kgco2e=cooling_global_warming_potential_kgco2e_2,
    electrictiy_energy_price_cent_kwh=electrictiy_energy_price_cent_kwh_2,
    electrictiy_global_warming_potential_kgc=electrictiy_global_warming_potential_kgc_2)  # -> dn_4, effective_floor_area_m²_2, specific_operational_global_warming_pote_2, construction_cost_2, return_a_2, construction_global_warming_potential_kg_2, operational_cost_a_2, operational_global_warming_potential_kgc_2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
expression_2 = Expression(x=egyasm.construction_cost_2, Expression="x/1000000")
expression_3 = Expression(x=egyasm.operational_cost_a_2, Expression="x/1000000")
expression_4 = Expression(x=egyasm.maintenance_expenses_a_2, Expression="x/1000000")
expression_5 = Expression(x=egyasm.income_2, Expression="x/1000000")
expression_6 = Expression(x=egyasm.return_a_2, Expression="x/1000000")
expression_7 = Expression(x=egyasm.operational_energy_cost_a_2, Expression="x/1000000")
expression_8 = Expression(x=egyasm.construction_global_warming_potential_kg_2, Expression="x/1000")
expression_9 = Expression(x=egyasm.operational_global_warming_potential_kgc_2, Expression="x/1000")
expression_10 = Expression(x=egyasm.heating_energy_demand_kwh_a_2, Expression="x/1000")
expression_11 = Expression(x=egyasm.cooling_energy_demand_kwh_a_2, Expression="x/1000")
expression_12 = Expression(x=egyasm.technical_equipment_energy_demand_kwh_a_2, Expression="x/1000")
roundmult = RoundToMultiple(N=expression_5, M="0.05")  # -> R; inputs N: tree, M: tree; same code as roundmult
roundmult_2 = RoundToMultiple(N=expression_4, M="0.05")  # -> R; inputs N: tree, M: tree; same code as roundmult
roundmult_3 = RoundToMultiple(N=egyasm.specific_energy_demand_kwh_m²a_2, M="2.5")  # -> R; inputs N: tree, M: tree; same code as roundmult
roundmult_4 = RoundToMultiple(N=expression_7, M="0.05")  # -> R; inputs N: tree, M: tree; same code as roundmult
roundmult_5 = RoundToMultiple(N=expression_10, M=1)  # -> R; inputs N: tree, M: tree; same code as roundmult
roundmult_6 = RoundToMultiple(N=expression_11, M=1)  # -> R; inputs N: tree, M: tree; same code as roundmult
roundmult_7 = RoundToMultiple(N=expression_12, M=1)  # -> R; inputs N: tree, M: tree; same code as roundmult
roundmult_8 = RoundToMultiple(N=egyasm.effective_floor_area_m²_2, M="25")  # -> R; inputs N: tree, M: tree; same code as roundmult
roundmult_9 = RoundToMultiple(N=egyasm.specific_operational_global_warming_pote_2, M=1)  # -> R; inputs N: tree, M: tree; same code as roundmult
roundmult_10 = RoundToMultiple(N=expression_2, M="0.05")  # -> R; inputs N: tree, M: tree; same code as roundmult
roundmult_11 = RoundToMultiple(N=expression_6, M="0.05")  # -> R; inputs N: tree, M: tree; same code as roundmult
roundmult_12 = RoundToMultiple(N=expression_8, M="25")  # -> R; inputs N: tree, M: tree; same code as roundmult
roundmult_13 = RoundToMultiple(N=expression_3, M="0.05")  # -> R; inputs N: tree, M: tree; same code as roundmult
roundmult_14 = RoundToMultiple(N=expression_9, M="5")  # -> R; inputs N: tree, M: tree; same code as roundmult
effective_floor_area_m²_5 = Number(roundmult_8)
specific_operational_global_warming_pote_5 = Number(roundmult_9)  # "Specific Operational Global Warming Potential [kgCO2e/m²a]"
construction_cost_mio_5 = Number(roundmult_10)
construction_global_warming_potential_tc_5 = Number(roundmult_12)  # "Construction Global Warming Potential [tCO2e]"
operational_cost_mio_a_5 = Number(roundmult_13)
income_mio_a_5 = Number(roundmult)
maintenance_expenses_mio_a_5 = Number(roundmult_2)
operational_energy_cost_a_5 = Number(roundmult_4)
cooling_energy_demand_mwh_a_5 = Number(roundmult_6)
return_a_5 = Number(roundmult_11)
operational_global_warming_potential_tco_5 = Number(roundmult_14)  # "Operational Global Warming Potential [tCO2e/a]"
specific_energy_demand_kwh_m²a_5 = Number(roundmult_3)
heating_energy_demand_mwh_a_5 = Number(roundmult_5)
technical_equipment_energy_demand_mwh_a_5 = Number(roundmult_7)

# ----
# Save the designs
merge_2 = Merge(
    Data1=base_with_twin_capsule_towers_with_capit_4.dn,
    Data2=base_with_twin_capsule_towers_with_capit_3.dn,
    Data3=base_with_twin_capsule_towers_with_capit.dn,
    Data4=base_with_twin_capsule_towers_with_capit_2.dn,
    Data5=egyasm.dn_4)
save = BooleanToggle(False)
dsn = PutDesign(Design=merge_2, Uri=path_2, Run=save)

dn = Design(merge_2)
kit_4 = ModelKit(
    Name="Metabolism",
    Description=panel,
    Version=version_2,
    Remote=ghbkit.remote_2,
    Homepage=ghbkit.homepage_2,
    Types=ty,
    Designs=dn)  # -> Kit, Valid, Name, Description, Icon, Version, Remote, Homepage, Types, Designs
kit_5 = CreateKit(Kit=kit_4.Kit, Uri=path_2, Run=create_kit)

# ----
# Filter & load
mime = Mime({".stl": "model/stl", ".obj": "model/obj", ".glb": "model/gltf-binary", ".gltf": "model/gltf+json", ".3dm": "model/vnd.3dm", ".speckle": "model/vnd.speckle+json", ".png": "image/png", ".jpg": "image/jpeg", ".jpeg": "image/jpeg", ".svg": "image/svg+xml", ".pdf": "application/pdf", ".zip": "application/zip", ".json": "application/json", ".csv": "text/csv", ".txt": "text/plain"}, selected=".3dm")
list_5 = ValueList({"1to500", "1to200"}, selected="1to500")
shwdsn = ShowDesign(dn=egyasm.dn_4, ty=trim, mm=mime, lod=list_5, tags="volume")  # -> id_2, ur_2, pa_ur_2, pln_2
curdir = CSharpScript()  # -> D, S; same code as curdir
concat = Concatenate(FragmentA=path_2, FragmentB=curdir.S, FragmentC=shwdsn.pa_ur_2)
loageo = LoadGeometry(path=flatten(concat), pln=flatten(shwdsn.pln_2))
geo = SemioGeometryPreview(geo=flatten(loageo))

zoom = Button()
# Zoom
bbox = BoundingBox(Content=flatten(loageo), Plane=PlaneXY(0, 0, 0), UnionBox=True)  # -> Box, Box_2
zoom2bb = ZoomToBoundingBox(N=["Top", "Front", "Right", "Perspective", "Parallel"], BB=bbox.Box, S=0, R=zoom)  # -> F, SBB; inputs BB: Box, R: Boolean
# ---------- zoom2bb: Python ----------
#Component Information
#--------------------------------------------------------------------------------------------
if ghenv.Component.RunCount<2:
    #General
    #--------------------------------------------------------------------------------------------
    __author__ = "Ueli Saluz"
    __version__ = "2022.05.21"
    
    ghenv.Component.Name = "ZoomToBoundingBox"
    ghenv.Component.NickName = "Zoom2BB"
    ghenv.Component.Description = "Zoom the view of a Rhino viewport to a bounding box."
    ghenv.Component.Message = "VER 1.0"
    ghenv.Component.Category = "Display"
    ghenv.Component.SubCategory = "Camera"
    
     #Inputs
    #--------------------------------------------------------------------------------------------
    inputIndex=0
    
    ghenv.Component.Params.Input[inputIndex].Name = "Name"
    ghenv.Component.Params.Input[inputIndex].NickName = "N"
    ghenv.Component.Params.Input[inputIndex].Description = "Name of the viewport"
    ghenv.Component.Params.Input[inputIndex].Optional = False
    inputIndex+=1
    
    ghenv.Component.Params.Input[inputIndex].Name = "BoundingBox"
    ghenv.Component.Params.Input[inputIndex].NickName = "BB"
    ghenv.Component.Params.Input[inputIndex].Description = ""
    ghenv.Component.Params.Input[inputIndex].Optional = False
    inputIndex+=1
    
    ghenv.Component.Params.Input[inputIndex].Name = "ScaleFactor"
    ghenv.Component.Params.Input[inputIndex].NickName = "S"
    ghenv.Component.Params.Input[inputIndex].Description = "A factor for the extension of the bounding box." \
    +"0 means 0 extension, a positive number makes the bounding box larger a negative smaller. The amount is proportional to the length."
    ghenv.Component.Params.Input[inputIndex].Optional = False
    inputIndex+=1
   
    
    ghenv.Component.Params.Input[inputIndex].Name = "Run"
    ghenv.Component.Params.Input[inputIndex].NickName = "R"
    ghenv.Component.Params.Input[inputIndex].Description = "Zoom to the given bounding box."
    ghenv.Component.Params.Input[inputIndex].Optional = False
    inputIndex+=1
    
    #Outputs
    #--------------------------------------------------------------------------------------------
    outputIndex=0
    
    ghenv.Component.Params.Output[outputIndex].Name = "Finished"
    ghenv.Component.Params.Output[outputIndex].NickName = "F"
    ghenv.Component.Params.Output[outputIndex].Description = "Sends True when finished. Just to trigger other depending components."
    outputIndex+=1
    
    ghenv.Component.Params.Output[outputIndex].Name = "ScaledBoundingBox"
    ghenv.Component.Params.Output[outputIndex].NickName = "SBB"
    ghenv.Component.Params.Output[outputIndex].Description = "The scaled bounding box."
    outputIndex+=1


#Imports
#--------------------------------------------------------------------------------------------
from Rhino import RhinoDoc
from Rhino.Geometry import Box

#Solver - Run with trees to enhance performance drastically
#--------------------------------------------------------------------------------------------
if __name__ == "__main__":
    try:
        vp = RhinoDoc.ActiveDoc.Views.Find(N, False).ActiveViewport
        if R:
            box = BB
            bb = BB.BoundingBox
            bb.Inflate(S*box.X.Length,S*box.Y.Length,S*box.Z.Length)
            vp.ZoomBoundingBox(bb)
            SBB = bb
        F = True
    except:
        pass
# ---------- end zoom2bb ----------

dn_2 = ClusterOutput(egyasm.dn_4)
effective_floor_area_m²_6 = ClusterOutput(effective_floor_area_m²_5)
specific_operational_global_warming_pote_6 = ClusterOutput(specific_operational_global_warming_pote_5)  # "Specific Operational Global Warming Potential [kgCO2e/m²a]"
construction_cost_mio_6 = ClusterOutput(construction_cost_mio_5)
return_a_6 = ClusterOutput(return_a_5)
construction_global_warming_potential_tc_6 = ClusterOutput(construction_global_warming_potential_tc_5)  # "Construction Global Warming Potential [tCO2e]"
operational_cost_mio_a_6 = ClusterOutput(operational_cost_mio_a_5)
operational_global_warming_potential_tco_6 = ClusterOutput(operational_global_warming_potential_tco_5)  # "Operational Global Warming Potential [tCO2e/a]"
income_mio_a_6 = ClusterOutput(income_mio_a_5)
maintenance_expenses_mio_a_6 = ClusterOutput(maintenance_expenses_mio_a_5)
specific_energy_demand_kwh_m²a_6 = ClusterOutput(specific_energy_demand_kwh_m²a_5)
operational_energy_cost_a_6 = ClusterOutput(operational_energy_cost_a_5)
heating_energy_demand_mwh_a_6 = ClusterOutput(heating_energy_demand_mwh_a_5)
cooling_energy_demand_mwh_a_6 = ClusterOutput(cooling_energy_demand_mwh_a_5)
technical_equipment_energy_demand_mwh_a_6 = ClusterOutput(technical_equipment_energy_demand_mwh_a_5)

# ==== cluster GitHubKit_2: Get the uri of the remote kit of a specific version (either a branch name or a tag name) for a kit hosted as a repository on GitHub.
domain = ClusterInput()
account = ClusterInput()
repo = ClusterInput()
branch = ClusterInput()
tag = ClusterInput()
domain_2 = Text(domain)
account_2 = Text(account)
repo_2 = Text(repo)
branch_2 = Text(branch)
tag_2 = Text(tag)
null = NullItem(Item=tag_2)  # -> NullFlags, InvalidFlags, Description
null_2 = NullItem(Item=branch_2)  # -> NullFlags, InvalidFlags, Description
not = GateNot(A=null.NullFlags)
not_2 = GateNot(A=null_2.NullFlags)
and = GateAnd(A=null_2.NullFlags, B=null.NullFlags)
and_2 = GateAnd(A=not_2, B=not)
or = GateOr(A=and, B=and_2)
filter = StreamFilter(Gate=null_2.NullFlags, Stream0="heads", Stream1="tags")
filter_2 = StreamFilter(Gate=null_2.NullFlags, Stream0=branch_2, Stream1=tag_2)
concat = Concatenate(FragmentA="https://", FragmentE=domain_2, FragmentF="/", FragmentB=account_2, FragmentC="/", FragmentD=repo_2)
concat_2 = Concatenate(FragmentA=concat, FragmentE="/archive/refs/", FragmentH=filter, FragmentB="/", FragmentF=filter_2, FragmentG=".zip")
concat_3 = Concatenate(FragmentA=concat, FragmentB="/", FragmentC="tree", FragmentF="/", FragmentD=branch_2, FragmentE=tag_2)
filter_3 = StreamFilter(Gate=or, Stream0=concat_3)
filter_4 = StreamFilter(Gate=or, Stream0=concat_2)
remote = Remote(filter_4)
homepage = Homepage(filter_3)
remote_2 = ClusterOutput(remote)
homepage_2 = ClusterOutput(homepage)

# ==== cluster DesignToGeometry: Extract the geometry of a design for a remote kit.
dn = ClusterInput()
uri = ClusterInput()
R = ClusterInput()
lod = ClusterInput()
tags = ClusterInput()
kit = LoadKit(Uri=uri, Run=R)  # -> Success, Kit, LocalDirectory
kit_2 = ModelKit(Kit=kit.Kit)  # -> Kit, Valid, Name, Description, Icon, Remote, Homepage, Types, Designs, Designs_2
trim = TrimTree(Tree=kit_2.Types, Depth=1)
shwdsn = ShowDesign(dn=dn, ty=trim, mm="model/vnd.3dm", lod=lod, tags=tags)  # -> id_2, ur_2, pa_ur_2, pln_2
sep = Separator()  # -> S; same code as sep
concat = Concatenate(FragmentA=kit.LocalDirectory, FragmentB=sep, FragmentC=shwdsn.pa_ur_2)
geo = LoadGeometry(path=concat, pln=shwdsn.pln_2)
geo_2 = ClusterOutput(geo)

# ==== cluster LoadDesign_2: Load the design. If the representations are urls to files then the geometry is loaded for a certain level of details and tags.
uri = ClusterInput()
na = ClusterInput()
variant = ClusterInput()
mm = ClusterInput()
lod = ClusterInput()
tags = ClusterInput()
R = ClusterInput()
uri_2 = Uri(uri)
na_2 = Name(na)
variant_2 = Variant(variant)
mm_2 = Mime(mm)
lod_2 = Lod(lod)
tags_2 = Tags(tags)
R_2 = Run(R)
kit = LoadKit(Uri=uri_2, Run=R_2)  # -> Success, Kit, LocalDirectory
kit_2 = ModelKit(Kit=kit.Kit)  # -> Kit, Valid, Name, Description, Icon, Version, Remote, Homepage, Types, Designs
trim = TrimTree(Tree=kit_2.Designs, Depth=1)
trim_2 = TrimTree(Tree=kit_2.Types, Depth=1)
seldsn = SelectDesign(dn=trim, na=na_2, variant=variant_2)
shwdsn = ShowDesign(dn=seldsn, ty=trim_2, mm=mm_2, lod=lod_2, tags=tags_2)  # -> id_2, ur_2, pa_ur_2, pln_2
sep = Separator()  # -> S; same code as sep
concat = Concatenate(FragmentA=kit.LocalDirectory, FragmentB=sep, FragmentC=shwdsn.pa_ur_2)
loageo = LoadGeometry(path=flatten(concat), pln=flatten(shwdsn.pln_2))
pln = Plane(flatten(shwdsn.pln_2))
path = FilePath(concat)
id = Id(shwdsn.id_2)
dn = Design(seldsn)
geo = Geometry(loageo)
ur = Url(shwdsn.ur_2)
dn_2 = ClusterOutput(dn)
geo_2 = ClusterOutput(geo)
ur_2 = ClusterOutput(ur)
path_2 = ClusterOutput(path)
id_2 = ClusterOutput(id)
pln_2 = ClusterOutput(pln)

# ==== cluster LoadGeometry: Load local geometry from absolute file paths to planes.
path = ClusterInput()
pln = ClusterInput()
path_2 = FilePath(path)

pln_2 = Plane(graft(pln))
cset = CreateSet(List=path_2)  # -> Set, Map
panel = Panel("*")
_3dm = Import3DM(File=graft(cset.Set), Layer="*", Name="*")
lng = ListLength(List=cset.Set)
expression = Expression(x=lng, Expression="x>1")
trim = TrimTree(Tree=_3dm, Depth=1)
filter = StreamFilter(Gate=expression, Stream0=_3dm, Stream1=trim)
tstat = TreeStatistics(Tree=filter)  # -> Paths, Length, Count
item = ListItem(List=tstat.Paths, Index=cset.Map, Wrap=True)
branch = TreeBranch(Tree=filter, Path=item, MaintainPaths=False)
match = MatchTree(Tree=branch, Guide=pln_2)
mtchanc = MatchAncestor(AT=pln_2, CT=graft(match))  # -> MAT; inputs AT: tree, CT: tree
# ---------- mtchanc: Python ----------
if ghenv.Component.RunCount<2:
    __author__ = "Ueli Saluz"
    __version__ = "2022.04.25"
    
    ghenv.Component.Name = "Match Ancestor"
    ghenv.Component.NickName = "MtchAnc"
    ghenv.Component.Description = "Duplicates all elements of an ancestor tree to match the amount of elements in the child tree."
    ghenv.Component.Message = "VER 1.1"
    
    ghenv.Component.Params.Input[0].Name = "AncestorTree"
    ghenv.Component.Params.Input[0].NickName = "AT"
    ghenv.Component.Params.Input[0].Description = "Ancestor tree that data will the duplicated until it matches the child tree"
    ghenv.Component.Params.Input[0].Optional = False
    
    ghenv.Component.Params.Input[1].Name = "ChildTree"
    ghenv.Component.Params.Input[1].NickName = "CT"
    ghenv.Component.Params.Input[1].Description = "Child tree that branches will the guide to duplicat the data of the ancestor tree"
    ghenv.Component.Params.Input[0].Optional = False
    
    ghenv.Component.Params.Output[0].Name = "MatchedAncestorTree"
    ghenv.Component.Params.Output[0].NickName = "MAT"
    ghenv.Component.Params.Output[0].Description = "Matched ancestor tree with the amount of items and the branch paths of the child tree"

from System import Object
from Grasshopper import DataTree

"""Returns a new tree with the ancestor data being duplicated along all child branches which where child paths of that ancestor.
    Inputs:
        ancestorTree: Ancestor tree that data will the duplicated until it matches the child tree
        childTree: Child tree that branches will the guide to duplicat the data of the ancestor tree
    Output:
        matchedAncestorTree: Matched ancestor tree with the amount of items and the branch paths of the child tree"""
def MatchAncestorTreeToChildTree (ancestorTree, childTree):
    
    matchedAncestorTree = DataTree[Object]()
    dummy = 0
    for i,pathAncestor in enumerate(ancestorTree.Paths):
        branch = ancestorTree.Branch(pathAncestor)
        if len(branch)!=1:
            raise Exception("Ancestor must be grafted and containing one item per branch")
        #The item to be duplicated
        item = branch[0]
        for j,pathChild in enumerate(childTree.Paths):
            #Returns a tuple and not like in the documentation described a bool with a pointer to the int to store the generations
            checkAncestor = pathChild.IsAncestor(pathAncestor,dummy)
            if(checkAncestor[0]):
                matchedAncestorTree.AddRange([item]*childTree.Branch(pathChild).Count,pathChild)
    return matchedAncestorTree

if __name__ == "__main__":
    MAT = MatchAncestorTreeToChildTree (AT,CT)
# ---------- end mtchanc ----------
trim_2 = TrimTree(Tree=mtchanc, Depth=1)
pl2pl = MoveObjectPlaneToPlane(G=match, S=PlaneXY(0, 0, 0), T=trim_2)  # -> TG, T; inputs S: Plane, T: Plane
# ---------- pl2pl: Python ----------
#Component Information
#--------------------------------------------------------------------------------------------
if ghenv.Component.RunCount<2:
    #General
    #--------------------------------------------------------------------------------------------
    __author__ = "Ueli Saluz"
    __version__ = "2023.02.12"
    
    ghenv.Component.Name = "MoveObjectPlaneToPlane"
    ghenv.Component.NickName = "Pl2Pl"
    ghenv.Component.Description = "Moves abitrary geometry from a source plane to a target plane."
    ghenv.Component.Message = "VER 1.2"
    ghenv.Component.Category = "Transform"
    ghenv.Component.SubCategory = "Euclidean"
    
     #Inputs
    #--------------------------------------------------------------------------------------------
    inputIndex=0
    
    ghenv.Component.Params.Input[inputIndex].Name = "Geometry"
    ghenv.Component.Params.Input[inputIndex].NickName = "G"
    ghenv.Component.Params.Input[inputIndex].Description = "Geometry to move."
    ghenv.Component.Params.Input[inputIndex].Optional = False
    inputIndex+=1
    
    ghenv.Component.Params.Input[inputIndex].Name = "SourcePlane"
    ghenv.Component.Params.Input[inputIndex].NickName = "S"
    ghenv.Component.Params.Input[inputIndex].Description = "Source plane of object."
    ghenv.Component.Params.Input[inputIndex].Optional = False
    inputIndex+=1
    
    ghenv.Component.Params.Input[inputIndex].Name = "TargetPlane"
    ghenv.Component.Params.Input[inputIndex].NickName = "T"
    ghenv.Component.Params.Input[inputIndex].Description = "Target plane of object."
    ghenv.Component.Params.Input[inputIndex].Optional = False
    inputIndex+=1
    
    #Outputs
    #--------------------------------------------------------------------------------------------
    outputIndex=0
    
    ghenv.Component.Params.Output[outputIndex].Name = "TranslatedGeometry"
    ghenv.Component.Params.Output[outputIndex].NickName = "TG"
    ghenv.Component.Params.Output[outputIndex].Description = "Translated geometry in target plane."
    outputIndex+=1
    
    ghenv.Component.Params.Output[outputIndex].Name = "Trasnform"
    ghenv.Component.Params.Output[outputIndex].NickName = "T"
    ghenv.Component.Params.Output[outputIndex].Description = "Transform describing translation form source to target plane."
    outputIndex+=1


#Imports
#--------------------------------------------------------------------------------------------
import Rhino.Geometry.Transform as trsf

def MvObjPlnToPln (geo,plnObj,plnDest):
    transform = trsf.PlaneToPlane(plnObj,plnDest)
    geo.Transform(transform)
    return (geo,transform)

TG, T = MvObjPlnToPln(G,S,T)
# ---------- end pl2pl ----------
geo = Geometry(pl2pl.TG)

geo_2 = ClusterOutput(geo)

# ==== cluster ShowDesign: Show a design by flattening it and selecting only representations with the same mime, lod and tags.
ty = ClusterInput()
dn = ClusterInput()
mm = ClusterInput()
lod = ClusterInput()
tags = ClusterInput()
ty_2 = Type(ty)
mm_2 = Mime(mm)
tags_2 = Tags(tags)
dn_2 = Design(dn)
lod_2 = Lod(lod)
fltdsn = FlattenDesign(Design=dn_2, Type=ty_2)
typ = ModelType(Type=ty_2)  # -> Type, Valid, Name, Description, Icon, Variant, Unit, Representations, Ports, Qualities
dsn = ModelDesign(Design=fltdsn)  # -> Design, Valid, Name, Description, Icon, Variant, Unit, Pieces, Connections, Qualities
tstat = TreeStatistics(Tree=typ.Representations)  # -> Paths, Length, Count
trim = TrimTree(Tree=dsn.Pieces, Depth=1)
pce = ModelPiece(Piece=trim)  # -> Piece, Valid, Id, TypeName, TypeVariant, Plane, ScreenPoint
expression = Expression(x=graft(pce.TypeName), y=typ.Name, Expression="x=y")
expression_2 = Expression(x=graft(pce.TypeVariant), y=typ.Variant, Expression="x=y")
and = GateAnd(A=expression, B=expression_2)
cull = CullPattern(List=ty_2, CullPattern=and)
lng = ListLength(List=ty_2)
txt = Text(cull)
series = Series(Start=0, Step=1, Count=lng)
txt_2 = Text(ty_2)
expression_3 = Expression(x=txt, y=txt_2, Expression="x=y")
trim_2 = TrimTree(Tree=series, Depth=1)
cull_2 = CullPattern(List=trim_2, CullPattern=expression_3)
trim_3 = TrimTree(Tree=cull_2, Depth=1)
item = ListItem(List=tstat.Paths, Index=trim_3, Wrap=True)
branch = TreeBranch(Tree=typ.Representations, Path=item, MaintainPaths=False)
mrg_p = MergeSeperatlyPrepend(x=branch)  # -> Mrgd; inputs x: tree
# ---------- mrg_p: Python ----------
if ghenv.Component.RunCount<2:
    __author__ = "Ueli Saluz"
    __version__ = "2020.05.28"
    
    ghenv.Component.Name = "MergeSeperatly(Prepend)"
    ghenv.Component.NickName = "Mrg(P)"
    ghenv.Component.Description = "Merge inputs seperatly on a new path. Prepend index of input parameter for distincting."
    ghenv.Component.Message = "VER 1.0"

from System import Object
from Grasshopper import DataTree
from Grasshopper.Kernel import GH_ParamAccess as Access

if __name__ == "__main__":
    Mrgd = DataTree[Object]()
    access = Access()
    
    for input in ghenv.Component.Params.Input:  #set all Inputaccess to Tree Access
        input.Access = access.tree
    
    for i,input in enumerate(ghenv.Component.Params.Input):
        for j,source in enumerate(input.Sources):
            for path in source.VolatileData.Paths:
                Mrgd.AddRange(source.VolatileData[path],path.PrependElement(i))
# ---------- end mrg_p ----------
selrep = SelectRepresentation(rp=mrg_p, mm=mm_2, lod=lod_2, tags=tags_2)  # -> rp_4, ur_2, pa_ur_2
trim_4 = TrimTree(Tree=selrep.rp_4, Depth=1)
trim_5 = TrimTree(Tree=selrep.pa_ur_2, Depth=1)
id = Id(pce.Id)
ur = Url(trim_4)
pa_ur = Url(trim_5)
pln = Plane(pce.Plane)
id_2 = ClusterOutput(id)
ur_2 = ClusterOutput(ur)
pa_ur_2 = ClusterOutput(pa_ur)
pln_2 = ClusterOutput(pln)

# ==== cluster SelectDesign: Select a design with a name and an optional variant. If no variant is provided it will select all variants. If you want to select the default design then use the empty text.
dn = ClusterInput()
na = ClusterInput()
variant = ClusterInput()
dn_2 = Design(dn)
na_2 = Name(na)
variant_2 = Variant(variant)
dsn = ModelDesign(Design=dn_2)  # -> Design, Valid, Name, Description, Icon, Variant, Unit, Pieces, Connections, Qualities
expression = Expression(x=dsn.Name, y=na_2, Expression="x=y")
null = NullItem(Item=variant_2)  # -> NullFlags, InvalidFlags, Description
cull = CullPattern(List=dsn.Design, CullPattern=expression)
dsn_2 = ModelDesign(Design=cull)  # -> Design, Valid, Name, Description, Icon, Variant, Unit, Pieces, Connections, Qualities
expression_2 = Expression(x=dsn_2.Variant, y=variant_2, Expression="x=y")
lng = ListLength(List=cull)
cull_2 = CullPattern(List=dsn_2.Design, CullPattern=expression_2)
lng_2 = ListLength(List=cull_2)
expression_3 = Expression(x=lng_2, Expression="x=0")
expression_4 = Expression(x=lng, Expression="x=0")
filter = StreamFilter(Gate=null.NullFlags, Stream0=cull_2, Stream1=cull)
filter_2 = StreamFilter(Gate=expression_3, Stream0=filter)
filter_3 = StreamFilter(Gate=expression_4, Stream0=filter_2)
dn_3 = Design(filter_3)
dn_4 = ClusterOutput(dn_3)

# ==== cluster SelectType: Select a type with a name and an optional variant. If no variant is provided it will select all variants. If you want to select the default type then use the empty text.
ty = ClusterInput()
na = ClusterInput()
variant = ClusterInput()
na_2 = Name(na)
variant_2 = Variant(variant)
ty_2 = Type(ty)
typ = ModelType(Type=ty_2)  # -> Type, Valid, Name, Description, Icon, Variant, Unit, Representations, Ports, Qualities
expression = Expression(x=typ.Name, y=na_2, Expression="x=y")
null = NullItem(Item=variant_2)  # -> NullFlags, InvalidFlags, Description
cull = CullPattern(List=typ.Type, CullPattern=expression)
typ_2 = ModelType(Type=cull)  # -> Type, Valid, Name, Description, Icon, Variant, Unit, Representations, Ports, Qualities
expression_2 = Expression(x=typ_2.Variant, y=variant_2, Expression="x=y")
cull_2 = CullPattern(List=typ_2.Type, CullPattern=expression_2)
filter = StreamFilter(Gate=null.NullFlags, Stream0=cull_2, Stream1=cull)
ty_3 = Type(filter)
ty_4 = ClusterOutput(ty_3)

# ==== cluster BaseWithTwinCapsuleTowersWithCapital
ty = ClusterInput()

electrictiy_global_warming_potential_kgc = ClusterInput()  # "Electrictiy Global Warming Potential [kgCO2e/kWh]"
heating_energy_price_kwh = ClusterInput()
heating_efficiency_factor = ClusterInput()
cooling_efficiency_factor = ClusterInput()
cooling_global_warming_potential_kgco2e = ClusterInput()  # "Cooling Global Warming Potential [kgCO2e/kWh]"
heating_global_warming_potential_kgco2e = ClusterInput()  # "Heating Global Warming Potential [kgCO2e/kWh]"
cooling_energy_price_kwh = ClusterInput()
electrictiy_energy_price_cent_kwh = ClusterInput()
electrictiy_global_warming_potential_kgc_2 = Number(electrictiy_global_warming_potential_kgc)  # "Electrictiy Global Warming Potential [kgCO2e/kWh]"
heating_energy_price_kwh_2 = Number(heating_energy_price_kwh)
heating_efficiency_factor_2 = Number(heating_efficiency_factor)
heating_global_warming_potential_kgco2e_2 = Number(heating_global_warming_potential_kgco2e)  # "Heating Global Warming Potential [kgCO2e/kWh]"
cooling_efficiency_factor_2 = Number(cooling_efficiency_factor)
cooling_global_warming_potential_kgco2e_2 = Number(cooling_global_warming_potential_kgco2e)  # "Cooling Global Warming Potential [kgCO2e/kWh]"
electrictiy_energy_price_cent_kwh_2 = Number(electrictiy_energy_price_cent_kwh)
cooling_energy_price_kwh_2 = Number(cooling_energy_price_kwh)

name = ClusterInput()
variant = ClusterInput()
capsule_type = ClusterInput()
base_plane = ClusterInput()
name_2 = Text(name)
variant_2 = Text(variant)
capsule_type_2 = Integer(capsule_type)
base_plane_2 = Plane(base_plane)

capsule_corner_ne = ClusterInput()
capsule_corner_se = ClusterInput()
capsule_corner_sw = ClusterInput()
capsule_corner_nw = ClusterInput()
capsule_corner_nw_2 = Integer(capsule_corner_nw)
capsule_corner_ne_2 = Integer(capsule_corner_ne)
capsule_corner_se_2 = Integer(capsule_corner_se)
capsule_corner_sw_2 = Integer(capsule_corner_sw)

shaft_rotation = ClusterInput()
shaft_tilt = ClusterInput()
shaft_gap = ClusterInput()
shaft_shift = ClusterInput()
tambour_rotation = ClusterInput()
tambour_tilt = ClusterInput()
tambour_gap = ClusterInput()
tambour_shift = ClusterInput()
capsule_rotation = ClusterInput()
capsule_tilt = ClusterInput()
capsule_gap = ClusterInput()
capsule_shift = ClusterInput()
capital_rotation = ClusterInput()
capital_tilt = ClusterInput()
capital_gap = ClusterInput()
capital_shift = ClusterInput()
shaft_tilt_2 = Number(shaft_tilt)
shaft_gap_2 = Number(shaft_gap)
tambour_rotation_2 = Number(tambour_rotation)
tambour_tilt_2 = Number(tambour_tilt)
capsule_rotation_2 = Number(capsule_rotation)
capsule_shift_2 = Number(capsule_shift)
capital_rotation_2 = Number(capital_rotation)
capital_tilt_2 = Number(capital_tilt)
capital_gap_2 = Number(capital_gap)
capital_shift_2 = Number(capital_shift)
shaft_rotation_2 = Number(shaft_rotation)
shaft_shift_2 = Number(shaft_shift)
tambour_gap_2 = Number(tambour_gap)
tambour_shift_2 = Number(tambour_shift)
capsule_tilt_2 = Number(capsule_tilt)
capsule_gap_2 = Number(capsule_gap)

ty_2 = Type(ty)

lng = ListLength(List=capsule_corner_sw_2)
lng_2 = ListLength(List=capsule_corner_ne_2)
dup = DuplicateData(Data="0", Number=lng_2, Order=True)
dup_2 = DuplicateData(Data="6", Number=lng_2, Order=True)
dup_3 = DuplicateData(Data="0", Number=lng, Order=True)
dup_4 = DuplicateData(Data="6", Number=lng, Order=True)
trim = TrimTree(Tree=dup, Depth=1)
trim_2 = TrimTree(Tree=dup_2, Depth=1)
trim_3 = TrimTree(Tree=dup_3, Depth=1)
trim_4 = TrimTree(Tree=dup_4, Depth=1)

# ----
# Model the initial design
panel = Panel("Capital")
neg = Negative(Value="-90")
neg_2 = Negative(Value="-9")
concat = Concatenate(FragmentA="c", FragmentC="1")
concat_2 = Concatenate(FragmentA="c", FragmentC="0")
addition = Addition(A="-90", B=neg_2)
addition_2 = Addition(A="-90", B=neg_2)
filter = StreamFilter(Gate=capsule_type_2, Stream0="-90", Stream1="-90", Stream2=addition, Stream3="-90")
filter_2 = StreamFilter(Gate=capsule_type_2, Stream0="-90", Stream1="-90", Stream2=addition_2, Stream3="-90")
neg_3 = Negative(Value=filter_2)
bridge_tilt = Slider(0, range=-360..360)
bridge_gap = Slider(0, range=-10..10)
bridge_rotation = Slider(0, range=-360..360)
bridge_shift = Slider(-0.8, range=-10..10)
genes = GenePool(Decimals=0, Maximum=10, Minimum=0, Value=[3, 6, 9])

concat_3 = Concatenate(FragmentA="b", FragmentB="_", FragmentC=concat_2)
tower = Tower(
    shaftpieceid=concat_3,
    capsulepatternnorthwest=trim_2,
    capsulepatternsoutheast=capsule_corner_ne_2,
    capsulepatternsouthwest=capsule_corner_se_2,
    capsulepatternnortheast=trim,
    capsulerotation=capsule_rotation_2,
    capsuletilt=capsule_tilt_2,
    capsulegap=capsule_gap_2,
    capsuleshift=capsule_shift_2,
    tambourrotation=tambour_rotation_2,
    tambourtilt=tambour_tilt_2,
    tambourgap=tambour_gap_2,
    tambourshift=tambour_shift_2)  # -> pc_2, co_2, tambour_co_2, tambour_pc_2, first_tambour_id_2, last_tambour_id_2, capsule_pc_2, caspule_co_2

concat_4 = Concatenate(FragmentA="b", FragmentB="_", FragmentC=concat)
tower_2 = Tower(
    shaftpieceid=concat_4,
    capsulepatternnorthwest=trim_4,
    capsulepatternsoutheast=capsule_corner_sw_2,
    capsulepatternsouthwest=capsule_corner_nw_2,
    capsulepatternnortheast=trim_3,
    capsulerotation=capsule_rotation_2,
    capsuletilt=capsule_tilt_2,
    capsulegap=capsule_gap_2,
    capsuleshift=capsule_shift_2,
    tambourrotation=tambour_rotation_2,
    tambourtilt=tambour_tilt_2,
    tambourgap=tambour_gap_2,
    tambourshift=tambour_shift_2)  # -> pc_2, co_2, tambour_co_2, tambour_pc_2, first_tambour_id_2, last_tambour_id_2, capsule_pc_2, caspule_co_2

concat_5 = Concatenate(FragmentD="ci", FragmentC="_", FragmentB=tower_2.last_tambour_id_2)
concat_6 = Concatenate(FragmentD="ci", FragmentC="_", FragmentB=tower.last_tambour_id_2)
merge = Merge(Data1=tower.pc_2, Data2=tower_2.pc_2)
merge_2 = Merge(Data1=tower.co_2, Data2=tower_2.co_2)

pce = ModelPiece(Id=concat_5, TypeName=panel)  # -> Piece, Valid, Id, TypeName, TypeVariant, Plane, ScreenPoint
pce_2 = ModelPiece(Id=concat_6, TypeName=panel)  # -> Piece, Valid, Id, TypeName, TypeVariant, Plane, ScreenPoint
pce_3 = ModelPiece(Id="b", TypeName="Base", Plane=base_plane_2)  # -> Piece, Valid, Id, TypeName, TypeVariant, Plane, ScreenPoint
addition_3 = Addition(A="-90", B=capital_rotation_2)
addition_4 = Addition(A=neg_3, B=capital_rotation_2)
addition_5 = Addition(A=neg, B=shaft_rotation_2)
addition_6 = Addition(A=shaft_rotation_2, B=filter)
con = ModelConnection(
    ConnectedPieceId=pce_3.Id,
    ConnectedPieceTypePortId=concat_2,
    ConnectingPieceId=tower.first_tambour_id_2,
    ConnectingPieceTypePortId="b",
    Rotation=addition_6,
    Tilt=shaft_tilt_2,
    Gap=shaft_gap_2,
    Shift=shaft_shift_2)  # -> Connection, Valid, ConnectedPieceId, ConnectedPieceTypePortId, ConnectingPieceId, ConnectingPieceTypePortId, Rotation, Tilt, Gap, Shift
con_2 = ModelConnection(
    ConnectedPieceId=pce_3.Id,
    ConnectedPieceTypePortId=concat,
    ConnectingPieceId=tower_2.first_tambour_id_2,
    ConnectingPieceTypePortId="b",
    Rotation=addition_5,
    Tilt=shaft_tilt_2,
    Gap=shaft_gap_2,
    Shift=shaft_shift_2)  # -> Connection, Valid, ConnectedPieceId, ConnectedPieceTypePortId, ConnectingPieceId, ConnectingPieceTypePortId, Rotation, Tilt, Gap, Shift
con_3 = ModelConnection(
    ConnectedPieceId=tower.last_tambour_id_2,
    ConnectedPieceTypePortId="t",
    ConnectingPieceId=pce_2.Id,
    Rotation=addition_4,
    Tilt=capital_tilt_2,
    Gap=capital_gap_2,
    Shift=capital_shift_2)  # -> Connection, Valid, ConnectedPieceId, ConnectedPieceTypePortId, ConnectingPieceId, ConnectingPieceTypePortId, Rotation, Tilt, Gap, Shift
con_4 = ModelConnection(
    ConnectedPieceId=tower_2.last_tambour_id_2,
    ConnectedPieceTypePortId="t",
    ConnectingPieceId=pce.Id,
    Rotation=addition_3,
    Tilt=capital_tilt_2,
    Gap=capital_gap_2,
    Shift=capital_shift_2)  # -> Connection, Valid, ConnectedPieceId, ConnectedPieceTypePortId, ConnectingPieceId, ConnectingPieceTypePortId, Rotation, Tilt, Gap, Shift

merge_3 = Merge(Data1=pce_3.Piece, Data2=pce_2.Piece, Data3=pce.Piece)
merge_4 = Merge(Data1=con.Connection, Data2=con_2.Connection, Data3=con_3.Connection, Data4=con_4.Connection)
merge_5 = Merge(Data1=merge_4, Data2=merge_2)
merge_6 = Merge(Data1=merge_3, Data2=merge)
dsn = ModelDesign(Name=name_2, Variant=variant_2, Pieces=merge_6, Connections=merge_5)  # -> Design, Valid, Name, Description, Icon, Variant, Unit, Pieces, Connections, Qualities
addbridges = AddBridges(
    dn=dsn.Design,
    levels=genes,
    bridge_rotation=bridge_rotation,
    bridge_tilt=bridge_tilt,
    bridge_gap=bridge_gap,
    bridge_shift=bridge_shift)

# ----
# Change the design later
panel_2 = Panel("Base")
vartyp = VaryTypes(dn=addbridges, na=panel_2, new_vn="Blob")
rpltyp = ReplaceType(dn=vartyp, old_na="Capsule", new_na="Ellipsoid Capsule")
rpltyp_2 = ReplaceType(dn=addbridges, old_na="Capsule", new_na="Trapezoid Capsule")
rpltyp_3 = ReplaceType(dn=addbridges, old_na="Capsule", new_na="Capsule with Balcony")
rpltyp_4 = ReplaceType(dn=rpltyp, old_na="Tambour", new_na="Cylindric Tambour")
rpltyp_5 = ReplaceType(dn=rpltyp_2, old_na="Tambour", new_na="Cylindric Tambour")
rpltyp_6 = ReplaceType(dn=rpltyp_4, old_na="Capital", new_na="Cylindric Capital")
rpltyp_7 = ReplaceType(dn=rpltyp_5, old_na="Capital", new_na="Cylindric Capital")
dsn_2 = ModelDesign(Design=rpltyp_6)  # -> Design, Valid, Name, Description, Icon, Variant, Unit, Pieces, Connections, Qualities
filter_3 = StreamFilter(Gate=capsule_type_2, Stream0=addbridges, Stream1=rpltyp_3, Stream2=dsn_2.Design, Stream3=rpltyp_7)

# ----
# Do some calculations based on metadata
performance_assessment = PerformanceAssessment(
    dn=filter_3,
    ty=ty_2,
    heating_energy_price_cent_kwh=heating_energy_price_kwh_2,
    heating_efficiency_factor=heating_efficiency_factor_2,
    heating_global_warming_potential_kgco2e=heating_global_warming_potential_kgco2e_2,
    cooling_energy_price_cent_kwh=cooling_energy_price_kwh_2,
    cooling_efficiency_factor=cooling_efficiency_factor_2,
    cooling_global_warming_potential_kgco2e=cooling_global_warming_potential_kgco2e_2,
    electrictiy_energy_price_cent_kwh=electrictiy_energy_price_cent_kwh_2,
    electrictiy_global_warming_potential_kgc=electrictiy_global_warming_potential_kgc_2)  # -> dn_4, effective_floor_area_m²_2, specific_operational_global_warming_pote_2, construction_cost_2, return_a_2, construction_global_warming_potential_kg_2, operational_cost_a_2, operational_global_warming_potential_kgc_2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
expression = Expression(x=performance_assessment.construction_cost_2, Expression="x/1000000")
expression_2 = Expression(x=performance_assessment.operational_cost_a_2, Expression="x/1000000")
expression_3 = Expression(x=performance_assessment.maintenance_expenses_a_2, Expression="x/1000000")
expression_4 = Expression(x=performance_assessment.income_2, Expression="x/1000000")
expression_5 = Expression(x=performance_assessment.return_a_2, Expression="x/1000000")
expression_6 = Expression(x=performance_assessment.operational_energy_cost_a_2, Expression="x/1000000")
expression_7 = Expression(x=performance_assessment.construction_global_warming_potential_kg_2, Expression="x/1000")
expression_8 = Expression(x=performance_assessment.operational_global_warming_potential_kgc_2, Expression="x/1000")
expression_9 = Expression(x=performance_assessment.heating_energy_demand_kwh_a_2, Expression="x/1000")
expression_10 = Expression(x=performance_assessment.cooling_energy_demand_kwh_a_2, Expression="x/1000")
expression_11 = Expression(x=performance_assessment.technical_equipment_energy_demand_kwh_a_2, Expression="x/1000")
roundmult = RoundToMultiple(N=expression_4, M="0.05")  # -> R; inputs N: tree, M: tree
# ---------- roundmult: Python ----------
#Component Information
#--------------------------------------------------------------------------------------------
if ghenv.Component.RunCount<2:
    #General
    #--------------------------------------------------------------------------------------------
    __author__ = "YOUR NAME"
    __version__ = "2000.00.00"
    
    ghenv.Component.Name = "Round to Multiple"
    ghenv.Component.NickName = "RoundMult"
    ghenv.Component.Description = "Rounds a number to the nearest specified multiple."
    ghenv.Component.Message = "VER 1.0"
    ghenv.Component.Category = "Math"
    ghenv.Component.SubCategory = "Arithmetic"
    
     #Inputs
    #--------------------------------------------------------------------------------------------
    inputIndex=0
    
    ghenv.Component.Params.Input[inputIndex].Name = "Number"
    ghenv.Component.Params.Input[inputIndex].NickName = "N"
    ghenv.Component.Params.Input[inputIndex].Description = "Number to round."
    ghenv.Component.Params.Input[inputIndex].Optional = False
    inputIndex+=1
    
    ghenv.Component.Params.Input[inputIndex].Name = "Multiple"
    ghenv.Component.Params.Input[inputIndex].NickName = "M"
    ghenv.Component.Params.Input[inputIndex].Description = "Multiple to round to."
    ghenv.Component.Params.Input[inputIndex].Optional = False
    inputIndex+=1
    
    #Outputs
    #--------------------------------------------------------------------------------------------
    outputIndex=0
    
    ghenv.Component.Params.Output[outputIndex].Name = "Rounded"
    ghenv.Component.Params.Output[outputIndex].NickName = "R"
    ghenv.Component.Params.Output[outputIndex].Description = "Number rounded to the nearest specified multiple."
    outputIndex+=1


#Imports
#--------------------------------------------------------------------------------------------
from System import Object
from Grasshopper import DataTree
import math


#The Component function - Business logic only (e.g. working without trees)
#--------------------------------------------------------------------------------------------
"""Function that this component is computing.
    Inputs:
        number: The number to round.
        multiple: The multiple to round to.
    Output:
        rounded: The number rounded to the nearest specified multiple."""
def RoundToMultiple(number, multiple):
    rounded = math.ceil(number / multiple) * multiple
    return rounded

#Solver - Run with trees to enhance performance drastically
#--------------------------------------------------------------------------------------------
if __name__ == "__main__":
    
    #Initialize trees
    #--------------------------------------------------------------------------------------------
    RoundedTree = DataTree[Object]()
    
    #Data matching
    #--------------------------------------------------------------------------------------------
    for path in N.Paths:
        numberBranch = N.Branch(path)
        for i, number in enumerate(numberBranch):
            multiple = M.Branch(path)[i]
            rounded = RoundToMultiple(number, multiple)
            RoundedTree.Add(rounded, path)
    
     #Assign trees to output
    #--------------------------------------------------------------------------------------------
    R = RoundedTree
# ---------- end roundmult ----------
roundmult_2 = RoundToMultiple(N=expression_3, M="0.05")  # -> R; inputs N: tree, M: tree; same code as roundmult
roundmult_3 = RoundToMultiple(N=performance_assessment.specific_energy_demand_kwh_m²a_2, M="2.5")  # -> R; inputs N: tree, M: tree; same code as roundmult
roundmult_4 = RoundToMultiple(N=expression_6, M="0.05")  # -> R; inputs N: tree, M: tree; same code as roundmult
roundmult_5 = RoundToMultiple(N=expression_9, M=1)  # -> R; inputs N: tree, M: tree; same code as roundmult
roundmult_6 = RoundToMultiple(N=expression_10, M=1)  # -> R; inputs N: tree, M: tree; same code as roundmult
roundmult_7 = RoundToMultiple(N=expression_11, M=1)  # -> R; inputs N: tree, M: tree; same code as roundmult
roundmult_8 = RoundToMultiple(N=performance_assessment.effective_floor_area_m²_2, M="25")  # -> R; inputs N: tree, M: tree; same code as roundmult
roundmult_9 = RoundToMultiple(N=performance_assessment.specific_operational_global_warming_pote_2, M=1)  # -> R; inputs N: tree, M: tree; same code as roundmult
roundmult_10 = RoundToMultiple(N=expression, M="0.05")  # -> R; inputs N: tree, M: tree; same code as roundmult
roundmult_11 = RoundToMultiple(N=expression_5, M="0.05")  # -> R; inputs N: tree, M: tree; same code as roundmult
roundmult_12 = RoundToMultiple(N=expression_7, M="25")  # -> R; inputs N: tree, M: tree; same code as roundmult
roundmult_13 = RoundToMultiple(N=expression_2, M="0.05")  # -> R; inputs N: tree, M: tree; same code as roundmult
roundmult_14 = RoundToMultiple(N=expression_8, M="5")  # -> R; inputs N: tree, M: tree; same code as roundmult
effective_floor_area_m² = Number(roundmult_8)
operational_cost_mio_a = Number(roundmult_13)
specific_operational_global_warming_pote = Number(roundmult_9)  # "Specific Operational Global Warming Potential [kgCO2e/m²a]"
construction_cost_mio = Number(roundmult_10)
return_a = Number(roundmult_11)
construction_global_warming_potential_tc = Number(roundmult_12)  # "Construction Global Warming Potential [tCO2e]"
operational_global_warming_potential_tco = Number(roundmult_14)  # "Operational Global Warming Potential [tCO2e/a]"
income_mio_a = Number(roundmult)
maintenance_expenses_mio_a = Number(roundmult_2)
specific_energy_demand_kwh_m²a = Number(roundmult_3)
operational_energy_cost_a = Number(roundmult_4)
heating_energy_demand_mwh_a = Number(roundmult_5)
cooling_energy_demand_mwh_a = Number(roundmult_6)
technical_equipment_energy_demand_mwh_a = Number(roundmult_7)

dn = ClusterOutput(performance_assessment.dn_4)
effective_floor_area_m²_2 = ClusterOutput(effective_floor_area_m²)
specific_operational_global_warming_pote_2 = ClusterOutput(specific_operational_global_warming_pote)  # "Specific Operational Global Warming Potential [kgCO2e/m²a]"
construction_cost_mio_2 = ClusterOutput(construction_cost_mio)
return_a_2 = ClusterOutput(return_a)
construction_global_warming_potential_tc_2 = ClusterOutput(construction_global_warming_potential_tc)  # "Construction Global Warming Potential [tCO2e]"
operational_cost_mio_a_2 = ClusterOutput(operational_cost_mio_a)
operational_global_warming_potential_tco_2 = ClusterOutput(operational_global_warming_potential_tco)  # "Operational Global Warming Potential [tCO2e/a]"
income_mio_a_2 = ClusterOutput(income_mio_a)
maintenance_expenses_mio_a_2 = ClusterOutput(maintenance_expenses_mio_a)
specific_energy_demand_kwh_m²a_2 = ClusterOutput(specific_energy_demand_kwh_m²a)
operational_energy_cost_a_2 = ClusterOutput(operational_energy_cost_a)
heating_energy_demand_mwh_a_2 = ClusterOutput(heating_energy_demand_mwh_a)
cooling_energy_demand_mwh_a_2 = ClusterOutput(cooling_energy_demand_mwh_a)
technical_equipment_energy_demand_mwh_a_2 = ClusterOutput(technical_equipment_energy_demand_mwh_a)

# ==== cluster InterpolateDesigns: Interpolate between a source design and a target design. The target will act as a blueprint. The result is an interpolated union design and two unmodified but filtered difference design.
T = ClusterInput()
S = ClusterInput()
t = ClusterInput()
T_2 = Design(T)
S_2 = Design(S)
t_2 = Number(t)
nordsn = NormalizeDesign(dn=S_2)
nordsn_2 = NormalizeDesign(dn=T_2)
dsn = ModelDesign(Design=nordsn)  # -> Design, Valid, Name, Description, Icon, Variant, Unit, Pieces, Connections, Qualities
dsn_2 = ModelDesign(Design=nordsn_2)  # -> Design, Valid, Name, Description, Icon, Variant, Unit, Pieces, Connections, Qualities
trim = TrimTree(Tree=dsn_2.Connections, Depth=1)
trim_2 = TrimTree(Tree=dsn.Pieces, Depth=1)
trim_3 = TrimTree(Tree=dsn.Connections, Depth=1)
trim_4 = TrimTree(Tree=dsn_2.Pieces, Depth=1)
pce = ModelPiece(Piece=trim_4)  # -> Piece, Valid, Id, TypeName, TypeVariant, Plane, ScreenPoint
pce_2 = ModelPiece(Piece=trim_2)  # -> Piece, Valid, Id, TypeName, TypeVariant, Plane, ScreenPoint
con = ModelConnection(Connection=trim)  # -> Connection, Valid, ConnectedPieceId, ConnectedPieceTypePortId, ConnectingPieceId, ConnectingPieceTypePortId, Rotation, Tilt, Gap, Shift
con_2 = ModelConnection(Connection=trim_3)  # -> Connection, Valid, ConnectedPieceId, ConnectedPieceTypePortId, ConnectingPieceId, ConnectingPieceTypePortId, Rotation, Tilt, Gap, Shift
intersection = SetIntersection(SetA=pce_2.Id, SetB=pce.Id)
difference = SetDifference(SetA=pce.Id, SetB=pce_2.Id)
difference_2 = SetDifference(SetA=pce_2.Id, SetB=pce.Id)
selcon = SelectConnection(co=trim, cdpc=graft(con_2.ConnectedPieceId), cgpc=graft(con_2.ConnectingPieceId))
selcon_2 = SelectConnection(co=trim_3, cdpc=graft(con.ConnectedPieceId), cgpc=graft(con.ConnectingPieceId))
selpce = SelectPiece(pc=pce.Piece, id=graft(intersection))
selpce_2 = SelectPiece(pc=pce.Piece, id=graft(difference))
selpce_3 = SelectPiece(pc=pce_2.Piece, id=graft(difference_2))
selpce_4 = SelectPiece(pc=pce_2.Piece, id=graft(intersection))
trim_5 = TrimTree(Tree=selcon, Depth=1)
trim_6 = TrimTree(Tree=selcon_2, Depth=1)
expression = Expression(x=t_2, Expression="1-x")
trim_7 = TrimTree(Tree=selpce_2, Depth=1)
trim_8 = TrimTree(Tree=selpce, Depth=1)
trim_9 = TrimTree(Tree=selpce_4, Depth=1)
trim_10 = TrimTree(Tree=selpce_3, Depth=1)
con_3 = ModelConnection(Connection=trim_5)  # -> Connection, Valid, ConnectedPieceId, ConnectedPieceTypePortId, ConnectingPieceId, ConnectingPieceTypePortId, Rotation, Tilt, Gap, Shift
con_4 = ModelConnection(Connection=trim_6)  # -> Connection, Valid, ConnectedPieceId, ConnectedPieceTypePortId, ConnectingPieceId, ConnectingPieceTypePortId, Rotation, Tilt, Gap, Shift
pce_3 = ModelPiece(Piece=trim_8)  # -> Piece, Valid, Id, TypeName, TypeVariant, Plane, ScreenPoint
pce_4 = ModelPiece(Piece=trim_9)  # -> Piece, Valid, Id, TypeName, TypeVariant, Plane, ScreenPoint
merge = Merge(Data1=expression, Data2=t_2)
expression_2 = Expression(x=con_4.Rotation, y=con_3.Rotation, Expression="If(Abs(x-y)≤180,y,-(360-y))")
expression_3 = Expression(x=con_4.Tilt, y=con_3.Tilt, Expression="If(Abs(x-y)≤180,y,-(360-y))")
merge_2 = Merge(Data1=graft(pce_4.Plane), Data2=graft(pce_3.Plane))
panel = Panel(")")
panel_2 = Panel("(")
concat = Concatenate(FragmentA=dsn_2.Name, FragmentE=",", FragmentF=dsn_2.Variant)
concat_2 = Concatenate(FragmentA=dsn.Name, FragmentE=",", FragmentF=dsn.Variant)
avgpl = AveragePlane(Pl=merge_2, M=merge)  # -> AvPl; inputs Pl: list of Plane, M: list of Double
# ---------- avgpl: C# usings ----------
using System.Linq;
# ---------- avgpl: C# ----------
    //Author: Ueli Saluz
    //Last modified: 29.05.2020
    //Contact: usaluz@outlook.de

    if (Component.RunCount < 2)
    {
      Component.Name = "AveragePlane";
      Component.NickName = "AvgPl";
      Component.Description = "Get the average plane from a set of planes. Provide multiplier to weight some planes more.";

      Component.Params.Input[0].Name = "Planes";
      Component.Params.Input[0].Description = "Planes to take average from.";
      Component.Params.Input[1].Name = "weights";
      Component.Params.Input[1].Description = "weights act like weights towards a plane.";

      Component.Params.Output[0].Name = "AveragePlane";
      Component.Params.Output[0].Description = "Resulting average plane.";

      Component.Message = "VER 1.0";
    }
    AvPl = GetAveragePlane(Pl.ToArray(), M.ToArray());
# ---------- avgpl: C# additional code ----------
  /// <summary>
  /// Gets the average plane from a set of of planes. Each plane can have a weight.
  /// </summary>
  /// <param name="planes"></param>
  /// <param name="weights"></param>
  /// <returns>Average plane under consideration of weights</returns>
  public Plane GetAveragePlane(Plane[] planes, double[] weights)
  {
    //If there are less weights than planes then the weight of 1 is assumed.
    if (weights.Length < planes.Length)
      weights = weights.Concat(Enumerable.Repeat(1d, planes.Length - weights.Length)).ToArray();
    //If there are more weights than planes then the last ones will be ignored.
    else if (weights.Length > planes.Length)
      weights = weights.Take(planes.Length).ToArray();

    if (weights.Sum() == 0)
      weights = Enumerable.Repeat(1d, planes.Length).ToArray();

    var sum = weights.Sum();
    weights = weights.Select(x => x / sum).ToArray();

    var origins = planes.Select(x => x.Origin).ToArray();
    var xAxes = planes.Select(x => x.XAxis).ToArray();
    var yAxes = planes.Select(x => x.YAxis).ToArray();

    for (int i = 0; i < planes.Length; i++)
    {
      origins[i].Transform(new Transform(weights[i]));
      xAxes[i].Transform(new Transform(weights[i]));
      yAxes[i].Transform(new Transform(weights[i]));
    }

    return new Plane(origins.Aggregate((a,b) => a + b), xAxes.Aggregate((a,b) => a + b), yAxes.Aggregate((a,b) => a + b));
  }
# ---------- end avgpl ----------
expression_4 = Expression(x=t_2, Expression="x≥0.5")
concat_3 = Concatenate(FragmentA=concat_2, FragmentB=" U ", FragmentC=concat)
concat_4 = Concatenate(FragmentA=concat_2, FragmentB=" \ ", FragmentC=concat)
concat_5 = Concatenate(FragmentA=concat_2, FragmentB=" \ ", FragmentC=concat)
c_script = CSharpScript(x=avgpl)  # -> a; inputs x: Plane
# ---------- c_script: C# ----------
// Grasshopper Script Instance
#region Usings
using System;
using System.Linq;
using System.Collections;
using System.Collections.Generic;
using System.Drawing;

using Rhino;
using Rhino.Geometry;

using Grasshopper;
using Grasshopper.Kernel;
using Grasshopper.Kernel.Data;
using Grasshopper.Kernel.Types;
#endregion

public class Script_Instance : GH_ScriptInstance
{
    #region Notes
    /* 
      Members:
        RhinoDoc RhinoDocument
        GH_Document GrasshopperDocument
        IGH_Component Component
        int Iteration

      Methods (Virtual & overridable):
        Print(string text)
        Print(string format, params object[] args)
        Reflect(object obj)
        Reflect(object obj, string method_name)
    */
    #endregion

    private void RunScript(Plane x, ref object a)
    {
        a = x.IsValid ? x : null;
    }
}
# ---------- end c_script ----------
filter = StreamFilter(Gate=expression_4, Stream0=pce_4.Piece, Stream1=pce_3.Piece)
trim_11 = TrimTree(Tree=c_script, Depth=1)
merge_3 = Merge(Data1=graft(con_4.Gap), Data2=graft(con_3.Gap))
merge_4 = Merge(Data1=graft(con_4.Shift), Data2=graft(con_3.Shift))
merge_5 = Merge(Data1=graft(con_4.Tilt), Data2=graft(expression_3))
merge_6 = Merge(Data1=graft(con_4.Rotation), Data2=graft(expression_2))
tstat = TreeStatistics(Tree=selcon_2)  # -> Paths, Length, Count
tstat_2 = TreeStatistics(Tree=selcon)  # -> Paths, Length, Count
concat_6 = Concatenate(FragmentA=t_2, FragmentB=",", FragmentC=expression)
pce_5 = ModelPiece(Piece=filter, Plane=trim_11)  # -> Piece, Valid, Id, TypeName, TypeVariant, Plane, ScreenPoint
trim_12 = TrimTree(Tree=tstat_2.Length, Depth=1)
trim_13 = TrimTree(Tree=tstat.Length, Depth=1)
interp = InterpolateData(Data=merge_6, Parameter=t_2, Interpolation=2)
interp_2 = InterpolateData(Data=merge_3, Parameter=t_2, Interpolation=2)
interp_3 = InterpolateData(Data=merge_4, Parameter=t_2, Interpolation=2)
interp_4 = InterpolateData(Data=merge_5, Parameter=t_2, Interpolation=2)
filter_2 = StreamFilter(Gate=expression_4, Stream0=con_4.Connection, Stream1=con_3.Connection)
pc_s_u_t = Piece(pce_5.Piece)
trim_14 = TrimTree(Tree=interp_3, Depth=1)
equals = Equality(FirstNumber=trim_13, SecondNumber="0")  # -> Equality, Inequality
pc_s_t = Piece(trim_10)
trim_15 = TrimTree(Tree=interp, Depth=1)
trim_16 = TrimTree(Tree=interp_4, Depth=1)
equals_2 = Equality(FirstNumber=trim_12, SecondNumber="0")  # -> Equality, Inequality
pc_t_s = Piece(trim_7)
trim_17 = TrimTree(Tree=interp_2, Depth=1)
con_5 = ModelConnection(Connection=filter_2, Rotation=trim_15, Tilt=trim_16, Gap=trim_17, Shift=trim_14)  # -> Connection, Valid, ConnectedPieceId, ConnectedPieceTypePortId, ConnectingPieceId, ConnectingPieceTypePortId, Rotation, Tilt, Gap, Shift
cull = CullPattern(List=trim_3, CullPattern=equals_2.Equality)
cull_2 = CullPattern(List=trim, CullPattern=equals.Equality)
co_s_u_t = Connection(con_5.Connection)
co_s_t = Connection(cull)
co_t_s = Connection(cull_2)
dsn_3 = ModelDesign(Name=concat_3, Variant=concat_6, Pieces=pc_s_u_t, Connections=co_s_u_t)  # -> Design, Valid, Name, Description, Icon, Variant, Unit, Pieces, Connections, Qualities
dsn_4 = ModelDesign(Name=concat_4, Pieces=pc_s_t, Connections=co_s_t)  # -> Design, Valid, Name, Description, Icon, Variant, Unit, Pieces, Connections, Qualities
dsn_5 = ModelDesign(Name=concat_5, Pieces=pc_t_s, Connections=co_t_s)  # -> Design, Valid, Name, Description, Icon, Variant, Unit, Pieces, Connections, Qualities
dn_s_u_t = Design(dsn_3.Design)
dn_s_t = Design(dsn_4.Design)
dn_t_s = Design(dsn_5.Design)
dn_s_t_2 = ClusterOutput(dn_s_t)
dn_s_u_t_2 = ClusterOutput(dn_s_u_t)
dn_t_s_2 = ClusterOutput(dn_t_s)

# ==== cluster GitHubKit: Get the uri of the remote kit of a specific version (branch name or tag name) for a repository hosted on GitHub.
account = ClusterInput()
repo = ClusterInput()
branch = ClusterInput()
tag = ClusterInput()
account_2 = Text(account)
repo_2 = Text(repo)
branch_2 = Text(branch)
tag_2 = Text(tag)
null = NullItem(Item=tag_2)  # -> NullFlags, InvalidFlags, Description
null_2 = NullItem(Item=branch_2)  # -> NullFlags, InvalidFlags, Description
not = GateNot(A=null.NullFlags)
not_2 = GateNot(A=null_2.NullFlags)
and = GateAnd(A=null_2.NullFlags, B=null.NullFlags)
and_2 = GateAnd(A=not_2, B=not)
or = GateOr(A=and, B=and_2)
filter = StreamFilter(Gate=null_2.NullFlags, Stream0="heads", Stream1="tags")
filter_2 = StreamFilter(Gate=null_2.NullFlags, Stream0=branch_2, Stream1=tag_2)
concat = Concatenate(FragmentA="https://github.com/", FragmentB=account_2, FragmentC="/", FragmentD=repo_2)
concat_2 = Concatenate(FragmentA=concat, FragmentE="/archive/refs/", FragmentH=filter, FragmentB="/", FragmentF=filter_2, FragmentG=".zip")
concat_3 = Concatenate(FragmentA=concat, FragmentB="/", FragmentC="tree", FragmentF="/", FragmentD=branch_2, FragmentE=tag_2)
filter_3 = StreamFilter(Gate=or, Stream0=concat_3)
filter_4 = StreamFilter(Gate=or, Stream0=concat_2)
remote = Remote(filter_4)
homepage = Homepage(filter_3)
remote_2 = ClusterOutput(remote)
homepage_2 = ClusterOutput(homepage)

# ==== cluster MergeDesigns: Merge a list of distinct designs into a new design. All the pieces have the name and variant as a prefix to ensure uniqueness. Make sure every design is distinct by having a unique combination of name and variant.
dn = ClusterInput()
na = ClusterInput()
description = ClusterInput()
icon = ClusterInput()
variant = ClusterInput()
ut = ClusterInput()
qualities = ClusterInput()
dn_2 = Design(dn)
na_2 = Name(na)
description_2 = Description(description)
icon_2 = Icon(icon)
variant_2 = Variant(variant)
ut_2 = Unit(ut)
qualities_2 = Qualities(qualities)
dsn = ModelDesign(Design=dn_2)  # -> Design, Valid, Name, Description, Icon, Variant, Unit, Pieces, Connections, Qualities
con = ModelConnection(Connection=dsn.Connections)  # -> Connection, Valid, ConnectedPieceId, ConnectedPieceTypePortId, ConnectingPieceId, ConnectingPieceTypePortId, Rotation, Tilt, Gap, Shift
pce = ModelPiece(Piece=dsn.Pieces)  # -> Piece, Valid, Id, TypeName, TypeVariant, Plane, ScreenPoint
concat = Concatenate(FragmentA=dsn.Name, FragmentB=",", FragmentC=dsn.Variant)
concat_2 = Concatenate(FragmentC=graft(concat), FragmentA=",", FragmentB=con.ConnectingPieceId)
concat_3 = Concatenate(FragmentC=graft(concat), FragmentA=",", FragmentB=pce.Id)
concat_4 = Concatenate(FragmentC=graft(concat), FragmentA=",", FragmentB=con.ConnectedPieceId)
con_2 = ModelConnection(Connection=con.Connection, ConnectedPieceId=concat_4, ConnectingPieceId=concat_2)  # -> Connection, Valid, ConnectedPieceId, ConnectedPieceTypePortId, ConnectingPieceId, ConnectingPieceTypePortId, Rotation, Tilt, Gap, Shift
pce_2 = ModelPiece(Piece=pce.Piece, Id=concat_3)  # -> Piece, Valid, Id, TypeName, TypeVariant, Plane, ScreenPoint
trim = TrimTree(Tree=con_2.Connection, Depth=1)
trim_2 = TrimTree(Tree=pce_2.Piece, Depth=1)
dsn_2 = ModelDesign(
    Name=na_2,
    Description=description_2,
    Icon=icon_2,
    Variant=variant_2,
    Unit=ut_2,
    Pieces=trim_2,
    Connections=trim,
    Qualities=qualities_2)  # -> Design, Valid, Name, Description, Icon, Variant, Unit, Pieces, Connections, Qualities
dn_3 = Design(dsn_2.Design)
dn_4 = ClusterOutput(dn_3)

# ==== cluster SelectRepresentation: Select a representation based on mime, lod and tags. The mime and lod must be equal and the tags must contain all the given tags.
rp = ClusterInput()
mm = ClusterInput()
lod = ClusterInput()
tags = ClusterInput()
rp_2 = Representation(rp)
mm_2 = Mime(mm)
lod_2 = Lod(lod)
tags_2 = Tags(tags)
rep = ModelRepresentation(Representation=rp_2)  # -> Representation, Valid, Url, Mime, Lod, Tags
expression = Expression(x=rep.Mime, y=mm_2, Expression="x=y")
cull = CullPattern(List=rep.Representation, CullPattern=expression)
rep_2 = ModelRepresentation(Representation=cull)  # -> Representation, Valid, Url, Mime, Lod, Tags
expression_2 = Expression(x=rep_2.Lod, y=lod_2, Expression="x=y")
cull_2 = CullPattern(List=rep_2.Representation, CullPattern=expression_2)
rep_3 = ModelRepresentation(Representation=cull_2)  # -> Representation, Valid, Url, Mime, Lod, Tags
trim = TrimTree(Tree=rep_3.Tags, Depth=1)
contains = Contains(L=trim, I=tags_2)  # -> R; inputs L: list, I: list
# ---------- contains: Python ----------
#Component Information
#--------------------------------------------------------------------------------------------
if ghenv.Component.RunCount<2:
    #General
    #--------------------------------------------------------------------------------------------
    __author__ = "Ueli Saluz"
    __version__ = "2023.02.04"
    
    ghenv.Component.Name = "Contains"
    ghenv.Component.NickName = "Contains"
    ghenv.Component.Description = "True if list contains one of the items."
    ghenv.Component.Message = "VER 1.0"
    ghenv.Component.Category = "Set"
    ghenv.Component.SubCategory = "List"
    
     #Inputs
    #--------------------------------------------------------------------------------------------
    inputIndex=0
    
    ghenv.Component.Params.Input[inputIndex].Name = "List"
    ghenv.Component.Params.Input[inputIndex].NickName = "L"
    ghenv.Component.Params.Input[inputIndex].Description = ""
    ghenv.Component.Params.Input[inputIndex].Optional = False
    inputIndex+=1
    
    ghenv.Component.Params.Input[inputIndex].Name = "Items"
    ghenv.Component.Params.Input[inputIndex].NickName = "I"
    ghenv.Component.Params.Input[inputIndex].Description = ""
    ghenv.Component.Params.Input[inputIndex].Optional = False
    inputIndex+=1
    
    #Outputs
    #--------------------------------------------------------------------------------------------
    outputIndex=0
    
    ghenv.Component.Params.Output[outputIndex].Name = "Contains"
    ghenv.Component.Params.Output[outputIndex].NickName = "R"
    ghenv.Component.Params.Output[outputIndex].Description = ""
    outputIndex+=1

R = False
for i in I:
    if i in L:
        R = True
# ---------- end contains ----------
ma = MassAddition(Input=contains)  # -> Result, PartialResults
lng = ListLength(List=contains)
equals = Equality(FirstNumber=ma.Result, SecondNumber=lng)  # -> Equality, Inequality
cull_3 = CullPattern(List=rep_3.Representation, CullPattern=equals.Equality)
rep_4 = ModelRepresentation(Representation=cull_3)  # -> Representation, Valid, Url, Mime, Lod, Tags
curdir = CSharpScript()  # -> D, S
# ---------- curdir: C# ----------
#region Usings
using System;
using System.Linq;
using System.Collections;
using System.Collections.Generic;
using System.Drawing;
using System.IO;

using Rhino;
using Rhino.Geometry;

using Grasshopper;
using Grasshopper.Kernel;
using Grasshopper.Kernel.Data;
using Grasshopper.Kernel.Types;
#endregion

public class Script_Instance : GH_ScriptInstance
{
    private void RunScript(ref object D, ref object S)
    {
        D = Path.GetDirectoryName(this.GrasshopperDocument.FilePath);
        S = Path.DirectorySeparatorChar;
    }
}
# ---------- end curdir ----------
rep_5 = ReplaceText(Text=rep_4.Url, Find="/", Replace=curdir.S, RecursiveReplace=False)
rp_3 = Representation(rep_4.Representation)
pa_ur = Text(rep_5)
ur = Url(rep_4.Url)
rp_4 = ClusterOutput(rp_3)
ur_2 = ClusterOutput(ur)
pa_ur_2 = ClusterOutput(pa_ur)

# ==== cluster Tower
floor = Panel("f")
shaftpieceid = ClusterInput()
capsulepatternnorthwest = ClusterInput()
capsulepatternsoutheast = ClusterInput()
capsulepatternsouthwest = ClusterInput()
capsulepatternnortheast = ClusterInput()
capsulerotation = ClusterInput()
capsuletilt = ClusterInput()
capsulegap = ClusterInput()
capsuleshift = ClusterInput()
tambourrotation = ClusterInput()
tambourtilt = ClusterInput()
tambourgap = ClusterInput()
tambourshift = ClusterInput()
panel = Panel("""0
0
1
0
1
0
2
3
3""")
panel_2 = Panel("""2
3
3
0
0
1
0
0
1""")
split_level = Panel("sl")
merge = Merge(Data1="\", Data2="q", Data3="J", Data4="s")
merge_2 = Merge(Data1="/", Data2="p", Data3="L", Data4="z")
door = Panel("d")
shaftpieceid_2 = Text(shaftpieceid)
capsulepatternnorthwest_2 = Integer(capsulepatternnorthwest)
item = ListItem(List=panel, Index=capsulepatternnorthwest_2, Wrap=True)
item_2 = ListItem(List=panel_2, Index=capsulepatternnorthwest_2, Wrap=True)
item_3 = ListItem(List=merge, Index=item, Wrap=True)
item_4 = ListItem(List=merge_2, Index=item_2, Wrap=True)
lng = ListLength(List=capsulepatternnorthwest_2)
capsulepatternsoutheast_2 = Integer(capsulepatternsoutheast)
item_5 = ListItem(List=panel_2, Index=capsulepatternsoutheast_2, Wrap=True)
item_6 = ListItem(List=panel, Index=capsulepatternsoutheast_2, Wrap=True)
item_7 = ListItem(List=merge, Index=item_6, Wrap=True)
item_8 = ListItem(List=merge_2, Index=item_5, Wrap=True)
capsulepatternsouthwest_2 = Integer(capsulepatternsouthwest)
item_9 = ListItem(List=panel, Index=capsulepatternsouthwest_2, Wrap=True)
item_10 = ListItem(List=panel_2, Index=capsulepatternsouthwest_2, Wrap=True)
item_11 = ListItem(List=merge, Index=item_9, Wrap=True)
item_12 = ListItem(List=merge_2, Index=item_10, Wrap=True)
capsulepatternnortheast_2 = Integer(capsulepatternnortheast)
item_13 = ListItem(List=panel, Index=capsulepatternnortheast_2, Wrap=True)
item_14 = ListItem(List=panel_2, Index=capsulepatternnortheast_2, Wrap=True)
item_15 = ListItem(List=merge_2, Index=item_14, Wrap=True)
item_16 = ListItem(List=merge, Index=item_13, Wrap=True)
capsulerotation_2 = Number(capsulerotation)
tambourrotation_2 = Number(tambourrotation)
tambourtilt_2 = Number(tambourtilt)
capsuletilt_2 = Number(capsuletilt)
capsulegap_2 = Number(capsulegap)
capsuleshift_2 = Number(capsuleshift)
tambourgap_2 = Number(tambourgap)
tambourshift_2 = Number(tambourshift)
bottom = Panel("b")
capsulevariantsouthright = Text(item_12)
number_of_floors = Integer(lng)
capsulevariantwestright = Text(item_4)
capsulevariantnorthleft = Text(item_3)
capsulevariantwestleft = Text(item_11)
capsulevariantsouthleft = Text(item_7)
capsulevariantnorthright = Text(item_15)
capsulevarianteastright = Text(item_8)
capsulevarianteastleft = Text(item_16)
neg = Negative(Value=capsuleshift_2)
top = Panel("t")

series = Series(Start=0, Step=1, Count=number_of_floors)
trim = TrimTree(Tree=series, Depth=1)
concat = Concatenate(FragmentA=floor, FragmentB=trim)
concat_2 = Concatenate(FragmentD="t", FragmentE="_", FragmentA=concat, FragmentF="_", FragmentG=shaftpieceid_2)
lito3p = ListInto3Parts(ListToSlice=concat_2, StartIndex="1", EndIndex="-1")  # -> FilteredList, ItemsBefore, ItemsAfter; inputs ListToSlice: tree, StartIndex: tree of Int32, EndIndex: tree of Int32
# ---------- lito3p: Python ----------
if ghenv.Component.RunCount<2:
    __author__ = "Ueli Saluz"
    __version__ = "2020.05.28"
    
    ghenv.Component.Name = "ListInto3Parts"
    ghenv.Component.NickName = "LiTo3P"
    ghenv.Component.Description = "Slice list into 3 parts. All lists are sliced with the same indices. End index = 0 = length(list)."
    ghenv.Component.Message = "VER 1.6"

from System import Object
from Grasshopper import DataTree

def filterList(listToFilter,startIndex,endIndex):
    # Return: FilteredList, Before, After
    if (((startIndex == 0) or (startIndex is None)) and ((endIndex == 0) or (endIndex is None))) or (endIndex <= startIndex and endIndex > 0):
        return (listToFilter,None,None)
    elif (startIndex == 0) or (startIndex is None):
        return (listToFilter[:endIndex],None,listToFilter[endIndex:])
    elif (endIndex == 0) or (endIndex is None):
        print 1
        return (listToFilter[:startIndex],listToFilter[startIndex:],None)
    else:
        return (listToFilter[startIndex:endIndex],listToFilter[:startIndex],listToFilter[endIndex:])

if __name__ == "__main__":
    FilteredList = DataTree[Object]()
    ItemsBefore = DataTree[Object]()
    ItemsAfter = DataTree[Object]()
    
    for path in ListToSlice.Paths:
        listBranch = ListToSlice.Branch(path)
        pyList = list(listBranch)   #Convert .Net List to Python
        try: #terrible way of writing code but if I set the list to list access the performance decreases massivly due to many calls
            startIndex = StartIndex.Branch(path)
            startIndex = startIndex[0]
        except Exception:
            try:
                startIndex = StartIndex.Branch(0)
                startIndex = startIndex[0]
            except Exception:
                startIndex = 0
        try:
            endIndex = EndIndex.Branch(path)
            endIndex = endIndex[0]
        except Exception:
            try:
                endIndex = EndIndex.Branch(0)
                endIndex = endIndex[0]
            except Exception:
                endIndex = len(pyList)
        filtList=filterList(pyList,startIndex,endIndex)
        if filtList[0]:
            FilteredList.AddRange(filtList[0],path)
        if filtList[1]:
            ItemsBefore.AddRange(filtList[1],path)
        if filtList[2]:
            ItemsAfter.AddRange(filtList[2],path)
# ---------- end lito3p ----------
pce = ModelPiece(Id=lito3p.FilteredList, TypeName="Tambour")  # -> Piece, Valid, Id, TypeName, TypeVariant, Plane, ScreenPoint
pce_2 = ModelPiece(Id=lito3p.ItemsBefore, TypeName="Tambour", TypeVariant="First Storey")  # -> Piece, Valid, Id, TypeName, TypeVariant, Plane, ScreenPoint
pce_3 = ModelPiece(Id=lito3p.ItemsAfter, TypeName="Tambour", TypeVariant="Last Storey")  # -> Piece, Valid, Id, TypeName, TypeVariant, Plane, ScreenPoint
expression = Expression(x=number_of_floors, Expression="x=1")
merge_3 = Merge(Data1=pce_2.Piece, Data2=pce.Piece, Data3=pce_3.Piece)
pce_4 = ModelPiece(Id=concat_2, TypeName="Tambour")  # -> Piece, Valid, Id, TypeName, TypeVariant, Plane, ScreenPoint
filter = StreamFilter(Gate=expression, Stream0=merge_3, Stream1=pce_4.Piece)
pce_5 = ModelPiece(Piece=filter, TypeName="Tambour")  # -> Piece, Valid, Id, TypeName, TypeVariant, Plane, ScreenPoint
tambour_pc = Piece(pce_5.Piece)

concat_3 = Concatenate(FragmentA=split_level, FragmentB="0")
concat_4 = Concatenate(FragmentA=door, FragmentB="0")
concat_5 = Concatenate(FragmentA=concat_3, FragmentC="_", FragmentB=concat_4)
concat_6 = Concatenate(FragmentF="cs", FragmentA="_", FragmentD=concat_5, FragmentB="_", FragmentC=concat_2)
pce_6 = ModelPiece(Id=concat_6, TypeName="Capsule", TypeVariant=capsulevarianteastleft)  # -> Piece, Valid, Id, TypeName, TypeVariant, Plane, ScreenPoint
con = ModelConnection(
    ConnectedPieceId=pce_5.Id,
    ConnectedPieceTypePortId=concat_5,
    ConnectingPieceId=pce_6.Id,
    Rotation=capsulerotation_2,
    Tilt=capsuletilt_2,
    Gap=capsulegap_2,
    Shift=neg)  # -> Connection, Valid, ConnectedPieceId, ConnectedPieceTypePortId, ConnectingPieceId, ConnectingPieceTypePortId, Rotation, Tilt, Gap, Shift

concat_7 = Concatenate(FragmentA=door, FragmentB="1")
concat_8 = Concatenate(FragmentA=split_level, FragmentB="0")
concat_9 = Concatenate(FragmentA=concat_8, FragmentC="_", FragmentB=concat_7)
concat_10 = Concatenate(FragmentF="cs", FragmentA="_", FragmentD=concat_9, FragmentB="_", FragmentC=concat_2)
pce_7 = ModelPiece(Id=concat_10, TypeName="Capsule", TypeVariant=capsulevariantnorthright)  # -> Piece, Valid, Id, TypeName, TypeVariant, Plane, ScreenPoint
con_2 = ModelConnection(
    ConnectedPieceId=pce_5.Id,
    ConnectedPieceTypePortId=concat_9,
    ConnectingPieceId=pce_7.Id,
    Rotation=capsulerotation_2,
    Tilt=capsuletilt_2,
    Gap=capsulegap_2,
    Shift=capsuleshift_2)  # -> Connection, Valid, ConnectedPieceId, ConnectedPieceTypePortId, ConnectingPieceId, ConnectingPieceTypePortId, Rotation, Tilt, Gap, Shift

concat_11 = Concatenate(FragmentA=split_level, FragmentB="0")
concat_12 = Concatenate(FragmentA=door, FragmentB="2")
concat_13 = Concatenate(FragmentA=concat_11, FragmentC="_", FragmentB=concat_12)
concat_14 = Concatenate(FragmentF="cs", FragmentA="_", FragmentD=concat_13, FragmentB="_", FragmentC=concat_2)
pce_8 = ModelPiece(Id=concat_14, TypeName="Capsule", TypeVariant=capsulevariantnorthleft)  # -> Piece, Valid, Id, TypeName, TypeVariant, Plane, ScreenPoint
con_3 = ModelConnection(
    ConnectedPieceId=pce_5.Id,
    ConnectedPieceTypePortId=concat_13,
    ConnectingPieceId=pce_8.Id,
    Rotation=capsulerotation_2,
    Tilt=capsuletilt_2,
    Gap=capsulegap_2,
    Shift=neg)  # -> Connection, Valid, ConnectedPieceId, ConnectedPieceTypePortId, ConnectingPieceId, ConnectingPieceTypePortId, Rotation, Tilt, Gap, Shift

concat_15 = Concatenate(FragmentA=door, FragmentB="3")
concat_16 = Concatenate(FragmentA=split_level, FragmentB="0")
concat_17 = Concatenate(FragmentA=concat_16, FragmentC="_", FragmentB=concat_15)
concat_18 = Concatenate(FragmentF="cs", FragmentA="_", FragmentD=concat_17, FragmentB="_", FragmentC=concat_2)
pce_9 = ModelPiece(Id=concat_18, TypeName="Capsule", TypeVariant=capsulevariantwestright)  # -> Piece, Valid, Id, TypeName, TypeVariant, Plane, ScreenPoint
con_4 = ModelConnection(
    ConnectedPieceId=pce_5.Id,
    ConnectedPieceTypePortId=concat_17,
    ConnectingPieceId=pce_9.Id,
    Rotation=capsulerotation_2,
    Tilt=capsuletilt_2,
    Gap=capsulegap_2,
    Shift=capsuleshift_2)  # -> Connection, Valid, ConnectedPieceId, ConnectedPieceTypePortId, ConnectingPieceId, ConnectingPieceTypePortId, Rotation, Tilt, Gap, Shift

concat_19 = Concatenate(FragmentA=split_level, FragmentB="1")
concat_20 = Concatenate(FragmentA=door, FragmentB="0")
concat_21 = Concatenate(FragmentA=concat_19, FragmentC="_", FragmentB=concat_20)
concat_22 = Concatenate(FragmentF="cs", FragmentA="_", FragmentD=concat_21, FragmentB="_", FragmentC=concat_2)
pce_10 = ModelPiece(Id=concat_22, TypeName="Capsule", TypeVariant=capsulevariantwestleft)  # -> Piece, Valid, Id, TypeName, TypeVariant, Plane, ScreenPoint
con_5 = ModelConnection(
    ConnectedPieceId=pce_5.Id,
    ConnectedPieceTypePortId=concat_21,
    ConnectingPieceId=pce_10.Id,
    Rotation=capsulerotation_2,
    Tilt=capsuletilt_2,
    Gap=capsulegap_2,
    Shift=neg)  # -> Connection, Valid, ConnectedPieceId, ConnectedPieceTypePortId, ConnectingPieceId, ConnectingPieceTypePortId, Rotation, Tilt, Gap, Shift

concat_23 = Concatenate(FragmentA=door, FragmentB="1")
concat_24 = Concatenate(FragmentA=split_level, FragmentB="1")
concat_25 = Concatenate(FragmentA=concat_24, FragmentC="_", FragmentB=concat_23)
concat_26 = Concatenate(FragmentF="cs", FragmentA="_", FragmentD=concat_25, FragmentB="_", FragmentC=concat_2)
pce_11 = ModelPiece(Id=concat_26, TypeName="Capsule", TypeVariant=capsulevariantsouthright)  # -> Piece, Valid, Id, TypeName, TypeVariant, Plane, ScreenPoint
con_6 = ModelConnection(
    ConnectedPieceId=pce_5.Id,
    ConnectedPieceTypePortId=concat_25,
    ConnectingPieceId=pce_11.Id,
    Rotation=capsulerotation_2,
    Tilt=capsuletilt_2,
    Gap=capsulegap_2,
    Shift=capsuleshift_2)  # -> Connection, Valid, ConnectedPieceId, ConnectedPieceTypePortId, ConnectingPieceId, ConnectingPieceTypePortId, Rotation, Tilt, Gap, Shift

tambour_pc_2 = ClusterOutput(tambour_pc)

shift = ShiftList(List=pce_5.Id, Shift="-1", Wrap="F")
shift_2 = ShiftList(List=pce_5.Id, Shift=1, Wrap="F")
trim_2 = TrimTree(Tree=shift_2, Depth=1)
trim_3 = TrimTree(Tree=shift, Depth=1)
con_7 = ModelConnection(
    ConnectedPieceId=trim_3,
    ConnectedPieceTypePortId=top,
    ConnectingPieceId=trim_2,
    ConnectingPieceTypePortId=bottom,
    Rotation=tambourrotation_2,
    Tilt=tambourtilt_2,
    Gap=tambourgap_2,
    Shift=tambourshift_2)  # -> Connection, Valid, ConnectedPieceId, ConnectedPieceTypePortId, ConnectingPieceId, ConnectingPieceTypePortId, Rotation, Tilt, Gap, Shift
filter_2 = StreamFilter(Gate=expression, Stream0=con_7.Connection)
tambour_co = Connection(filter_2)

tambour_co_2 = ClusterOutput(tambour_co)

concat_27 = Concatenate(FragmentA=split_level, FragmentB="2")
concat_28 = Concatenate(FragmentA=door, FragmentB="0")
concat_29 = Concatenate(FragmentA=concat_27, FragmentC="_", FragmentB=concat_28)
concat_30 = Concatenate(FragmentF="cs", FragmentA="_", FragmentD=concat_29, FragmentB="_", FragmentC=concat_2)
pce_12 = ModelPiece(Id=concat_30, TypeName="Capsule", TypeVariant=capsulevariantsouthleft)  # -> Piece, Valid, Id, TypeName, TypeVariant, Plane, ScreenPoint
con_8 = ModelConnection(
    ConnectedPieceId=pce_5.Id,
    ConnectedPieceTypePortId=concat_29,
    ConnectingPieceId=pce_12.Id,
    Rotation=capsulerotation_2,
    Tilt=capsuletilt_2,
    Gap=capsulegap_2,
    Shift=neg)  # -> Connection, Valid, ConnectedPieceId, ConnectedPieceTypePortId, ConnectingPieceId, ConnectingPieceTypePortId, Rotation, Tilt, Gap, Shift

concat_31 = Concatenate(FragmentA=split_level, FragmentB="2")
concat_32 = Concatenate(FragmentA=door, FragmentB="1")
concat_33 = Concatenate(FragmentA=concat_31, FragmentC="_", FragmentB=concat_32)
concat_34 = Concatenate(FragmentF="cs", FragmentA="_", FragmentD=concat_33, FragmentB="_", FragmentC=concat_2)
pce_13 = ModelPiece(Id=concat_34, TypeName="Capsule", TypeVariant=capsulevarianteastright)  # -> Piece, Valid, Id, TypeName, TypeVariant, Plane, ScreenPoint
con_9 = ModelConnection(
    ConnectedPieceId=pce_5.Id,
    ConnectedPieceTypePortId=concat_33,
    ConnectingPieceId=pce_13.Id,
    Rotation=capsulerotation_2,
    Tilt=capsuletilt_2,
    Gap=capsulegap_2,
    Shift=capsuleshift_2)  # -> Connection, Valid, ConnectedPieceId, ConnectedPieceTypePortId, ConnectingPieceId, ConnectingPieceTypePortId, Rotation, Tilt, Gap, Shift

merge_4 = Merge(
    Data1=pce_6.Piece,
    Data2=pce_7.Piece,
    Data3=pce_8.Piece,
    Data4=pce_9.Piece,
    Data5=pce_10.Piece,
    Data6=pce_11.Piece,
    Data7=pce_12.Piece,
    Data8=pce_13.Piece)
merge_5 = Merge(
    Data1=con.Connection,
    Data2=con_2.Connection,
    Data3=con_3.Connection,
    Data4=con_4.Connection,
    Data5=con_5.Connection,
    Data6=con_6.Connection,
    Data7=con_8.Connection,
    Data8=con_9.Connection)
capsule_pc = Piece(merge_4)
caspule_co = Connection(merge_5)
merge_6 = Merge(Data1=tambour_co, Data2=caspule_co)
merge_7 = Merge(Data1=tambour_pc, Data2=capsule_pc)
co = Connection(merge_6)
pc = Piece(merge_7)
capsule_pc_2 = ClusterOutput(capsule_pc)
caspule_co_2 = ClusterOutput(caspule_co)
pc_2 = ClusterOutput(pc)
co_2 = ClusterOutput(co)
item_17 = ListItem(List=tambour_pc, Index=0, Wrap=True)  # -> Item1, Item
pce_14 = ModelPiece(Piece=item_17.Item)  # -> Piece, Valid, Id, TypeName, TypeVariant, Plane, ScreenPoint
pce_15 = ModelPiece(Piece=item_17.Item1)  # -> Piece, Valid, Id, TypeName, TypeVariant, Plane, ScreenPoint
first_tambour_id = Text(pce_14.Id)
first_tambour_id_2 = ClusterOutput(first_tambour_id)
last_tambour_id = Text(pce_15.Id)
last_tambour_id_2 = ClusterOutput(last_tambour_id)

# ==== cluster AddBridges
dn = ClusterInput()
levels = ClusterInput()
bridge_rotation = ClusterInput()
bridge_tilt = ClusterInput()
bridge_gap = ClusterInput()
bridge_shift = ClusterInput()
dn_2 = Design(dn)
levels_2 = Integer(levels)
bridge_rotation_2 = Number(bridge_rotation)
bridge_tilt_2 = Number(bridge_tilt)
bridge_gap_2 = Number(bridge_gap)
bridge_shift_2 = Number(bridge_shift)
expression = Expression(x=levels_2, Expression="x-1")
concat = Concatenate(
    FragmentA="cs_",
    FragmentD="sl",
    FragmentH="0",
    FragmentI="_d",
    FragmentJ="1",
    FragmentB="_t_f",
    FragmentC=expression,
    FragmentE="_b_c",
    FragmentF="1")
concat_2 = Concatenate(
    FragmentA="cs_",
    FragmentD="sl",
    FragmentH="0",
    FragmentI="_d",
    FragmentJ="2",
    FragmentB="_t_f",
    FragmentC=expression,
    FragmentE="_b_c",
    FragmentF="0")
merge = Merge(Data1=concat_2, Data2=concat)
rmvpces = RemovePieces(dn=dn_2, ids=merge)  # -> dn_4, pc_2, co_2
dsn = ModelDesign(Design=rmvpces.dn_4)  # -> Design, Valid, Name, Description, Icon, Variant, Unit, Pieces, Connections, Qualities
lng = ListLength(List=levels_2)
split = SplitList(List=rmvpces.pc_2, Index=lng)  # -> ListA, ListB
split_2 = SplitList(List=rmvpces.co_2, Index=lng)  # -> ListA, ListB
trim = TrimTree(Tree=dsn.Pieces, Depth=1)
trim_2 = TrimTree(Tree=dsn.Connections, Depth=1)
concat_3 = Concatenate(
    FragmentA="br_",
    FragmentD="sl",
    FragmentH="0",
    FragmentI="_d",
    FragmentJ="2",
    FragmentB="_t_f",
    FragmentC=expression,
    FragmentE="_b_c",
    FragmentF="0")
trim_3 = TrimTree(Tree=split.ListA, Depth=1)
trim_4 = TrimTree(Tree=split_2.ListA, Depth=1)
pce = ModelPiece(Piece=trim_3, Id=concat_3, TypeName="Bridge")  # -> Piece, Valid, Id, TypeName, TypeVariant, Plane, ScreenPoint
con = ModelConnection(
    Connection=trim_4,
    ConnectingPieceId=pce.Id,
    ConnectingPieceTypePortId="e",
    Rotation=bridge_rotation_2,
    Tilt=bridge_tilt_2,
    Offset=bridge_gap_2,
    Shift=bridge_shift_2)  # -> Connection, Valid, ConnectedPieceId, ConnectedPieceTypePortId, ConnectingPieceId, ConnectingPieceTypePortId, Rotation, Tilt, Offset, Shift
merge_2 = Merge(Data1=trim_2, Data2=con.Connection)
merge_3 = Merge(Data1=trim, Data2=pce.Piece)
dsn_2 = ModelDesign(Design=dsn.Design, Pieces=merge_3, Connections=merge_2)  # -> Design, Valid, Name, Description, Icon, Variant, Unit, Pieces, Connections, Qualities
dn_3 = Design(dsn_2.Design)
dn_4 = ClusterOutput(dn_3)

# ==== cluster PerformanceAssessment
dn = ClusterInput()
ty = ClusterInput()
heating_energy_price_cent_kwh = ClusterInput()
heating_efficiency_factor = ClusterInput()
heating_global_warming_potential_kgco2e = ClusterInput()  # "Heating Global Warming Potential [kgCO2e/kWh]"
cooling_energy_price_cent_kwh = ClusterInput()
cooling_efficiency_factor = ClusterInput()
cooling_global_warming_potential_kgco2e = ClusterInput()  # "Cooling Global Warming Potential [kgCO2e/kWh]"
electrictiy_energy_price_cent_kwh = ClusterInput()
electrictiy_global_warming_potential_kgc = ClusterInput()  # "Electrictiy Global Warming Potential [kgCO2e/kWh]"
dn_2 = Design(dn)
heating_energy_price_cent_kwh_2 = Number(heating_energy_price_cent_kwh)
heating_efficiency_factor_2 = Number(heating_efficiency_factor)
heating_global_warming_potential_kgco2e_2 = Number(heating_global_warming_potential_kgco2e)  # "Heating Global Warming Potential [kgCO2e/kWh]"
cooling_energy_price_cent_kwh_2 = Number(cooling_energy_price_cent_kwh)
cooling_efficiency_factor_2 = Number(cooling_efficiency_factor)
cooling_global_warming_potential_kgco2e_2 = Number(cooling_global_warming_potential_kgco2e)  # "Cooling Global Warming Potential [kgCO2e/kWh]"
electrictiy_energy_price_cent_kwh_2 = Number(electrictiy_energy_price_cent_kwh)
electrictiy_global_warming_potential_kgc_2 = Number(electrictiy_global_warming_potential_kgc)  # "Electrictiy Global Warming Potential [kgCO2e/kWh]"
ty_2 = Type(ty)
sumqal = SumQualities(dn=dn_2, ty=ty_2, na="cooling energy demand")  # -> num_2, ql_2
sumqal_2 = SumQualities(dn=dn_2, ty=ty_2, na="technical equipment energy demand")  # -> num_2, ql_2
sumqal_3 = SumQualities(dn=dn_2, ty=ty_2, na="maintenance expenses")  # -> num_2, ql_2
sumqal_4 = SumQualities(dn=dn_2, ty=ty_2, na="heating energy demand")  # -> num_2, ql_2
sumqal_5 = SumQualities(dn=dn_2, ty=ty_2, na="income")  # -> num_2, ql_2
sumqal_6 = SumQualities(dn=dn_2, ty=ty_2, na="effective floor area")  # -> num_2, ql_2
sumqal_7 = SumQualities(dn=dn_2, ty=ty_2, na="construction cost")  # -> num_2, ql_2
expression = Expression(x=sumqal_4.num_2, y=heating_efficiency_factor_2, Expression="x*(1/y)")
expression_2 = Expression(x=sumqal.num_2, y=cooling_efficiency_factor_2, Expression="x*(1/y)")
addition = Addition(A=expression, B=expression_2, C=sumqal_2.num_2)
multiplication = Multiplication(A=heating_energy_price_cent_kwh_2, B=expression)
multiplication_2 = Multiplication(A=heating_global_warming_potential_kgco2e_2, B=expression)
multiplication_3 = Multiplication(A=cooling_energy_price_cent_kwh_2, B=expression_2)
multiplication_4 = Multiplication(A=cooling_global_warming_potential_kgco2e_2, B=expression_2)
multiplication_5 = Multiplication(A=sumqal_2.num_2, B=electrictiy_energy_price_cent_kwh_2)
multiplication_6 = Multiplication(A=electrictiy_global_warming_potential_kgc_2, B=electrictiy_global_warming_potential_kgc_2)
sumqal_8 = SumQualities(dn=dn_2, ty=ty_2, na="construction global warming potential")  # -> num_2, ql_2
division = Division(A=addition, B=sumqal_6.num_2)
addition_2 = Addition(A=multiplication, B=multiplication_3, C=multiplication_5)
addition_3 = Addition(A=multiplication_2, B=multiplication_4, C=multiplication_6)
division_2 = Division(A=addition_3, B=sumqal_6.num_2)
addition_4 = Addition(A=sumqal_3.num_2, B=addition_2)
subtraction = Subtraction(A=sumqal_5.num_2, B=addition_4)
panel = Panel("""https://identifier.buildingsmart.org/uri/buildingsmart/ifc/4.3/prop/NetFloorArea
https://identifier.buildingsmart.org/uri/etim/etim/9.0/prop/EF016979


https://identifier.buildingsmart.org/uri/etim/etim/9.0/prop/EF016979

https://identifier.buildingsmart.org/uri/etim/etim/9.0/prop/EF016979


https://identifier.buildingsmart.org/uri/buildingsmart/ifc/4.3/prop/EnergyConsumption

https://identifier.buildingsmart.org/uri/buildingsmart/ifc/4.3/prop/EnergyConsumption
https://identifier.buildingsmart.org/uri/buildingsmart/ifc/4.3/prop/EnergyConsumption
https://identifier.buildingsmart.org/uri/buildingsmart/ifc/4.3/prop/EnergyConsumption""")
panel_2 = Panel("""effective floor area
specific operational global warming potential
construction cost
return
construction global warming potential
operational cost
operational global warming potential
income
maintenance expenses
specific energy demand
operational energy cost
heating energy demand
cooling energy demand
technical equipment energy demand""")
effective_floor_area_m² = Number(sumqal_6.num_2)
specific_operational_global_warming_pote = Number(division_2)  # "Specific Operational Global Warming Potential [kgCO2e/m²a]"
construction_cost = Number(sumqal_7.num_2)
return_a = Number(subtraction)
operational_cost_a = Number(addition_4)
maintenance_expenses_a = Number(sumqal_3.num_2)
specific_energy_demand_kwh_m²a = Number(division)
operational_energy_cost_a = Number(addition_2)
cooling_energy_demand_kwh_a = Number(sumqal.num_2)
construction_global_warming_potential_kg = Number(sumqal_8.num_2)  # "Construction Global Warming Potential [kgCO2e]"
operational_global_warming_potential_kgc = Number(addition_3)  # "Operational Global Warming Potential [kgCO2e/a]"
income = Number(sumqal_5.num_2)
heating_energy_demand_kwh_a = Number(sumqal_4.num_2)
technical_equipment_energy_demand_kwh_a = Number(sumqal_2.num_2)
merge = Merge(
    Data1=effective_floor_area_m²,
    Data2=specific_operational_global_warming_pote,
    Data3=construction_cost,
    Data4=return_a,
    Data5=construction_global_warming_potential_kg,
    Data6=operational_cost_a,
    Data7=operational_global_warming_potential_kgc,
    Data8=income,
    Data9=maintenance_expenses_a,
    Data10=specific_energy_demand_kwh_m²a,
    Data11=operational_energy_cost_a,
    Data12=heating_energy_demand_kwh_a,
    Data13=cooling_energy_demand_kwh_a,
    Data14=technical_equipment_energy_demand_kwh_a)
panel_3 = Panel("""m²
kgCO2e/m²a
€
€/a
kgCO2e
€/a
kgCO2e/a
€
€/a
kWh/m²a
€/a
kWh/a
kWh/a
kWh/a""")
dsn = ModelDesign(Design=dn_2)  # -> Design, Valid, Name, Description, Icon, Variant, Unit, Pieces, Connections, Qualities
trim = TrimTree(Tree=dsn.Qualities, Depth=1)
qal = ModelQuality(Name=panel_2, Value=merge, Unit=panel_3, Definition=panel)  # -> Quality, Valid, Name, Value, Unit, Definition
merge_2 = Merge(Data1=trim, Data2=qal.Quality)
dsn_2 = ModelDesign(Design=dsn.Design, Qualities=merge_2)  # -> Design, Valid, Name, Description, Icon, Variant, Unit, Pieces, Connections, Qualities
dn_3 = Design(dsn_2.Design)
effective_floor_area_m²_2 = ClusterOutput(effective_floor_area_m²)
specific_operational_global_warming_pote_2 = ClusterOutput(specific_operational_global_warming_pote)  # "Specific Operational Global Warming Potential [kgCO2e/m²a]"
construction_cost_2 = ClusterOutput(construction_cost)
return_a_2 = ClusterOutput(return_a)
construction_global_warming_potential_kg_2 = ClusterOutput(construction_global_warming_potential_kg)  # "Construction Global Warming Potential [kgCO2e]"
operational_cost_a_2 = ClusterOutput(operational_cost_a)
operational_global_warming_potential_kgc_2 = ClusterOutput(operational_global_warming_potential_kgc)  # "Operational Global Warming Potential [kgCO2e/a]"
income_2 = ClusterOutput(income)
maintenance_expenses_a_2 = ClusterOutput(maintenance_expenses_a)
specific_energy_demand_kwh_m²a_2 = ClusterOutput(specific_energy_demand_kwh_m²a)
operational_energy_cost_a_2 = ClusterOutput(operational_energy_cost_a)
heating_energy_demand_kwh_a_2 = ClusterOutput(heating_energy_demand_kwh_a)
cooling_energy_demand_kwh_a_2 = ClusterOutput(cooling_energy_demand_kwh_a)
technical_equipment_energy_demand_kwh_a_2 = ClusterOutput(technical_equipment_energy_demand_kwh_a)
dn_4 = ClusterOutput(dn_3)

# ==== cluster ReplaceType: Replace a type (name) in a design. All variants stay the same and must exist in the new type.
new_na = ClusterInput()
dn = ClusterInput()
old_na = ClusterInput()
new_na_2 = Text(new_na)
dn_2 = Design(dn)
old_na_2 = Text(old_na)
dsn = ModelDesign(Design=dn_2)  # -> Design, Valid, Name, Description, Icon, Variant, Unit, Pieces, Connections, Qualities
trim = TrimTree(Tree=dsn.Pieces, Depth=1)
lng = ListLength(List=trim)
pce = ModelPiece(Piece=trim)  # -> Piece, Valid, Id, TypeName, TypeVariant, Plane, ScreenPoint
series = Series(Start=0, Step=1, Count=lng)
trim_2 = TrimTree(Tree=series, Depth=1)
expression = Expression(x=pce.TypeName, y=old_na_2, Expression="x=y")
dispatch = Dispatch(List=pce.Piece, DispatchPattern=expression)  # -> ListA, ListB
dispatch_2 = Dispatch(List=trim_2, DispatchPattern=expression)  # -> ListA, ListB
pce_2 = ModelPiece(Piece=dispatch.ListA, TypeName=new_na_2)  # -> Piece, Valid, Id, TypeName, TypeVariant, Plane, ScreenPoint
replace = ReplaceItems(List=trim, Item=pce_2.Piece, Indices=dispatch_2.ListA, Wrap=False)
trim_3 = TrimTree(Tree=replace, Depth=1)
dsn_2 = ModelDesign(Design=dsn.Design, Pieces=trim_3)  # -> Design, Valid, Name, Description, Icon, Variant, Unit, Pieces, Connections, Qualities
dn_3 = Design(dsn_2.Design)
dn_4 = ClusterOutput(dn_3)

# ==== cluster VaryTypes: Change a variant (name) from one type to another variant of the same type for all pieces of a design.
dn = ClusterInput()
na = ClusterInput()
old_vn = ClusterInput()
new_vn = ClusterInput()
dn_2 = Design(dn)
na_2 = TypeName(na)
old_vn_2 = TypeVariant(old_vn)
new_vn_2 = TypeVariant(new_vn)
dsn = ModelDesign(Design=dn_2)  # -> Design, Valid, Name, Description, Icon, Variant, Unit, Pieces, Connections, Qualities
trim = TrimTree(Tree=dsn.Pieces, Depth=1)
pce = ModelPiece(Piece=trim)  # -> Piece, Valid, Id, TypeName, TypeVariant, Plane, ScreenPoint
lng = ListLength(List=trim)
series = Series(Start=0, Step=1, Count=lng)
expression = Expression(x=pce.TypeVariant, y=old_vn_2, Expression="x=y")
expression_2 = Expression(x=pce.TypeName, y=na_2, Expression="x=y")
trim_2 = TrimTree(Tree=series, Depth=1)
and = GateAnd(A=expression_2, B=expression)
dispatch = Dispatch(List=trim_2, DispatchPattern=and)  # -> ListA, ListB
dispatch_2 = Dispatch(List=pce.Piece, DispatchPattern=and)  # -> ListA, ListB
pce_2 = ModelPiece(Piece=dispatch_2.ListA, TypeVariant=new_vn_2)  # -> Piece, Valid, Id, TypeName, TypeVariant, Plane, ScreenPoint
replace = ReplaceItems(List=trim, Item=pce_2.Piece, Indices=dispatch.ListA, Wrap=False)
trim_3 = TrimTree(Tree=replace, Depth=1)
dsn_2 = ModelDesign(Design=dsn.Design, Pieces=trim_3)  # -> Design, Valid, Name, Description, Icon, Variant, Unit, Pieces, Connections, Qualities
dn_3 = Design(dsn_2.Design)
dn_4 = ClusterOutput(dn_3)

# ==== cluster SelectPiece: Select a piece with the id.
pc = ClusterInput()
id = ClusterInput()
pc_2 = Piece(pc)
id_2 = Id(id)
pce = ModelPiece(Piece=pc_2)  # -> Piece, Valid, Id, TypeName, TypeVariant, Plane, ScreenPoint
expression = Expression(x=pce.Id, y=id_2, Expression="x=y")
cull = CullPattern(List=pce.Piece, CullPattern=expression)
pc_3 = Piece(cull)
pc_4 = ClusterOutput(pc_3)

# ==== cluster SelectConnection: Select a connection with the connected id and the connected id. The connections are symetric, so if the conected is the connecting and vice versa it will still selct them.
co = ClusterInput()
cdpc = ClusterInput()
cgpc = ClusterInput()
co_2 = Connection(co)
cdpc_2 = ConnectedPieceId(cdpc)
cgpc_2 = ConnectingPieceId(cgpc)
con = ModelConnection(Connection=co_2)  # -> Connection, Valid, ConnectedPieceId, ConnectedPieceTypePortId, ConnectingPieceId, ConnectingPieceTypePortId, Rotation, Tilt, Gap, Shift
expression = Expression(x=con.ConnectedPieceId, y=cdpc_2, Expression="x=y")
expression_2 = Expression(x=con.ConnectedPieceId, y=cgpc_2, Expression="x=y")
expression_3 = Expression(x=con.ConnectingPieceId, y=cgpc_2, Expression="x=y")
expression_4 = Expression(x=con.ConnectingPieceId, y=cdpc_2, Expression="x=y")
and = GateAnd(A=expression, B=expression_3)
and_2 = GateAnd(A=expression_2, B=expression_4)
or = GateOr(A=and, B=and_2)
cull = CullPattern(List=con.Connection, CullPattern=or)
co_3 = Connection(cull)
co_4 = ClusterOutput(co_3)

# ==== cluster NormalizeDesign: Normalize a design to a standard way. It does not change the design, only the way that it is structured. This includes reodering pieces and connections. In the future, this will optionally convert units automatically.
dn = ClusterInput()
dn_2 = Design(dn)
dsn = ModelDesign(Design=dn_2)  # -> Design, Valid, Name, Description, Icon, Variant, Unit, Pieces, Connections, Qualities
trim = TrimTree(Tree=dsn.Pieces, Depth=1)
trim_2 = TrimTree(Tree=dsn.Connections, Depth=1)
con = ModelConnection(Connection=trim_2)  # -> Connection, Valid, ConnectedPieceId, ConnectedPieceTypePortId, ConnectingPieceId, ConnectingPieceTypePortId, Rotation, Tilt, Gap, Shift
merge = Merge(Data1=graft(con.ConnectedPieceId), Data2=graft(con.ConnectingPieceId))
tsort = SortText(Keys=merge, Culture=127)  # -> Keys, Values
trim_3 = TrimTree(Tree=tsort.Keys, Depth=1)
expression = Expression(x=merge, y=trim_3, Expression="x=y")
item = ListItem(List=expression, Index=0, Wrap=True)
trim_4 = TrimTree(Tree=item, Depth=1)
dispatch = Dispatch(List=con.Connection, DispatchPattern=trim_4)  # -> ListA, ListB
con_2 = ModelConnection(Connection=dispatch.ListB)  # -> Connection, Valid, ConnectedPieceId, ConnectedPieceTypePortId, ConnectingPieceId, ConnectingPieceTypePortId, Rotation, Tilt, Gap, Shift
con_3 = ModelConnection(
    Connection=dispatch.ListB,
    ConnectedPieceId=con_2.ConnectingPieceId,
    ConnectedPieceTypePortId=con_2.ConnectingPieceTypePortId,
    ConnectingPieceId=con_2.ConnectedPieceId,
    ConnectingPieceTypePortId=con_2.ConnectedPieceTypePortId)  # -> Connection, Valid, ConnectedPieceId, ConnectedPieceTypePortId, ConnectingPieceId, ConnectingPieceTypePortId, Rotation, Tilt, Gap, Shift
merge_2 = Merge(Data1=dispatch.ListA, Data2=con_3.Connection)
con_4 = ModelConnection(Connection=merge_2)  # -> Connection, Valid, ConnectedPieceId, ConnectedPieceTypePortId, ConnectingPieceId, ConnectingPieceTypePortId, Rotation, Tilt, Gap, Shift
concat = Concatenate(FragmentA=con_4.ConnectedPieceId, FragmentB=con_4.ConnectingPieceId)
pce = ModelPiece(Piece=trim)  # -> Piece, Valid, Id, TypeName, TypeVariant, Plane, ScreenPoint
tsort_2 = SortText(Keys=concat, Values=con_4.Connection, Culture=127)  # -> Keys, Values
tsort_3 = SortText(Keys=pce.Id, Values=pce.Piece, Culture=127)  # -> Keys, Values
trim_5 = TrimTree(Tree=tsort_2.Values, Depth=1)
trim_6 = TrimTree(Tree=tsort_3.Values, Depth=1)
dsn_2 = ModelDesign(Design=dsn.Design, Pieces=trim_6, Connections=trim_5)  # -> Design, Valid, Name, Description, Icon, Variant, Unit, Pieces, Connections, Qualities
dn_3 = Design(dsn_2.Design)
dn_4 = ClusterOutput(dn_3)

# ==== cluster RemovePieces: Remove all pieces (and all associated connections) from a design.
dn = ClusterInput()
ids = ClusterInput()
dn_2 = Design(dn)
ids_2 = Text(ids)
dsn = ModelDesign(Design=dn_2)  # -> Design, Valid, Name, Description, Icon, Variant, Unit, Pieces, Connections, Qualities

trim = TrimTree(Tree=dsn.Connections, Depth=1)
con = ModelConnection(Connection=trim)  # -> Connection, Valid, ConnectedPieceId, ConnectedPieceTypePortId, ConnectingPieceId, ConnectingPieceTypePortId, Rotation, Tilt, Offset, Shift
expression = Expression(x=graft(con.ConnectingPieceId), y=ids_2, Expression="x=y")
expression_2 = Expression(x=graft(con.ConnectedPieceId), y=ids_2, Expression="x=y")
ma = MassAddition(Input=expression)  # -> Result, PartialResults
ma_2 = MassAddition(Input=expression_2)  # -> Result, PartialResults
or = GateOr(A=ma_2.Result, B=ma.Result)
trim_2 = TrimTree(Tree=or, Depth=1)
dispatch = Dispatch(List=trim, DispatchPattern=trim_2)  # -> ListA, ListB

trim_3 = TrimTree(Tree=dsn.Pieces, Depth=1)
pce = ModelPiece(Piece=trim_3)  # -> Piece, Valid, Id, TypeName, TypeVariant, Plane, ScreenPoint
expression_3 = Expression(x=graft(pce.Id), y=ids_2, Expression="x=y")
ma_3 = MassAddition(Input=expression_3)  # -> Result, PartialResults
trim_4 = TrimTree(Tree=ma_3.Result, Depth=1)
dispatch_2 = Dispatch(List=trim_3, DispatchPattern=trim_4)  # -> ListA, ListB

dsn_2 = ModelDesign(Design=dsn.Design, Pieces=dispatch_2.ListB, Connections=dispatch.ListB)  # -> Design, Valid, Name, Description, Icon, Variant, Unit, Pieces, Connections, Qualities
dn_3 = Design(dsn_2.Design)
pc = Piece(dispatch_2.ListA)
co = Connection(dispatch.ListA)
dn_4 = ClusterOutput(dn_3)
pc_2 = ClusterOutput(pc)
co_2 = ClusterOutput(co)

# ==== cluster SumQualities: Sum up the qualities of a type for each piece with this type in a design.
dn = ClusterInput()
ty = ClusterInput()
na = ClusterInput()
ty_2 = Type(ty)
dn_2 = Design(dn)
na_2 = Name(na)
typ = ModelType(Type=ty_2)  # -> Type, Valid, Name, Description, Icon, Variant, Unit, Representations, Ports, Qualities
dsn = ModelDesign(Design=dn_2)  # -> Design, Valid, Name, Description, Icon, Variant, Unit, Pieces, Connections, Qualities
lng = ListLength(List=ty_2)
series = Series(Start=0, Step=1, Count=lng)
trim = TrimTree(Tree=dsn.Pieces, Depth=1)
qal = ModelQuality(Quality=typ.Qualities)  # -> Quality, Valid, Name, Value, Unit, Definition
trim_2 = TrimTree(Tree=series, Depth=1)
pce = ModelPiece(Piece=trim)  # -> Piece, Valid, Id, TypeName, TypeVariant, Plane, ScreenPoint
expression = Expression(x=na_2, y=qal.Name, Expression="x=y")
expression_2 = Expression(x=graft(pce.TypeVariant), y=typ.Variant, Expression="x=y")
expression_3 = Expression(x=graft(pce.TypeName), y=typ.Name, Expression="x=y")
cull = CullPattern(List=typ.Qualities, CullPattern=expression)
qal_2 = ModelQuality(Quality=cull)  # -> Quality, Valid, Name, flatten(Value), Unit, Definition
and = GateAnd(A=expression_3, B=expression_2)
cull_2 = CullPattern(List=ty_2, CullPattern=and)
txt = Text(ty_2)
txt_2 = Text(cull_2)
expression_4 = Expression(x=txt_2, y=txt, Expression="x=y")
ql = Quality(qal_2.Quality)
cull_3 = CullPattern(List=trim_2, CullPattern=expression_4)
ql_2 = ClusterOutput(ql)
trim_3 = TrimTree(Tree=cull_3, Depth=1)
item = ListItem(List=qal_2.Value, Index=trim_3, Wrap=True)
clean = CleanTree(RemoveNulls=True, RemoveInvalid=True, RemoveEmpty=False, Tree=item)
ma = MassAddition(Input=clean)  # -> Result, PartialResults
num = Number(ma.Result)
num_2 = ClusterOutput(num)
