# Grasshopper definition capital.gh (Grasshopper 1.0.8)
# Copyright: GNU Lesser General Public License Version 3
# plug-ins: RhinoCodePluginGH, semio

save_representation = BooleanToggle(False)
icon_export = BooleanToggle(False)
validate = BooleanToggle(False)
save = BooleanToggle(False)
sep = Separator()  # -> S
# ---------- sep: C# ----------
#region Usings
using System;
using System.Linq;
using System.Collections;
using System.Collections.Generic;
using System.Drawing;
using System.IO;

using Rhino;
using Rhino.Geometry;

using Grasshopper;
using Grasshopper.Kernel;
using Grasshopper.Kernel.Data;
using Grasshopper.Kernel.Types;
#endregion

public class Script_Instance : GH_ScriptInstance
{
    private void RunScript(ref object S)
    {
        S = Path.DirectorySeparatorChar;
    }
}
# ---------- end sep ----------
dir = Directory()  # -> D
# ---------- dir: C# ----------
#region Usings
using System;
using System.Linq;
using System.Collections;
using System.Collections.Generic;
using System.Drawing;
using System.IO;

using Rhino;
using Rhino.Geometry;

using Grasshopper;
using Grasshopper.Kernel;
using Grasshopper.Kernel.Data;
using Grasshopper.Kernel.Types;
#endregion

public class Script_Instance : GH_ScriptInstance
{
    private void RunScript(ref object D)
    {
        D = Path.GetDirectoryName(this.GrasshopperDocument.FilePath);
    }
}
# ---------- end dir ----------
# ^                                    ^
#    |                                     |
# <-- Constants    Preview -->
# Parameters    External    Local -->
# <-- Meta               |
#      |                       v
#      v
par = ParentDirectory(D=dir)  # -> P; inputs D: String
# ---------- par: C# ----------
#region Usings
using System;
using System.Linq;
using System.Collections;
using System.Collections.Generic;
using System.Drawing;
using System.IO;

using Rhino;
using Rhino.Geometry;

using Grasshopper;
using Grasshopper.Kernel;
using Grasshopper.Kernel.Data;
using Grasshopper.Kernel.Types;
#endregion

public class Script_Instance : GH_ScriptInstance
{
    private void RunScript(string D, ref object P)
    {
        P = new DirectoryInfo(D).Parent;
    }
}
# ---------- end par ----------
and = GateAnd(A=save, B=save_representation)
and_2 = GateAnd(A=save, B=icon_export)
variant = GetString("", AtLeast=0, AtMost=1, TreeAccess=False)
panel = Panel("""north east
south east
south west
north west""")
xy = XYPlane(Origin=Point(0, 0, 0))
zoom = Button()
list = ValueList({"north east", "south east", "south west", "north west"}, selected="north west")
expression = Expression(x=Slider(550, range=0..1000), Expression="x/100")
width_m = Number(expression)
expression_2 = Expression(x=width_m, Expression="x*2")
length_m = Number(width_m)
height_m = Number(expression_2)
peak = Text(list)
itemindex = ItemIndex(L=panel, I=peak)  # -> i; inputs L: list
# ---------- itemindex: Python ----------
#Component Information
#--------------------------------------------------------------------------------------------
if ghenv.Component.RunCount<2:
    #General
    #--------------------------------------------------------------------------------------------
    __author__ = "Ueli Saluz"
    __version__ = "2022.11.18"
    
    ghenv.Component.Name = "ItemIndex"
    ghenv.Component.NickName = "ItemIndex"
    ghenv.Component.Description = "A better IdemIndex"
    ghenv.Component.Message = "VER 1.0"
    ghenv.Component.Category = "Set"
    ghenv.Component.SubCategory = "List"
    
     #Inputs
    #--------------------------------------------------------------------------------------------
    inputIndex=0
    
    ghenv.Component.Params.Input[inputIndex].Name = "List"
    ghenv.Component.Params.Input[inputIndex].NickName = "L"
    ghenv.Component.Params.Input[inputIndex].Description = "Input1 is..."
    ghenv.Component.Params.Input[inputIndex].Optional = False
    inputIndex+=1
    
    ghenv.Component.Params.Input[inputIndex].Name = "Item"
    ghenv.Component.Params.Input[inputIndex].NickName = "I"
    ghenv.Component.Params.Input[inputIndex].Description = "Input2 is..."
    ghenv.Component.Params.Input[inputIndex].Optional = False
    inputIndex+=1
    
    #Outputs
    #--------------------------------------------------------------------------------------------
    outputIndex=0
    
    ghenv.Component.Params.Output[outputIndex].Name = "Index"
    ghenv.Component.Params.Output[outputIndex].NickName = "i"
    ghenv.Component.Params.Output[outputIndex].Description = "Output1 is..."
    outputIndex+=1

i = L.index(I)
# ---------- end itemindex ----------
valueor0 = ValueOr0(value=itemindex)
expression_3 = Expression(x=Slider(100, range=0..100), Expression="x/100")
expression_4 = Expression(x=Slider(30, range=0..100), Expression="x/100")
side_height_m = Number(width_m)
lower_height_m = Number(expression_3)

_2d = _2D(x=width_m)
_2d_2 = _2D(x=length_m)
subtraction = Subtraction(A=height_m, B=lower_height_m)
Z = UnitZ(Factor=height_m)
rectangle = Rectangle(Plane=xy, XSize=_2d_2, YSize=_2d, Radius=0)  # -> Rectangle, Length
merge = Merge(Data1="0", Data2=side_height_m, Data3=subtraction, Data4=side_height_m)
move = Move(Geometry=rectangle.Rectangle, Motion=Z)  # -> Geometry, Transform
debrep = DeconstructBrep(Brep=move.Geometry)  # -> Faces, Edges, Vertices
rulesrf = RuledSurface(CurveA=rectangle.Rectangle, CurveB=move.Geometry)
neg = Negative(Value=merge)
Z_2 = UnitZ(Factor=neg)
cap = CapHoles(Brep=rulesrf)
trim = TrimTree(Tree=debrep.Vertices, Depth=1)
move_2 = Move(Geometry=trim, Motion=Z_2)  # -> Geometry, Transform
item = ListItem(List=move_2.Geometry, Index=0, Wrap=True)  # -> Item, Item1, Item2, Item3
srf4pt = _4PointSurface(CornerA=item.Item, CornerB=item.Item1, CornerC=item.Item2, CornerD=item.Item3)

wall_thickness_m = Number(expression_4)

neg_2 = Negative(Value=wall_thickness_m)
offset = OffsetCurve(Curve=move.Geometry, Distance=neg_2, Corners=1)
trim_2 = TrimTree(Tree=offset, Depth=1)
Z_3 = UnitZ(Factor=height_m)
rulesrf_2 = RuledSurface(CurveA=move.Geometry, CurveB=trim_2)
rev = Reverse(Vector=Z_3)
extr = Extrude(Base=rulesrf_2, Direction=rev)

split = SplitBrep(Brep=extr, Cutter=srf4pt)
split_2 = SplitBrep(Brep=srf4pt, Cutter=extr)
item_2 = ListItem(List=split, Index=0, Wrap=True)  # -> Item, Item1
item_3 = ListItem(List=split_2, Index=0, Wrap=True)  # -> Item, Item1
merge_2 = Merge(Data1=item_3.Item, Data2=item_2.Item1)
join = BrepJoin(Breps=merge_2)  # -> Breps, Closed
trim_3 = TrimTree(Tree=join.Breps, Depth=1)
panel_2 = Panel("""180
90
0
270""")
item_4 = ListItem(List=panel_2, Index=valueor0, Wrap=True)
rotate = Rotate(Geometry=trim_3, Angle=degrees(item_4), Plane=PlaneXY(0, 0, 0))  # -> Geometry, Transform
capital1to200 = Brep(rotate.Geometry)

geo = GeometryPreview(geo=capital1to200)

split_3 = SplitBrep(Brep=cap, Cutter=srf4pt)
item_5 = ListItem(List=split_3, Index=0, Wrap=True)  # -> Item, Item1
capex = CapHolesEx(Brep=item_5.Item1)  # -> Brep, Caps, Solid
transform = Transform(Geometry=capex.Brep, Transform=rotate.Transform)
capital1to500 = Brep(transform)

bbox = BoundingBox(Content=flatten(capital1to500), Plane=PlaneXY(0, 0, 0), UnionBox=True)  # -> Box, Box_2
zoom2bb = ZoomToBoundingBox(N=["Top", "Front", "Right", "Perspective", "Parallel"], BB=bbox.Box, S=0, R=zoom)  # -> F, SBB; inputs BB: Box, R: Boolean
# ---------- zoom2bb: Python ----------
#Component Information
#--------------------------------------------------------------------------------------------
if ghenv.Component.RunCount<2:
    #General
    #--------------------------------------------------------------------------------------------
    __author__ = "Ueli Saluz"
    __version__ = "2022.05.21"
    
    ghenv.Component.Name = "ZoomToBoundingBox"
    ghenv.Component.NickName = "Zoom2BB"
    ghenv.Component.Description = "Zoom the view of a Rhino viewport to a bounding box."
    ghenv.Component.Message = "VER 1.0"
    ghenv.Component.Category = "Display"
    ghenv.Component.SubCategory = "Camera"
    
     #Inputs
    #--------------------------------------------------------------------------------------------
    inputIndex=0
    
    ghenv.Component.Params.Input[inputIndex].Name = "Name"
    ghenv.Component.Params.Input[inputIndex].NickName = "N"
    ghenv.Component.Params.Input[inputIndex].Description = "Name of the viewport"
    ghenv.Component.Params.Input[inputIndex].Optional = False
    inputIndex+=1
    
    ghenv.Component.Params.Input[inputIndex].Name = "BoundingBox"
    ghenv.Component.Params.Input[inputIndex].NickName = "BB"
    ghenv.Component.Params.Input[inputIndex].Description = ""
    ghenv.Component.Params.Input[inputIndex].Optional = False
    inputIndex+=1
    
    ghenv.Component.Params.Input[inputIndex].Name = "ScaleFactor"
    ghenv.Component.Params.Input[inputIndex].NickName = "S"
    ghenv.Component.Params.Input[inputIndex].Description = "A factor for the extension of the bounding box." \
    +"0 means 0 extension, a positive number makes the bounding box larger a negative smaller. The amount is proportional to the length."
    ghenv.Component.Params.Input[inputIndex].Optional = False
    inputIndex+=1
   
    
    ghenv.Component.Params.Input[inputIndex].Name = "Run"
    ghenv.Component.Params.Input[inputIndex].NickName = "R"
    ghenv.Component.Params.Input[inputIndex].Description = "Zoom to the given bounding box."
    ghenv.Component.Params.Input[inputIndex].Optional = False
    inputIndex+=1
    
    #Outputs
    #--------------------------------------------------------------------------------------------
    outputIndex=0
    
    ghenv.Component.Params.Output[outputIndex].Name = "Finished"
    ghenv.Component.Params.Output[outputIndex].NickName = "F"
    ghenv.Component.Params.Output[outputIndex].Description = "Sends True when finished. Just to trigger other depending components."
    outputIndex+=1
    
    ghenv.Component.Params.Output[outputIndex].Name = "ScaledBoundingBox"
    ghenv.Component.Params.Output[outputIndex].NickName = "SBB"
    ghenv.Component.Params.Output[outputIndex].Description = "The scaled bounding box."
    outputIndex+=1


#Imports
#--------------------------------------------------------------------------------------------
from Rhino import RhinoDoc
from Rhino.Geometry import Box

#Solver - Run with trees to enhance performance drastically
#--------------------------------------------------------------------------------------------
if __name__ == "__main__":
    try:
        vp = RhinoDoc.ActiveDoc.Views.Find(N, False).ActiveViewport
        if R:
            box = BB
            bb = BB.BoundingBox
            bb.Inflate(S*box.X.Length,S*box.Y.Length,S*box.Z.Length)
            vp.ZoomBoundingBox(bb)
            SBB = bb
        F = True
    except:
        pass
# ---------- end zoom2bb ----------

qal = ModelQuality(Name="wasp rotation", Value="180")  # -> Quality, Valid, Name, Value, Unit, Definition
Z_4 = UnitZ(Factor=1)
pt = ConstructPoint(XCoordinate=0, YCoordinate=0, ZCoordinate=0)
rev_2 = Reverse(Vector=Z_4)
merge_3 = Merge(Data1="bottom", Data2=qal.Quality)
por = ModelPort(
    Validate=validate,
    Description="The center of the bottom.",
    Family="roof rectangular top",
    CompatibleFamilies="roof rectangular bottom",
    Point=pt,
    Direction=rev_2,
    Qualities=merge_3)  # -> Port, Valid, Id, Description, Family, CompatibleFamilies, Point, Direction, T, Qualities

prv = PortPreview(po=por.Port)

aut = ModelAuthor(Name="Ueli Saluz", Email="ueli@semio-tech.org")  # -> Author, Valid, Name, Email

rec = Rectangle({Plane=Plane(origin=(-1675.978212, -1680.385471, 1682.315001), x=(-0.7071067812, 0.7071067812, 0), y=(0.4082482905, 0.4082482905, 0.8164965809)), Size=Domain2(u=-22.8648997..22.8648997, v=-12.18498478..12.18498478)})
m2d_parallel = Make2DParallelView(Projection=rec)
make2d = Make2D(Geometry=capital1to200, View=m2d_parallel, TangentEdges="T", TangentSeams=False, AutoComputeMake2D=True)  # -> VisibleCurves, VisibleIndex, VisibleType, HiddenCurves, HiddenIndex, HiddenType
trim_4 = TrimTree(Tree=make2d.VisibleCurves, Depth=1)
capital = Geometry(trim_4)

construction_global_warming_potential_kg = Number(Slider(200, range=0..2000))  # "Construction Global Warming Potential [kgCO2e/m²]"
construction_cost_m² = Number(Slider(2500, range=0..10000))
maintenance_expenses_month_m² = Number(Slider(2.5, range=0..10))

maintenance_expenses_month_m²_2 = Number(maintenance_expenses_month_m²)
# Outputs   ->
#                 |
#                 v
construction_global_warming_potential_kg_2 = Number(construction_global_warming_potential_kg)  # "Construction Global Warming Potential [kgCO2e/m²]"
construction_cost_m²_2 = Number(construction_cost_m²)
area = Area(Geometry=trim_2)  # -> Area, Centroid
multiplication = Multiplication(A=area.Area, B=maintenance_expenses_month_m²_2)
expression_5 = Expression(x=multiplication, Expression="x*12")
multiplication_2 = Multiplication(A=area.Area, B=construction_cost_m²_2)
multiplication_3 = Multiplication(A=area.Area, B=construction_global_warming_potential_kg_2)
round = Round(Number=expression_5)  # -> Nearest, Floor, Ceiling
round_2 = Round(Number=multiplication_3)  # -> Nearest, Floor, Ceiling
round_3 = Round(Number=multiplication_2)  # -> Nearest, Floor, Ceiling
merge_4 = Merge(
    Data1=peak,
    Data2=length_m,
    Data3=width_m,
    Data4=width_m,
    Data5=side_height_m,
    Data6=lower_height_m,
    Data7=wall_thickness_m,
    Data8=round_3.Nearest,
    Data9=round.Nearest,
    Data10=round_2.Nearest)
panel_3 = Panel("https://identifier.buildingsmart.org/uri/etim/etim/9.0/prop/EF016979")
panel_4 = Panel("""peak
length
width
height
height side
height low
wall thickness
construction cost
maintenance expenses
construction global warming potential""")
panel_5 = Panel(merge_4)
panel_6 = Panel("""m
m
m
m
m
m
€
€/a
kgCO2e""")
qal_2 = ModelQuality(Validate=validate, Name=panel_4, Value=panel_5, Unit=panel_6, Definition=panel_3)  # -> Quality, Valid, Name, Value, Unit, Definition

jagged = SettingsSpeed()
mesh = MeshBrep(Brep=capital1to200, Settings=jagged)
collider = Mesh(mesh)

panel_7 = Panel("Parallel")  # disabled
m2d_rhino = Make2DRhinoView(Name=panel_7, Clip=True)  # disabled
number_slider = Slider(876, range=0..1000)  # disabled
view_rectangle = ViewRectangle(view=m2d_rhino)  # disabled
previewplane = PreviewPlane(plane=view_rectangle, axis_length=number_slider)  # disabled

panel_8 = Panel("https://app.speckle.systems")
mime = ValueList({".stl": "model/stl", ".obj": "model/obj", ".glb": "model/gltf-binary", ".gltf": "model/gltf+json", ".3dm": "model/vnd.3dm", ".speckle": "model/vnd.speckle+json", ".png": "image/png", ".jpg": "image/jpeg", ".jpeg": "image/jpeg", ".svg": "image/svg+xml", ".pdf": "application/pdf", ".zip": "application/zip", ".json": "application/json", ".csv": "text/csv", ".txt": "text/plain"}, selected=".speckle")
concat = Concatenate(FragmentA="capital", FragmentB="_", FragmentE="1to500")
concat_2 = Concatenate(FragmentA="capital", FragmentB="_", FragmentE="1to200")
concat_3 = Concatenate(FragmentA="capital", FragmentB="_", FragmentE="collider")
concat_4 = Concatenate(FragmentC="representations", FragmentD=sep, FragmentA="capital")
concat_5 = Concatenate(FragmentC="representations", FragmentD=sep, FragmentA=concat)
concat_6 = Concatenate(FragmentC="representations", FragmentD=sep, FragmentA=concat_2)
concat_7 = Concatenate(FragmentA=panel_8, FragmentB="/projects/", FragmentC="e7de1a2f8f", FragmentD="/models/", FragmentE="82fd28f19e")
concat_8 = Concatenate(FragmentA=concat_4, FragmentB=".glb")
concat_9 = Concatenate(FragmentA=concat_5, FragmentB=".3dm")
concat_10 = Concatenate(FragmentA=concat_6, FragmentB=".3dm")
concat_11 = Concatenate(FragmentA=panel_8, FragmentB="/projects/", FragmentC="e7de1a2f8f", FragmentD="/models/", FragmentE="90435c0046")
concat_12 = Concatenate(FragmentC="representations", FragmentD=sep, FragmentA=concat_3)
concat_13 = Concatenate(FragmentA=concat_12, FragmentB=".glb")
concat_14 = Concatenate(FragmentA=concat_12, FragmentB=".3dm")

rep = ModelRepresentation(Validate=validate, Url=concat_8)  # -> Representation, Valid, Url, Description, Mime, Tags, Qualities
rep_2 = ModelRepresentation(Validate=validate, Url=concat_10, Tags="1to200")  # -> Representation, Valid, Url, Description, Mime, Tags, Qualities
rep_3 = ModelRepresentation(Validate=validate, Url=concat_9, Tags="1to500")  # -> Representation, Valid, Url, Description, Mime, Tags, Qualities
rep_4 = ModelRepresentation(Url=concat_13, Tags="collider")  # -> Representation, Valid, Url, Description, Mime, Tags, Qualities

concat_15 = Concatenate(FragmentA="images/", FragmentB="capital", FragmentC=".png")

concat_16 = Concatenate(FragmentA="icons/", FragmentB="capital", FragmentC=".svg")

concat_17 = Concatenate(FragmentA=par, FragmentB=sep, FragmentC=concat_14)

concat_18 = Concatenate(FragmentA=par, FragmentB=sep, FragmentC=concat_10)
concat_19 = Concatenate(FragmentA=par, FragmentB=sep, FragmentC=concat_9)
concat_20 = Concatenate(FragmentA=par, FragmentB=sep, FragmentC=concat_13)
blc = ExportBlock(path=concat_17, name=concat_2, url=concat_14, geo=collider, layer_name="capital", export=and)  # -> block_definition_3, path_4, exported_2
blc_2 = ExportBlock(path=concat_18, name=concat_2, url=rep_2.Url, geo=capital1to200, layer_name="capital", export=and)  # -> block_definition_3, path_4, exported_2
blc_3 = ExportBlock(path=concat_19, name=concat, url=rep_3.Url, geo=capital1to500, layer_name="capital", export=and)  # -> block_definition_3, path_4, exported_2
geo_2 = ExportGeometry(F=concat_20, G=collider, R=and)  # -> S; inputs G: tree of GeometryBase, R: Boolean
# ---------- geo_2: C# ----------
// Grasshopper Script Instance
#region Usings
using System;
using System.Linq;
using System.Collections;
using System.Collections.Generic;
using System.Drawing;
using System.IO;

using Rhino;
using Rhino.Geometry;

using Grasshopper;
using Grasshopper.Kernel;
using Grasshopper.Kernel.Data;
using Grasshopper.Kernel.Types;
#endregion

public class Script_Instance : GH_ScriptInstance
{
    #region Notes
    /* 
      Members:
        RhinoDoc RhinoDocument
        GH_Document GrasshopperDocument
        IGH_Component Component
        int Iteration

      Methods (Virtual & overridable):
        Print(string text)
        Print(string format, params object[] args)
        Reflect(object obj)
        Reflect(object obj, string method_name)
    */
    #endregion

    private void RunScript(object F, DataTree<GeometryBase> G, bool R, ref object S)
    {
        // inspired from https://github.com/jhorikawa/GrasshopperProgrammingTutorials/blob/master/0015%20Export%20Geometry%20with%20Grasshopper%20C%23/Export%20Geometry%20with%20Grasshopper%20C%23.gh
        if(R){
            var guids = new List<Guid>();

            for(int i = 0; i < G.BranchCount; i++){
                for(int n = 0; n < G.Branches[i].Count; n++){
                var geom = G.Branches[i][n];
                var guid = Rhino.RhinoDoc.ActiveDoc.Objects.Add(geom);
                guids.Add(guid);
                }
            }

            Rhino.RhinoDoc.ActiveDoc.Objects.Select(guids);

            string cmd = "_-Export " + "\"" + F + "\"" + " _Enter _Enter";

            Rhino.RhinoApp.RunScript(cmd, false);

            Rhino.RhinoDoc.ActiveDoc.Objects.Delete(guids, true);
            S = true;
        }
    }
}
# ---------- end geo_2 ----------

concat_21 = Concatenate(FragmentA="capital", FragmentB="_", FragmentC="icon")
concat_22 = Concatenate(FragmentC="icons", FragmentD=sep, FragmentA="capital")
expression_6 = Expression(x="capital", y=capital, Expression="x")
concat_23 = Concatenate(FragmentA=concat_22, FragmentB=".3dm")
concat_24 = Concatenate(FragmentA=par, FragmentB=sep, FragmentC=concat_23)
blc_4 = ExportBlock(path=concat_24, name=concat_21, url=concat_23, geo=capital, layer_name=expression_6, export=and_2)  # -> block_definition_3, path_4, exported_2

trim_5 = TrimTree(Tree=rep_3.Tags, Depth=1)
trim_6 = TrimTree(Tree=rep_2.Tags, Depth=1)

rep_5 = ModelRepresentation(Validate=validate, Url=concat_7, Mime=mime, Tags=trim_5)  # -> Representation, Valid, Url, Description, Mime, Tags, Qualities
rep_6 = ModelRepresentation(Validate=validate, Url=concat_11, Mime=mime, Tags=trim_6)  # -> Representation, Valid, Url, Description, Mime, Tags, Qualities

merge_5 = Merge(
    Data1=rep.Representation,
    Data2=rep_3.Representation,
    Data3=rep_2.Representation,
    Data4=rep_5.Representation,
    Data5=rep_6.Representation,
    Data6=rep_4.Representation)

panel_9 = Panel("🎓")

typ = ModelType(
    Validate=validate,
    Name="Capital",
    Description="A roof that has the skin of a cut extruded cuboid.",
    Icon=concat_16,
    Image=concat_15,
    Variant=variant,
    Unit="m",
    Representations=merge_5,
    Ports=por.Port,
    Authors=aut.Author,
    Qualities=qal_2.Quality)  # -> Type, Valid, Name, Description, Icon, Image, Variant, Unit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
typ_2 = SerializeType(Type=typ.Type)
txt = EncodeText(Text=typ_2, Mode=0)
type = Text(txt)
context_bake = ContextBake(Geometry=type)

typ_3 = PutType(Type=typ.Type, Uri=par, Run=save)

# ==== cluster _2D
x = ClusterInput()
expression = Expression(x=x, Expression="x/2")
neg = Negative(Value=expression)
dom = ConstructDomain(DomainStart=neg, DomainEnd=expression)
I = ClusterOutput(dom)

# ==== cluster ValueOr0
value = ClusterInput()
value_2 = Number(value)
null = NullItem(Item=value_2)  # -> NullFlags, InvalidFlags, Description
filter = StreamFilter(Gate=null.NullFlags, Stream0=value_2, Stream1="0")
valueor0 = Number(filter)
valueor0_2 = ClusterOutput(valueor0)

# ==== cluster PreviewPlane: Preview a plane with axis colors and naming.
axis_length = ClusterInput()
plane = ClusterInput()
axis_length_2 = Number(axis_length)
plane_2 = Plane(plane)
deplane = DeconstructPlane(Plane=plane_2)  # -> Origin, XAxis, YAxis, ZAxis
line = LineSDL(Start=deplane.Origin, Direction=deplane.YAxis, Length=axis_length_2)
line_2 = LineSDL(Start=deplane.Origin, Direction=deplane.XAxis, Length=axis_length_2)
line_3 = LineSDL(Start=deplane.Origin, Direction=deplane.ZAxis, Length=axis_length_2)
swatch = ColourSwatch(SwatchColor=RGB(235, 52, 79))
swatch_2 = ColourSwatch(SwatchColor=RGB(0, 166, 157))
swatch_3 = ColourSwatch(SwatchColor=RGB(240, 117, 24))
end = EndPoints(Curve=line_2)  # -> Start, End
end_2 = EndPoints(Curve=line)  # -> Start, End
end_3 = EndPoints(Curve=line_3)  # -> Start, End
tag = TextTag(Location=end.End, Text="X", Colour=swatch)
tag_2 = TextTag(Location=end_2.End, Text="Y", Colour=swatch_2)
tag_3 = TextTag(Location=end_3.End, Text="Z", Colour=swatch_3)
preview = CustomPreview(Geometry=line_2, Material=swatch)
preview_2 = CustomPreview(Geometry=line, Material=swatch_2)
preview_3 = CustomPreview(Geometry=line_3, Material=swatch_3)

# ==== cluster ViewRectangle
view = ClusterInput()
view_2 = Data(view)
nickname = NAME(view=view_2)  # -> c, x, y, z, h, w
# ---------- nickname: Python ----------
uselss, c, x, y, z = view.GetCameraFrame()
h = view.FrustumHeight
w = view.FrustumWidth
# ---------- end nickname ----------
rev = Reverse(Vector=nickname.x)
rev_2 = Reverse(Vector=nickname.y)
pl = ConstructPlane(Origin=nickname.c, XAxis=rev, YAxis=nickname.y)
_2d = _2D(x=nickname.w)
_2d_2 = _2D(x=nickname.h)
rectangle = Rectangle(Plane=pl, XSize=_2d, YSize=_2d_2, Radius=0)  # -> Rectangle, Length
rec = Rectangle(rectangle.Rectangle)
rec_2 = ClusterOutput(rec)

# ==== cluster ExportBlock: Export geometry with layer names to a file.
path = ClusterInput()
name = ClusterInput()
url = ClusterInput()
geo = ClusterInput()
layer_name = ClusterInput()
export = ClusterInput()
path_2 = FilePath(path)
name_2 = Text(name)
url_2 = Text(url)
geo_2 = Geometry(geo)
layer_name_2 = Text(layer_name)
export_2 = Boolean(export)
layer = ModelLayer(Name=layer_name_2)  # -> Layer, Name, Hidden, Locked, DisplayColour, Material, Linetype
object = ModelObject(Geometry=geo_2, Layer=layer.Layer)  # -> Object, Geometry, Name, Layer, Visibility, Display, Drafting, Render
block_definition = ModelBlockDefinition(Objects=object.Object, Name=name_2, URL=url_2)  # -> BlockDefinition, Objects, Units, Name, Notes, URL, URLDescription
export_definition = ExportModelBlockDefinition(BlockDefinition=block_definition.BlockDefinition, FilePath=path_2, Overwrite="T", Export=export_2)  # -> BlockDefinition, FilePath, Exported
block_definition_2 = ModelBlockDefinition(export_definition.BlockDefinition)
path_3 = FilePath(export_definition.FilePath)
exported = Boolean(export_definition.Exported)
path_4 = ClusterOutput(path_3)
exported_2 = ClusterOutput(exported)
block_definition_3 = ClusterOutput(block_definition_2)

# ==== cluster PortPreview: semio styled preview of ports.
po = ClusterInput()
po_2 = Port(po)
por = ModelPort(Port=po_2)  # -> Port, Valid, Id, Point, Direction, Locators, Locators_2, T, Locators_3, T_2
vdisex = VectorDisplayEx(Point=por.Point, Vector=por.Direction, Colour=ColourSwatch(SwatchColor=RGB(0, 166, 157)), Width=2)
preview = CustomPreview(Geometry=por.Point, Material=ColourSwatch(SwatchColor=RGB(235, 52, 79)))
tag = TextTag(Location=por.Point, Text=por.Id, Colour=ColourSwatch(SwatchColor=RGB(250, 149, 0)))

# ==== cluster GeometryPreview: semio styled preview of geometry.
geo = ClusterInput()
geo_2 = Geometry(flatten(geo))
debrep = DeconstructBrep(Brep=geo_2)  # -> Faces, Edges, Vertices
preview = CustomPreview(Geometry=flatten(debrep.Edges), Material=ColourSwatch(SwatchColor=RGB(0, 0, 0)))
preview_2 = CustomPreview(Geometry=flatten(debrep.Faces), Material=ColourSwatch(SwatchColor=RGB(255, 255, 255)))
